# Grasshopper definition parallel coordinates graph.gh (Grasshopper 1.0.7)
# Copyright: Co-de-iT
# plug-ins: froGH, Human

# try the Remote Control Panel: View > Remote Control Panel
# parallel coordinates data.csv
panel = Panel("parallel coordinates big data.csv")
f_ghfilepath = GHFilePathInfo()  # -> FileName, FilePath
concat = Concatenate(FragmentA=f_ghfilepath.FilePath, FragmentB=panel)
# <title>
# 
# <description>
# 
# code by Alessio Erioli
# 
# v 0.1
file = ReadFile(File=concat, PerLineParse=True)
# © a3 2021 / Creative Commons Attribution-Non Commercial-ShareAlike 4.0 International License
split = TextSplit(Text=file, Separators=",")  # -> simplify(Result)
split_2 = SplitList(List=split, Index="1")  # -> ListA, ListB
flip = FlipMatrix(Data=split_2.ListB)  # -> simplify(Data)

column_span = Slider(12.139, range=0..50)
graph_height = Slider(14.556, range=0..50)

split_3 = SplitList(List=flip, Index="1")  # -> ListA, ListB
split_4 = SplitList(List=flatten(split_2.ListA), Index="1")  # -> ListA, simplify(graft(ListB))

# ---- group: normalize data (0-1)
bnd = Bounds(Numbers=split_3.ListB)
remap = RemapNumbers(Value=split_3.ListB, Source=bnd, Target=Domain(0, 1))  # -> Mapped, Clipped

# ----
lng = ListLength(List=flatten(split_3.ListA))

column_label_rotation = Slider(0, range=0..1.57)
column_label_span = Slider(1.048, range=0..10)
column_label_size = Slider(0.3, range=0..1)

# ---- group: shortlist by data intervals
data_type_selector = Slider(0, range=0..1)
min = Slider(0.393, range=0..1)
max = Slider(0.576, range=0..1)

# ----
column_labels = Panel(split_3.ListA)
row_labels = Panel(split_4.ListB)
series = Series(Start=0, Step=column_span, Count=lng)
pt = ConstructPoint(XCoordinate=series, YCoordinate=0, ZCoordinate=0)
Y = UnitY(Factor=1)
single_enter_character = Panel("")

# ---- group: column lines
line = LineSDL(Start=pt, Direction=Y, Length=graph_height)

# ----
swatch = ColourSwatch(SwatchColor=RGB(0, 0, 0))
concat_2 = Concatenate(FragmentA=column_labels, FragmentC=single_enter_character, FragmentB=bnd)

# ---- group: column labels
addition = Addition(A=graph_height, B=column_label_span)
Y_2 = UnitY(Factor=addition)
move = Move(Geometry=pt, Motion=Y_2)  # -> Geometry, Transform
xy = XYPlane(Origin=move.Geometry)
prot = RotatePlane(Plane=xy, Angle=column_label_rotation)  # -> graft(Plane)
tag = TextTag3D(Location=prot, Text=concat_2, Size=column_label_size, Colour=swatch, Justification=8)

# ----
crv = Curve(reparameterize(graft(line)))
previewlw = CustomPreviewLineweights(Geometry=line, Shader=swatch, Absolute=False)
eval = EvaluateCurve(Curve=crv, Parameter=remap.Mapped)  # -> Point, Tangent, Angle
flip_2 = FlipMatrix(Data=eval.Point)

# ---- group: graph polylines
pline = PolyLine(Vertices=flip_2, Closed=False)  # -> flatten(Polyline)
lng_2 = ListLength(List=flatten(pline))  # -> expr("x-1", Length)
range = Range(Domain=Domain(0, 1), Steps=lng_2)
gradient = Gradient(LowerLimit=0, UpperLimit=1, Parameter=range, stops=[0: RGB(255, 0, 0), 0.496: RGB(171, 171, 171), 1: RGB(42, 0, 255)])
previewlw_2 = CustomPreviewLineweights(Geometry=pline, Shader=gradient, Thickness="1", Absolute=False)

# ---- group: data text
data_text_size = Slider(0.1, range=0..1)
tag_2 = TextTag3D(Location=eval.Point, Text=split_3.ListB, Size=data_text_size, Colour=swatch, Justification=8)

# ---- group: highlight single curve
item_selector = Slider(0.263, range=0..1)
multiplication = Multiplication(A=lng_2, B=item_selector)
int = Integer(multiplication)
item = Panel(int)
item_2 = ListItem(List=pline, Index=int, Wrap=True)
item_3 = ListItem(List=gradient, Index=int, Wrap=True)
display = BooleanToggle(False)
thickness = Slider(8, range=1..10)
filter = StreamFilter(Gate=display, Stream1=item_2)
previewlw_3 = CustomPreviewLineweights(Geometry=filter, Shader=item_3, Thickness=thickness, Absolute=False)

# ---- group: row labels
row_labels_span = Slider(-1, range=-10..-1)
row_label_size = Slider(0.248, range=0..1)

item_4 = ListItem(List=flip_2, Index=0, Wrap=True)
X = UnitX(Factor=row_labels_span)
move_2 = Move(Geometry=item_4, Motion=X)  # -> Geometry, Transform
tag_3 = TextTag3D(Location=move_2.Geometry, Text=split_4.ListB, Size=row_label_size, Colour=graft(gradient), Justification=9)

# ----
color = ColourSwatch(SwatchColor=RGB(42, 163, 31))
thickness_2 = Slider(3, range=1..10)

# ---- group: shortlist by data intervals
tstat = TreeStatistics(Tree=split_3.ListB)  # -> Paths, Length, expr("x-1", Count)

# ----
multiplication_2 = Multiplication(A=data_type_selector, B=tstat.Count)
int_2 = Integer(multiplication_2)

# ---- group: shortlist by data intervals (continued)
item_5 = ListItem(List=tstat.Paths, Index=int_2, Wrap=True)
item_6 = ListItem(List=flatten(split_3.ListA), Index=int_2, Wrap=True)
branch = TreeBranch(Tree=split_3.ListB, Path=item_5, MaintainPaths=True)
bnd_2 = Bounds(Numbers=branch)
data_range = Panel(bnd_2)
data_label = Panel(item_6)

# ---- group: shortlist by data intervals / evaluate domain
c_script = CSharpScript(I=bnd_2, t=min)  # -> V; inputs t: Double
# ---------- c_script: C# ----------
    V = I.ParameterAt(t);
# ---------- end c_script ----------
c_script_2 = CSharpScript(I=bnd_2, t=max)  # -> V; inputs t: Double; same code as c_script

# ---- group: shortlist by data intervals (continued)
dom = ConstructDomain(DomainStart=c_script, DomainEnd=c_script_2)
restricted_values = Panel(dom)
inc = Includes(Value=branch, Domain=dom)  # -> Includes, Deviation

# ----
cull = CullPattern(List=pline, CullPattern=inc.Includes)
display_2 = BooleanToggle(True)
filter_2 = StreamFilter(Gate=display_2, Stream1=cull)
previewlw_4 = CustomPreviewLineweights(Geometry=filter_2, Shader=color, Thickness=thickness_2, Absolute=False)
