# Grasshopper definition point inclusion checks.gh (Grasshopper 1.0.7)
# Copyright: Co-de-iT

pop2d = Populate2D(Region={Plane=PlaneXY(0, 0, 0), Size=Domain2(u=0..20, v=0..10)}, Count="5", Seed=1)
lng = ListLength(List=pop2d)
random = Random(Range="1 to 5", Number=lng, Seed="0")
random_2 = Random(Range="1 to 5", Number=lng, Seed="1")
random_3 = Random(Range="1 to 5", Number=lng, Seed="2")
box = CenterBox(Base=pop2d, X=random, Y=random_2, Z=random_3)
# <title>
# 
# <description>
# 
# code by Alessio Erioli
# 
# v 0.1
# © Co-de-iT 2020 / Creative Commons Attribution-Non Commercial-ShareAlike 4.0 International License
item = ListItem(List=box, Index=0, Wrap=True)
Y = UnitY(Factor="30")
item_2 = ListItem(List=box, Index=0, Wrap=True)
move = Move(Geometry=item, Motion=Y)  # -> Geometry, Transform
Y_2 = UnitY(Factor="20")
move_2 = Move(Geometry=item_2, Motion=Y_2)  # -> Geometry, Transform
mesh = Mesh(move.Geometry)

# ----
# Points checked for inclusion
pt = Point(Point(12.45710099, 8.876566129, 0))
pt_2 = Point(Point(5.526661588, 8.876566129, 0))
pt_3 = Point(Point(22.32283544, 1.764989682, 0))
merge = Merge(Data1=pt_2, Data2=pt, Data3=pt_3)

# ----
# Point checked for inclusion
pt_4 = Point(Point(0.08806904168, 29.610445, 0))

# ----
# Point checked for inclusion
pt_5 = Point(Point(-0.7410463151, 21.00185967, 0))

minc = MeshInclusion(Mesh=mesh, Point=pt_4, Strict=False)
brepinc = PointInBrep(Brep=move_2.Geometry, Point=pt_5, Strict=False)
edges = BrepEdges(Brep=box)  # -> Naked, Interior, NonManifold
brepsinc = PointInBreps(Brep=box, Point=merge, Strict=False)  # -> Inside, Index
weave = Weave(
    Pattern=minc,
    Stream0=ColourSwatch(SwatchColor=RGBA(115, 115, 115, 59)),
    Stream1=ColourSwatch(SwatchColor=RGB(255, 255, 255)),
    NullGaps=False)
weave_2 = Weave(
    Pattern=brepinc,
    Stream0=ColourSwatch(SwatchColor=RGBA(79, 79, 79, 59)),
    Stream1=ColourSwatch(SwatchColor=RGB(195, 255, 0)),
    NullGaps=False)
panel = Panel(minc)
panel_2 = Panel(brepinc)
panel_3 = Panel(brepsinc.Inside)
move_3 = Move(Geometry=merge, Motion=Vector(0, 0, 10))  # -> Geometry, Transform
item_3 = ListItem(List=box, Index=brepsinc.Index, Wrap="false")
Z = UnitZ(Factor=1)
# How to check if a point is inside....
# a single mesh
preview = CustomPreview(Geometry=mesh, Material=weave)
# a single BRep
preview_2 = CustomPreview(Geometry=move_2.Geometry, Material=weave_2)
panel_4 = Panel(brepsinc.Index)
line = LineSDL(Start=merge, Direction=Z, Length="8")
# multiple BReps (multiple points)
preview_3 = CustomPreview(Geometry=item_3, Material=ColourSwatch(SwatchColor=RGBA(20, 138, 156, 139)))
tag = TextTag3D(Location=move_3.Geometry, Text=brepsinc.Index, Size=Slider(3.838, range=0..5), Justification=5)
