# Grasshopper definition 00-00_base 1 object_AO setup.gh (Grasshopper 1.0.7)
# Copyright: Co-de-iT
# plug-ins: Assembler

# ---- group: type 1
# constructing handles - the compact way: This is a more compact way to construct handles. However, since it relies on a clever use of data structures, it is suggested for advanced users that have confidence with Data Trees.
# 
# If you're having a hard time understanding it, don't worry and keep using the extended way of creating Handles used above!
crv = Curve([<curve referenced from the Rhino model> x4])

# ---- group: type 2
crv_2 = Curve(<curve referenced from the Rhino model>)

# ----
rotations = Panel("0")
# Rotations: Each handle must have one or more rotations assigned. Rotations must be structured as a Data Tree, each branch containing the rotations for the corresponding handle. The number of branches should equal the number of polylines.
rotations_2 = Panel("""0
180""")
merge = Merge(Data1=crv, Data2=crv_2)
merge_2 = Merge(Data1="0", Data2=Slider(90, range=0..180))
entwine = Entwine(Branch00=rotations, Branch01=merge_2, Branch02=merge_2, Branch03=merge_2, Branch04=rotations_2, FlattenInputs=True)
crv_3 = Curve(merge)
type = Panel("""1
1
1
1
2""")
handles = ConstructHandles(Polyline=crv_3, RotationAngles=entwine, Type=type)

# ----
# a more extended explanation of the AssemblyObject setup
viewer = ParamViewer(merge)

# ----
# try and modify this value to see what changes
angle = Slider(90, range=0..180)

# ----
# Type: Type qualifies the Handle compatibility (by default, only handles of the same type are compatible). Specify a number for each Handle.
type_2 = Panel("1")
# © Co-de-iT 2021 / Creative Commons Attribution-Non Commercial-ShareAlike 4.0 International License
# In Assembler, inputs and outputs with the same denomination indicate the same data type (H - Handle, AO - AssemblyObject, HeS - Heuristic Set, AOs - AssemblyObject set, AOa - Assemblage, XD - XData)
# H
# construct Handles
# AOs
# HeS
# AOa
# type 1
# XData
# Rotations: Each handle must have one or more rotations assigned (in degrees).
rotations_3 = Panel("0")
rotations_4 = Panel("0")
type_3 = Panel("1")
rotations_5 = Panel("0")
type_4 = Panel("1")
type_5 = Panel("1")
rotations_6 = Panel("0")
merge_3 = Merge(Data1=rotations_6, Data2=angle)
crv_4 = Curve(<curve referenced from the Rhino model>)
crv_5 = Curve(<curve referenced from the Rhino model>)
crv_6 = Curve(<curve referenced from the Rhino model>)
crv_7 = Curve(<curve referenced from the Rhino model>)

# ---- group: type 2
crv_8 = Curve(<curve referenced from the Rhino model>)

# ----
type_6 = Panel("2")
# type 2
rotations_7 = Panel("""0
180""")
handles_2 = ConstructHandles(Polyline=crv_8, RotationAngles=rotations_7, Type=type_6)

# ----
# Assembler
# 
# Framework for Iterative Assemblages workflow
# 
# code by Alessio Erioli
# 
# v 1.0
construct_a_handle = Panel(""". L polyline
. rotations
. type
. weigth (optional)""")

# ---- group: Create Handle
handles_3 = ConstructHandles(Polyline=crv_4, RotationAngles=rotations_3, Type=type_2)

handles_4 = ConstructHandles(Polyline=crv_5, RotationAngles=rotations_5, Type=type_4)

handles_5 = ConstructHandles(Polyline=crv_6, RotationAngles=rotations_4, Type=type_3)

handles_6 = ConstructHandles(Polyline=crv_7, RotationAngles=merge_3, Type=type_5)

# ----
panel = Panel(handles)
merge_4 = Merge(Data1=handles_3, Data2=handles_4, Data3=handles_5, Data4=handles_6, Data5=handles_2)
# display Handles
number_slider = Slider(0.168, range=0..0.5)
panel_2 = Panel(merge_4)
# COLLISION MESH: The collision mesh represents the SPACE OCCUPIED EXCLUSIVELY by the object or the space that should be unobstructed, a simplified "wrapper" used for fast check of collisions. Imagine a stair, for instance: the collision geometry includes the stairs and the space that should remain unobstructed, the actual geometry is the flight of stairs alone.
# XDATA: XDATA (X-tra DATA) contains extra data associated with the AssemblyObject, as a geometry or other data types.
# 
# XDATA can contain almost any type of data (Geometry, points, vectors, planes, text). Geometry might be actual, physically intended geometry (such as a wall), but also diagrammatic geometry (such as circulation curves, placeholders, etc.).
# 
# A typical use of XDATA is to insert lo-res geometry for preview, or planes and curves as placeholders to conditionally assign post-assemblage objects and data, once the AssemblyObject is seen in the context of the whole assemblage.
image = ImageSampler(Filter="Colour", Interpolate=True, Umax=1, Umin=0, Vmax=1, Vmin=0, Wrap=1)

# ---- group: Display Handles
# right click on component to toggle absolute/relative text size
handdisp = DisplayHandle(Handles=merge_4, DisplaySize=number_slider, absHTextSize=False)

# ---- group: Accepted data types
pt = Point()
pln = Plane()
brep = Brep()
txt = Text()
bool = Boolean()
vec = Vector()
crv_9 = Curve()
mesh = Mesh()
num = Number()
int = Integer()

# ---- group: Collision Mesh
# construct AssemblyObject
# construct an AssemblyObject: . object name
# . collision mesh
# . reference plane
# . direction vector
# . weight (optional)
# . Handles
mesh_2 = Mesh(<mesh referenced from the Rhino model>)

mesh_3 = Mesh(<mesh referenced from the Rhino model>)

# ---- group: lo-res geometry
mesh_4 = Mesh(<mesh referenced from the Rhino model>)

# ---- group: circulation path
crv_10 = Curve([<curve referenced from the Rhino model> x8])

# ---- group: volume centroid
volume = Volume(Geometry=mesh_2)  # -> Volume, Centroid

volume_2 = Volume(Geometry=mesh_3)  # -> Volume, Centroid

# ----
weight_optional = Panel("1.0")
# construct an AssemblyObject: . object name
# . collision mesh
# . reference plane
# . direction vector
# .
# . Handles
name = Panel("type A")

# ---- group: reference plane
xy = XYPlane(Origin=volume.Centroid)

# ---- group: direction vector
X = UnitX(Factor=1)

# ----
name_2 = Panel("type A")
aocon = ConstructAssemblyObject(Name=name_2, CollisionMesh=mesh_2, ReferencePlane=xy, Direction=X, Weight=1, Handles=merge_4, ZLockAO=False)

# ---- group: reference plane
xy_2 = XYPlane(Origin=volume_2.Centroid)

# ----
# as a rule of thumb, keep geometric and non-geometric data separated, so you can split the list at a specific index to easily treat them separately later
rhino_block_id = Panel("block_typeA")
text_data = Panel("Hello XData!")
numeric_data = Panel("1.0")
merge_5 = Merge(Data1=rhino_block_id, Data2=numeric_data, Data3=text_data, Data4=mesh_4, Data5=crv_10)
xdcon = ConstructXData(Label="type A_data", Data=merge_5, ReferencePlane=xy_2, AssemblyObjectNameReference=name)

# ---- group: direction vector
# construct XData: . XData label
# . data (as list)
# . reference plane (same as object for convenience)
# . name of associated AssemblyObject
X_2 = UnitX(Factor=1)

# ---- group: Create AssemblyObject
aocon_2 = ConstructAssemblyObject(
    Name=name,
    CollisionMesh=mesh_3,
    ReferencePlane=xy_2,
    Direction=X_2,
    Weight=weight_optional,
    Handles=handles,
    ZLockAO=False)

# ----
vec_2 = VectorXYZ(XComponent=Slider(-0.614, range=-1..1), YComponent=Slider(0.647, range=-1..1), ZComponent=Slider(0.821, range=-1..1))  # -> Vector, Length
pt_2 = Point(Point(0, -4.944666666, 0))
pt_3 = Point(Point(7.183137742, -11.54511325, 5.195245391))
xy_3 = XYPlane(Origin=pt_2)
xy_4 = XYPlane(Origin=Point(0, 0, 0))
pl = PlaneNormal(Origin=pt_3, ZAxis=vec_2.Vector)
X_3 = UnitX(Factor="10")
xddecon = DeconstructXData(XData=xdcon)  # -> Label, Data, ReferencePlane, AssemblyObjectNameReference

# ----
# AssemblyObjects can be used with rigid transofrmations:
# 
# . move
# . rotate
# . orient
move = Move(Geometry=aocon, Motion=X_3)  # -> Geometry, Transform
rotate = Rotate(Geometry=aocon, Angle=1.570796327, Plane=xy_3)  # -> Geometry, Transform
orient = Orient(Geometry=aocon, Source=xy_4, Target=pl)  # -> Geometry, Transform

# ----
# generate heuristics rules
# Want to add more AssembyObjects to the set?
# Add to a Merge component, just make sure each object has a unique name!
merge_6 = Merge(Data1=aocon)

# ---- group: AssemblyObject type
# You can use the AssemblyObject type (or generic Data type) to internalize AssemblyObjects and copy-paste them in other definitions
ao = AssemblyObject(aocon)

# ----
data = Panel(xddecon.Data)
reference_plane = Panel(xddecon.ReferencePlane)
xdata_label = Panel(xddecon.Label)
name_of_associated_assemblyobject = Panel(xddecon.AssemblyObjectNameReference)
# This component writes the heuristics: all the possible assemblage permutation rules given a set of AssemblyObjects
heuw = HeuristicsWriter(AssemblyObjectsSet=merge_6, noSH=False, noSO=False, xHT=False)
cell_size = Slider(1.481, range=1..2)

# ---- group: base point
pt_4 = Point(Point(0, 20, 0))

# ----
heuristics_rules = Panel(heuw)

# ---- group: Heuristics Display
heud = HeuristicDisplay(
    OriginPoint=pt_4,
    AssemblyObjectsSet=merge_6,
    HeuristicsString=heuw,
    XSize=cell_size,
    YSize=cell_size,
    NRows=Slider(10, range=10..50),
    DisplayType="AO Types",
    ZLockFilter=False)

# ----
# heuristics rules: The rules are the language expressing grammar and syntax of the Assemblage, they define the possible combinations among AssemblyObjects.
# 
# Knowing their structure is not required to generate and select them, however, it is useful to interpret them at a glance.
# receiver rotation angle (in degrees)
# Rule integer weight is an experimental feature, not yet implemented
# receiver Handle index
# sender Handle index
# rule integer Weight
# receiver Object name
# sender Object name
# rO | rH = rHA < sO | sH % r_iWeight
panel_3 = Panel("rName|1=90<sName|3%0")
