# Grasshopper definition 00-01_base 1 object_Assemblage random.gh (Grasshopper 1.0.7)
# Copyright: Co-de-iT
# plug-ins: Assembler

# ----
# try and modify this value to see what changes
angle = Slider(90, range=0..180)

# ----
# In Assembler, inputs and outputs with the same denomination indicate the same data type (H - Handle, AO - AssemblyObject, HeS - Heuristic Set, AOs - AssemblyObject set, AOa - Assemblage)
# H
# Type: Type qualifies the Handle compatibility (by default, only handles of the same type are compatible). Specify a number for each Handle.
# AOs
# HeS
# AOa
type = Panel("1")
# © Co-de-iT 2021 / Creative Commons Attribution-Non Commercial-ShareAlike 4.0 International License
# ASSEMBLAGES IN BRIEF: GENERAL DESCRIPTION (WHAT TO DO)
# 
# . choose WHERE to add next object and WHICH object to add
# 
# 
# 
# PROCESS STEPS (HOW TO DO IT)
# 
# . select receiver object in the assemblage according to a given criteria
# 
# . list all possible combinations of free handles and related compatible candidates (based on the available rules)
# 
# . choose a winning candidate according to given criteria
# DEFINITION ANATOMY: 00 - constuct
# 
# Construct the object and relationships necessary for the Assemblage
# 
# 
# 
# 01 - simulate
# 
# Simulate the Assemblage growth
# 
# 
# 
# 02 - analyze/post-process
# 
# Analyze results and post-process the obtained assemblage
# construct Handles
# type 1
# Rotations: Each handle must have one or more rotations assigned (in degrees).
# Assemblages, not aggregates: Assembler is aimed at the design of... you guessed it, assemblages.
# 
# Not aggregates.
# 
# "Aren't they the same thing? Or at least synonyms?"
# 
# No, they aren't.
# 
# Without entering the phylosophical orign (see Deleuze's "assemblements" - or De Landa assemblage theory for that), the main difference is that aggregates are piles or heaps of objects with no relation to each other, while assemblages focus both on the parts AND the relations these parts establish with each other.
rotations = Panel("0")
rotations_2 = Panel("0")
type_2 = Panel("1")
rotations_3 = Panel("0")
type_3 = Panel("1")
type_4 = Panel("1")
rotations_4 = Panel("0")
merge = Merge(Data1=rotations_4, Data2=angle)
crv = Curve(<curve referenced from the Rhino model>)
crv_2 = Curve(<curve referenced from the Rhino model>)
crv_3 = Curve(<curve referenced from the Rhino model>)
crv_4 = Curve(<curve referenced from the Rhino model>)

# ---- group: type 2
crv_5 = Curve(<curve referenced from the Rhino model>)

# ----
type_5 = Panel("2")
# type 2
rotations_5 = Panel("""0
180""")
handles = ConstructHandles(Polyline=crv_5, RotationAngles=rotations_5, Type=type_5)

# ----
# Assembler
# 
# Framework for Iterative Assemblages workflow
# 
# code by Alessio Erioli
# 
# v 1.0
crete_a_handle = Panel(""". L polyline
. rotations
. type
. weigth (optional)""")

# ---- group: Create Handle
handles_2 = ConstructHandles(Polyline=crv_3, RotationAngles=rotations_2, Type=type_2)

handles_3 = ConstructHandles(Polyline=crv_4, RotationAngles=merge, Type=type_4)

handles_4 = ConstructHandles(Polyline=crv, RotationAngles=rotations, Type=type)

handles_5 = ConstructHandles(Polyline=crv_2, RotationAngles=rotations_3, Type=type_3)

# ----
merge_2 = Merge(Data1=handles_4, Data2=handles_5, Data3=handles_2, Data4=handles_3, Data5=handles)
panel = Panel(merge_2)
# display Handles
number_slider = Slider(0.168, range=0..0.5)

# ---- group: Display Handles
# right click on component to toggle absolute/relative text size
handdisp = DisplayHandle(Handles=merge_2, DisplaySize=number_slider, absHTextSize=False)

# ---- group: Collision Mesh
# construct AssemblyObject
# create an AssemblyObject: . object name
# . collision mesh
# . reference plane
# . direction vector
# . weight (optional)
# . Handles
mesh = Mesh(<mesh referenced from the Rhino model>)

# ---- group: volume centroid
volume = Volume(Geometry=mesh)  # -> Volume, Centroid

# ----
name = Panel("type A")

# ---- group: reference plane
xy = XYPlane(Origin=volume.Centroid)

# ---- group: direction vector
X = UnitX(Factor=1)

# ---- group: Create AssemblyObject
aocon = ConstructAssemblyObject(Name=name, CollisionMesh=mesh, ReferencePlane=xy, Direction=X, Weight=1, Handles=merge_2, ZLockAO=False)

# ----
# generate heuristics rules
# Want to add more AssembyObjects to the set?
# Add to a Merge component, just make sure each object has a unique name!
merge_3 = Merge(Data1=aocon)
# This component writes the heuristics: all the possible assemblage permutation rules given a set of AssemblyObjects
heuw = HeuristicsWriter(AssemblyObjectsSet=merge_3, noSH=False, noSO=False, xHT=False)
cell_size = Slider(1.481, range=1..2)

# ---- group: base point
pt = Point(Point(0, 20, 0))

# ----
heuristics_rules = Panel(heuw)

# ---- group: Heuristics Display
heud = HeuristicDisplay(
    OriginPoint=pt,
    AssemblyObjectsSet=merge_3,
    HeuristicsString=heuw,
    XSize=cell_size,
    YSize=cell_size,
    NRows=Slider(10, range=10..50),
    DisplayType="AO Types",
    ZLockFilter=False)

# ----
# Reset the system to apply setup changes
# A note on randomness: This simplified engine is a fast-and-cheap way to test AssemblyObjects in a larger assemblage.
# 
# In a design process, it should be used for testing purposes only, NOT as a feature.
# 
# Why?
# 
# The reasons are too many to list here, but let me just say this one thing: randomness gives you the serendipitous feeling of novelty over a fortuitous result, but it stands in the way of control, iterability and refinement of outcomes.
# 
# Complexity in assemblages emerges from non-linear distributed decisions, governed by rules and criteria. First time results can still surprise, with the added bonus of repeatability and control over variation due to a stable input-to-output relation.
# 
# All the introductory examples use this simplified, random engine though.
# 
# Again, why?
# 
# Because learning proceeds in steps: building criteria and understanding rules is difficult, and requires building an understanding of how AssemblyObjects work in the first place.
# 
# So, every time you see an example that is using the random engine, know that it is there just to demonstrate other principles at work.
reset = Button()
# s - step; executes the specified number of iterations before outputting results
# 
# nI - n. of iterations equals the number of objects the engine will try to place at each step.
step = Button()
max_objects = Panel("1000")
# double-click for a single step
pt_2 = Point(Point(0, -100, 0))

# ---- group: Random Assemblage Engine
# 1 - simulate
aoeng = AssemblerEngineSimple(
    AssemblyObjectsSet=merge_3,
    StartingPlane=pt_2,
    StartingObjectType=0,
    HeuristicsString=heuw,
    Go=False,
    Step=step,
    NIterations=Slider(100, range=10..100),
    MaxNObjects=max_objects,
    Reset=reset)  # -> Assemblage, AssemblageCount

# ----
n_of_objects = Panel(aoeng.AssemblageCount)
aoadecon = DeconstructAssemblage(Assemblage=aoeng.Assemblage)  # -> AssemblageObjects, AssemblageRules, ReceiverObjectsIndexes, AvailableObjectIndexes, UnreachableObjectIndexes
# 2 - analyze/post-process
assemblyobjects = Panel(aoadecon.AssemblageObjects)
assemblage_rules = Panel(aoadecon.AssemblageRules)
receiver_object_index = Panel(aoadecon.ReceiverObjectsIndexes)
available_objects_indexes = Panel(aoadecon.AvailableObjectIndexes)
unreachable_objects_indexes = Panel(aoadecon.UnreachableObjectIndexes)
# Display modes: Objects - just the collision meshes in white
# 
# Type - colors assigned by type
# 
# Occupancy - white=available, light green=unreachable, dark green=saturated
# 
# Sequence - gradient of blue, darkest=oldest
# 
# Z value - pink gradient, by Z value of reference plane origin
# 
# AO Weights - AO weights in grayscale gradient
# 
# Connectedness - % of free handles green-to-red gradient
aoadisp = DisplayAssemblage(Assemblage=aoeng.Assemblage, Bypass=False, OutputType="Objects")  # -> ColoredCollisionMeshes, Edges, Colors
aocmesh = ExtractCollisionMesh(AssemblyObject=aoadecon.AssemblageObjects)
mjoin = MeshJoin(Meshes=aoadisp.ColoredCollisionMeshes)
line = Line(aoadisp.Edges)

# ---- group: enable for preview
# Collision mesh preview: What you see here in the preview are the collision meshes - if you remember from the previous example, they represent the OCCUPIED SPACE, you can consider them as placeholders, but they are not the actual, contained geometry.
# 
# So, how do I preview/access the ACTUAL geometry?
# 
# See next definition: 00-02
preview = CustomPreview(Geometry=mjoin, Material=ColourSwatch(SwatchColor=RGB(255, 255, 255)))
