# Grasshopper definition 00-02_base 1 object_Assemblage random + associate geometry.gh (Grasshopper 1.0.7)
# Copyright: Co-de-iT
# plug-ins: Assembler, EleFront, Human, froGH

# ----
# try and modify this value to see what changes
angle = Slider(90, range=0..180)

# ----
# In Assembler, inputs and outputs with the same denomination indicate the same data type (H - Handle, AO - AssemblyObject, HeS - Heuristic Set, AOs - AssemblyObject set, Aoa - Assemblage, XD - XData)
# H
# Type: Type qualifies the Handle compatibility (by default, only handles of the same type are compatible). Specify a number for each Handle.
# AOs
# HeS
# AOa
# XData
type = Panel("1")
# © Co-de-iT 2021 / Creative Commons Attribution-Non Commercial-ShareAlike 4.0 International License
# ASSEMBLAGES IN BRIEF: GENERAL DESCRIPTION (WHAT TO DO)
# 
# . choose WHERE to add next object and WHICH object to add
# 
# 
# 
# PROCESS STEPS (HOW TO DO IT)
# 
# . select receiver object in the assemblage according to a given criteria
# 
# . list all possible combinations of free handles and related compatible candidates (based on the available rules)
# 
# . choose a winning candidate according to given criteria
# DEFINITION ANATOMY: 00 - construct
# 
# Construct the object and relationships necessary for the Assemblage
# 
# 
# 
# 01 - simulate
# 
# Simulate the Assemblage growth
# 
# 
# 
# 02 - analyze/post-process
# 
# Analyze results and post-process the obtained assemblage
# construct Handles
# type 1
# Rotations: Each handle must have one or more rotations assigned (in degrees).
rotations = Panel("0")
rotations_2 = Panel("0")
type_2 = Panel("1")
rotations_3 = Panel("0")
type_3 = Panel("1")
type_4 = Panel("1")
rotations_4 = Panel("0")
merge = Merge(Data1=rotations_4, Data2=angle)
crv = Curve(<curve referenced from the Rhino model>)
crv_2 = Curve(<curve referenced from the Rhino model>)
crv_3 = Curve(<curve referenced from the Rhino model>)
crv_4 = Curve(<curve referenced from the Rhino model>)

# ---- group: type 2
crv_5 = Curve(<curve referenced from the Rhino model>)

# ----
type_5 = Panel("2")
# type 2
rotations_5 = Panel("""0
180""")
handles = ConstructHandles(Polyline=crv_5, RotationAngles=rotations_5, Type=type_5)

# ----
# Assembler
# 
# Framework for Iterative Assemblages workflow
# 
# code by Alessio Erioli
# 
# v 1.0
construct_a_handle = Panel(""". L polyline
. rotations
. type
. weigth (optional)""")

# ---- group: Create Handle
handles_2 = ConstructHandles(Polyline=crv_3, RotationAngles=rotations_2, Type=type_2)

handles_3 = ConstructHandles(Polyline=crv_4, RotationAngles=merge, Type=type_4)

handles_4 = ConstructHandles(Polyline=crv, RotationAngles=rotations, Type=type)

handles_5 = ConstructHandles(Polyline=crv_2, RotationAngles=rotations_3, Type=type_3)

# ----
# display Handles
number_slider = Slider(0.168, range=0..0.5)
merge_2 = Merge(Data1=handles_4, Data2=handles_5, Data3=handles_2, Data4=handles_3, Data5=handles)
# XDATA: XDATA (X-tra DATA) contains extra data associated with the AssemblyObject, as a geometry or other data types.
# 
# XDATA can contain almost any type of data (Geometry, points, vectors, planes, text). Geometry might be actual, physically intended geometry (such as a wall), but also diagrammatic geometry (such as circulation curves, placeholders, etc.).
# 
# A typical use of XDATA is to insert lo-res geometry for preview, or planes and curves as placeholders to conditionally assign post-assemblage objects and data, once the AssemblyObject is seen in the context of the whole assemblage.
# 
# You can associate multple XData to the same AssemblyObject and selectively pass custom data. XData can be later combined together.
panel = Panel(merge_2)

# ---- group: Display Handles
# right click on component to toggle absolute/relative text size
handdisp = DisplayHandle(Handles=merge_2, DisplaySize=number_slider, absHTextSize=False)

# ---- group: Collision Mesh
# construct AssemblyObject
# construct an AssemblyObject: . object name
# . collision mesh
# . reference plane
# . direction vector
# . weight (optional)
# . Handles
mesh = Mesh(<mesh referenced from the Rhino model>)

# ---- group: volume centroid
volume = Volume(Geometry=mesh)  # -> Volume, Centroid

# ----
name = Panel("type A")

# ---- group: circulation path
crv_6 = Curve([<curve referenced from the Rhino model> x8])

# ---- group: reference plane
xy = XYPlane(Origin=volume.Centroid)

# ----
# as a rule of thumb, keep geometric and non-geometric data separated, so you can split the list at a specific index to easily treat them separately later
rhino_block_id = Panel("block_typeA")
text_data = Panel("Hello XData!")
numeric_data = Panel("1.0")
merge_3 = Merge(Data1=rhino_block_id, Data2=numeric_data, Data3=text_data, Data5=crv_6)
xdcon = ConstructXData(Label="type A_data", Data=merge_3, ReferencePlane=xy, AssemblyObjectNameReference=name)

# ---- group: direction vector
X = UnitX(Factor=1)

# ---- group: lo-res geometry
mesh_2 = Mesh(<mesh referenced from the Rhino model>)

# ----
# construct XData
panel_2 = Panel("type A_lo-res geom")
# construct XData: . XData label
# . data (as list)
# . reference plane (same as object for convenience)
# . name of associated AssemblyObject
xdcon_2 = ConstructXData(Label=panel_2, Data=mesh_2, ReferencePlane=xy, AssemblyObjectNameReference=name)

# ---- group: Create AssemblyObject
aocon = ConstructAssemblyObject(Name=name, CollisionMesh=mesh, ReferencePlane=xy, Direction=X, Weight=1, Handles=merge_2, ZLockAO=False)

# ----
# generate heuristics rules
# Want to add more AssembyObjects to the set?
# Add to a Merge component, just make sure each object has a unique name!
merge_4 = Merge(Data1=aocon)
merge_5 = Merge(Data1=xdcon_2, Data2=xdcon)
# This component writes the heuristics: all the possible assemblage permutation rules given a set of AssemblyObjects
heuw = HeuristicsWriter(AssemblyObjectsSet=merge_4, noSH=False, noSO=False, xHT=False)
cell_size = Slider(1.481, range=1..2)

# ---- group: base point
pt = Point(Point(0, 20, 0))

# ----
heuristics_rules = Panel(heuw)

# ---- group: Heuristics Display
heud = HeuristicDisplay(
    OriginPoint=pt,
    AssemblyObjectsSet=merge_4,
    XData=xdcon_2,
    HeuristicsString=heuw,
    XSize=cell_size,
    YSize=cell_size,
    NRows=Slider(10, range=10..50),
    DisplayType="S-R",
    ZLockFilter=False,
    OutputType="S-R")

# ----
# Reset the system to apply setup changes
reset = Button()
# s - step; executes the specified number of iterations before outputting results
# 
# nI - n. of iterations equals the number of objects the engine will try to place at each step.
step = Button()
max_objects = Panel("1000")
# double-click for a single step
pt_2 = Point(Point(0, -100, 0))

# ---- group: Random Assemblage Engine
# 1 - simulate
aoeng = AssemblerEngineSimple(
    AssemblyObjectsSet=merge_4,
    StartingPlane=pt_2,
    StartingObjectType=0,
    HeuristicsString=heuw,
    Go=False,
    Step=step,
    NIterations=Slider(100, range=10..100),
    MaxNObjects=max_objects,
    Reset=reset)  # -> Assemblage, AssemblageCount

# ----
n_of_objects = Panel(aoeng.AssemblageCount)
aoadecon = DeconstructAssemblage(Assemblage=aoeng.Assemblage)  # -> AssemblageObjects, AssemblageRules, ReceiverObjectsIndexes, AvailableObjectIndexes, UnreachableObjectIndexes
# 2 - analyze/post-process
assemblyobjects = Panel(aoadecon.AssemblageObjects)
assemblage_rules = Panel(aoadecon.AssemblageRules)
receiver_object_index = Panel(aoadecon.ReceiverObjectsIndexes)
available_objects_indexes = Panel(aoadecon.AvailableObjectIndexes)
unreachable_objects_indexes = Panel(aoadecon.UnreachableObjectIndexes)
aoadisp = DisplayAssemblage(Assemblage=aoeng.Assemblage, Bypass=False, OutputType="Objects")  # -> ColoredCollisionMeshes, Edges, Colors

# ---- group: data dam
# data dam: A data dam stops the data flow until you press play
dam = DataDam(DataA=aoadecon.AssemblageObjects, BufferDelay=10000000, BufferMode=0)

# ----
mjoin = MeshJoin(Meshes=aoadisp.ColoredCollisionMeshes)

# ---- group: collision mesh contour
# associate actual geometry
# There are essentially 2 alternative methods:
# 
# 1. using geometry in XData
# 
# 2. using blocks (2 ways - needs Elefront)
swatch = ColourSwatch(SwatchColor=RGB(94, 94, 94))
previewlw = CustomPreviewLineweights(Geometry=aoadisp.Edges, Shader=swatch, Absolute=False)

# ----
# other data
aoxd = AssociateXData(AssemblyObjects=aoadecon.AssemblageObjects, XData=xdcon)
xddecon = DeconstructXData(XData=aoxd)  # -> Label, Data, ReferencePlane, AssemblyObjectNameReference
panel_3 = Panel(xddecon.Data)
split = SplitList(List=xddecon.Data, Index="3")  # -> ListA, ListB
item = ListItem(List=split.ListA, Index=0, Wrap=True)  # -> Item, Item1, Item2
numeric_data_2 = Panel(item.Item1)
text_data_2 = Panel(item.Item2)
block_id = Panel(item.Item)

# ----
# 2.1 associate actual geometry using blocks - v1
aoplane = ExtractReferencePlane(AssemblyObject=aoadecon.AssemblageObjects)
bake = BooleanToggle(False)

# ---- group: enable for preview
# What you see here in the preview are the collision meshes - if you remember from the previous example, they represent the OCCUPIED SPACE, you can consider them as placeholders, but they are not the actual, contained geometry.
# 
# So, how do I access/preview the ACTUAL geometry?
# 
# See below....
preview = CustomPreview(Geometry=mjoin, Material=ColourSwatch(SwatchColor=RGB(255, 255, 255)))  # disabled

# ---- group: display circulation path
# Blocks: see : tinyurl.com/rhino6blocks
# 
# for help on Blocks in Rhino.
# 
# Since the geometry is stored only once in the block definition and only transformation data (position, rotation, scale) is stored for each instance, they are recommended for assemblages with a large amount of AssemblyObjects (1000+).
# 
# The reference plane for a block is defined at the moment of creation, and it's the CPlane with origin in the point chosen as a base point.
# 
# A good strategy to ensure correct block alignment (used in this example) is to create the block alredy positioned as aligned as desired within the collision geometry, and use as a reference point the same point used for the AssemblyObject reference plane.
# 
# A good test is to insert the block you want to check using the AssemblyObject reference plane origin as insertion point. If the block aligns correctly things are OK, otherwise the block insertion point should be redefined.
# Blocks pro-con: PRO
# 
# . extremely lightweight
# . recommended in case of a large quantity of instances in the assemblage
# . blocks can propagate editing (replacement and/or modification), selectively or to all instances, even after baking
# 
# CON
# 
#  . blocks must be defined in Rhino
# . blocks must be defined so that they align with the collision geometry (this can be tricky)
# . need a plugin (like Elefront) and might take some seconds before showing a preview
previewlw_2 = CustomPreviewLineweights(Geometry=split.ListB, Shader=ColourSwatch(SwatchColor=RGB(0, 13, 255)), Absolute=False)

# ----
# 1. associate geometry & more using XData
# lo-res geometry for preview
aoxd_2 = AssociateXData(AssemblyObjects=aoadecon.AssemblageObjects, XData=xdcon_2)
xddecon_2 = DeconstructXData(XData=aoxd_2)  # -> Label, Data, ReferencePlane, AssemblyObjectNameReference

# ---- group: bake this to Rhino
mesh_3 = Mesh(xddecon_2.Data)

# ----
f_mseea = MeshExtractEdgesWithToleranceAngle(Mesh=mesh_3, Angle=45)  # -> InternalEdges, NakedEdges
# Display lo-res geometry via XData
preview_2 = CustomPreview(Geometry=mesh_3, Material=graft(aoadisp.Colors))
previewlw_3 = CustomPreviewLineweights(Geometry=f_mseea.InternalEdges, Shader=ColourSwatch(SwatchColor=RGB(0, 0, 0)), Absolute=False)

# ----
# 2.2 associate actual geometry using blocks - v2
aoxd_3 = AssociateXData(AssemblyObjects=dam, XData=xdcon)
xddecon_3 = DeconstructXData(XData=aoxd_3)  # -> Label, Data, ReferencePlane, AssemblyObjectNameReference
index_of_blockid_in_xdata = Panel("0")
item_2 = ListItem(List=xddecon_3.Data, Index=index_of_blockid_in_xdata, Wrap=True)
bake_2 = BooleanToggle(False)

# ---- group: insert block
inblock = InsertBlock(BlockName=item_2, SourcePlane=xddecon_3.ReferencePlane)

# ----
# If you have a more complex setup (multiple objects, ect.) the block name can be passed through XData and retrieved after the assemblage process.
bake_3 = BakeObjects(Geometry=inblock, Bake=bake_2)

# ---- group: apply blocks
panel_4 = Panel("block_typeA")

# ---- group: apply blocks / insert block
inblock_2 = InsertBlock(BlockName=panel_4, SourcePlane=PlaneXY(0, 0, 0))

# ---- group: apply blocks (continued)
# in case of simple setups (like this one, only one AssemblyObject), the block ID can be fetched via manual input.
bake_4 = BakeObjects(Geometry=inblock_2, Bake=bake)
