# Grasshopper definition 01-00-1_base 2 objects_AO setup - sort-filter rules.gh (Grasshopper 1.0.7)
# Copyright: Co-de-iT
# plug-ins: Assembler

# ---- group: type 1
crv = Curve([<curve referenced from the Rhino model> x4])

crv_2 = Curve([<curve referenced from the Rhino model> x3])

# ---- group: type 2
crv_3 = Curve([<curve referenced from the Rhino model> x2])

crv_4 = Curve([<curve referenced from the Rhino model> x2])

# ----
merge = Merge(Data1=crv_2, Data2=crv_3)
merge_2 = Merge(Data1=crv, Data2=crv_4)

lng = ListLength(List=crv)
lng_2 = ListLength(List=crv_4)
rotations = Panel("""0
180""")
lng_3 = ListLength(List=merge_2)
repeat = RepeatData(Data="1", Length=lng)
repeat_2 = RepeatData(Data="2", Length=lng_2)
repeat_3 = RepeatData(Data=graft(rotations), Length=lng_3)
merge_3 = Merge(Data1=repeat, Data2=repeat_2)
flip = FlipMatrix(Data=repeat_3)  # -> simplify(Data)

crv_5 = Curve(merge)

# ----
# Assembler
# 
# Framework for Iterative Assemblages workflow
# 
# code by Alessio Erioli
# 
# v 1.0
# © Co-de-iT 2021 / Creative Commons Attribution-Non Commercial-ShareAlike 4.0 International License
rotations_2 = Panel("""0
180""")
lng_4 = ListLength(List=crv_5)
lng_5 = ListLength(List=crv_2)
lng_6 = ListLength(List=crv_3)
repeat_4 = RepeatData(Data=graft(rotations_2), Length=lng_4)
repeat_5 = RepeatData(Data="1", Length=lng_5)
repeat_6 = RepeatData(Data="2", Length=lng_6)
flip_2 = FlipMatrix(Data=repeat_4)  # -> simplify(Data)
merge_4 = Merge(Data1=repeat_5, Data2=repeat_6)

# ---- group: Create Handles
handles = ConstructHandles(Polyline=merge_2, RotationAngles=flip, Type=merge_3)

handles_2 = ConstructHandles(Polyline=crv_5, RotationAngles=flip_2, Type=merge_4)

# ----
mesh = Mesh(<mesh referenced from the Rhino model>)
volume = Volume(Geometry=mesh)  # -> Volume, Centroid
name = Panel("typeB")
xy = XYPlane(Origin=volume.Centroid)
X = UnitX(Factor=1)

mesh_2 = Mesh(<mesh referenced from the Rhino model>)
volume_2 = Volume(Geometry=mesh_2)  # -> Volume, Centroid
name_2 = Panel("typeA")
xy_2 = XYPlane(Origin=volume_2.Centroid)
X_2 = UnitX(Factor=1)

# ---- group: Display Handles
handdisp = DisplayHandle(Handles=handles, DisplaySize=Slider(0.1, range=0..0.5), absHTextSize=False)

handdisp_2 = DisplayHandle(Handles=handles_2, DisplaySize=Slider(0.1, range=0..0.5), absHTextSize=False)

# ---- group: body
mesh_3 = Mesh(<mesh referenced from the Rhino model>)

# ---- group: circulation path
crv_6 = Curve([<curve referenced from the Rhino model> x11])

# ---- group: body v1
mesh_4 = Mesh(<mesh referenced from the Rhino model>)

# ---- group: circulation path
crv_7 = Curve([<curve referenced from the Rhino model> x11])

# ---- group: Create AssemblyObject
aocon = ConstructAssemblyObject(Name=name_2, CollisionMesh=mesh_2, ReferencePlane=xy_2, Direction=X_2, Weight="1.0", Handles=handles_2, ZLockAO=False)

aocon_2 = ConstructAssemblyObject(Name=name, CollisionMesh=mesh, ReferencePlane=xy, Direction=X, Weight="1.0", Handles=handles, ZLockAO=False)

# ----
merge_5 = Merge(Data1=mesh_3, Data2=crv_6)
xdcon = ConstructXData(Label="typeB_data", Data=merge_5, ReferencePlane=xy, AssemblyObjectNameReference=name)

merge_6 = Merge(Data1=mesh_4, Data2=crv_7)
xdcon_2 = ConstructXData(Label="typeA_data", Data=merge_6, ReferencePlane=xy_2, AssemblyObjectNameReference=name_2)

# ---- group: XData
# to pass Assembler data around, use the generic Data container
merge_7 = Merge(Data1=flatten(xdcon_2), Data2=flatten(xdcon))
data = Data(merge_7)

# ---- group: AssemblyObjects
# AO set: With more than one AssemblyObject, just build a list with the Merge component
merge_8 = Merge(Data1=flatten(aocon), Data2=flatten(aocon_2))
data_2 = Data(merge_8)

# ----
# right-click menu options: no self-AO - prevents an object from connecting with itself
# 
# no self-Handle - prevents an handle from connecting with itself
# 
# allow cross-Handle type - enables Handles universal compatibility
heuw = HeuristicsWriter(AssemblyObjectsSet=data_2, noSH=False, noSO=False, xHT=False)

# ---- group: Heuristics Display Extended
# Heuristics Display Ex: Heuristics Display Extended outputs the AssemblyObject pairs for each rule, the rule itself, a coherence true/false pattern for the validity of the rule, and the associated XData (if present).
# 
# This enables a more sophisticated rules selection process, based on the objects data in the context of their pairing rule.
# 
# See:
# 
# 01-00-3_base 2 objects_AO setup - heuristics display ex.gh
heudex = HeuristicsDisplayEx(OriginPoint=Point(0, 0, 0), AssemblyObjectsSet=data_2, HeuristicsString=heuw, XSize=1, YSize=1, NRows=10)  # -> AssemblyObjectPairs, CoherencePattern, HeuristicsStringTree, TextBasePoints, XData

# ----
# Sorting Rules note: Sorting rules might affect the result: in case two or more rules equally satisfy a selection criteria, the first one in the list is chosen
heuristics_rules = Panel(heuw)
# receiver rotation angle (in degrees)
# receiver Handle index
# sender Handle index
# receiver Object name
# sender Object name
# rO | rH = rHA < sO | sH % r_iWeight
panel = Panel("rName|1=90<sName|3%0")

# ---- group: filter valid rules only
cull = CullPattern(List=heudex.HeuristicsStringTree, CullPattern=heudex.CoherencePattern)  # -> flatten(List)

# ----
display = ValueList({"by Type": 0, "by s/r status": 1}, selected="by Type")

# ---- group: custom colors
# ...not happy with the default colors?
# 
# You can use your own custom color palette. 2 colors for s/r display mode, one color per type in the type-based display mode.
receiver = ColourSwatch(SwatchColor=RGB(106, 140, 77))
type_0 = ColourSwatch(SwatchColor=RGB(255, 212, 0))
type_1 = ColourSwatch(SwatchColor=RGB(140, 106, 148))
sender = ColourSwatch(SwatchColor=RGB(255, 255, 255))
merge_9 = Merge(Data1=receiver, Data2=sender)
merge_10 = Merge(Data1=type_0, Data2=type_1)
filter = StreamFilter(Gate=display, Stream0=merge_10, Stream1=merge_9)

# ----
number_slider = Slider(1.2, range=1..2)
pt = Point(Point(0, 20, 0))

aocmesh = ExtractCollisionMesh(AssemblyObject=heudex.AssemblyObjectPairs)
bbox = BoundingBox(Content=aocmesh, Plane=PlaneXY(0, 0, 0), UnionBox=True)  # -> Box, Box_2
boxprop = BoxProperties(Box=bbox.Box)  # -> Center, Diagonal, Area, Volume, Degeneracy
# sorting operations on rules
sorting = ValueList({"none": 0, "volume (min to max)": 1, "volume (max to min)": 2, "Z height (min to max)": 3, "bbox diagonal (min to max)": 4}, selected="none")
# rule integer Weight
valid_rules_only = BooleanToggle(False)

# ---- group: sort by volume
volume_3 = Volume(Geometry=bbox.Box)  # -> Volume, Centroid
cull_2 = CullPattern(List=volume_3.Volume, CullPattern=heudex.CoherencePattern)  # -> flatten(List)
sort = SortList(Keys=cull_2, ValuesA=cull)  # -> Keys, ValuesA

# ---- group: sort by Z height
devec = DeconstructVector(Vector=boxprop.Diagonal)  # -> XComponent, YComponent, ZComponent
cull_3 = CullPattern(List=devec.ZComponent, CullPattern=heudex.CoherencePattern)  # -> flatten(List)
sort_2 = SortList(Keys=cull_3, ValuesA=cull)  # -> Keys, ValuesA

# ---- group: sort by Bounding Box diagonal
vlen = VectorLength(Vector=boxprop.Diagonal)
cull_4 = CullPattern(List=vlen, CullPattern=heudex.CoherencePattern)  # -> flatten(List)
sort_3 = SortList(Keys=cull_4, ValuesA=cull)  # -> Keys, ValuesA

# ----
filter_2 = StreamFilter(
    Gate=sorting,
    Stream0=cull,
    Stream1=sort.ValuesA,
    Stream2=reverse(sort.ValuesA),
    Stream3=sort_2.ValuesA,
    Stream4=sort_3.ValuesA)
filter_3 = StreamFilter(Gate=valid_rules_only, Stream0=heuw, Stream1=filter_2)

# ---- group: Heuristics Display
heud = HeuristicDisplay(
    OriginPoint=pt,
    AssemblyObjectsSet=data_2,
    HeuristicsString=filter_3,
    XSize=number_slider,
    YSize=number_slider,
    NRows=Slider(10, range=10..50),
    DisplayType="AO Types",
    ZLockFilter=False,
    OutputType="S-R Status")
