# Grasshopper definition 01-00-2_base 2 objects_AO setup - heuristics display EX.gh (Grasshopper 1.0.7)
# Copyright: Co-de-iT
# plug-ins: Assembler, froGH, Human

# ---- group: type 1
crv = Curve([<curve referenced from the Rhino model> x4])

crv_2 = Curve([<curve referenced from the Rhino model> x3])

# ---- group: type 2
crv_3 = Curve([<curve referenced from the Rhino model> x2])

crv_4 = Curve([<curve referenced from the Rhino model> x2])

# ----
merge = Merge(Data1=crv_2, Data2=crv_3)
merge_2 = Merge(Data1=crv, Data2=crv_4)

lng = ListLength(List=crv)
lng_2 = ListLength(List=crv_4)
rotations = Panel("""0
180""")
lng_3 = ListLength(List=merge_2)
repeat = RepeatData(Data="1", Length=lng)
repeat_2 = RepeatData(Data="2", Length=lng_2)
repeat_3 = RepeatData(Data=graft(rotations), Length=lng_3)
merge_3 = Merge(Data1=repeat, Data2=repeat_2)
flip = FlipMatrix(Data=repeat_3)  # -> simplify(Data)

crv_5 = Curve(merge)

# ----
# Assembler
# 
# Framework for Iterative Assemblages workflow
# 
# code by Alessio Erioli
# 
# v 1.0
# © Co-de-iT 2021 / Creative Commons Attribution-Non Commercial-ShareAlike 4.0 International License
rotations_2 = Panel("""0
180""")
lng_4 = ListLength(List=crv_5)
lng_5 = ListLength(List=crv_2)
lng_6 = ListLength(List=crv_3)
repeat_4 = RepeatData(Data=graft(rotations_2), Length=lng_4)
repeat_5 = RepeatData(Data="1", Length=lng_5)
repeat_6 = RepeatData(Data="2", Length=lng_6)
flip_2 = FlipMatrix(Data=repeat_4)  # -> simplify(Data)
merge_4 = Merge(Data1=repeat_5, Data2=repeat_6)

# ---- group: Create Handles
handles = ConstructHandles(Polyline=merge_2, RotationAngles=flip, Type=merge_3)

handles_2 = ConstructHandles(Polyline=crv_5, RotationAngles=flip_2, Type=merge_4)

# ----
mesh = Mesh(<mesh referenced from the Rhino model>)
volume = Volume(Geometry=mesh)  # -> Volume, Centroid
name = Panel("typeB")
xy = XYPlane(Origin=volume.Centroid)
X = UnitX(Factor=1)

mesh_2 = Mesh(<mesh referenced from the Rhino model>)
volume_2 = Volume(Geometry=mesh_2)  # -> Volume, Centroid
name_2 = Panel("typeA")
xy_2 = XYPlane(Origin=volume_2.Centroid)
X_2 = UnitX(Factor=1)

# ---- group: Display Handles
handdisp = DisplayHandle(Handles=handles, DisplaySize=Slider(0.1, range=0..0.5), absHTextSize=False)

handdisp_2 = DisplayHandle(Handles=handles_2, DisplaySize=Slider(0.1, range=0..0.5), absHTextSize=False)

# ---- group: body v1
mesh_3 = Mesh(<mesh referenced from the Rhino model>)

# ---- group: circulation path
crv_6 = Curve([<curve referenced from the Rhino model> x11])

# ---- group: body
mesh_4 = Mesh(<mesh referenced from the Rhino model>)

# ---- group: circulation path
crv_7 = Curve([<curve referenced from the Rhino model> x11])

# ---- group: Create AssemblyObject
aocon = ConstructAssemblyObject(Name=name_2, CollisionMesh=mesh_2, ReferencePlane=xy_2, Direction=X_2, Weight="1.0", Handles=handles_2, ZLockAO=False)

aocon_2 = ConstructAssemblyObject(Name=name, CollisionMesh=mesh, ReferencePlane=xy, Direction=X, Weight="1.0", Handles=handles, ZLockAO=False)

# ----
merge_5 = Merge(Data1=mesh_3, Data2=crv_6)
xdcon = ConstructXData(Label="typeA_data", Data=merge_5, ReferencePlane=xy_2, AssemblyObjectNameReference=name_2)

merge_6 = Merge(Data1=mesh_4, Data2=crv_7)
xdcon_2 = ConstructXData(Label="typeB_data", Data=merge_6, ReferencePlane=xy, AssemblyObjectNameReference=name)

# ---- group: XData
# to pass Assembler data around, use the generic Data container
merge_7 = Merge(Data1=flatten(xdcon), Data2=flatten(xdcon_2))
data = Data(merge_7)

# ---- group: AssemblyObjects
# AO set: With more than one AssemblyObject, just build a list with the Merge component
merge_8 = Merge(Data1=flatten(aocon), Data2=flatten(aocon_2))
data_2 = Data(merge_8)

# ----
heuw = HeuristicsWriter(AssemblyObjectsSet=data_2, noSH=False, noSO=False, xHT=False)
number_slider = Slider(1.093, range=1..2)
# Heuristics Display Ex: Heuristics Display Extended outputs the AssemblyObject pairs for each rule, the rule itself, a coherence true/false pattern for the validity of the rule, and the associated XData (if present).
# 
# This enables a more sophisticated rules selection process, based on the objects data in the context of their pairing rule.
# 
# See:
# 
# 01-00-1_base 2 objects_AO setup - sort-filter rules.gh
number_slider_2 = Slider(14, range=10..50)
pt = Point(Point(0, 20, 0))
heuristics_rules = Panel(heuw)
heudex = HeuristicsDisplayEx(
    OriginPoint=pt,
    AssemblyObjectsSet=data_2,
    XData=data,
    HeuristicsString=heuw,
    XSize=number_slider,
    YSize=number_slider,
    NRows=number_slider_2)  # -> AssemblyObjectPairs, CoherencePattern, HeuristicsStringTree, TextBasePoints, XData

# ---- group: display text
number_slider_3 = Slider(0.8, range=0..1)
swatch = ColourSwatch(SwatchColor=RGB(99, 99, 99))
f_ifroml = IndexesFromList(Data=flatten(heudex.HeuristicsStringTree))  # -> graft(Indexes)
swatch_2 = ColourSwatch(SwatchColor=RGB(0, 0, 0))

# ---- group: filter valid AO XData
cull = CullPattern(List=heudex.XData, CullPattern=heudex.CoherencePattern)

# ---- group: filter valid Heuristics
cull_2 = CullPattern(List=heudex.HeuristicsStringTree, CullPattern=heudex.CoherencePattern)

# ---- group: filter valid AO
dispatch = Dispatch(List=heudex.AssemblyObjectPairs, DispatchPattern=heudex.CoherencePattern)  # -> ListA, ListB

# ---- group: display invalid combinations / Extract Collision mesh
aocmesh = ExtractCollisionMesh(AssemblyObject=dispatch.ListB)

# ----
pshift = ShiftPaths(Data=cull, Offset=-1)

# ---- group: display text / bake rule index
tag = TextTag3D(Location=heudex.TextBasePoints, Text=f_ifroml, Size=number_slider_3, Colour=swatch, Justification=8)

# ---- group: display text / bake text
tag_2 = TextTag3D(
    Location=heudex.TextBasePoints,
    Text=heudex.HeuristicsStringTree,
    Size=Slider(1, range=0..1),
    Colour=swatch_2,
    Justification=2)

# ---- group: display invalid combinations
f_mmeea = MeshesExtractEdgesWithToleranceAngle(Mesh=aocmesh, Angle=45)  # -> InternalEdges, NakedEdges
preview = CustomPreview(Geometry=[f_mmeea.InternalEdges, f_mmeea.NakedEdges], Material=ColourSwatch(SwatchColor=RGB(28, 28, 28)))

# ----
selection_indexes = Panel("""0
3
5
6
8
34
35""")
rules = ValueList({"all": 0, "manual": 1}, selected="all")
branch = TreeBranch(Tree=dispatch.ListA, Path=selection_indexes, MaintainPaths=True)

# ---- group: selected rules
branch_2 = TreeBranch(Tree=cull_2, Path=selection_indexes, MaintainPaths=True)  # -> flatten(Branch)

# ----
branch_3 = TreeBranch(Tree=pshift, Path=selection_indexes, MaintainPaths=True)
display = ValueList({"collision geometry": 0, "actual geometry (XData)": 1}, selected="actual geometry (XData)")
filter = StreamFilter(Gate=rules, Stream0=dispatch.ListA, Stream1=branch)
filter_2 = StreamFilter(Gate=rules, Stream0=pshift, Stream1=branch_3)
selected_rules = Panel(branch_2)

# ---- group: display XData
xddecon = DeconstructXData(XData=filter_2)  # -> Label, Data, ReferencePlane, AssemblyObjectNameReference

# ---- group: bake Collision meshes / Extract Collision mesh
aocmesh_2 = ExtractCollisionMesh(AssemblyObject=filter)

# ----
panel = Panel(xddecon.Data)

# ---- group: display XData / bake XData
data_3 = Data(xddecon.Data)

# ---- group: separate Mesh and circulation path
split = SplitList(List=data_3, Index="1")  # -> ListA, ListB

# ----
pshift_2 = ShiftPaths(Data=split.ListB, Offset=-1)
pshift_3 = ShiftPaths(Data=split.ListA, Offset=-1)

# ---- group: display geometries / Extract type
aotype = ExtractType(AssemblyObject=filter)

# ----
pshift_4 = ShiftPaths(Data=pshift_3, Offset=-1)
filter_3 = StreamFilter(Gate=display, Stream0=aocmesh_2, Stream1=pshift_4)

# ---- group: display geometries
color = ValueList({"by type": 0, "by s/r status": 1}, selected="by s/r status")
by_type = Panel("""DarkRed
DimGray""")
s_r_status = Panel("""SlateGray
229,229,220""")
unweld = UnweldMesh(Mesh=filter_3, Angle="0")
item = ListItem(List=by_type, Index=aotype, Wrap=True)
filter_4 = StreamFilter(Gate=color, Stream0=item, Stream1=s_r_status)
f_mmeea_2 = MeshesExtractEdgesWithToleranceAngle(Mesh=unweld, Angle=45)  # -> InternalEdges, NakedEdges
col = Colour(filter_4)
previewlw = CustomPreviewLineweights(Geometry=[f_mmeea_2.InternalEdges, f_mmeea_2.NakedEdges], Shader=ColourSwatch(SwatchColor=RGB(0, 0, 0)), Absolute=False)
preview_2 = CustomPreview(Geometry=unweld, Material=col)

# ---- group: circulation path
previewlw_2 = CustomPreviewLineweights(Geometry=pshift_2, Shader=ColourSwatch(SwatchColor=RGB(128, 255, 0)), Thickness="2", Absolute=False)
