# Grasshopper definition 01-00_base 2 objects_AO setup.gh (Grasshopper 1.0.7)
# Copyright: Co-de-iT
# plug-ins: Assembler

rotations = Panel("""0
180""")
rotations_2 = Panel("""0
90
180""")
rotations_3 = Panel("""0
180""")
crv = Curve(<curve referenced from the Rhino model>)
type = Panel("1")
crv_2 = Curve(<curve referenced from the Rhino model>)
type_2 = Panel("1")
crv_3 = Curve(<curve referenced from the Rhino model>)
type_3 = Panel("1")

# ---- group: Create Handles
# manual handles setup
handles = ConstructHandles(Polyline=crv, RotationAngles=rotations, Type=type)

handles_2 = ConstructHandles(Polyline=crv_2, RotationAngles=rotations_2, Type=type_2)

handles_3 = ConstructHandles(Polyline=crv_3, RotationAngles=rotations_3, Type=type_3)

# ---- group: type 1
# this is in case all handles of the same type also have same rotations
crv_4 = Curve([<curve referenced from the Rhino model> x3])

# ----
# a (slightly) more automated handles setup
rotations_4 = Panel("""0
180""")
lng = ListLength(List=crv_4)

# ---- group: type 1
crv_5 = Curve([<curve referenced from the Rhino model> x3])

# ---- group: building type
repeat = RepeatData(Data="1", Length=lng)
panel = Panel(repeat)

# ---- group: building rotations
repeat_2 = RepeatData(Data=graft(rotations_4), Length=lng)
panel_2 = Panel(repeat_2)
viewer = ParamViewer(repeat_2)
flip = FlipMatrix(Data=repeat_2)  # -> simplify(Data)
viewer_2 = ParamViewer(flip)
panel_3 = Panel(flip)

# ---- group: type 1
# in case you need to specify individual values for each handle type, you can use multiple copies of the set above and join the outputs in a Merge component.
# 
# Here's the case for 2 different types and the related rotations and weights
crv_6 = Curve([<curve referenced from the Rhino model> x4])

# ---- group: type 2
crv_7 = Curve([<curve referenced from the Rhino model> x2])

# ----
rotations_5 = Panel("""0
180""")
rotations_6 = Panel("""0
90
180""")
# Manually set the rotations for each handle polyline, using an entwine component. Rotations for each handle can be different.
# 
# Same type handles can have different individual rotations.
viewer_3 = ParamViewer(crv_5)
entwine = Entwine(Branch00=rotations_5, Branch01=rotations_6, Branch02=rotations_5, FlattenInputs=True)
viewer_4 = ParamViewer(entwine)
panel_4 = Panel(entwine)
type_4 = Panel("""1
1
1""")

lng_2 = ListLength(List=crv_7)
rotations_7 = Panel("""0
180""")
type_5 = Panel("2")
repeat_3 = RepeatData(Data=graft(rotations_7), Length=lng_2)
repeat_4 = RepeatData(Data=type_5, Length=lng_2)
flip_2 = FlipMatrix(Data=repeat_3)  # -> simplify(Data)

lng_3 = ListLength(List=crv_6)
# more ways to construct handles
rotations_8 = Panel("""0
90
180""")
type_6 = Panel("1")
repeat_5 = RepeatData(Data=graft(rotations_8), Length=lng_3)
repeat_6 = RepeatData(Data=type_6, Length=lng_3)
flip_3 = FlipMatrix(Data=repeat_5)  # -> simplify(Data)

# ---- group: Create Handles
handles_4 = ConstructHandles(Polyline=crv_6, RotationAngles=flip_3, Type=repeat_6)

handles_5 = ConstructHandles(Polyline=crv_7, RotationAngles=flip_2, Type=repeat_4)

handles_6 = ConstructHandles(Polyline=crv_5, RotationAngles=entwine, Type=type_4)

handles_7 = ConstructHandles(Polyline=crv_4, RotationAngles=flip, Type=repeat)

# ----
merge = Merge(Data1=flatten(handles_4), Data2=flatten(handles_5))
# to pass Assembler data around, use the generic Data container
data = Data(merge)

# ---- group: type 1
crv_8 = Curve([<curve referenced from the Rhino model> x4])

crv_9 = Curve([<curve referenced from the Rhino model> x3])

# ---- group: type 2
crv_10 = Curve([<curve referenced from the Rhino model> x2])

crv_11 = Curve([<curve referenced from the Rhino model> x2])

# ----
merge_2 = Merge(Data1=crv_9, Data2=crv_10)
merge_3 = Merge(Data1=crv_8, Data2=crv_11)

lng_4 = ListLength(List=crv_8)
lng_5 = ListLength(List=crv_11)
rotations_9 = Panel("""0
180""")
lng_6 = ListLength(List=merge_3)
repeat_7 = RepeatData(Data="1", Length=lng_4)
repeat_8 = RepeatData(Data="2", Length=lng_5)
repeat_9 = RepeatData(Data=graft(rotations_9), Length=lng_6)
merge_4 = Merge(Data1=repeat_7, Data2=repeat_8)
flip_4 = FlipMatrix(Data=repeat_9)  # -> simplify(Data)

crv_12 = Curve(merge_2)

# ----
# Assembler
# 
# Framework for Iterative Assemblages workflow
# 
# code by Alessio Erioli
# 
# v 1.0
# © Co-de-iT 2021 / Creative Commons Attribution-Non Commercial-ShareAlike 4.0 International License
rotations_10 = Panel("""0
180""")
lng_7 = ListLength(List=crv_12)
lng_8 = ListLength(List=crv_9)
lng_9 = ListLength(List=crv_10)
repeat_10 = RepeatData(Data=graft(rotations_10), Length=lng_7)
repeat_11 = RepeatData(Data="1", Length=lng_8)
repeat_12 = RepeatData(Data="2", Length=lng_9)
flip_5 = FlipMatrix(Data=repeat_10)  # -> simplify(Data)
merge_5 = Merge(Data1=repeat_11, Data2=repeat_12)

# ---- group: Create Handles
handles_8 = ConstructHandles(Polyline=merge_3, RotationAngles=flip_4, Type=merge_4)

handles_9 = ConstructHandles(Polyline=crv_12, RotationAngles=flip_5, Type=merge_5)

# ----
mesh = Mesh(<mesh referenced from the Rhino model>)
volume = Volume(Geometry=mesh)  # -> Volume, Centroid
name = Panel("typeB")
xy = XYPlane(Origin=volume.Centroid)
X = UnitX(Factor=1)

mesh_2 = Mesh(<mesh referenced from the Rhino model>)
volume_2 = Volume(Geometry=mesh_2)  # -> Volume, Centroid
name_2 = Panel("typeA")
xy_2 = XYPlane(Origin=volume_2.Centroid)
X_2 = UnitX(Factor=1)

# ---- group: Display Handles
handdisp = DisplayHandle(Handles=handles_8, DisplaySize=Slider(0.1, range=0..0.5), absHTextSize=False)

handdisp_2 = DisplayHandle(Handles=handles_9, DisplaySize=Slider(0.1, range=0..0.5), absHTextSize=False)

# ---- group: body
mesh_3 = Mesh(<mesh referenced from the Rhino model>)

# ---- group: circulation path
crv_13 = Curve([<curve referenced from the Rhino model> x11])

# ---- group: body v1
mesh_4 = Mesh(<mesh referenced from the Rhino model>)

# ---- group: circulation path
crv_14 = Curve([<curve referenced from the Rhino model> x11])

# ---- group: Create AssemblyObject
aocon = ConstructAssemblyObject(Name=name_2, CollisionMesh=mesh_2, ReferencePlane=xy_2, Direction=X_2, Weight="1.0", Handles=handles_9, ZLockAO=False)

aocon_2 = ConstructAssemblyObject(Name=name, CollisionMesh=mesh, ReferencePlane=xy, Direction=X, Weight="1.0", Handles=handles_8, ZLockAO=False)

# ----
merge_6 = Merge(Data1=mesh_3, Data2=crv_13)
xdcon = ConstructXData(Label="typeB_data", Data=merge_6, ReferencePlane=xy, AssemblyObjectNameReference=name)

merge_7 = Merge(Data1=mesh_4, Data2=crv_14)
xdcon_2 = ConstructXData(Label="typeA_data", Data=merge_7, ReferencePlane=xy_2, AssemblyObjectNameReference=name_2)

# ---- group: XData
# to pass Assembler data around, use the generic Data container
merge_8 = Merge(Data1=flatten(xdcon_2), Data2=flatten(xdcon))
data_2 = Data(merge_8)

# ---- group: AssemblyObjects
# AO set: With more than one AssemblyObject, just build a list with the Merge component
merge_9 = Merge(Data1=flatten(aocon), Data2=flatten(aocon_2))
data_3 = Data(merge_9)

# ----
# right-click menu options: no self-AO - prevents an object from connecting with itself
# 
# no self-Handle - prevents an handle from connecting with itself
# 
# allow cross-Handle type - enables Handles universal compatibility
heuw = HeuristicsWriter(AssemblyObjectsSet=data_3, noSH=False, noSO=False, xHT=False)
number_slider = Slider(1.2, range=1..2)
pt = Point(Point(0, 20, 0))
heuristics_rules = Panel(heuw)

# ---- group: Heuristics Display
# Try connecting XData:
# 
# when you have XData the collision meshes are displayed as outlines only
heud = HeuristicDisplay(
    OriginPoint=pt,
    AssemblyObjectsSet=data_3,
    HeuristicsString=heuw,
    XSize=number_slider,
    YSize=number_slider,
    NRows=Slider(10, range=10..50),
    DisplayType="AO Types",
    ZLockFilter=False,
    OutputType="AO Types")
