# Grasshopper definition 01-03_base 2 objects_Assemblage random + save-load.gh (Grasshopper 1.0.7)
# Copyright: Co-de-iT
# plug-ins: Assembler, froGH, Human

# ---- group: type 1
crv = Curve([<curve referenced from the Rhino model> x4])

crv_2 = Curve([<curve referenced from the Rhino model> x3])

# ---- group: type 2
crv_3 = Curve([<curve referenced from the Rhino model> x2])

crv_4 = Curve([<curve referenced from the Rhino model> x2])

# ----
merge = Merge(Data1=crv_2, Data2=crv_3)
merge_2 = Merge(Data1=crv, Data2=crv_4)

lng = ListLength(List=crv)
lng_2 = ListLength(List=crv_4)
rotations = Panel("""0
180""")
lng_3 = ListLength(List=merge_2)
repeat = RepeatData(Data="1", Length=lng)
repeat_2 = RepeatData(Data="2", Length=lng_2)
repeat_3 = RepeatData(Data=graft(rotations), Length=lng_3)
merge_3 = Merge(Data1=repeat, Data2=repeat_2)
flip = FlipMatrix(Data=repeat_3)  # -> simplify(Data)

crv_5 = Curve(merge)

# ----
# Assembler
# 
# Framework for Iterative Assemblages workflow
# 
# code by Alessio Erioli
# 
# v 1.0
# © Co-de-iT 2021 / Creative Commons Attribution-Non Commercial-ShareAlike 4.0 International License
rotations_2 = Panel("""0
180""")
lng_4 = ListLength(List=crv_5)
lng_5 = ListLength(List=crv_2)
lng_6 = ListLength(List=crv_3)
repeat_4 = RepeatData(Data=graft(rotations_2), Length=lng_4)
repeat_5 = RepeatData(Data="1", Length=lng_5)
repeat_6 = RepeatData(Data="2", Length=lng_6)
flip_2 = FlipMatrix(Data=repeat_4)  # -> simplify(Data)
merge_4 = Merge(Data1=repeat_5, Data2=repeat_6)

# ---- group: Create Handles
handles = ConstructHandles(Polyline=merge_2, RotationAngles=flip, Type=merge_3)

handles_2 = ConstructHandles(Polyline=crv_5, RotationAngles=flip_2, Type=merge_4)

# ----
# "Intermediate" geometry: Fast mesh representation of actual geometry - derived from the BRep. Check if Fast Mesh is good enough, otherwise:
# . either play with meshing parameters to get a good quality/speed compromise
# . model a mesh geometry in Rhino to use as representative
mesh = Mesh(<mesh referenced from the Rhino model>)

mesh_2 = Mesh(<mesh referenced from the Rhino model>)

# ---- group: Display Handles
handdisp = DisplayHandle(Handles=handles, DisplaySize=Slider(0.1, range=0..0.5), absHTextSize=False)

handdisp_2 = DisplayHandle(Handles=handles_2, DisplaySize=Slider(0.1, range=0..0.5), absHTextSize=False)

# ----
mesh_3 = Mesh(<mesh referenced from the Rhino model>)
volume = Volume(Geometry=mesh_3)  # -> Volume, Centroid
name = Panel("typeB")
xy = XYPlane(Origin=volume.Centroid)
X = UnitX(Factor=1)

mesh_4 = Mesh(<mesh referenced from the Rhino model>)
volume_2 = Volume(Geometry=mesh_4)  # -> Volume, Centroid
name_2 = Panel("typeA")
xy_2 = XYPlane(Origin=volume_2.Centroid)
X_2 = UnitX(Factor=1)

concat = Concatenate(FragmentA=name_2, FragmentB="_geometry")
xdcon = ConstructXData(Label=concat, Data=mesh, ReferencePlane=xy_2, AssemblyObjectNameReference=name_2)

concat_2 = Concatenate(FragmentA=name, FragmentB="_geometry")
xdcon_2 = ConstructXData(Label=concat_2, Data=mesh_2, ReferencePlane=xy, AssemblyObjectNameReference=name)

concat_3 = Concatenate(FragmentA=name, FragmentB="_data")

# ---- group: circulation path
crv_6 = Curve([<curve referenced from the Rhino model> x11])

crv_7 = Curve([<curve referenced from the Rhino model> x11])

# ---- group: Create AssemblyObject
aocon = ConstructAssemblyObject(Name=name_2, CollisionMesh=mesh_4, ReferencePlane=xy_2, Direction=X_2, Weight="1.0", Handles=handles_2, ZLockAO=False)

aocon_2 = ConstructAssemblyObject(Name=name, CollisionMesh=mesh_3, ReferencePlane=xy, Direction=X, Weight="1.0", Handles=handles, ZLockAO=False)

# ----
xdcon_3 = ConstructXData(Label=concat_3, Data=crv_7, ReferencePlane=xy, AssemblyObjectNameReference=name)
# The starting orientation plane
starting_plane = ValueList({"XY": 0, "YZ": 1, "custom": 2}, selected="XY")
pt = Point(Point(0, -100, 0))

# ---- group: XData - geometries
merge_5 = Merge(Data1=flatten(xdcon), Data2=flatten(xdcon_2))
data = Data(merge_5)

# ---- group: AssemblyObjects
# AO set: With more than one AssemblyObject, just build a list with the Merge component
merge_6 = Merge(Data1=flatten(aocon), Data2=flatten(aocon_2))
data_2 = Data(merge_6)

# ----
xy_3 = XYPlane(Origin=pt)
yz = YZPlane(Origin=pt)
pl = PlaneNormal(Origin=pt, ZAxis="1,-1,1")
filter = StreamFilter(Gate=starting_plane, Stream0=xy_3, Stream1=yz, Stream2=pl)
heuw = HeuristicsWriter(AssemblyObjectsSet=data_2, noSH=False, noSO=False, xHT=False)
# The object type is the index of the AssemblyObject in the list
number_slider = Slider(0, range=0..1)

# ---- group: filter heuristics
# Filtering invalid heuristics speeds up the process (the engine will not test rules that are already invalid)
heudex = HeuristicsDisplayEx(OriginPoint=Point(0, 0, 0), AssemblyObjectsSet=data_2, HeuristicsString=heuw, XSize=1, YSize=1, NRows=10)  # -> AssemblyObjectPairs, CoherencePattern, HeuristicsStringTree, TextBasePoints, XData
cull = CullPattern(List=flatten(heudex.HeuristicsStringTree), CullPattern=flatten(heudex.CoherencePattern))

# ----
# Reset the system to apply setup changes
reset = Button()
max_objects = Panel("2000")
step = Button()
number_slider_2 = Slider(1.2, range=1..2)
heuristics_rules = Panel(heuw)
pt_2 = Point(Point(0, 20, 0))

# ---- group: Heuristics Display
# Try connecting XData:
# 
# when you have XData the collision meshes are displayed as outlines only
heud = HeuristicDisplay(
    OriginPoint=pt_2,
    AssemblyObjectsSet=data_2,
    HeuristicsString=heuw,
    XSize=number_slider_2,
    YSize=number_slider_2,
    NRows=Slider(10, range=10..50),
    DisplayType="AO Types",
    ZLockFilter=False)

# ----
# NOTE: When the Save toggle is active, any change upstream will trigger a new save. Deactivate the toggle if you do not need to save anymore!
directory = Panel("saved assemblages\")
f_ghfilepath = GHFilePathInfo()  # -> FileName, FilePath
file_name = Panel("assemblage2obj")
start_index_optional = Panel("0")
save = BooleanToggle(False)
concat_4 = Concatenate(FragmentA=f_ghfilepath.FilePath, FragmentB=directory)

folder_path = Panel(concat_4)

# ----
# Change this index to select the desired file
f_dirread = DirectoryReader(DirectoryPath=concat_4)  # -> FileList, SubdirList
# This chain of components reads the same directory in which the assemblges are saved and allows you to pick the file with a list item. Deactivate/reactivate the Directory reader to update the files list.
panel = Panel(f_dirread.FileList)
item = ListItem(List=f_dirread.FileList, Index="0", Wrap=True)
concat_5 = Concatenate(FragmentA=concat_4, FragmentB=item)

selected_file = Panel(concat_5)

# ---- group: file path (generated)
# File Path: write the full path to your saved .JSON file
txt = Text(concat_5)

# ----
concat_6 = Concatenate(FragmentA=name_2, FragmentB="_data")

xdcon_4 = ConstructXData(Label=concat_6, Data=crv_6, ReferencePlane=xy_2, AssemblyObjectNameReference=name_2)

# ---- group: XData
# to pass Assembler data around, use the generic Data container
merge_7 = Merge(Data1=flatten(xdcon_4), Data2=flatten(xdcon_3))
data_3 = Data(merge_7)

# ----
# Load AssemblyObjects
# NOTE: Keep Load toggle activated to maintain the objects in this file
load = BooleanToggle(False)

# ---- group: Load AssemblyObject
json2ao = AssemblyObjectsFromJSON(FilePath=txt, Load=load)

# ---- group: to AOpa input in Engine
# NOTE: A saved assemblage can be used as AOpa (previous assemblage) in the Assembler Engines.
data_4 = Data(json2ao)
data_5 = Data()

# ---- group: from loaded file
data_6 = Data(data_5)

# ---- group: Random Assemblage Engine
aoeng = AssemblerEngineSimple(
    AssemblyObjectsSet=data_2,
    PreviousAssemblage=data_6,
    StartingPlane=filter,
    StartingObjectType=number_slider,
    HeuristicsString=cull,
    Go=False,
    Step=step,
    NIterations=Slider(100, range=10..100),
    MaxNObjects=max_objects,
    Reset=reset)  # -> Assemblage, AssemblageCount

# ----
# Save AssemblyObjects
n_of_objects = Panel(aoeng.AssemblageCount)

# ---- group: Deconstruct Assembage
aoadecon = DeconstructAssemblage(Assemblage=aoeng.Assemblage)  # -> AssemblageObjects, AssemblageRules, ReceiverObjectsIndexes, AvailableObjectIndexes, UnreachableObjectIndexes

# ----
aoadisp = DisplayAssemblage(Assemblage=aoeng.Assemblage, Bypass=False, OutputType="Objects")  # -> ColoredCollisionMeshes, Edges, Colors

# ---- group: Save AssemblyObjects
ao2json = AssemblyObjectsToJSON(
    AssemblyObjects=aoadecon.AssemblageObjects,
    StartIndex=start_index_optional,
    Directory=concat_4,
    FileName=file_name,
    Save=save)

# ---- group: display ccollision geometries
mjoin = MeshJoin(Meshes=aoadisp.ColoredCollisionMeshes)
preview = CustomPreview(Geometry=mjoin, Material=ColourSwatch(SwatchColor=RGB(255, 255, 255)))  # disabled

# ----
panel_3 = Panel(ao2json)

# ---- group: display "intermediate" geometries
aoadecon_2 = DeconstructAssemblage(Assemblage=aoeng.Assemblage)  # -> AssemblageObjects, AssemblageRules, ReceiverObjectsIndexes, AvailableObjectIndexes, UnreachableObjectIndexes
aoxd = AssociateXData(AssemblyObjects=aoadecon_2.AssemblageObjects, XData=data)
xddecon = DeconstructXData(XData=aoxd)  # -> Label, Data, ReferencePlane, AssemblyObjectNameReference
preview_2 = CustomPreview(Geometry=xddecon.Data, Material=graft(aoadisp.Colors))

# ---- group: display ccollision geometries / display edges
previewlw = CustomPreviewLineweights(Geometry=aoadisp.Edges, Shader=ColourSwatch(SwatchColor=RGB(0, 0, 0)), Thickness=Slider(1, range=1..3), Absolute=False)

# ----
aocmesh = ExtractCollisionMesh(AssemblyObject=json2ao)
