# Grasshopper definition 01-05_base 2 objects_Assemblge random + previous objects.gh (Grasshopper 1.0.7)
# Copyright: Co-de-iT
# plug-ins: Assembler, Human, froGH

# ---- group: type 1
crv = Curve([<curve referenced from the Rhino model> x4])

crv_2 = Curve([<curve referenced from the Rhino model> x3])

# ---- group: type 2
crv_3 = Curve([<curve referenced from the Rhino model> x2])

crv_4 = Curve([<curve referenced from the Rhino model> x2])

# ----
merge = Merge(Data1=crv_2, Data2=crv_3)
merge_2 = Merge(Data1=crv, Data2=crv_4)

lng = ListLength(List=crv)
lng_2 = ListLength(List=crv_4)
rotations = Panel("""0
180""")
lng_3 = ListLength(List=merge_2)
repeat = RepeatData(Data="1", Length=lng)
repeat_2 = RepeatData(Data="2", Length=lng_2)
repeat_3 = RepeatData(Data=graft(rotations), Length=lng_3)
merge_3 = Merge(Data1=repeat, Data2=repeat_2)
flip = FlipMatrix(Data=repeat_3)  # -> simplify(Data)

crv_5 = Curve(merge)

# ----
# Assembler
# 
# Framework for Iterative Assemblages workflow
# 
# code by Alessio Erioli
# 
# v 1.0
# © Co-de-iT 2021 / Creative Commons Attribution-Non Commercial-ShareAlike 4.0 International License
rotations_2 = Panel("""0
180""")
lng_4 = ListLength(List=crv_5)
lng_5 = ListLength(List=crv_2)
lng_6 = ListLength(List=crv_3)
repeat_4 = RepeatData(Data=graft(rotations_2), Length=lng_4)
repeat_5 = RepeatData(Data="1", Length=lng_5)
repeat_6 = RepeatData(Data="2", Length=lng_6)
flip_2 = FlipMatrix(Data=repeat_4)  # -> simplify(Data)
merge_4 = Merge(Data1=repeat_5, Data2=repeat_6)

# ---- group: Create Handles
handles = ConstructHandles(Polyline=merge_2, RotationAngles=flip, Type=merge_3)

handles_2 = ConstructHandles(Polyline=crv_5, RotationAngles=flip_2, Type=merge_4)

# ----
# "Intermediate" geometry: Fast mesh representation of actual geometry - derived from the BRep. Check if Fast Mesh is good enough, otherwise:
# . either play with meshing parameters to get a good quality/speed compromise
# . model a mesh geometry in Rhino to use as representative
mesh = Mesh(<mesh referenced from the Rhino model>)

mesh_2 = Mesh(<mesh referenced from the Rhino model>)

# ---- group: Display Handles
handdisp = DisplayHandle(Handles=handles, DisplaySize=Slider(0.1, range=0..0.5), absHTextSize=False)

handdisp_2 = DisplayHandle(Handles=handles_2, DisplaySize=Slider(0.1, range=0..0.5), absHTextSize=False)

# ----
mesh_3 = Mesh(<mesh referenced from the Rhino model>)
volume = Volume(Geometry=mesh_3)  # -> Volume, Centroid
name = Panel("typeB")
xy = XYPlane(Origin=volume.Centroid)
X = UnitX(Factor=1)

mesh_4 = Mesh(<mesh referenced from the Rhino model>)
volume_2 = Volume(Geometry=mesh_4)  # -> Volume, Centroid
name_2 = Panel("typeA")
xy_2 = XYPlane(Origin=volume_2.Centroid)
X_2 = UnitX(Factor=1)

concat = Concatenate(FragmentA=name_2, FragmentB="_geometry")
xdcon = ConstructXData(Label=concat, Data=mesh, ReferencePlane=xy_2, AssemblyObjectNameReference=name_2)

concat_2 = Concatenate(FragmentA=name, FragmentB="_geometry")
xdcon_2 = ConstructXData(Label=concat_2, Data=mesh_2, ReferencePlane=xy, AssemblyObjectNameReference=name)

# ---- group: circulation path
crv_6 = Curve([<curve referenced from the Rhino model> x11])

crv_7 = Curve([<curve referenced from the Rhino model> x11])

# ----
concat_3 = Concatenate(FragmentA=name, FragmentB="_data")
xdcon_3 = ConstructXData(Label=concat_3, Data=crv_7, ReferencePlane=xy, AssemblyObjectNameReference=name)

# ---- group: Create AssemblyObject
aocon = ConstructAssemblyObject(Name=name_2, CollisionMesh=mesh_4, ReferencePlane=xy_2, Direction=X_2, Weight="1.0", Handles=handles_2, ZLockAO=False)

aocon_2 = ConstructAssemblyObject(Name=name, CollisionMesh=mesh_3, ReferencePlane=xy, Direction=X, Weight="1.0", Handles=handles, ZLockAO=False)

# ---- group: XData - geometries
merge_5 = Merge(Data1=flatten(xdcon), Data2=flatten(xdcon_2))
data = Data(merge_5)

# ---- group: AssemblyObjects
# AO set: With more than one AssemblyObject, just build a list with the Merge component
merge_6 = Merge(Data1=flatten(aocon), Data2=flatten(aocon_2))
data_2 = Data(merge_6)

# ----
heuw = HeuristicsWriter(AssemblyObjectsSet=data_2, noSH=False, noSO=False, xHT=False)

# ---- group: multiple starting objects
types = Panel("""0
1
0""")
pt = Point(Point(-107.0217453, -58.06245355, 9.786645481))
pt_2 = Point(Point(-63.2120757, -83.8355895, 0))
pt_3 = Point(Point(-125.2124071, -126.6341651, -26.05595137))
item = ListItem(List=data_2, Index=types, Wrap=True)
xy_3 = XYPlane(Origin=pt)
xz = XZPlane(Origin=pt_2)
yz = YZPlane(Origin=pt_3)
aoplane = ExtractReferencePlane(AssemblyObject=item)
merge_7 = Merge(Data1=xy_3, Data2=xz, Data3=yz)
orient = Orient(Source=aoplane, Target=merge_7)  # -> Geometry, Transform

# ----
heuristics_rules = Panel(heuw)
number_slider = Slider(1.2, range=1..2)
pt_4 = Point(Point(0, 20, 0))

# ---- group: Heuristics Display
# Try connecting XData:
# 
# when you have XData the collision meshes are displayed as outlines only
heud = HeuristicDisplay(
    OriginPoint=pt_4,
    AssemblyObjectsSet=data_2,
    HeuristicsString=heuw,
    XSize=number_slider,
    YSize=number_slider,
    NRows=Slider(10, range=10..50),
    DisplayType="AO Types",
    ZLockFilter=False)

# ---- group: multiple starting objects / Transform AssemblyObject
aoxform = TransformAssemblyObject(AssemblyObject=item, Transformation=orient.Transform)

# ----
# if previous objects are connected, these 2 parameters will be ignored
number_slider_2 = Slider(0, range=0..1)
pt_5 = Point(Point(0, -100, 0))

# ---- group: filter heuristics
# Filtering invalid heuristics speeds up the process (the engine will not test rules that are already invalid)
heudex = HeuristicsDisplayEx(OriginPoint=Point(0, 0, 0), AssemblyObjectsSet=data_2, HeuristicsString=heuw, XSize=1, YSize=1, NRows=10)  # -> AssemblyObjectPairs, CoherencePattern, HeuristicsStringTree, TextBasePoints, XData
cull = CullPattern(List=flatten(heudex.HeuristicsStringTree), CullPattern=flatten(heudex.CoherencePattern))

# ----
# Reset the system to apply setup changes
reset = Button()
max_objects = Panel("2000")
step = Button()

# ---- group: Random Assemblage Engine
aoeng = AssemblerEngineSimple(
    AssemblyObjectsSet=data_2,
    PreviousAssemblage=aoxform,
    StartingPlane=pt_5,
    StartingObjectType=number_slider_2,
    HeuristicsString=cull,
    Go=False,
    Step=step,
    NIterations=Slider(100, range=10..100),
    MaxNObjects=max_objects,
    Reset=reset)  # -> Assemblage, AssemblageCount

# ----
n_of_objects = Panel(aoeng.AssemblageCount)
aoadisp = DisplayAssemblage(Assemblage=aoeng.Assemblage, Bypass=False, OutputType="Objects")  # -> ColoredCollisionMeshes, Edges, Colors

# ---- group: display "intermediate" geometries
aoadecon = DeconstructAssemblage(Assemblage=aoeng.Assemblage)  # -> AssemblageObjects, AssemblageRules, ReceiverObjectsIndexes, AvailableObjectIndexes, UnreachableObjectIndexes
aoxd = AssociateXData(AssemblyObjects=aoadecon.AssemblageObjects, XData=data)
xddecon = DeconstructXData(XData=aoxd)  # -> Label, Data, ReferencePlane, AssemblyObjectNameReference
preview = CustomPreview(Geometry=xddecon.Data, Material=graft(aoadisp.Colors))

# ---- group: display edges
f_mmeea = MeshesExtractEdgesWithToleranceAngle(Mesh=flatten(xddecon.Data), Angle=45)  # -> InternalEdges, NakedEdges
previewlw = CustomPreviewLineweights(
    Geometry=f_mmeea.InternalEdges,
    Shader=ColourSwatch(SwatchColor=RGB(0, 0, 0)),
    Thickness=Slider(1, range=1..3),
    Absolute=False)

# ---- group: display components / display edges
previewlw_2 = CustomPreviewLineweights(
    Geometry=aoadisp.Edges,
    Shader=ColourSwatch(SwatchColor=RGB(56, 56, 56)),
    Thickness=Slider(1, range=1..3),
    Absolute=False)

# ---- group: display components
mjoin = MeshJoin(Meshes=aoadisp.ColoredCollisionMeshes)
preview_2 = CustomPreview(Geometry=mjoin, Material=ColourSwatch(SwatchColor=RGB(255, 255, 255)))  # disabled

# ----
concat_4 = Concatenate(FragmentA=name_2, FragmentB="_data")

xdcon_4 = ConstructXData(Label=concat_4, Data=crv_6, ReferencePlane=xy_2, AssemblyObjectNameReference=name_2)

# ---- group: XData
# to pass Assembler data around, use the generic Data container
merge_8 = Merge(Data1=flatten(xdcon_4), Data2=flatten(xdcon_3))
data_3 = Data(merge_8)
