# Grasshopper definition 01-06_base 2 objects comp_Assemblage random - composite v1.gh (Grasshopper 1.0.7)
# Copyright: Co-de-iT
# plug-ins: Assembler, EleFront, froGH, Human

# ---- group: all polylines
crv = Curve([<curve referenced from the Rhino model> x10])

# ---- group: selected polylines
crv_2 = Curve([<curve referenced from the Rhino model> x7])

crv_3 = Curve([<curve referenced from the Rhino model> x6])

# ----
lng = ListLength(List=crv)
# Assembler
# 
# Framework for Iterative Assemblages workflow
# 
# code by Alessio Erioli
# 
# v 1.0
# © Co-de-iT 2021 / Creative Commons Attribution-Non Commercial-ShareAlike 4.0 International License
# Composite Objects strategy 1: Composite objects in this case are created manually. You can use a nested block system to associate the children objects with their parent when it comes to the actual geometry or create new blocks with different geometries for the composites.
# 
# Collision meshes must be modeled manually.
# 0 - construct
rotations = Panel("0")
type = Panel("1")
repeat = RepeatData(Data=graft(rotations), Length=lng)
repeat_2 = RepeatData(Data=type, Length=lng)
flip = FlipMatrix(Data=repeat)  # -> simplify(Data)

lng_2 = ListLength(List=crv_2)
rotations_2 = Panel("0")
type_2 = Panel("1")
repeat_3 = RepeatData(Data=graft(rotations_2), Length=lng_2)
repeat_4 = RepeatData(Data=type_2, Length=lng_2)
flip_2 = FlipMatrix(Data=repeat_3)  # -> simplify(Data)

lng_3 = ListLength(List=crv_3)
rotations_3 = Panel("""0
180""")
type_3 = Panel("1")
repeat_5 = RepeatData(Data=graft(rotations_3), Length=lng_3)
repeat_6 = RepeatData(Data=type_3, Length=lng_3)
flip_3 = FlipMatrix(Data=repeat_5)  # -> simplify(Data)

# ---- group: Create Handles
handles = ConstructHandles(Polyline=crv_2, RotationAngles=flip_2, Type=repeat_4)

handles_2 = ConstructHandles(Polyline=crv_3, RotationAngles=flip_3, Type=repeat_6)

handles_3 = ConstructHandles(Polyline=crv, RotationAngles=flip, Type=repeat_2)

# ----
mesh = Mesh(<mesh referenced from the Rhino model>)
volume = Volume(Geometry=mesh)  # -> Volume, Centroid
name = Panel("AO type A")
X = UnitX(Factor=1)
xy = XYPlane(Origin=volume.Centroid)

mesh_2 = Mesh(<mesh referenced from the Rhino model>)
volume_2 = Volume(Geometry=mesh_2)  # -> Volume, Centroid
name_2 = Panel("composite v1")
X_2 = UnitX(Factor=1)
xy_2 = XYPlane(Origin=volume_2.Centroid)

mesh_3 = Mesh(<mesh referenced from the Rhino model>)
volume_3 = Volume(Geometry=mesh_3)  # -> Volume, Centroid
name_3 = Panel("composite v2")
X_3 = UnitX(Factor=1)
xy_3 = XYPlane(Origin=volume_3.Centroid)

# ---- group: Display Handles
handdisp = DisplayHandle(Handles=handles_3, DisplaySize=Slider(0.1, range=0..0.5), absHTextSize=False)

handdisp_2 = DisplayHandle(Handles=handles, DisplaySize=Slider(0.1, range=0..0.5), absHTextSize=False)

handdisp_3 = DisplayHandle(Handles=handles_2, DisplaySize=Slider(0.1, range=0..0.5), absHTextSize=False)

# ---- group: Create AssemblyObject
aocon = ConstructAssemblyObject(Name=name, CollisionMesh=mesh, ReferencePlane=xy, Direction=X, Weight="1.0", Handles=handles_3, ZLockAO=False)

aocon_2 = ConstructAssemblyObject(Name=name_2, CollisionMesh=mesh_2, ReferencePlane=xy_2, Direction=X_2, Weight="1.0", Handles=handles, ZLockAO=False)

aocon_3 = ConstructAssemblyObject(Name=name_3, CollisionMesh=mesh_3, ReferencePlane=xy_3, Direction=X_3, Weight="1.0", Handles=handles_2, ZLockAO=False)

# ---- group: AssemblyObject names
merge = Merge(Data1=name, Data2=name_2, Data3=name_3)

# ---- group: AO set
merge_2 = Merge(Data1=aocon, Data2=aocon_2, Data3=aocon_3)

# ----
heuw = HeuristicsWriter(AssemblyObjectsSet=merge_2, noSH=False, noSO=False, xHT=False)
heuristics_rules = Panel(heuw)

# ---- group: filter heuristics
heudex = HeuristicsDisplayEx(OriginPoint=Point(0, 0, 0), AssemblyObjectsSet=merge_2, HeuristicsString=heuw, XSize=1, YSize=1, NRows=10)  # -> AssemblyObjectPairs, CoherencePattern, HeuristicsStringTree, TextBasePoints, XData
cull = CullPattern(List=flatten(heudex.HeuristicsStringTree), CullPattern=flatten(heudex.CoherencePattern))

# ----
step = Button()
reset = Button()
filter_invalid = BooleanToggle(False)
pt = Point(Point(0, -50, 0))
filter = StreamFilter(Gate=filter_invalid, Stream0=heuw, Stream1=cull)

# ---- group: Random Assemblage Engine
# 1 - simulate
aoeng = AssemblerEngineSimple(
    AssemblyObjectsSet=merge_2,
    StartingPlane=pt,
    StartingObjectType=0,
    HeuristicsString=cull,
    Go=False,
    Step=step,
    NIterations=Slider(100, range=10..100),
    MaxNObjects="1000",
    Reset=reset)  # -> Assemblage, AssemblageCount

# ----
cell_size = Slider(1.2, range=1..2)
panel = Panel(aoeng.AssemblageCount)
pt_2 = Point(Point(0, 20, 0))
dam = DataDam(DataA=aoeng.Assemblage, BufferDelay=10000000, BufferMode=0)

# ---- group: Heuristics Display
heud = HeuristicDisplay(
    OriginPoint=pt_2,
    AssemblyObjectsSet=merge_2,
    HeuristicsString=filter,
    XSize=cell_size,
    YSize=cell_size,
    NRows=Slider(27, range=10..50),
    DisplayType="AO Types",
    ZLockFilter=False,
    OutputType="AO Types")

# ----
aoadecon = DeconstructAssemblage(Assemblage=dam)  # -> AssemblageObjects, AssemblageRules, ReceiverObjectsIndexes, AvailableObjectIndexes, UnreachableObjectIndexes
aoadisp = DisplayAssemblage(Assemblage=aoeng.Assemblage, Bypass=False, OutputType="AO Types")  # -> ColoredCollisionMeshes, Edges, Colors

# ---- group: filter by AssemblyObject name
aodecon = DeconstructAssemblyObject(AssemblyObject=aoadecon.AssemblageObjects)  # -> Name, CollisionMesh, ReferencePlane, Direction, Weight, OccludedNeighbours, Handles, Children, ZLock
tmatch = MatchText(Text=graft(aodecon.Name), Pattern=merge, Case=True)
f_ifroml = IndexesFromList(Data=tmatch)
cull_2 = CullPattern(List=f_ifroml, CullPattern=tmatch)  # -> flatten(List)

# ---- group: display components / display edges
previewlw = CustomPreviewLineweights(Geometry=aoadisp.Edges, Shader=ColourSwatch(SwatchColor=RGB(0, 0, 0)), Thickness=Slider(1, range=1..3), Absolute=False)

# ---- group: display components
# 2 - analyze/post-process
mjoin = MeshJoin(Meshes=aoadisp.ColoredCollisionMeshes)
preview = CustomPreview(Geometry=mjoin, Material=ColourSwatch(SwatchColor=RGB(255, 255, 255)))  # disabled

# ---- group: filter by type
aotype = ExtractType(AssemblyObject=aoadecon.AssemblageObjects)

# ----
filter_by = ValueList({"type": 0, "name": 1}, selected="name")

# ---- group: associate blocks / block names
panel_2 = Panel("block_typeA_v1")
panel_3 = Panel("composite_v1")
panel_4 = Panel("composite_v2")

# ---- group: associate blocks
filter_2 = StreamFilter(Gate=filter_by, Stream0=aotype, Stream1=cull_2)
sift = SiftPattern(List=aodecon.ReferencePlane, SiftPattern=filter_2)  # -> Output0, Output1, Output2
inblock = InsertBlock(BlockName=panel_3, SourcePlane=sift.Output1)
inblock_2 = InsertBlock(BlockName=panel_4, SourcePlane=sift.Output2)
inblock_3 = InsertBlock(BlockName=panel_2, SourcePlane=sift.Output0)
bake_blocks = BooleanToggle(False)
combine = CombineData(Input0=inblock_3, Input1=inblock, Input2=inblock_2)  # -> Result, Index
bake = BakeObjects(Geometry=combine.Result, Bake=bake_blocks)

# ----
preview_2 = CustomPreview(Geometry=combine.Result, Material=aoadisp.Colors)  # disabled
