# Grasshopper definition 01-07-1_base 2 objects selGeom_Assemblage random + selective geometry clash check.gh (Grasshopper 1.0.7)
# Copyright: Co-de-iT
# plug-ins: Assembler, EleFront, froGH, Human

# ---- group: type 1
crv = Curve([<curve referenced from the Rhino model> x3])

crv_2 = Curve([<curve referenced from the Rhino model> x4])

# ---- group: type 2
crv_3 = Curve([<curve referenced from the Rhino model> x2])

# ---- group: type 1
crv_4 = Curve([<curve referenced from the Rhino model> x3])

# ---- group: type 2
crv_5 = Curve([<curve referenced from the Rhino model> x2])

crv_6 = Curve([<curve referenced from the Rhino model> x2])

# ----
merge = Merge(Data1=crv, Data2=crv_3)
merge_2 = Merge(Data1=crv_4, Data2=crv_5)
merge_3 = Merge(Data1=crv_2, Data2=crv_6)

lng = ListLength(List=crv_2)
lng_2 = ListLength(List=crv_6)
rotations = Panel("""0
180""")
lng_3 = ListLength(List=merge_3)
repeat = RepeatData(Data="1", Length=lng)
repeat_2 = RepeatData(Data="2", Length=lng_2)
repeat_3 = RepeatData(Data=graft(rotations), Length=lng_3)
merge_4 = Merge(Data1=repeat, Data2=repeat_2)
flip = FlipMatrix(Data=repeat_3)  # -> simplify(Data)

crv_7 = Curve(merge)

rotations_2 = Panel("""0
180""")
lng_4 = ListLength(List=crv_7)
lng_5 = ListLength(List=crv)
lng_6 = ListLength(List=crv_3)
repeat_4 = RepeatData(Data=graft(rotations_2), Length=lng_4)
repeat_5 = RepeatData(Data="1", Length=lng_5)
repeat_6 = RepeatData(Data="2", Length=lng_6)
flip_2 = FlipMatrix(Data=repeat_4)  # -> simplify(Data)
merge_5 = Merge(Data1=repeat_5, Data2=repeat_6)

crv_8 = Curve(merge_2)

# ----
# Assembler
# 
# Framework for Iterative Assemblages workflow
# 
# code by Alessio Erioli
# 
# v 1.0
# © Co-de-iT 2021 / Creative Commons Attribution-Non Commercial-ShareAlike 4.0 International License
rotations_3 = Panel("""0
180""")
lng_7 = ListLength(List=crv_8)
lng_8 = ListLength(List=crv_4)
lng_9 = ListLength(List=crv_5)
repeat_7 = RepeatData(Data=graft(rotations_3), Length=lng_7)
repeat_8 = RepeatData(Data="1", Length=lng_8)
repeat_9 = RepeatData(Data="2", Length=lng_9)
flip_3 = FlipMatrix(Data=repeat_7)  # -> simplify(Data)
merge_6 = Merge(Data1=repeat_8, Data2=repeat_9)

# ---- group: Create Handles
handles = ConstructHandles(Polyline=merge_3, RotationAngles=flip, Type=merge_4)

handles_2 = ConstructHandles(Polyline=crv_7, RotationAngles=flip_2, Type=merge_5)

handles_3 = ConstructHandles(Polyline=crv_8, RotationAngles=flip_3, Type=merge_6)

# ----
mesh = Mesh(<mesh referenced from the Rhino model>)
volume = Volume(Geometry=mesh)  # -> Volume, Centroid
name = Panel("objectB")
xy = XYPlane(Origin=volume.Centroid)
X = UnitX(Factor=1)

mesh_2 = Mesh(<mesh referenced from the Rhino model>)
volume_2 = Volume(Geometry=mesh_2)  # -> Volume, Centroid
name_2 = Panel("objectC")
xy_2 = XYPlane(Origin=volume_2.Centroid)
X_2 = UnitX(Factor=1)

mesh_3 = Mesh(<mesh referenced from the Rhino model>)
volume_3 = Volume(Geometry=mesh_3)  # -> Volume, Centroid
name_3 = Panel("objectA")
xy_3 = XYPlane(Origin=volume_3.Centroid)
X_3 = UnitX(Factor=1)

# ---- group: Display Handles
handdisp = DisplayHandle(Handles=handles, DisplaySize=Slider(0.1, range=0..0.5), absHTextSize=False)

handdisp_2 = DisplayHandle(Handles=handles_2, DisplaySize=Slider(0.1, range=0..0.5), absHTextSize=False)

handdisp_3 = DisplayHandle(Handles=handles_3, DisplaySize=Slider(0.1, range=0..0.5), absHTextSize=False)

# ---- group: v1 - horizontal
mesh_4 = Mesh(<mesh referenced from the Rhino model>)

# ---- group: v2 - vertical
mesh_5 = Mesh(<mesh referenced from the Rhino model>)

# ---- group: circulation path
crv_9 = Curve([<curve referenced from the Rhino model> x11])

# ----
block_name = Panel("block_typeB")
merge_7 = Merge(Data1=block_name, Data2=crv_9)
xdcon = ConstructXData(Label="objectB_data", Data=merge_7, ReferencePlane=xy, AssemblyObjectNameReference=name)

# ---- group: circulation path
crv_10 = Curve([<curve referenced from the Rhino model> x11])

# ----
block_name_2 = Panel("block_typeA_v1")
merge_8 = Merge(Data1=block_name_2, Data2=crv_10)
xdcon_2 = ConstructXData(Label="objectA_data", Data=merge_8, ReferencePlane=xy_3, AssemblyObjectNameReference=name_3)

mesh_6 = Mesh(<mesh referenced from the Rhino model>)
xdcon_3 = ConstructXData(Label="objectB_geometry", Data=mesh_6, ReferencePlane=xy, AssemblyObjectNameReference=name)

merge_9 = Merge(Data1=mesh_4, Data2=mesh_5)

xdcon_4 = ConstructXData(Label="objectA_geometry", Data=merge_9, ReferencePlane=xy_3, AssemblyObjectNameReference=name_3)

# ---- group: circulation path
crv_11 = Curve([<curve referenced from the Rhino model> x11])

# ----
crv_12 = Curve(<curve referenced from the Rhino model>)
block_name_3 = Panel("block_typeA_v3")
f_plp = PlaneFromLPolyline(Polyline=crv_12)
merge_10 = Merge(Data1=block_name_3, Data2=f_plp, Data3=crv_11)
xdcon_5 = ConstructXData(Label="objectC_data", Data=merge_10, ReferencePlane=xy_2, AssemblyObjectNameReference=name_2)

# ---- group: Create AssemblyObject
aocon = ConstructAssemblyObject(Name=name_2, CollisionMesh=mesh_2, ReferencePlane=xy_2, Direction=X_2, Weight="1.0", Handles=handles_2, ZLockAO=False)

aocon_2 = ConstructAssemblyObject(Name=name_3, CollisionMesh=mesh_3, ReferencePlane=xy_3, Direction=X_3, Weight="1.0", Handles=handles_3, ZLockAO=False)

aocon_3 = ConstructAssemblyObject(Name=name, CollisionMesh=mesh, ReferencePlane=xy, Direction=X, Weight="1.0", Handles=handles, ZLockAO=False)

# ---- group: v3
mesh_7 = Mesh(<mesh referenced from the Rhino model>)

# ----
xdcon_6 = ConstructXData(Label="objectC_geometry", Data=mesh_7, ReferencePlane=xy_2, AssemblyObjectNameReference=name_2)

# ---- group: XData
# to pass Assembler data around, use the generic Data container
merge_11 = Merge(Data1=flatten(xdcon_2), Data2=flatten(xdcon), Data3=flatten(xdcon_5))
data = Data(merge_11)

# ---- group: AssemblyObjects
# AO set: With more than one AssemblyObject, just build a list with the Merge component.
# 
# Here, object types are decided: the first slot in the Merge will be type 0, the second type 1 and so on.
merge_12 = Merge(Data1=flatten(aocon_2), Data2=flatten(aocon_3), Data3=flatten(aocon))
data_2 = Data(merge_12)

# ---- group: XData - geometries
merge_13 = Merge(Data1=flatten(xdcon_4), Data2=flatten(xdcon_3), Data3=flatten(xdcon_6))
data_3 = Data(merge_13)

# ----
starting_plane = ValueList({"XY": 0, "YZ": 1, "custom": 2}, selected="XY")
pt = Point(Point(-50, 50, 0))
xy_4 = XYPlane(Origin=pt)
yz = YZPlane(Origin=pt)
pl = PlaneNormal(Origin=pt, ZAxis="1,-1,1")
filter = StreamFilter(Gate=starting_plane, Stream0=xy_4, Stream1=yz, Stream2=pl)
max_objects = Panel("2000")
step = Button()
reset = Button()

# ---- group: base point
pt_2 = Point(Point(0, 20, 0))

# ---- group: Objects in a closed geometry
# reference a Geometry (Mesh, BRep) from Rhino
geo = Geometry(<mesh referenced from the Rhino model>)

# ---- group: XData
data_4 = Data(data)

data_5 = Data(data)

# ---- group: 2 flights / clash lines
crv_13 = Curve([<curve referenced from the Rhino model> x9])

# ---- group: 2 flights / base point
pt_3 = Point(<point referenced from the Rhino model>)

# ---- group: 1 flight / base point
# Clash lines are modeled in Rhino to check if the circulation space of the stairs is free. They are oriented using the same base point and plane of the relative stair block
pt_4 = Point(<point referenced from the Rhino model>)

# ---- group: 1 flight / clash lines
crv_14 = Curve([<curve referenced from the Rhino model> x4])

# ---- group: 1 flight
xy_5 = XYPlane(Origin=pt_4)

# ---- group: 2 flights
xy_6 = XYPlane(Origin=pt_3)

# ----
# IMPORTANT!!!: Join all actual geoemetry meshes in a single mesh to speed up clash calculation.
# clash check
# Orient clash lines in place and check for intersection with the rest of the assemblage.
# 
# The result are clash-free stairs
# 
# Clash lines might have to be adjusted depending on the geometry and assemblage capability of AssemblyObjects.
panel = Panel("-2")

selective_geometry_block_name = Panel("stair")
selective_geometry_block_name_2 = Panel("stair_2")
bake = BooleanToggle(False)

heuw = HeuristicsWriter(AssemblyObjectsSet=data_2, noSH=False, noSO=False, xHT=False)
heuristics_rules = Panel(heuw)
filter_invalid = BooleanToggle(True)
cell_size = Slider(1.2, range=1..2)

# ---- group: filter heuristics
heudex = HeuristicsDisplayEx(OriginPoint=Point(0, 0, 0), AssemblyObjectsSet=data_2, HeuristicsString=heuw, XSize=1, YSize=1, NRows=10)  # -> AssemblyObjectPairs, CoherencePattern, HeuristicsStringTree, TextBasePoints, XData
cull = CullPattern(List=flatten(heudex.HeuristicsStringTree), CullPattern=flatten(heudex.CoherencePattern))

# ---- group: Random Assemblage Engine
aoeng = AssemblerEngineSimple(
    AssemblyObjectsSet=data_2,
    StartingPlane=filter,
    StartingObjectType=0,
    HeuristicsString=cull,
    Go=False,
    Step=step,
    NIterations=Slider(100, range=10..100),
    MaxNObjects=max_objects,
    Reset=reset)  # -> Assemblage, AssemblageCount

# ----
filter_2 = StreamFilter(Gate=filter_invalid, Stream0=heuw, Stream1=cull)

n_of_objects = Panel(aoeng.AssemblageCount)
aoadisp = DisplayAssemblage(Assemblage=aoeng.Assemblage, Bypass=False, OutputType="AO Types")  # -> ColoredCollisionMeshes, Edges, Colors
aoadecon = DeconstructAssemblage(Assemblage=aoeng.Assemblage)  # -> AssemblageObjects, AssemblageRules, ReceiverObjectsIndexes, AvailableObjectIndexes, UnreachableObjectIndexes

# ---- group: Heuristics Display
heud = HeuristicDisplay(
    OriginPoint=pt_2,
    AssemblyObjectsSet=data_2,
    XData=data_3,
    HeuristicsString=filter_2,
    XSize=cell_size,
    YSize=cell_size,
    NRows=Slider(20, range=10..50),
    DisplayType="AO Types",
    ZLockFilter=False,
    OutputType="AO Types",
    Z_Lock=False)

# ---- group: display collision geometries / display edges
previewlw = CustomPreviewLineweights(Geometry=aoadisp.Edges, Shader=ColourSwatch(SwatchColor=RGB(0, 0, 0)), Thickness=Slider(1, range=1..3), Absolute=False)

# ----
dam = DataDam(DataA=aoadecon.AssemblageObjects, BufferDelay=10000000, BufferMode=0)

# ---- group: display collision geometries
mjoin = MeshJoin(Meshes=aoadisp.ColoredCollisionMeshes)
preview = CustomPreview(Geometry=mjoin, Material=ColourSwatch(SwatchColor=RGB(255, 255, 255)))  # disabled

# ---- group: Filter a specific type
aotype = ExtractType(AssemblyObject=dam)
equals = Equality(FirstNumber=aotype, SecondNumber="2")  # -> Equality, Inequality

# ---- group: associate XData
aoxd = AssociateXData(AssemblyObjects=aoadecon.AssemblageObjects, XData=data_3)

# ---- group: deconstruct XData
xddecon = DeconstructXData(XData=aoxd)  # -> Label, Data, ReferencePlane, AssemblyObjectNameReference

# ---- group: type boolean pattern
aotype_2 = ExtractType(AssemblyObject=aoadecon.AssemblageObjects)
target_type = Panel("0")
equals_2 = Equality(FirstNumber=aotype_2, SecondNumber=target_type)  # -> graft(Equality), Inequality

# ---- group: geometries
dispatch = Dispatch(List=xddecon.Data, DispatchPattern=equals_2.Equality)  # -> ListA, ListB

# ---- group: reference planes
dispatch_2 = Dispatch(List=xddecon.ReferencePlane, DispatchPattern=equals_2.Equality)  # -> ListA, ListB

# ----
# display shortlisted objects
# These materials are referenced from Rhino.
# 
# Right-click on the M input > Set one material
# 
# To see the Rhino material palette (or define a new material) use the Materials command in Rhino
aocmesh = ExtractCollisionMesh(AssemblyObject=dam)
unweld = UnweldMesh(Mesh=aocmesh, Angle="0")

# ---- group: Objects in a closed geometry
mesh_8 = Mesh(geo)

# ----
# filtering
aoplane = ExtractReferencePlane(AssemblyObject=dam)
# selective geometry operations
f_ifroml = IndexesFromList(Data=aoplane)

# ---- group: Objects in a closed geometry (continued)
minc = MeshInclusion(Mesh=mesh_8, Point=aoplane, Strict=False)

# ---- group: combined filter
and = GateAnd(A=minc, B=equals.Equality)

# ----
cull_2 = CullPattern(List=f_ifroml, CullPattern=and)

# ---- group: shortlisted indexes
int = Integer(cull_2)

# ----
# selective geometry integration
# Facing up means a normal pointing in the direction of the absolute Z coordinate, so if a plane faces up, the Z coordinate of its Z vector should be > 0
# 
# To prevent precision problems, use a number that is slightly > 0, like 0.0001
item = ListItem(List=dam, Index=int, Wrap=True)
aoxd_2 = AssociateXData(AssemblyObjects=item, XData=data_4)
xddecon_2 = DeconstructXData(XData=aoxd_2)  # -> Label, Data, ReferencePlane, AssemblyObjectNameReference
# index of plane in the XData list
panel_2 = Panel("1")
item_2 = ListItem(List=xddecon_2.Data, Index=panel_2, Wrap="false")

# ---- group: shortlisted objects
item_3 = ListItem(List=unweld, Index=int, Wrap=True)

# ---- group: all other objects
cull_i = CullIndex(List=unweld, Indices=int, Wrap=True)

# ----
panel_3 = Panel(xddecon_2.Data)

preview_2 = CustomPreview(
    Geometry=item_3,
    Material={diffuse=RGB(255, 255, 255), emission=RGB(0, 0, 0), shine=0.8, specular=RGB(255, 255, 255), transparency=0})  # disabled
preview_3 = CustomPreview(
    Geometry=cull_i,
    Material={diffuse=RGB(77, 77, 158), emission=RGB(0, 0, 0), shine=0, specular=RGB(255, 255, 255), transparency=0.8480002284})  # disabled

# ---- group: filter planes facing up - the easy way
deplane = DeconstructPlane(Plane=item_2)  # -> Origin, XAxis, YAxis, ZAxis
devec = DeconstructVector(Vector=deplane.ZAxis)  # -> XComponent, YComponent, ZComponent
larger = LargerThan(FirstNumber=devec.ZComponent, SecondNumber="0.0001")  # -> LargerThan, OrEqualTo

# ----
panel_4 = Panel(devec.ZComponent)
panel_5 = Panel(larger.LargerThan)
cull_3 = CullPattern(List=item_2, CullPattern=larger.LargerThan)

# ---- group: filter horizontal/vertical
deplane_2 = DeconstructPlane(Plane=dispatch_2.ListA)  # -> Origin, XAxis, YAxis, ZAxis
Z = UnitZ(Factor=1)
dprod = DotProduct(VectorA=deplane_2.XAxis, VectorB=Z, Unitize=False)
abs = Absolute(Value=dprod)

# ----
# insert objects as Blocks in the Rhino file
# index of block name in the XData list
aoxd_3 = AssociateXData(AssemblyObjects=dam, XData=data_5)
xddecon_3 = DeconstructXData(XData=aoxd_3)  # -> Label, Data, ReferencePlane, AssemblyObjectNameReference
bake_2 = BooleanToggle(False)

panel_6 = Panel(xddecon_3.Data)

# ---- group: retrieve block names from XData
item_4 = ListItem(List=xddecon_3.Data, Index="0", Wrap="false")  # -> flatten(Item)

# ----
inblock = InsertBlock(BlockName=item_4, SourcePlane=aoplane)
bake_3 = BakeObjects(Geometry=inblock, Bake=bake_2)

# ----
# display intermediate geometries (filtering horizontal/vertical)
# 0 - associate XData
# 1 - generate boolean pattern
# (mask)
# 2 - filter by type
# 3 - filter horizontal and vertical
# 4 - merge types together
# merge branches: Merging branches rebuilds the data tree thanks to the individual branch indices
# process: Only the AssemblyObject of type 0 has different geometries for horizontal and vertical orientation, so the sequence of operations is:
# 
# . filter by type
# . only for type 0: separate horizontal and vertical, associate relative geometry
# . merge type 1 horizontal and vertical together
# . merge all types back together
# boolean pattern (mask): generate a true/false pattern (or mask) to filter data belonging to a target type
# filter by type: filters with a boolean pattern. If type=0 data is passed to output A, else to output B
# filter horizontal/vertical: See explanation in the panel below.
# 
# We use those 0 and 1 as filtering indices in a List item, since we previously added the intermediate geometries in the XData in the corresponding order (0 horizontal, 1 vertical).
int_2 = Integer(abs)

# ---- group: filter horizontal/vertical (continued)
item_5 = ListItem(List=dispatch.ListA, Index=int_2, Wrap=True)

# ----
merge_14 = Merge(Data1=dispatch.ListB, Data2=item_5)
preview_4 = CustomPreview(Geometry=flatten(merge_14), Material=aoadisp.Colors)  # disabled

mesh_9 = Mesh(merge_14)

# ---- group: clash check
mjoin_2 = MeshJoin(Meshes=flatten(mesh_9))
orient = Orient(Geometry=crv_13, Source=xy_6, Target=cull_3)  # -> Geometry, Transform
mcx = MeshCurve(Mesh=mjoin_2, Curve=orient.Geometry)  # -> Points, Faces
pshift = ShiftPaths(Data=mcx.Points, Offset=panel)
lng_10 = ListLength(List=pshift)
equals_3 = Equality(FirstNumber=lng_10, SecondNumber="0")  # -> Equality, Inequality

# ----
dispatch_3 = Dispatch(List=cull_3, DispatchPattern=equals_3.Equality)  # -> ListA, ListB
inblock_2 = InsertBlock(BlockName=selective_geometry_block_name_2, SourcePlane=flatten(dispatch_3.ListA))
inblock_3 = InsertBlock(BlockName=selective_geometry_block_name_2, SourcePlane=flatten(dispatch_3.ListB))

# ---- group: preview selective geometry blocks
preview_5 = CustomPreview(Geometry=inblock_2, Material=ColourSwatch(SwatchColor=RGB(8, 177, 199)))

# ---- group: preview problematic geometry
preview_6 = CustomPreview(Geometry=inblock_3, Material=ColourSwatch(SwatchColor=RGB(199, 8, 8)))

# ----
bake_4 = BakeObjects(Geometry=inblock_2, Bake=bake)
