# Grasshopper definition 01-08_base 4 objects_Assemblage random - handle compatibility.gh (Grasshopper 1.0.7)
# Copyright: Co-de-iT
# plug-ins: Assembler, froGH, Human

# ---- group: type 2
crv = Curve([<curve referenced from the Rhino model> x4])

# ---- group: type 6
crv_2 = Curve(<curve referenced from the Rhino model>)

# ---- group: type 1
# type A
crv_3 = Curve([<curve referenced from the Rhino model> x4])

# ---- group: type 5
crv_4 = Curve(<curve referenced from the Rhino model>)

# ---- group: type 4
crv_5 = Curve(<curve referenced from the Rhino model>)

# ---- group: type 2
crv_6 = Curve([<curve referenced from the Rhino model> x4])

# ---- group: type 3
# core
crv_7 = Curve([<curve referenced from the Rhino model> x5])

# ---- group: type 2
crv_8 = Curve([<curve referenced from the Rhino model> x4])

# ---- group: type 6
crv_9 = Curve([<curve referenced from the Rhino model> x2])

# ---- group: type 1
# 0 - construct
# box
crv_10 = Curve([<curve referenced from the Rhino model> x2])

# type B
crv_11 = Curve([<curve referenced from the Rhino model> x6])

# ----
merge = Merge(Data1=flatten(crv_7), Data2=flatten(crv_5), Data3=flatten(crv_4))

rotations_type_2 = Panel("0")
lng = ListLength(List=crv)
lng_2 = ListLength(List=crv)
repeat = RepeatData(Data=graft(rotations_type_2), Length=lng)
repeat_2 = RepeatData(Data="2", Length=lng_2)
flip = FlipMatrix(Data=repeat)  # -> simplify(Data)

rotations_type_6 = Panel("""0
180""")
lng_3 = ListLength(List=crv_2)
lng_4 = ListLength(List=crv_2)
repeat_3 = RepeatData(Data=graft(rotations_type_6), Length=lng_3)
repeat_4 = RepeatData(Data="6", Length=lng_4)
flip_2 = FlipMatrix(Data=repeat_3)  # -> simplify(Data)

rotations_type_1 = Panel("""0
90
180""")
lng_5 = ListLength(List=crv_3)
lng_6 = ListLength(List=crv_3)
repeat_5 = RepeatData(Data=graft(rotations_type_1), Length=lng_5)
repeat_6 = RepeatData(Data="1", Length=lng_6)
flip_3 = FlipMatrix(Data=repeat_5)  # -> simplify(Data)

rotations_type_2_2 = Panel("0")
lng_7 = ListLength(List=crv_6)
lng_8 = ListLength(List=crv_6)
repeat_7 = RepeatData(Data=graft(rotations_type_2_2), Length=lng_7)
repeat_8 = RepeatData(Data="2", Length=lng_8)
flip_4 = FlipMatrix(Data=repeat_7)  # -> simplify(Data)

rotations_type_2_3 = Panel("0")
lng_9 = ListLength(List=crv_8)
lng_10 = ListLength(List=crv_8)
repeat_9 = RepeatData(Data=graft(rotations_type_2_3), Length=lng_9)
repeat_10 = RepeatData(Data="2", Length=lng_10)
flip_5 = FlipMatrix(Data=repeat_9)  # -> simplify(Data)

# ----
# Assembler
# 
# Framework for Iterative Assemblages workflow
# 
# code by Alessio Erioli
# 
# v 1.0
# © Co-de-iT 2021 / Creative Commons Attribution-Non Commercial-ShareAlike 4.0 International License
rotations_type_1_2 = Panel("""0
90
180""")
lng_11 = ListLength(List=crv_10)
lng_12 = ListLength(List=crv_10)
repeat_11 = RepeatData(Data=graft(rotations_type_1_2), Length=lng_11)
repeat_12 = RepeatData(Data="1", Length=lng_12)
flip_6 = FlipMatrix(Data=repeat_11)  # -> simplify(Data)

rotations_type_6_2 = Panel("""0
180""")
lng_13 = ListLength(List=crv_9)
lng_14 = ListLength(List=crv_9)
repeat_13 = RepeatData(Data=graft(rotations_type_6_2), Length=lng_13)
repeat_14 = RepeatData(Data="6", Length=lng_14)
flip_7 = FlipMatrix(Data=repeat_13)  # -> simplify(Data)

rotations_type_1_3 = Panel("""0
90
180""")
lng_15 = ListLength(List=crv_11)
lng_16 = ListLength(List=crv_11)
repeat_15 = RepeatData(Data=graft(rotations_type_1_3), Length=lng_15)
repeat_16 = RepeatData(Data="1", Length=lng_16)
flip_8 = FlipMatrix(Data=repeat_15)  # -> simplify(Data)

lng_17 = ListLength(List=crv_4)
lng_18 = ListLength(List=crv_5)
rotations_for_all_types = Panel("0")
lng_19 = ListLength(List=crv_7)
type = Panel("5")
lng_20 = ListLength(List=merge)
type_2 = Panel("4")
type_3 = Panel("3")
repeat_17 = RepeatData(Data=graft(rotations_for_all_types), Length=lng_20)
repeat_18 = RepeatData(Data=graft(type), Length=lng_17)
repeat_19 = RepeatData(Data=graft(type_2), Length=lng_18)
repeat_20 = RepeatData(Data=graft(type_3), Length=lng_19)
flip_9 = FlipMatrix(Data=repeat_17)  # -> simplify(Data)
merge_2 = Merge(Data1=repeat_20, Data2=repeat_19, Data3=repeat_18)

# ---- group: Create Handles
handles = ConstructHandles(Polyline=crv, RotationAngles=flip, Type=repeat_2)

handles_2 = ConstructHandles(Polyline=crv_2, RotationAngles=flip_2, Type=repeat_4)

handles_3 = ConstructHandles(Polyline=crv_3, RotationAngles=flip_3, Type=repeat_6)

handles_4 = ConstructHandles(Polyline=crv_6, RotationAngles=flip_4, Type=repeat_8)

handles_5 = ConstructHandles(Polyline=crv_8, RotationAngles=flip_5, Type=repeat_10)

handles_6 = ConstructHandles(Polyline=crv_10, RotationAngles=flip_6, Type=repeat_12)

handles_7 = ConstructHandles(Polyline=crv_9, RotationAngles=flip_7, Type=repeat_14)

handles_8 = ConstructHandles(Polyline=crv_11, RotationAngles=flip_8, Type=repeat_16)

handles_9 = ConstructHandles(Polyline=merge, RotationAngles=flip_9, Type=merge_2)

# ----
merge_3 = Merge(Data1=handles_3, Data2=handles, Data3=handles_2)
merge_4 = Merge(Data1=handles_6, Data2=handles_4)
merge_5 = Merge(Data1=handles_8, Data2=handles_5, Data3=handles_7)

mesh = Mesh(<mesh referenced from the Rhino model>)
volume = Volume(Geometry=mesh)  # -> Volume, Centroid
name = Panel("core")
xy = XYPlane(Origin=volume.Centroid)
X = UnitX(Factor=1)

mesh_2 = Mesh(<mesh referenced from the Rhino model>)
volume_2 = Volume(Geometry=mesh_2)  # -> Volume, Centroid
name_2 = Panel("type A")
xy_2 = XYPlane(Origin=volume_2.Centroid)
X_2 = UnitX(Factor=1)

mesh_3 = Mesh(<mesh referenced from the Rhino model>)
volume_3 = Volume(Geometry=mesh_3)  # -> Volume, Centroid
name_3 = Panel("type B")
xy_3 = XYPlane(Origin=volume_3.Centroid)
X_3 = UnitX(Factor=1)

mesh_4 = Mesh(<mesh referenced from the Rhino model>)
volume_4 = Volume(Geometry=mesh_4)  # -> Volume, Centroid
name_4 = Panel("type B")
xy_4 = XYPlane(Origin=volume_4.Centroid)
X_4 = UnitX(Factor=1)

# ---- group: Display Handles
handdisp = DisplayHandle(Handles=handles_9, DisplaySize=Slider(0.1, range=0..0.5), absHTextSize=False)

# ----
mesh_5 = Mesh(<mesh referenced from the Rhino model>)
xdcon = ConstructXData(Label="type A geometry", Data=mesh_5, ReferencePlane=xy_2, AssemblyObjectNameReference=name_2)

mesh_6 = Mesh(<mesh referenced from the Rhino model>)
xdcon_2 = ConstructXData(Label="type A geometry", Data=mesh_6, ReferencePlane=xy_3, AssemblyObjectNameReference=name_3)

mesh_7 = Mesh(<mesh referenced from the Rhino model>)
xdcon_3 = ConstructXData(Label="type A geometry", Data=mesh_7, ReferencePlane=xy_4, AssemblyObjectNameReference=name_4)

mesh_8 = Mesh(<mesh referenced from the Rhino model>)
xdcon_4 = ConstructXData(Label="core geometry", Data=mesh_8, ReferencePlane=xy, AssemblyObjectNameReference=name)

# ---- group: Display Handles
handdisp_2 = DisplayHandle(Handles=merge_3, DisplaySize=Slider(0.1, range=0..0.5), absHTextSize=False)

handdisp_3 = DisplayHandle(Handles=merge_4, DisplaySize=Slider(0.1, range=0..0.5), absHTextSize=False)

handdisp_4 = DisplayHandle(Handles=merge_5, DisplaySize=Slider(0.1, range=0..0.5), absHTextSize=False)

# ---- group: Create AssemblyObject
aocon = ConstructAssemblyObject(Name=name, CollisionMesh=mesh, ReferencePlane=xy, Direction=X, Weight="1.0", Handles=handles_9, ZLockAO=False)

aocon_2 = ConstructAssemblyObject(Name=name_2, CollisionMesh=mesh_2, ReferencePlane=xy_2, Direction=X_2, Weight="1.0", Handles=merge_3, ZLockAO=False)

aocon_3 = ConstructAssemblyObject(Name=name_3, CollisionMesh=mesh_3, ReferencePlane=xy_3, Direction=X_3, Weight="1.0", Handles=merge_4, ZLockAO=False)

aocon_4 = ConstructAssemblyObject(Name=name_4, CollisionMesh=mesh_4, ReferencePlane=xy_4, Direction=X_4, Weight="1.0", Handles=merge_5, ZLockAO=False)

# ---- group: XData for actual geometry
merge_6 = Merge(Data1=flatten(xdcon_2), Data2=flatten(xdcon_4))
data = Data(merge_6)

# ---- group: AssemblyObjects
# set 1 - box + core
merge_7 = Merge(Data1=flatten(aocon_3), Data2=flatten(aocon))
data_2 = Data(merge_7)

# ---- group: XData for actual geometry
merge_8 = Merge(Data1=flatten(xdcon), Data2=flatten(xdcon_3), Data3=flatten(xdcon_4))
data_3 = Data(merge_8)

# ---- group: AssemblyObjects
# set 2 type A + type B + core
merge_9 = Merge(Data1=flatten(aocon_2), Data2=flatten(aocon_4), Data3=flatten(aocon))
data_4 = Data(merge_9)

# ----
list = ValueList({"set 1": 0, "set 2": 1}, selected="set 2")

# ---- group: "Zero" vector
pt = Point(Point(0, 0, 0))
vec2pt = Vector2Pt(PointA=volume.Centroid, PointB=pt, Unitize=False)  # -> Vector, Length

# ----
# Handle compatibility syntax: 1<2
# 
# Means Handles of type 1 can receive Handles of type 2.
# 
# If used in the Hc input, these rules take precedence, overriding also the default same type compatibility;  self-Handle and cross-type options are also ignored.
# 
# For bilateral compatibility between types, the reverse relations should also be explicited:
# 
# 1<2
# 2<1
panel = Panel("""2<2
3<2
6<6
4<5
5<4""")
panel_2 = Panel("""4<5
5<4
2<2
3<2""")

filter = StreamFilter(Gate=list, Stream0=data_2, Stream1=data_4)
filter_2 = StreamFilter(Gate=list, Stream0=data, Stream1=data_3)
filter_3 = StreamFilter(Gate=list, Stream0=panel_2, Stream1=panel)
pt_2 = Point(Point(-72, -44, 4))
pt_3 = Point(Point(-40, 0, 0))
pt_4 = Point(Point(-80, 40, -4))
addition = Addition(A=vec2pt.Vector, B=pt_4)
addition_2 = Addition(A=vec2pt.Vector, B=pt_2)
addition_3 = Addition(A=vec2pt.Vector, B=pt_3)
heuw = HeuristicsWriter(AssemblyObjectsSet=filter, HandleCompatibility=filter_3, noSH=False, noSO=False, xHT=False)
merge_10 = Merge(Data1=addition, Data2=addition_3, Data3=addition_2)
move = Move(Geometry=aocon, Motion=merge_10)  # -> Geometry, Transform
go = BooleanToggle(False)
step = Button()
max_objects = Panel("1000")
reset = Button()
cell_size = Slider(1.2, range=1..2)

# ---- group: base point
pt_5 = Point(Point(0, 15, 0))

# ----
pt_6 = Point(Point(-40, 0, 0))

# ---- group: filter invalid heuristics
heudex = HeuristicsDisplayEx(OriginPoint=pt_5, AssemblyObjectsSet=filter, HeuristicsString=heuw, XSize=1, YSize=1, NRows=10)  # -> AssemblyObjectPairs, CoherencePattern, HeuristicsStringTree, TextBasePoints, XData
cull = CullPattern(List=flatten(heudex.HeuristicsStringTree), CullPattern=flatten(heudex.CoherencePattern))

# ----
# 1 - simulate
xy_5 = XYPlane(Origin=pt_6)

# ---- group: Assemblage Engine Random
aoeng = AssemblerEngineSimple(
    AssemblyObjectsSet=filter,
    PreviousAssemblage=move.Geometry,
    StartingPlane=xy_5,
    StartingObjectType="2",
    HeuristicsString=cull,
    Go=go,
    Step=step,
    NIterations=Slider(100, range=1..100),
    MaxNObjects=max_objects,
    Reset=reset)  # -> Assemblage, AssemblageCount

# ----
larger = LargerThan(FirstNumber=aoeng.AssemblageCount, SecondNumber=max_objects)  # -> LargerThan, OrEqualTo
n_of_objects = Panel(aoeng.AssemblageCount)
or = GateOr(A=go, B=step)
f_tas = ToggleAutostop(Toggle=go, Condition=larger.OrEqualTo)

# ---- group: Heuristics Display
heud = HeuristicDisplay(
    OriginPoint=pt_5,
    AssemblyObjectsSet=filter,
    XData=filter_2,
    HeuristicsString=cull,
    XSize=cell_size,
    YSize=cell_size,
    NRows=Slider(15, range=10..50),
    DisplayType="AO Types",
    ZLockFilter=False,
    OutputType="AO Types")

# ----
# 2 - analyze/post-process
aoadisp = DisplayAssemblage(Assemblage=aoeng.Assemblage, Bypass=False, OutputType="AO Types")  # -> ColoredCollisionMeshes, Edges, Colors

# ---- group: display components / display edges
previewlw = CustomPreviewLineweights(
    Geometry=aoadisp.Edges,
    Shader=ColourSwatch(SwatchColor=RGB(145, 145, 145)),
    Thickness=Slider(1, range=1..3),
    Absolute=False)

# ---- group: display components
mjoin = MeshJoin(Meshes=aoadisp.ColoredCollisionMeshes)
preview = CustomPreview(Geometry=mjoin, Material=ColourSwatch(SwatchColor=RGB(255, 255, 255)))  # disabled

# ---- group: display "intermediate" geometries
aoadecon = DeconstructAssemblage(Assemblage=aoeng.Assemblage)  # -> AssemblageObjects, AssemblageRules, ReceiverObjectsIndexes, AvailableObjectIndexes, UnreachableObjectIndexes
aoxd = AssociateXData(AssemblyObjects=aoadecon.AssemblageObjects, XData=filter_2)
xddecon = DeconstructXData(XData=aoxd)  # -> Label, Data, ReferencePlane, AssemblyObjectNameReference
preview_2 = CustomPreview(Geometry=xddecon.Data, Material=graft(aoadisp.Colors))

# ---- group: display edges
f_mmeea = MeshesExtractEdgesWithToleranceAngle(Mesh=xddecon.Data, Angle=45)  # -> InternalEdges, NakedEdges
previewlw_2 = CustomPreviewLineweights(
    Geometry=f_mmeea.InternalEdges,
    Shader=ColourSwatch(SwatchColor=RGB(0, 0, 0)),
    Thickness=Slider(1, range=1..3),
    Absolute=False)
