# Grasshopper definition 02-00_Exogenous+Heuristics Settings.gh (Grasshopper 1.0.7)
# Copyright: Co-de-iT
# plug-ins: Assembler, Human, MeshEdit Components, froGH

# environment mesh geometries
number_slider = Slider(96, range=1..2000)
list = ValueList({"polyine": 0, "curve": 1, "multiple curves": 2}, selected="multiple curves")

# ---- group: obstacle
pt = Point(Point(23.71025684, 107.0894528, 2.111111111))
box = CenterBox(Base=pt, X=Slider(53.959, range=10..100), Y=Slider(13.869, range=10..100), Z=Slider(38.768, range=10..100))
weldvertices = MeshWeldVertices(Mesh=box, Tolerance=0.01)  # -> RuntimeMessage, Mesh
mbox = MeshBox(Base=weldvertices.Mesh, XCount="1", YCount="1", ZCount="1")

# field from curves
number_slider_2 = Slider(38.768, range=10..100)
pt_2 = Point(Point(0, -93.75868973, 27.91609819))
box_2 = CenterBox(Base=pt_2, X=Slider(13.869, range=10..100), Y=Slider(53.959, range=10..100), Z=number_slider_2)
weldvertices_2 = MeshWeldVertices(Mesh=box_2, Tolerance=0.01)  # -> RuntimeMessage, Mesh
mbox_2 = MeshBox(Base=weldvertices_2.Mesh, XCount="1", YCount="1", ZCount="1")

# ---- group: polyline
crv = Curve(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)

# ---- group: smooth curve
crv_2 = Curve(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)

# ---- group: multiple curves
crv_3 = Curve([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])

# ----
# Assembler
# 
# Framework for Iterative Assemblages workflow
# 
# code by Alessio Erioli
# 
# v 1.0
# © Co-de-iT 2021 / Creative Commons Attribution-Non Commercial-ShareAlike 4.0 International License
box_3 = CenterBox(Base="0,0,0", X=Slider(150, range=1..1000), Y=Slider(189, range=1..2000), Z=number_slider)

# ---- group: container
mbox_3 = MeshBox(Base=box_3, XCount="1", YCount="1", ZCount="1")
weldvertices_3 = MeshWeldVertices(Mesh=mbox_3, Tolerance=0.01)  # -> RuntimeMessage, Mesh

# flip normals: A container must have normals pointing inward
flip = MeshFlip(Mesh=weldvertices_3.Mesh)

# ----
# IMPORTANT NOTE: The Container MUST be a single, joined mesh.
# 
# It isn't possible to use more than one container during the simulation.
# 
# Containers can have any shape, as long as they are single, joined meshes.
merge = Merge(Data1=flip, Data2=mbox, Data3=mbox_2)  # -> flatten(Result)

# ---- group: Heuristics String
txt = Text(["blockA|0=0<blockA|0%0", "blockA|0=180<blockA|0%0", "blockA|0=0<blockA|1%0", "blockA|0=180<blockA|1%0", "blockA|0=0<blockA|2%0", "blockA|0=180<blockA|2%0", "blockA|0=0<blockB|0%0", "blockA|0=180<blockB|0%0", "blockA|0=0<blockB|1%0", "blockA|0=180<blockB|1%0"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])

# ----
panel = Panel(txt)

selrec = ValueList({"random": 0, "scalar field": 1, "scalar field acc": 2, "dense packing (SLOW)": 3}, selected="scalar field acc")
heuristics_mode = ValueList({"manual": 0, "field driven": 1}, selected="manual")
selrule = ValueList({"random": 0, "scalar field": 1, "scalar field acc": 2, "vector field": 3, "vector field acc": 4, "min locl bb vol": 5, "min loc bb diag": 6}, selected="vector field acc")
heuset = HeuristicsSettings(
    HeuristicsString=txt,
    CurrentHeuristics=Slider(0, range=0..3),
    HeuristicsMode=heuristics_mode,
    ReceiverSelectionMode=selrec,
    RuleSelectionMode=selrule)

# ---- group: to Assembler Engine Ex
data = Data(heuset)

# ----
filter = StreamFilter(Gate=list, Stream0=crv, Stream1=crv_2, Stream2=crv_3)
gate = StreamGate(Stream=filter, Gate=list)  # -> Target0, Target1, Target2

# ---- group: attractor curve
previewlw = CustomPreviewLineweights(Geometry=filter, Shader=ColourSwatch(SwatchColor=RGB(255, 0, 0)), Thickness="5", Absolute=False)

# ---- group: Construct Field
afieldn = ConstructFieldN(Geometry=box_3, Plane=PlaneXY(0, 0, 0), NCells=Slider(15, range=10..30))  # -> Field, FieldPoints

# ---- group: single curve
crv_4 = Curve(reparameterize([gate.Target0, gate.Target1]))

# ---- group: multiple curves
crv_5 = Curve(reparameterize(gate.Target2))

# ---- group: calculate scalar
crv_cp = CurveClosestPoint(Point=afieldn.FieldPoints, Curve=crv_4)  # -> Point, Parameter, Distance

crv_cp_2 = CurveClosestPoint(Point=graft(afieldn.FieldPoints), Curve=crv_5)  # -> Point, Parameter, Distance

# ---- group: calculate vector from tangent
eval = EvaluateCurve(Curve=crv_4, Parameter=crv_cp.Parameter)  # -> Point, Tangent, Angle

# ----
f_ifroml = IndexesFromList(Data=crv_5)
sort = SortList(Keys=crv_cp_2.Distance, ValuesA=f_ifroml, ValuesB=crv_cp_2.Parameter)  # -> Keys, ValuesA, ValuesB
item = ListItem(List=sort.ValuesA, Index=0, Wrap=True)
item_2 = ListItem(List=sort.ValuesB, Index=0, Wrap=True)
item_3 = ListItem(List=crv_5, Index=item, Wrap=True)

# ---- group: scalar values
item_4 = ListItem(List=sort.Keys, Index=0, Wrap=True)  # -> flatten(Item)

# ---- group: calculate vector from tangent
eval_2 = EvaluateCurve(Curve=item_3, Parameter=item_2)  # -> Point, flatten(Tangent), Angle

# ---- group: scalar values
filter_2 = StreamFilter(Gate=list, Stream0=crv_cp.Distance, Stream1=crv_cp.Distance, Stream2=item_4)

# ---- group: vector values
filter_3 = StreamFilter(Gate=list, Stream0=eval.Tangent, Stream1=eval.Tangent, Stream2=eval_2.Tangent)

# ----
afpop = PopulateField(Field=afieldn.Field, ScalarValues=filter_2, VectorValues=filter_3)

# ---- group: display Field
merge_2 = Merge(Data1=ColourSwatch(SwatchColor=RGB(255, 0, 0)), Data2=ColourSwatch(SwatchColor=RGB(99, 99, 99)))
multiplication = Multiplication(A=filter_3, B=Slider(3.003, range=1..10))
afcol = ColorField(Field=afpop, Colors=merge_2, Index=0, Threshold=Slider(0.219, range=0..1), FieldValueBlend=False)  # -> Field, Colors
unit = UnitVector(Vector=multiplication)
vdisex = VectorDisplayEx(Point=afieldn.FieldPoints, Vector=multiplication, Colour=unit, Width=2)

# ---- group: Field for Assemblage
data_2 = Data(afcol.Field)

# ----
environment_mode = ValueList({"none": 0, "collision": 1, "centroid": 2}, selected="collision")
# this component also displays the environment Meshes
exoset = ExogeousSettings(
    EnvironmentMeshes=merge,
    EnvironmentMode=environment_mode,
    Field=data_2,
    FieldScalarThreshold=Slider(0.1, range=0..1),
    Sandbox={Plane=PlaneXY(0, 0, 0), X=Domain(-1, 1), Y=Domain(0, 0), Z=Domain(0, 0)})

# ---- group: to Assembler Engine Ex
data_3 = Data(exoset)

# ----
aoengx = AssemblerEngineX(
    StartingPlane=PlaneXY(0, 0, 0),
    StartingObjectType=0,
    HeuristicsSettings=data,
    ExogenousSettings=data_3,
    Go=False,
    Step=False,
    NIterations=10,
    MaxNObjects=1000,
    ResetExogenous=False,
    Reset=False,
    UseSupports=False,
    ZLockCheck=False)  # -> Assemblage, AssemblageCount
