# Grasshopper definition 02-02_base 2 Objects_Assemblage - Environment.gh (Grasshopper 1.0.7)
# Copyright: Co-de-iT
# plug-ins: Assembler, MeshEdit Components, froGH, Human

# ---- group: obstacle
pt = Point(Point(-153.8902437, 117.5771051, 21.66773957))
box = CenterBox(Base=pt, X=Slider(11, range=10..200), Y=Slider(22, range=10..200), Z=Slider(26, range=1..200))
weldvertices = MeshWeldVertices(Mesh=box, Tolerance=0.01)  # -> RuntimeMessage, Mesh
mbox = MeshBox(Base=weldvertices.Mesh, XCount="1", YCount="1", ZCount="1")

pt_2 = Point(Point(-122.3339923, 157.3850123, -20.10324875))
box_2 = CenterBox(Base=pt_2, X=Slider(30, range=10..200), Y=Slider(75, range=10..200), Z=Slider(8, range=1..200))
weldvertices_2 = MeshWeldVertices(Mesh=box_2, Tolerance=0.01)  # -> RuntimeMessage, Mesh
mbox_2 = MeshBox(Base=weldvertices_2.Mesh, XCount="1", YCount="1", ZCount="1")

# ---- group: container
# Containers can have any shape, but there can only be one during a simulation.
# 
# Obstacles can be as many as you want.
pt_3 = Point(Point(-138.3028437, 194.8813592, -3.9998166))
box_3 = CenterBox(Base=pt_3, X=Slider(60, range=10..200), Y=Slider(150, range=10..200), Z=Slider(6, range=1..200))
mbox_3 = MeshBox(Base=box_3, XCount="1", YCount="1", ZCount="1")
weldvertices_3 = MeshWeldVertices(Mesh=mbox_3, Tolerance=0.01)  # -> RuntimeMessage, Mesh

# ---- group: obstacle
pt_4 = Point(Point(-158.4726811, 181.8390975, 0))
box_4 = CenterBox(Base=pt_4, X=Slider(11, range=10..200), Y=Slider(22, range=10..200), Z=Slider(26, range=1..200))
weldvertices_4 = MeshWeldVertices(Mesh=box_4, Tolerance=0.01)  # -> RuntimeMessage, Mesh
mbox_4 = MeshBox(Base=weldvertices_4.Mesh, XCount="1", YCount="1", ZCount="1")

pt_5 = Point(Point(-122.3339923, 282.1586602, 0))
box_5 = CenterBox(Base=pt_5, X=Slider(24, range=10..200), Y=Slider(10, range=10..200), Z=Slider(26, range=1..200))
weldvertices_5 = MeshWeldVertices(Mesh=box_5, Tolerance=0.01)  # -> RuntimeMessage, Mesh
mbox_5 = MeshBox(Base=weldvertices_5.Mesh, XCount="1", YCount="1", ZCount="1")

# ---- group: type 1
crv = Curve([<curve referenced from the Rhino model> x4])

# ASSEMBLAGES IN BRIEF: GENERAL STEPS
# 
# a. select a RECEIVER (WHERE to add next piece)
# 
# b. select a SENDER (WHAT kind of piece to add and HOW)
# 
# 
# /////
# 
# 
# PROCESS STEPS
# (how the algorithm works)
# 
# 
# . select receiver object in the assemblage according to available criteria
# 
# . choose a winning candidate among all possible combinations compatible with the constraints in place (the "candidates"), according to given criteria
# DEFINITION ANATOMY: 0 - construct
# 
# Construct your assets (AssemblyObjects and Heuristics): these define the objects and relationships necessary for the Assemblage.
# 
# 
# 1 - simulate
# 
# Simulate the Assemblage growth
# 
# 
# 
# 2 - analyze/post-process
# 
# Analyze results and post-process the obtained assemblage
crv_2 = Curve([<curve referenced from the Rhino model> x3])

# ---- group: type 2
# AssemblyObjects use Handles to connect to others: when an AssenblyObject is added, it is called a SENDER, and the object it connects to RECEIVER. All Handles have specifics about their connection possibility, which in turn determine the Heuristics of the system.
crv_3 = Curve([<curve referenced from the Rhino model> x2])

crv_4 = Curve([<curve referenced from the Rhino model> x2])

# ----
merge = Merge(Data1=crv_2, Data2=crv_3)
merge_2 = Merge(Data1=crv, Data2=crv_4)

lng = ListLength(List=crv)
lng_2 = ListLength(List=crv_4)
rotations = Panel("""0
180""")
lng_3 = ListLength(List=merge_2)
repeat = RepeatData(Data="1", Length=lng)
repeat_2 = RepeatData(Data="2", Length=lng_2)
repeat_3 = RepeatData(Data=graft(rotations), Length=lng_3)
merge_3 = Merge(Data1=repeat, Data2=repeat_2)
flip = FlipMatrix(Data=repeat_3)  # -> simplify(Data)

crv_5 = Curve(merge)

# ----
# Assembler
# 
# Framework for Iterative Assemblages workflow
# 
# code by Alessio Erioli
# 
# v 1.0
# © Co-de-iT 2021 / Creative Commons Attribution-Non Commercial-ShareAlike 4.0 International License
# 0 - construct
rotations_2 = Panel("""0
180""")
lng_4 = ListLength(List=crv_5)
lng_5 = ListLength(List=crv_2)
lng_6 = ListLength(List=crv_3)
repeat_4 = RepeatData(Data=graft(rotations_2), Length=lng_4)
repeat_5 = RepeatData(Data="1", Length=lng_5)
repeat_6 = RepeatData(Data="2", Length=lng_6)
flip_2 = FlipMatrix(Data=repeat_4)  # -> simplify(Data)
merge_4 = Merge(Data1=repeat_5, Data2=repeat_6)

# ---- group: single container
mesh = Mesh(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)

# flip normals: A container must have normals pointing inward
flip_3 = MeshFlip(Mesh=mesh)

# ---- group: Create Handles
handles = ConstructHandles(Polyline=merge_2, RotationAngles=flip, Type=merge_3)

handles_2 = ConstructHandles(Polyline=crv_5, RotationAngles=flip_2, Type=merge_4)

# ---- group: container
# flip normals: A container must have normals pointing inward
flip_4 = MeshFlip(Mesh=weldvertices_3.Mesh)

# ----
merge_5 = Merge(Data1=mbox, Data2=mbox_2)  # -> flatten(Result)
merge_6 = Merge(Data1=flip_4, Data2=mbox_4, Data3=mbox_5)  # -> flatten(Result)

merge_7 = Merge(Data1=flip_4, Data2=mbox_4, Data3=mbox_5)  # -> flatten(Result)

# ----
# "Intermediate" geometry: Fast mesh representation of actual geometry - derived from the BRep. Check if Fast Mesh is good enough, otherwise:
# . either play with meshing parameters to get a good quality/speed compromise
# . model a mesh geometry in Rhino to use as representative
mesh_2 = Mesh(<mesh referenced from the Rhino model>)

mesh_3 = Mesh(<mesh referenced from the Rhino model>)

# ---- group: Display Handles
handdisp = DisplayHandle(Handles=handles, DisplaySize=Slider(0.1, range=0..0.5), absHTextSize=False)

handdisp_2 = DisplayHandle(Handles=handles_2, DisplaySize=Slider(0.1, range=0..0.5), absHTextSize=False)

# ----
mesh_4 = Mesh(<mesh referenced from the Rhino model>)
volume = Volume(Geometry=mesh_4)  # -> Volume, Centroid
name = Panel("typeB")
xy = XYPlane(Origin=volume.Centroid)
X = UnitX(Factor=1)

mesh_5 = Mesh(<mesh referenced from the Rhino model>)
volume_2 = Volume(Geometry=mesh_5)  # -> Volume, Centroid
name_2 = Panel("typeA")
xy_2 = XYPlane(Origin=volume_2.Centroid)
X_2 = UnitX(Factor=1)

concat = Concatenate(FragmentA=name_2, FragmentB="_geometry")
xdcon = ConstructXData(Label=concat, Data=mesh_2, ReferencePlane=xy_2, AssemblyObjectNameReference=name_2)

concat_2 = Concatenate(FragmentA=name, FragmentB="_geometry")
xdcon_2 = ConstructXData(Label=concat_2, Data=mesh_3, ReferencePlane=xy, AssemblyObjectNameReference=name)

# ---- group: circulation path
crv_6 = Curve([<curve referenced from the Rhino model> x11])

crv_7 = Curve([<curve referenced from the Rhino model> x11])

# ----
concat_3 = Concatenate(FragmentA=name, FragmentB="_data")
xdcon_3 = ConstructXData(Label=concat_3, Data=crv_7, ReferencePlane=xy, AssemblyObjectNameReference=name)

# ---- group: Create AssemblyObject
aocon = ConstructAssemblyObject(Name=name_2, CollisionMesh=mesh_5, ReferencePlane=xy_2, Direction=X_2, Weight="1.0", Handles=handles_2, ZLockAO=False)

aocon_2 = ConstructAssemblyObject(Name=name, CollisionMesh=mesh_4, ReferencePlane=xy, Direction=X, Weight="1.0", Handles=handles, ZLockAO=False)

# ---- group: XData - geometries
merge_8 = Merge(Data1=flatten(xdcon), Data2=flatten(xdcon_2))
data = Data(merge_8)

# ---- group: AssemblyObjects
# AO set: With more than one AssemblyObject, just build a list with the Merge component
merge_9 = Merge(Data1=flatten(aocon), Data2=flatten(aocon_2))
data_2 = Data(merge_9)

# ---- group: environment control
environment = ValueList({"single mesh container": 0, "container + obstacles": 1, "obstacles only": 2}, selected="single mesh container")
resetex = Button()

# ----
filter = StreamFilter(Gate=environment, Stream0=flip_3, Stream1=merge_6, Stream2=merge_5)
heuw = HeuristicsWriter(AssemblyObjectsSet=data_2, noSH=False, noSO=False, xHT=False)

# ---- group: filter heuristics
heudex = HeuristicsDisplayEx(OriginPoint=Point(0, 0, 0), AssemblyObjectsSet=data_2, HeuristicsString=heuw, XSize=1, YSize=1, NRows=10)  # -> AssemblyObjectPairs, CoherencePattern, HeuristicsStringTree, TextBasePoints, XData
cull = CullPattern(List=flatten(heudex.HeuristicsStringTree), CullPattern=flatten(heudex.CoherencePattern))

# ----
reset = Button()
step = Button()
heuset = HeuristicsSettings(HeuristicsString=cull, CurrentHeuristics=0, ReceiverSelectionMode=0, RuleSelectionMode=0)
exoset = ExogeousSettings(
    EnvironmentMeshes=filter,
    EnvironmentMode=Slider(1, range=1..2),
    FieldScalarThreshold=0.5,
    Sandbox={Plane=PlaneXY(0, 0, 0), X=Domain(-1, 1), Y=Domain(0, 0), Z=Domain(0, 0)})
go = BooleanToggle(False)
max_objects = Panel("1000")
cell_size = Slider(1.2, range=1..2)

# ---- group: base point
pt_6 = Point(Point(0, 20, 0))

# ----
pt_7 = Point(Point(-129.8796384, 113.0177957, 0))

# ---- group: Heuristics Display
heud = HeuristicDisplay(
    OriginPoint=pt_6,
    AssemblyObjectsSet=data_2,
    XData=data,
    HeuristicsString=heuw,
    XSize=cell_size,
    YSize=cell_size,
    NRows=Slider(10, range=10..50),
    DisplayType="AO Types",
    ZLockFilter=False)

# ----
xy_3 = XYPlane(Origin=pt_7)

# ---- group: Assemblage Engine Xtended
# 1 - simulate
aoengx = AssemblerEngineX(
    AssemblyObjectsSet=data_2,
    StartingPlane=xy_3,
    StartingObjectType=0,
    HeuristicsSettings=heuset,
    ExogenousSettings=exoset,
    Go=go,
    Step=step,
    NIterations=Slider(100, range=1..100),
    MaxNObjects=max_objects,
    ResetExogenous=resetex,
    Reset=reset,
    UseSupports=False,
    ZLockCheck=False)  # -> Assemblage, AssemblageCount

# ----
n_of_objects = Panel(aoengx.AssemblageCount)

# ---- group: auto-stop
larger = LargerThan(FirstNumber=aoengx.AssemblageCount, SecondNumber=max_objects)  # -> LargerThan, OrEqualTo
f_tas = ToggleAutostop(Toggle=go, Condition=larger.OrEqualTo)

# ----
or = GateOr(A=go, B=step)
# 2 - analyze/post-process
aoadisp = DisplayAssemblage(Assemblage=aoengx.Assemblage, Bypass=False, OutputType="Objects")  # -> ColoredCollisionMeshes, Edges, Colors

# ---- group: display "intermediate" geometries
aoadecon = DeconstructAssemblage(Assemblage=aoengx.Assemblage)  # -> AssemblageObjects, AssemblageRules, ReceiverObjectsIndexes, AvailableObjectIndexes, UnreachableObjectIndexes
aoxd = AssociateXData(AssemblyObjects=aoadecon.AssemblageObjects, XData=data)
xddecon = DeconstructXData(XData=aoxd)  # -> Label, Data, ReferencePlane, AssemblyObjectNameReference
preview = CustomPreview(Geometry=xddecon.Data, Material=graft(aoadisp.Colors))

# ---- group: display components
mjoin = MeshJoin(Meshes=aoadisp.ColoredCollisionMeshes)
preview_2 = CustomPreview(Geometry=mjoin, Material=ColourSwatch(SwatchColor=RGB(255, 255, 255)))  # disabled

# ---- group: display components / display edges
previewlw = CustomPreviewLineweights(Geometry=aoadisp.Edges, Shader=ColourSwatch(SwatchColor=RGB(0, 0, 0)), Thickness=Slider(1, range=1..3), Absolute=False)

# ----
concat_4 = Concatenate(FragmentA=name_2, FragmentB="_data")

xdcon_4 = ConstructXData(Label=concat_4, Data=crv_6, ReferencePlane=xy_2, AssemblyObjectNameReference=name_2)

# ---- group: XData
# to pass Assembler data around, use the generic Data container
merge_10 = Merge(Data1=flatten(xdcon_4), Data2=flatten(xdcon_3))
data_3 = Data(merge_10)
