# Grasshopper definition 02-03_base 2 Objects_Assemblage - Environment + filter blocks.gh (Grasshopper 1.0.7)
# Copyright: Co-de-iT
# plug-ins: Assembler, froGH, MeshEdit Components, Human, EleFront

# ---- group: obstacle
pt = Point(Point(-153.8902437, 117.5771051, 21.66773957))
box = CenterBox(Base=pt, X=Slider(11, range=10..200), Y=Slider(22, range=10..200), Z=Slider(26, range=1..200))
weldvertices = MeshWeldVertices(Mesh=box, Tolerance=0.01)  # -> RuntimeMessage, Mesh
mbox = MeshBox(Base=weldvertices.Mesh, XCount="1", YCount="1", ZCount="1")

pt_2 = Point(Point(-122.3339923, 157.3850123, -20.10324875))
box_2 = CenterBox(Base=pt_2, X=Slider(30, range=10..200), Y=Slider(75, range=10..200), Z=Slider(8, range=1..200))
weldvertices_2 = MeshWeldVertices(Mesh=box_2, Tolerance=0.01)  # -> RuntimeMessage, Mesh
mbox_2 = MeshBox(Base=weldvertices_2.Mesh, XCount="1", YCount="1", ZCount="1")

# ---- group: container
pt_3 = Point(Point(-138.3028437, 194.8813592, -3.9998166))
box_3 = CenterBox(Base=pt_3, X=Slider(60, range=10..200), Y=Slider(150, range=10..200), Z=Slider(6, range=1..200))
mbox_3 = MeshBox(Base=box_3, XCount="1", YCount="1", ZCount="1")
weldvertices_3 = MeshWeldVertices(Mesh=mbox_3, Tolerance=0.01)  # -> RuntimeMessage, Mesh

# ---- group: obstacle
pt_4 = Point(Point(-158.4726811, 181.8390975, 0))
box_4 = CenterBox(Base=pt_4, X=Slider(11, range=10..200), Y=Slider(22, range=10..200), Z=Slider(26, range=1..200))
weldvertices_4 = MeshWeldVertices(Mesh=box_4, Tolerance=0.01)  # -> RuntimeMessage, Mesh
mbox_4 = MeshBox(Base=weldvertices_4.Mesh, XCount="1", YCount="1", ZCount="1")

pt_5 = Point(Point(-122.3339923, 282.1586602, 0))
box_5 = CenterBox(Base=pt_5, X=Slider(24, range=10..200), Y=Slider(10, range=10..200), Z=Slider(26, range=1..200))
weldvertices_5 = MeshWeldVertices(Mesh=box_5, Tolerance=0.01)  # -> RuntimeMessage, Mesh
mbox_5 = MeshBox(Base=weldvertices_5.Mesh, XCount="1", YCount="1", ZCount="1")

# ---- group: type 1
crv = Curve([<curve referenced from the Rhino model> x4])

crv_2 = Curve([<curve referenced from the Rhino model> x3])

# ---- group: type 2
crv_3 = Curve([<curve referenced from the Rhino model> x2])

crv_4 = Curve([<curve referenced from the Rhino model> x2])

# ----
merge = Merge(Data1=crv_2, Data2=crv_3)
merge_2 = Merge(Data1=crv, Data2=crv_4)

lng = ListLength(List=crv)
lng_2 = ListLength(List=crv_4)
rotations = Panel("""0
180""")
lng_3 = ListLength(List=merge_2)
repeat = RepeatData(Data="1", Length=lng)
repeat_2 = RepeatData(Data="2", Length=lng_2)
repeat_3 = RepeatData(Data=graft(rotations), Length=lng_3)
merge_3 = Merge(Data1=repeat, Data2=repeat_2)
flip = FlipMatrix(Data=repeat_3)  # -> simplify(Data)

crv_5 = Curve(merge)

# ----
# Assembler
# 
# Framework for Iterative Assemblages workflow
# 
# code by Alessio Erioli
# 
# v 1.0
# © Co-de-iT 2021 / Creative Commons Attribution-Non Commercial-ShareAlike 4.0 International License
# 0 - construct
rotations_2 = Panel("""0
180""")
lng_4 = ListLength(List=crv_5)
lng_5 = ListLength(List=crv_2)
lng_6 = ListLength(List=crv_3)
repeat_4 = RepeatData(Data=graft(rotations_2), Length=lng_4)
repeat_5 = RepeatData(Data="1", Length=lng_5)
# "Intermediate" geometry: Fast mesh representation of actual geometry - derived from the BRep. Check if Fast Mesh is good enough, otherwise:
# . either play with meshing parameters to get a good quality/speed compromise
# . model a mesh geometry in Rhino to use as representative
repeat_6 = RepeatData(Data="2", Length=lng_6)
flip_2 = FlipMatrix(Data=repeat_4)  # -> simplify(Data)
merge_4 = Merge(Data1=repeat_5, Data2=repeat_6)

# ---- group: single container
mesh = Mesh(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)

# flip normals: A container must have normals pointing inward
flip_3 = MeshFlip(Mesh=mesh)

# ---- group: Create Handles
handles = ConstructHandles(Polyline=merge_2, RotationAngles=flip, Type=merge_3)

handles_2 = ConstructHandles(Polyline=crv_5, RotationAngles=flip_2, Type=merge_4)

# ---- group: container
# flip normals: A container must have normals pointing inward
flip_4 = MeshFlip(Mesh=weldvertices_3.Mesh)

# ---- group: v1 - horizontal
mesh_2 = Mesh(<mesh referenced from the Rhino model>)

# ---- group: v2 - vertical
mesh_3 = Mesh(<mesh referenced from the Rhino model>)

# ----
mesh_4 = Mesh(<mesh referenced from the Rhino model>)

# ---- group: Display Handles
handdisp = DisplayHandle(Handles=handles, DisplaySize=Slider(0.1, range=0..0.5), absHTextSize=False)

handdisp_2 = DisplayHandle(Handles=handles_2, DisplaySize=Slider(0.1, range=0..0.5), absHTextSize=False)

# ----
mesh_5 = Mesh(<mesh referenced from the Rhino model>)
volume = Volume(Geometry=mesh_5)  # -> Volume, Centroid
name = Panel("typeB")
xy = XYPlane(Origin=volume.Centroid)
X = UnitX(Factor=1)

mesh_6 = Mesh(<mesh referenced from the Rhino model>)
volume_2 = Volume(Geometry=mesh_6)  # -> Volume, Centroid
name_2 = Panel("typeA")
xy_2 = XYPlane(Origin=volume_2.Centroid)
X_2 = UnitX(Factor=1)

concat = Concatenate(FragmentA=name, FragmentB="_geometry")
xdcon = ConstructXData(Label=concat, Data=mesh_4, ReferencePlane=xy, AssemblyObjectNameReference=name)

merge_5 = Merge(Data1=mesh_2, Data2=mesh_3)

concat_2 = Concatenate(FragmentA=name_2, FragmentB="_geometry")
xdcon_2 = ConstructXData(Label=concat_2, Data=merge_5, ReferencePlane=xy_2, AssemblyObjectNameReference=name_2)

# ---- group: circulation path
crv_6 = Curve([<curve referenced from the Rhino model> x11])

crv_7 = Curve([<curve referenced from the Rhino model> x11])

# ----
concat_3 = Concatenate(FragmentA=name, FragmentB="_data")
xdcon_3 = ConstructXData(Label=concat_3, Data=crv_7, ReferencePlane=xy, AssemblyObjectNameReference=name)

# ---- group: Create AssemblyObject
aocon = ConstructAssemblyObject(Name=name_2, CollisionMesh=mesh_6, ReferencePlane=xy_2, Direction=X_2, Weight="1.0", Handles=handles_2, ZLockAO=False)

aocon_2 = ConstructAssemblyObject(Name=name, CollisionMesh=mesh_5, ReferencePlane=xy, Direction=X, Weight="1.0", Handles=handles, ZLockAO=False)

# ---- group: XData - geometries
merge_6 = Merge(Data1=flatten(xdcon_2), Data2=flatten(xdcon))
data = Data(merge_6)

# ---- group: AssemblyObjects
# AO set: With more than one AssemblyObject, just build a list with the Merge component
merge_7 = Merge(Data1=flatten(aocon), Data2=flatten(aocon_2))
data_2 = Data(merge_7)

# ---- group: environment control
environment = ValueList({"single mesh container": 0, "container + obstacles": 1, "obstacles only": 2}, selected="single mesh container")
resetex = Button()

# ----
# environment
# Containers can have any shape, but there can only be one during a simulation.
# 
# Obstacles can be as many as you want.
merge_8 = Merge(Data1=mbox, Data2=mbox_2)  # -> flatten(Result)
merge_9 = Merge(Data1=flip_4, Data2=mbox_4, Data3=mbox_5)  # -> flatten(Result)
merge_10 = Merge(Data1=flip_4, Data2=mbox_4, Data3=mbox_5)  # -> flatten(Result)
filter = StreamFilter(Gate=environment, Stream0=flip_3, Stream1=merge_9, Stream2=merge_8)

heuw = HeuristicsWriter(AssemblyObjectsSet=data_2, noSH=False, noSO=False, xHT=False)

# ---- group: filter heuristics
heudex = HeuristicsDisplayEx(OriginPoint=Point(0, 0, 0), AssemblyObjectsSet=data_2, HeuristicsString=heuw, XSize=1, YSize=1, NRows=10)  # -> AssemblyObjectPairs, CoherencePattern, HeuristicsStringTree, TextBasePoints, XData
cull = CullPattern(List=flatten(heudex.HeuristicsStringTree), CullPattern=flatten(heudex.CoherencePattern))

# ----
heuset = HeuristicsSettings(HeuristicsString=cull, CurrentHeuristics=0, HeuristicsMode=0, ReceiverSelectionMode=0, RuleSelectionMode=0)
exoset = ExogeousSettings(
    EnvironmentMeshes=filter,
    EnvironmentMode=1,
    FieldScalarThreshold=0.5,
    Sandbox={Plane=PlaneXY(0, 0, 0), X=Domain(-1, 1), Y=Domain(0, 0), Z=Domain(0, 0)})
go = BooleanToggle(False)
step = Button()
max_objects = Panel("2000")
reset = Button()
pt_6 = Point(Point(-129.8796384, 113.0177957, 0))
cell_size = Slider(1.2, range=1..2)
show_edges = BooleanToggle(True)

# ---- group: base point
pt_7 = Point(Point(0, 20, 0))

# ----
# 1 - simulate
xy_3 = XYPlane(Origin=pt_6)

# ---- group: Assemblage Engine Xtended
aoengx = AssemblerEngineX(
    AssemblyObjectsSet=data_2,
    StartingPlane=xy_3,
    StartingObjectType=0,
    HeuristicsSettings=heuset,
    ExogenousSettings=exoset,
    Go=go,
    Step=step,
    NIterations=Slider(100, range=10..100),
    MaxNObjects=max_objects,
    ResetExogenous=resetex,
    Reset=reset,
    UseSupports=False,
    ZLockCheck=False)  # -> Assemblage, AssemblageCount

# ----
n_of_objects = Panel(aoengx.AssemblageCount)

# ---- group: auto-stop
larger = LargerThan(FirstNumber=aoengx.AssemblageCount, SecondNumber=max_objects)  # -> LargerThan, OrEqualTo
f_tas = ToggleAutostop(Toggle=go, Condition=larger.OrEqualTo)

# ---- group: Heuristics Display
heud = HeuristicDisplay(
    OriginPoint=pt_7,
    AssemblyObjectsSet=data_2,
    HeuristicsString=heuw,
    XSize=cell_size,
    YSize=cell_size,
    NRows=Slider(10, range=10..50),
    DisplayType="AO Types",
    ZLockFilter=False)

# ----
or = GateOr(A=go, B=step)
# 2 - analyze/post-process
aoadisp = DisplayAssemblage(Assemblage=aoengx.Assemblage, Bypass=False, OutputType="AO Types")  # -> ColoredCollisionMeshes, Edges, Colors
aoadecon = DeconstructAssemblage(Assemblage=aoengx.Assemblage)  # -> AssemblageObjects, AssemblageRules, ReceiverObjectsIndexes, AvailableObjectIndexes, UnreachableObjectIndexes

# ---- group: display components / display edges
previewlw = CustomPreviewLineweights(Geometry=aoadisp.Edges, Shader=ColourSwatch(SwatchColor=RGB(0, 0, 0)), Thickness=Slider(1, range=1..3), Absolute=False)

# ---- group: data dam
dam = DataDam(DataA=aoadecon.AssemblageObjects, BufferDelay=10000000, BufferMode=0)

# ---- group: associate XData
# 0 - associate XData
aoxd = AssociateXData(AssemblyObjects=aoadecon.AssemblageObjects, XData=data)
# 1 - generate boolean pattern
# (mask)
xddecon = DeconstructXData(XData=aoxd)  # -> Label, Data, ReferencePlane, AssemblyObjectNameReference

# ---- group: display components
mjoin = MeshJoin(Meshes=aoadisp.ColoredCollisionMeshes)
preview = CustomPreview(Geometry=mjoin, Material=ColourSwatch(SwatchColor=RGB(255, 255, 255)))  # disabled

# ---- group: Extract AO Type
aotype = ExtractType(AssemblyObject=dam)

# ---- group: type boolean pattern
aotype_2 = ExtractType(AssemblyObject=aoadecon.AssemblageObjects)
# boolean pattern (mask): generate a true/false pattern (or mask) to filter data belonging to a target type
target_type = Panel("0")
equals = Equality(FirstNumber=aotype_2, SecondNumber=target_type)  # -> graft(Equality), Inequality

# ---- group: geometries
# 2 - filter by type
dispatch = Dispatch(List=xddecon.Data, DispatchPattern=equals.Equality)  # -> ListA, ListB

# ---- group: reference planes
dispatch_2 = Dispatch(List=xddecon.ReferencePlane, DispatchPattern=equals.Equality)  # -> ListA, ListB

# ----
concat_4 = Concatenate(FragmentA=name_2, FragmentB="_data")

xdcon_4 = ConstructXData(Label=concat_4, Data=crv_6, ReferencePlane=xy_2, AssemblyObjectNameReference=name_2)

# ---- group: XData
# to pass Assembler data around, use the generic Data container
merge_11 = Merge(Data1=flatten(xdcon_4), Data2=flatten(xdcon_3))
data_3 = Data(merge_11)

# ----
# recognizing horizontal and vertical: The dot product of 2 unit vectors is equal to the cosine of the comprised angle.
# 
# Two perpendicular vectors (angle 90) have a dot product of 0, while two parallel vectors (angle 0 or 180) the dot product is 1 or -1 respectively. Using the absolute value function, the value becomes 1 regardless of the sign.
# 
# In this case we test the angle of each AssemblyObject's  reference plane X vector with the global Z vector. If they are parallel (absolute dot product = 1) then the object is oriented vertically, if they are perpendicular (absolute dot product = 0) the object is horizontal.
# associate blocks
# You can use the same boolean pattern filtering process used above, but in case you have multiple AssemblyObject types (>2) and need to assign different object types this is a more adaptable and modular construct (add outputs to the Sift/inputs to the Combine components accordingly)
# delays updated data transmission by a certain amount of time or only when clicked
# recombine types: In case of more than 2 types, add other channels to the input accordingly.
# sift by type: filters by a pattern of integers. In case of more than 2 types, add other channels to the output.
aoplane = ExtractReferencePlane(AssemblyObject=dam)
sift = SiftPattern(List=aoplane, SiftPattern=aotype)  # -> Output0, Output1
panel = Panel("recombine horizontal/vertical")
bake = BooleanToggle(False)

# ---- group: separate horizontal/vertical
Z = UnitZ(Factor=1)
deplane = DeconstructPlane(Plane=sift.Output0)  # -> Origin, XAxis, YAxis, ZAxis
dprod = DotProduct(VectorA=deplane.XAxis, VectorB=Z, Unitize=False)
abs = Absolute(Value=dprod)
int = Integer(abs)
dispatch_3 = Dispatch(List=sift.Output0, DispatchPattern=int)  # -> ListA, ListB

# ---- group: associate blocks / vertical elements
pln = Plane(dispatch_3.ListA)

# ---- group: associate blocks / horizontal elements
pln_2 = Plane(dispatch_3.ListB)

# ---- group: associate blocks
# objectA / type 0
# objectB / type 1
pln_3 = Plane(sift.Output1)
inblock = InsertBlock(BlockName="block_typeA_v1", SourcePlane=pln_2)
inblock_2 = InsertBlock(BlockName="block_typeA_v2", SourcePlane=pln)
inblock_3 = InsertBlock(BlockName="block_typeB", SourcePlane=pln_3)

# ----
weave = Weave(Pattern=int, Stream0=inblock, Stream1=inblock_2, NullGaps=False)
combine = CombineData(Input0=weave, Input1=inblock_3)  # -> Result, Index
data_4 = Data(combine.Result)
bake_2 = BakeObjects(Geometry=data_4, Bake=bake)

# ---- group: filter horizontal/vertical
# 3 - filter horizontal and vertical
deplane_2 = DeconstructPlane(Plane=dispatch_2.ListA)  # -> Origin, XAxis, YAxis, ZAxis
Z_2 = UnitZ(Factor=1)
dprod_2 = DotProduct(VectorA=deplane_2.XAxis, VectorB=Z_2, Unitize=False)
abs_2 = Absolute(Value=dprod_2)

# ----
# display intermediate geometries (filtering horizontal/vertical)
# merge branches: Merging branches rebuilds the data tree thanks to the individual branch indices
# process: Only the AssemblyObject of type 0 has different geometries for horizontal and vertical orientation, so the sequence of operations is:
# 
# . filter by type
# . only for type 0: separate horizontal and vertical, associate relative geometry
# . merge type 1 horizontal and vertical together
# . merge all types back together
# filter by type: filters with a boolean pattern. If type=0 data is passed to output A, else to output B
# filter horizontal/vertical: See explanation in the panel below.
# 
# We use those 0 and 1 as filtering indices in a List item, since we previously added the intermediate geometries in the XData in the corresponding order (0 horizontal, 1 vertical).
int_2 = Integer(abs_2)

# ---- group: filter horizontal/vertical (continued)
item = ListItem(List=dispatch.ListA, Index=int_2, Wrap=True)

# ----
# 4 - merge types together
merge_12 = Merge(Data1=dispatch.ListB, Data2=item)
preview_2 = CustomPreview(Geometry=flatten(merge_12), Material=aoadisp.Colors)
