# Grasshopper definition 02-04_base 2 Objects_Assemblage - Environment + circulation.gh (Grasshopper 1.0.7)
# Copyright: Co-de-iT
# plug-ins: Assembler, froGH, Shortest Walk in Gh, Human, MeshEdit Components

# ---- group: obstacle
pt = Point(Point(-153.8902437, 117.5771051, 21.66773957))
box = CenterBox(Base=pt, X=Slider(11, range=10..200), Y=Slider(22, range=10..200), Z=Slider(26, range=1..200))
weldvertices = MeshWeldVertices(Mesh=box, Tolerance=0.01)  # -> RuntimeMessage, Mesh
mbox = MeshBox(Base=weldvertices.Mesh, XCount="1", YCount="1", ZCount="1")

pt_2 = Point(Point(-122.3339923, 157.3850123, -20.10324875))
box_2 = CenterBox(Base=pt_2, X=Slider(30, range=10..200), Y=Slider(75, range=10..200), Z=Slider(8, range=1..200))
weldvertices_2 = MeshWeldVertices(Mesh=box_2, Tolerance=0.01)  # -> RuntimeMessage, Mesh
mbox_2 = MeshBox(Base=weldvertices_2.Mesh, XCount="1", YCount="1", ZCount="1")

# ---- group: container
pt_3 = Point(Point(-138.3028437, 194.8813592, -3.9998166))
box_3 = CenterBox(Base=pt_3, X=Slider(60, range=10..200), Y=Slider(150, range=10..200), Z=Slider(6, range=1..200))
mbox_3 = MeshBox(Base=box_3, XCount="1", YCount="1", ZCount="1")
weldvertices_3 = MeshWeldVertices(Mesh=mbox_3, Tolerance=0.01)  # -> RuntimeMessage, Mesh

# ---- group: obstacle
pt_4 = Point(Point(-158.4726811, 181.8390975, 0))
box_4 = CenterBox(Base=pt_4, X=Slider(11, range=10..200), Y=Slider(22, range=10..200), Z=Slider(26, range=1..200))
weldvertices_4 = MeshWeldVertices(Mesh=box_4, Tolerance=0.01)  # -> RuntimeMessage, Mesh
mbox_4 = MeshBox(Base=weldvertices_4.Mesh, XCount="1", YCount="1", ZCount="1")

pt_5 = Point(Point(-122.3339923, 282.1586602, 0))
box_5 = CenterBox(Base=pt_5, X=Slider(24, range=10..200), Y=Slider(10, range=10..200), Z=Slider(26, range=1..200))
weldvertices_5 = MeshWeldVertices(Mesh=box_5, Tolerance=0.01)  # -> RuntimeMessage, Mesh
mbox_5 = MeshBox(Base=weldvertices_5.Mesh, XCount="1", YCount="1", ZCount="1")

# ---- group: type 1
crv = Curve([<curve referenced from the Rhino model> x4])

crv_2 = Curve([<curve referenced from the Rhino model> x3])

# ---- group: type 2
crv_3 = Curve([<curve referenced from the Rhino model> x2])

crv_4 = Curve([<curve referenced from the Rhino model> x2])

# ----
merge = Merge(Data1=crv_2, Data2=crv_3)
merge_2 = Merge(Data1=crv, Data2=crv_4)

lng = ListLength(List=crv)
lng_2 = ListLength(List=crv_4)
rotations = Panel("""0
180""")
lng_3 = ListLength(List=merge_2)
repeat = RepeatData(Data="1", Length=lng)
repeat_2 = RepeatData(Data="2", Length=lng_2)
repeat_3 = RepeatData(Data=graft(rotations), Length=lng_3)
merge_3 = Merge(Data1=repeat, Data2=repeat_2)
flip = FlipMatrix(Data=repeat_3)  # -> simplify(Data)

crv_5 = Curve(merge)

# ----
# Assembler
# 
# Framework for Iterative Assemblages workflow
# 
# code by Alessio Erioli
# 
# v 1.0
# © Co-de-iT 2021 / Creative Commons Attribution-Non Commercial-ShareAlike 4.0 International License
rotations_2 = Panel("""0
180""")
lng_4 = ListLength(List=crv_5)
lng_5 = ListLength(List=crv_2)
lng_6 = ListLength(List=crv_3)
repeat_4 = RepeatData(Data=graft(rotations_2), Length=lng_4)
repeat_5 = RepeatData(Data="1", Length=lng_5)
repeat_6 = RepeatData(Data="2", Length=lng_6)
flip_2 = FlipMatrix(Data=repeat_4)  # -> simplify(Data)
merge_4 = Merge(Data1=repeat_5, Data2=repeat_6)

# ---- group: single container
mesh = Mesh(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)

# flip normals: A container must have normals pointing inward
flip_3 = MeshFlip(Mesh=mesh)

# ---- group: Create Handles
handles = ConstructHandles(Polyline=merge_2, RotationAngles=flip, Type=merge_3)

handles_2 = ConstructHandles(Polyline=crv_5, RotationAngles=flip_2, Type=merge_4)

# ---- group: container
# flip normals: A container must have normals pointing inward
flip_4 = MeshFlip(Mesh=weldvertices_3.Mesh)

# ----
# "Intermediate" geometry: Fast mesh representation of actual geometry - derived from the BRep. Check if Fast Mesh is good enough, otherwise:
# . either play with meshing parameters to get a good quality/speed compromise
# . model a mesh geometry in Rhino to use as representative
mesh_2 = Mesh(<mesh referenced from the Rhino model>)

mesh_3 = Mesh(<mesh referenced from the Rhino model>)

# ---- group: Display Handles
handdisp = DisplayHandle(Handles=handles, DisplaySize=Slider(0.1, range=0..0.5), absHTextSize=False)

handdisp_2 = DisplayHandle(Handles=handles_2, DisplaySize=Slider(0.1, range=0..0.5), absHTextSize=False)

# ----
mesh_4 = Mesh(<mesh referenced from the Rhino model>)
volume = Volume(Geometry=mesh_4)  # -> Volume, Centroid
name = Panel("typeB")
xy = XYPlane(Origin=volume.Centroid)
X = UnitX(Factor=1)

mesh_5 = Mesh(<mesh referenced from the Rhino model>)
volume_2 = Volume(Geometry=mesh_5)  # -> Volume, Centroid
name_2 = Panel("typeA")
xy_2 = XYPlane(Origin=volume_2.Centroid)
X_2 = UnitX(Factor=1)

concat = Concatenate(FragmentA=name_2, FragmentB="_geometry")
xdcon = ConstructXData(Label=concat, Data=mesh_2, ReferencePlane=xy_2, AssemblyObjectNameReference=name_2)

concat_2 = Concatenate(FragmentA=name, FragmentB="_geometry")
xdcon_2 = ConstructXData(Label=concat_2, Data=mesh_3, ReferencePlane=xy, AssemblyObjectNameReference=name)

# ---- group: circulation path
crv_6 = Curve([<curve referenced from the Rhino model> x11])

crv_7 = Curve([<curve referenced from the Rhino model> x11])

# ----
concat_3 = Concatenate(FragmentA=name, FragmentB="_data")
xdcon_3 = ConstructXData(Label=concat_3, Data=crv_7, ReferencePlane=xy, AssemblyObjectNameReference=name)

# ---- group: Create AssemblyObject
aocon = ConstructAssemblyObject(Name=name_2, CollisionMesh=mesh_5, ReferencePlane=xy_2, Direction=X_2, Weight="1.0", Handles=handles_2, ZLockAO=False)

aocon_2 = ConstructAssemblyObject(Name=name, CollisionMesh=mesh_4, ReferencePlane=xy, Direction=X, Weight="1.0", Handles=handles, ZLockAO=False)

# ---- group: XData - geometries
merge_5 = Merge(Data1=flatten(xdcon), Data2=flatten(xdcon_2))
data = Data(merge_5)

# ---- group: AssemblyObjects
# AO set: With more than one AssemblyObject, just build a list with the Merge component
merge_6 = Merge(Data1=flatten(aocon), Data2=flatten(aocon_2))
data_2 = Data(merge_6)

# ---- group: environment control
environment = ValueList({"single mesh container": 0, "container + obstacles": 1, "obstacles only": 2}, selected="single mesh container")
resetex = Button()

# ----
# environment
# Containers can have any shape, but there can only be one during a simulation.
# 
# Obstacles can be as many as you want.
merge_7 = Merge(Data1=mbox, Data2=mbox_2)  # -> flatten(Result)
merge_8 = Merge(Data1=flip_4, Data2=mbox_4, Data3=mbox_5)  # -> flatten(Result)
merge_9 = Merge(Data1=flip_4, Data2=mbox_4, Data3=mbox_5)  # -> flatten(Result)
filter = StreamFilter(Gate=environment, Stream0=flip_3, Stream1=merge_8, Stream2=merge_7)

heuw = HeuristicsWriter(AssemblyObjectsSet=data_2, noSH=False, noSO=False, xHT=False)

# ---- group: filter heuristics
heudex = HeuristicsDisplayEx(OriginPoint=Point(0, 0, 0), AssemblyObjectsSet=data_2, HeuristicsString=heuw, XSize=1, YSize=1, NRows=10)  # -> AssemblyObjectPairs, CoherencePattern, HeuristicsStringTree, TextBasePoints, XData
cull = CullPattern(List=flatten(heudex.HeuristicsStringTree), CullPattern=flatten(heudex.CoherencePattern))

# ----
heuset = HeuristicsSettings(HeuristicsString=cull, CurrentHeuristics=0, ReceiverSelectionMode=0, RuleSelectionMode=0)
reset = Button()
go = BooleanToggle(False)
step = Button()
max_objects = Panel("2000")
exoset = ExogeousSettings(
    EnvironmentMeshes=filter,
    EnvironmentMode=1,
    FieldScalarThreshold=0.5,
    Sandbox={Plane=PlaneXY(0, 0, 0), X=Domain(-1, 1), Y=Domain(0, 0), Z=Domain(0, 0)})
cell_size = Slider(1.2, range=1..2)

# ---- group: base point
pt_6 = Point(Point(0, 15, 0))

# ----
pt_7 = Point(Point(-129.8796384, 113.0177957, 0))

# ---- group: Heuristics Display
heud = HeuristicDisplay(
    OriginPoint=pt_6,
    AssemblyObjectsSet=data_2,
    HeuristicsString=heuw,
    XSize=cell_size,
    YSize=cell_size,
    NRows=Slider(10, range=10..50),
    DisplayType="AO Types",
    ZLockFilter=False)

# ----
# 1 - simulate
xy_3 = XYPlane(Origin=pt_7)

# ---- group: Assemblage Engine Xtended
aoengx = AssemblerEngineX(
    AssemblyObjectsSet=data_2,
    StartingPlane=xy_3,
    StartingObjectType=0,
    HeuristicsSettings=heuset,
    ExogenousSettings=exoset,
    Go=go,
    Step=step,
    NIterations=Slider(100, range=10..100),
    MaxNObjects=max_objects,
    ResetExogenous=resetex,
    Reset=reset,
    UseSupports=False,
    ZLockCheck=False)  # -> Assemblage, AssemblageCount

# ----
n_of_objects = Panel(aoengx.AssemblageCount)

# ---- group: auto-stop
larger = LargerThan(FirstNumber=aoengx.AssemblageCount, SecondNumber=max_objects)  # -> LargerThan, OrEqualTo
f_tas = ToggleAutostop(Toggle=go, Condition=larger.OrEqualTo)

# ----
# Data Dam: Click on the play symbol (when present) to manually update the data
dam = DataDam(DataA=aoengx.Assemblage, BufferDelay=10000000, BufferMode=0)
# 2 - analyze/post-process
aoadisp = DisplayAssemblage(Assemblage=aoengx.Assemblage, Bypass=False, OutputType="Objects", ValueTable_OutputType="Occupancy")  # -> ColoredCollisionMeshes, Edges, Colors

# ---- group: display "intermediate" geometries
aoadecon = DeconstructAssemblage(Assemblage=aoengx.Assemblage)  # -> AssemblageObjects, AssemblageRules, ReceiverObjectsIndexes, AvailableObjectIndexes, UnreachableObjectIndexes
aoxd = AssociateXData(AssemblyObjects=aoadecon.AssemblageObjects, XData=data)
xddecon = DeconstructXData(XData=aoxd)  # -> Label, Data, ReferencePlane, AssemblyObjectNameReference
preview = CustomPreview(Geometry=xddecon.Data, Material=graft(aoadisp.Colors))

# ----
# shortest walk - AssemblyObjects connections
aoadecon_2 = DeconstructAssemblage(Assemblage=dam)  # -> AssemblageObjects, AssemblageRules, ReceiverObjectsIndexes, AvailableObjectIndexes, UnreachableObjectIndexes

# ---- group: Assemblage Topology
# Assemblage Topology: hO - Handle Occupancy
# 
# 0 - available
# 1 - connected
# -1 - occluded
# 
# nO - neighbour AssemblyObject index (-1 if Handle is available)
# 
# nH - neighbour Handle index (-1 if Handle is available or occluded)
aotopo = ExtractTopology(Assemblage=dam)  # -> HandleOccupancy, NeighbourObjectIndex, NeighbourHandleIndex

# ---- group: display components
mjoin = MeshJoin(Meshes=aoadisp.ColoredCollisionMeshes)
preview_2 = CustomPreview(Geometry=mjoin, Material=ColourSwatch(SwatchColor=RGB(255, 255, 255)))  # disabled

# ---- group: display components / display edges
previewlw = CustomPreviewLineweights(Geometry=aoadisp.Edges, Shader=ColourSwatch(SwatchColor=RGB(0, 0, 0)), Thickness=Slider(1, range=1..3), Absolute=False)

# ----
list = ValueList({"AO connectivity": 0, "Circulation path": 1}, selected="AO connectivity")

# ---- group: how Cross Reference works
# consider the connections among all points (A to B) avoiding duplicates (B to A) and points connecting to themselves (A to A or B to B)
number_slider = Slider(6, range=3..6)
series = Series(Start=0, Step=1, Count=number_slider)
crossref = CrossReference(ListA=series, ListB=series, CrossMode=1)  # -> ListA, ListB
concat_4 = Concatenate(FragmentA=crossref.ListA, FragmentB=crossref.ListB)
panel = Panel(series)
crossref_2 = CrossReference(ListA=series, ListB=series, CrossMode=5)  # -> ListA, ListB
matrix = ConstructMatrix(Rows=number_slider, Columns=number_slider, Values=concat_4)
concat_5 = Concatenate(FragmentA=crossref_2.ListA, FragmentB=crossref_2.ListB)
matrix_2 = DisplayMatrix(matrix)
panel_2 = Panel(concat_5)

# ----
data_3 = Data(graft(aoadecon_2.AssemblageObjects))

# ---- group: how Member Index works / set to search from
int = Integer(Tree({0;0;0}: [2, 1, 5, 8, 7], {0;0;1}: [7, 8, 8, 6, 2], {0;0;2}: [7, 8, 8, 6, 2], {0;0;3}: [2, 1, 5, 8, 7], {0;0;4}: [7, 8, 8, 6, 2]))

# ----
concat_6 = Concatenate(FragmentA=name_2, FragmentB="_data")

xdcon_4 = ConstructXData(Label=concat_6, Data=crv_6, ReferencePlane=xy_2, AssemblyObjectNameReference=name_2)

# ---- group: XData - circulation path
# to pass Assembler data around, use the generic Data container
merge_10 = Merge(Data1=flatten(xdcon_4), Data2=flatten(xdcon_3))
data_4 = Data(merge_10)

# ----
aoxd_2 = AssociateXData(AssemblyObjects=aoadecon_2.AssemblageObjects, XData=data_4)
xddecon_2 = DeconstructXData(XData=aoxd_2)  # -> Label, Data, ReferencePlane, AssemblyObjectNameReference

# ----
# AO connectivity network: Creates the connectivity network between AssemblyObjects by connecting centres of reference planes with connected handles.
# 
# This network does not necessarily coincide with the spatial connectivity network, just tells how the Assembly Objects are connected to each other.
aoplane = ExtractReferencePlane(AssemblyObject=aoadecon_2.AssemblageObjects)  # -> graft(ReferencePlane)
aosp = ExtractSenderHandlesPlanes(AssemblyObject=aoadecon_2.AssemblageObjects)

# ---- group: select free Handles
equals = Equality(FirstNumber=aotopo.HandleOccupancy, SecondNumber="0")  # -> Equality, Inequality
cull_2 = CullPattern(List=aosp, CullPattern=equals.Equality)  # -> flatten(List)

# ---- group: filter connected handles
# AO circulation path: Associates the designed circulation path to its AssemblyObject
panel_3 = Panel("1")
equals_2 = Equality(FirstNumber=aotopo.HandleOccupancy, SecondNumber=panel_3)  # -> Equality, Inequality
cull_3 = CullPattern(List=aosp, CullPattern=equals_2.Equality)

# ---- group: exclude occluded
equals_3 = Equality(FirstNumber=aotopo.HandleOccupancy, SecondNumber="-1")  # -> Equality, Inequality
cull_4 = CullPattern(List=aosp, CullPattern=equals_3.Inequality)

# ---- group: select vertical handles only
Z = UnitZ(Factor=1)
deplane = DeconstructPlane(Plane=cull_2)  # -> Origin, XAxis, YAxis, ZAxis
dprod = DotProduct(VectorA=deplane.ZAxis, VectorB=Z, Unitize=False)
abs = Absolute(Value=dprod)
int_2 = Integer("0")
int_3 = Integer(abs)
equals_4 = Equality(FirstNumber=int_3, SecondNumber=int_2)  # -> Equality, Inequality
cull_5 = CullPattern(List=cull_2, CullPattern=equals_4.Equality)

# ----
ln = Line(StartPoint=aoplane, EndPoint=cull_4)

filter_2 = StreamFilter(Gate=list, Stream0=ln, Stream1=xddecon_2.Data)
line = Line(simplify(filter_2))

# ---- group: generate all possible connections
crossref_3 = CrossReference(ListA=cull_5, ListB=cull_5, CrossMode=5)  # -> ListA, ListB
ln_2 = Line(StartPoint=crossref_3.ListA, EndPoint=crossref_3.ListB)

# ----
# note on shortest path: Whle connectivity network will always show a path (all objects are connected at least to another object, so a path between any two points always exists), circulation path might fail to find a path if the 2 points are on isolated clusters.
line_2 = Line(flatten(line))
explode = Explode(Curve=line_2, Recursive=True)  # -> Segments, flatten(Vertices)
pt_8 = Point(Point(-150.4171057, 80.40438104, 5.609692044))
pt_9 = Point(Point(-99.9410785, 130.5510248, -25.53229878))
cp = ClosestPoint(Point=pt_8, Cloud=explode.Vertices)  # -> ClosestPoint, CPIndex, Distance
cp_2 = ClosestPoint(Point=pt_9, Cloud=explode.Vertices)  # -> ClosestPoint, CPIndex, Distance
ln_3 = Line(StartPoint=pt_9, EndPoint=cp_2.ClosestPoint)
ln_4 = Line(StartPoint=pt_8, EndPoint=cp.ClosestPoint)
ln_5 = Line(StartPoint=cp.ClosestPoint, EndPoint=cp_2.ClosestPoint)
start = ColourSwatch(SwatchColor=RGB(255, 0, 0))
end = ColourSwatch(SwatchColor=RGB(0, 153, 255))
shortwalk = ShortestWalk(Curves=line_2, WantedPath=ln_5)  # -> ShortestWalk, Succession, Direction, Length
dots = DotDisplay(Point=[cp.ClosestPoint, cp_2.ClosestPoint], Colour=[start, end], Size="1")
previewlw_2 = CustomPreviewLineweights(Geometry=shortwalk.ShortestWalk, Shader=ColourSwatch(SwatchColor=RGB(255, 212, 0)), Thickness="5", Absolute=False)  # disabled

# ---- group: display line network
previewlw_3 = CustomPreviewLineweights(Geometry=line_2, Shader=ColourSwatch(SwatchColor=RGB(255, 0, 0)), Absolute=False)  # disabled

# ---- group: sub-selection (for testing)
subset = SubList(List=ln_2, Domain="10000", Wrap=True)  # -> List, Index

# ---- group: extract indexes of involved objects
f_ifroml = IndexesFromList(Data=line_2)
unflatten = UnflattenTree(Tree=f_ifroml, Guide=line)
mindex = MemberIndex(Set=unflatten, Member=shortwalk.Succession)  # -> Index, Count
f_massbool = MassBoolean(Values=mindex.Count, BooleanOperator="OR", Boolean_Operator="OR")

# ----
dispatch = Dispatch(List=xddecon.Data, DispatchPattern=f_massbool)  # -> ListA, ListB
# finding objects involved in the shortest walk: the steps are:
# 
# . generate an index for each of the lines in the network
# 
# . rebuild the original tree structure for the indexes (this puts the index of each line in a branch which index corresponds to the Object the line belongs to)
# 
# . check in which branches are the indexes involved in the shortest walk (see how Member Index works below)
dispatch_2 = Dispatch(List=data_3, DispatchPattern=f_massbool)  # -> ListA, ListB
preview_3 = CustomPreview(Geometry=dispatch.ListA, Material=ColourSwatch(SwatchColor=RGB(255, 255, 255)))  # disabled
preview_4 = CustomPreview(
    Geometry=dispatch_2.ListA,
    Material={diffuse=RGB(221, 160, 221), emission=RGB(66, 48, 66), shine=0.5, specular=RGB(255, 255, 255), transparency=0})  # disabled

# ----
# circulation frequency
shortwalk_2 = ShortestWalk(Curves=line_2, WantedPath=subset.List)  # -> ShortestWalk, Succession, Direction, Length
f_ifroml_2 = IndexesFromList(Data=line_2)
dom = ConstructDomain(DomainStart="1", DomainEnd=Slider(15, range=5..15))

# ---- group: counts occurrences in a list
c_script = CSharpScript(L=flatten(shortwalk_2.Succession), M=f_ifroml_2)  # -> out, N; inputs L: list of Int32, M: list of Int32
# ---------- c_script: C# usings ----------
using System.Threading.Tasks;
# ---------- c_script: C# ----------
    int[] occurrences = new int[M.Count];

    Parallel.For(0, M.Count, i =>
      {
      int count = 0;
      for (int j = 0; j < L.Count; j++)
      {
        if(L[j] == M[i]) count++;
      }
      occurrences[i] = count;
      });

   N = occurrences;
# ---------- end c_script ----------

# ----
log = Logarithm(Value=c_script.N)
sqrt = SquareRoot(Value=c_script.N)
num = Number(sqrt)
bnd = Bounds(Numbers=num)
remap = RemapNumbers(Value=num, Source=bnd, Target=Domain(0, 1))  # -> Mapped, Clipped
gradient = Gradient(LowerLimit=0, UpperLimit=1, Parameter=remap.Mapped, stops=[0: RGB(0, 128, 0), 0.5: RGB(255, 255, 0), 1: RGB(255, 0, 0)])
remap_2 = RemapNumbers(Value=remap.Mapped, Source=Domain(0, 1), Target=dom)  # -> Mapped, Clipped
previewlw_4 = CustomPreviewLineweights(Geometry=line_2, Shader=gradient, Thickness=remap_2.Mapped, Absolute=False)

# ---- group: original distribution
bar_graph = BarGraph(c_script.N, BarColor=RGB(255, 0, 90))

# ---- group: logarithmic distrbution
bar_graph_2 = BarGraph(log, BarColor=RGB(255, 0, 90))

# ---- group: inverse square distribution
bar_graph_3 = BarGraph(sqrt, BarColor=RGB(255, 0, 90))

# ---- group: how Member Index works
# This tells us if any number occurs in any of the provided sets (each branch is considered one separate set).
# 
# The first branch tells us that in the first set 5 and 1 occur one time each, while the other numbers occur 0 times.
members = Panel("""5
9
1
3""")
panel_4 = Panel(int)

# ---- group: how Member Index works / members to search for
int_4 = Integer(members)

# ---- group: how Member Index works (continued)
mindex_2 = MemberIndex(Set=int, Member=int_4)  # -> Index, Count
numbers_of_occurrences = Panel(mindex_2.Count)
