# Grasshopper definition 02-05_base 2 Objects_Assemblage - Environment + Weigh Heuristics.gh (Grasshopper 1.0.7)
# Copyright: Co-de-iT
# plug-ins: Assembler, froGH, Human, MeshEdit Components

# ---- group: obstacle
pt = Point(Point(-153.8902437, 117.5771051, 21.66773957))
box = CenterBox(Base=pt, X=Slider(11, range=10..200), Y=Slider(22, range=10..200), Z=Slider(26, range=1..200))
weldvertices = MeshWeldVertices(Mesh=box, Tolerance=0.01)  # -> RuntimeMessage, Mesh
mbox = MeshBox(Base=weldvertices.Mesh, XCount="1", YCount="1", ZCount="1")

pt_2 = Point(Point(-122.3339923, 157.3850123, -20.10324875))
box_2 = CenterBox(Base=pt_2, X=Slider(30, range=10..200), Y=Slider(75, range=10..200), Z=Slider(8, range=1..200))
weldvertices_2 = MeshWeldVertices(Mesh=box_2, Tolerance=0.01)  # -> RuntimeMessage, Mesh
mbox_2 = MeshBox(Base=weldvertices_2.Mesh, XCount="1", YCount="1", ZCount="1")

# ---- group: container
pt_3 = Point(Point(-138.3028437, 194.8813592, -3.9998166))
box_3 = CenterBox(Base=pt_3, X=Slider(60, range=10..200), Y=Slider(150, range=10..200), Z=Slider(6, range=1..200))
mbox_3 = MeshBox(Base=box_3, XCount="1", YCount="1", ZCount="1")
weldvertices_3 = MeshWeldVertices(Mesh=mbox_3, Tolerance=0.01)  # -> RuntimeMessage, Mesh

# ---- group: obstacle
pt_4 = Point(Point(-158.4726811, 181.8390975, 0))
box_4 = CenterBox(Base=pt_4, X=Slider(11, range=10..200), Y=Slider(22, range=10..200), Z=Slider(26, range=1..200))
weldvertices_4 = MeshWeldVertices(Mesh=box_4, Tolerance=0.01)  # -> RuntimeMessage, Mesh
mbox_4 = MeshBox(Base=weldvertices_4.Mesh, XCount="1", YCount="1", ZCount="1")

pt_5 = Point(Point(-122.3339923, 282.1586602, 0))
box_5 = CenterBox(Base=pt_5, X=Slider(24, range=10..200), Y=Slider(10, range=10..200), Z=Slider(26, range=1..200))
weldvertices_5 = MeshWeldVertices(Mesh=box_5, Tolerance=0.01)  # -> RuntimeMessage, Mesh
mbox_5 = MeshBox(Base=weldvertices_5.Mesh, XCount="1", YCount="1", ZCount="1")

# ---- group: type 1
crv = Curve([<curve referenced from the Rhino model> x4])

# 0 - construct
crv_2 = Curve([<curve referenced from the Rhino model> x3])

# ---- group: type 2
crv_3 = Curve([<curve referenced from the Rhino model> x2])

crv_4 = Curve([<curve referenced from the Rhino model> x2])

# ----
merge = Merge(Data1=crv_2, Data2=crv_3)
merge_2 = Merge(Data1=crv, Data2=crv_4)

lng = ListLength(List=crv)
lng_2 = ListLength(List=crv_4)
rotations = Panel("""0
180""")
lng_3 = ListLength(List=merge_2)
repeat = RepeatData(Data="1", Length=lng)
repeat_2 = RepeatData(Data="2", Length=lng_2)
repeat_3 = RepeatData(Data=graft(rotations), Length=lng_3)
merge_3 = Merge(Data1=repeat, Data2=repeat_2)
flip = FlipMatrix(Data=repeat_3)  # -> simplify(Data)

crv_5 = Curve(merge)

# ----
# Assembler
# 
# Framework for Iterative Assemblages workflow
# 
# code by Alessio Erioli
# 
# v 1.0
# © Co-de-iT 2021 / Creative Commons Attribution-Non Commercial-ShareAlike 4.0 International License
rotations_2 = Panel("""0
180""")
lng_4 = ListLength(List=crv_5)
lng_5 = ListLength(List=crv_2)
lng_6 = ListLength(List=crv_3)
repeat_4 = RepeatData(Data=graft(rotations_2), Length=lng_4)
repeat_5 = RepeatData(Data="1", Length=lng_5)
repeat_6 = RepeatData(Data="2", Length=lng_6)
flip_2 = FlipMatrix(Data=repeat_4)  # -> simplify(Data)
merge_4 = Merge(Data1=repeat_5, Data2=repeat_6)

# ---- group: single container
mesh = Mesh(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)

# flip normals: A container must have normals pointing inward
flip_3 = MeshFlip(Mesh=mesh)

# ---- group: Create Handles
handles = ConstructHandles(Polyline=merge_2, RotationAngles=flip, Type=merge_3)

handles_2 = ConstructHandles(Polyline=crv_5, RotationAngles=flip_2, Type=merge_4)

# ---- group: container
# flip normals: A container must have normals pointing inward
flip_4 = MeshFlip(Mesh=weldvertices_3.Mesh)

# ----
# "Intermediate" geometry: Fast mesh representation of actual geometry - derived from the BRep. Check if Fast Mesh is good enough, otherwise:
# . either play with meshing parameters to get a good quality/speed compromise
# . model a mesh geometry in Rhino to use as representative
mesh_2 = Mesh(<mesh referenced from the Rhino model>)

mesh_3 = Mesh(<mesh referenced from the Rhino model>)

# ---- group: Display Handles
handdisp = DisplayHandle(Handles=handles, DisplaySize=Slider(0.1, range=0..0.5), absHTextSize=False)

handdisp_2 = DisplayHandle(Handles=handles_2, DisplaySize=Slider(0.1, range=0..0.5), absHTextSize=False)

# ----
mesh_4 = Mesh(<mesh referenced from the Rhino model>)
volume = Volume(Geometry=mesh_4)  # -> Volume, Centroid
name = Panel("typeB")
xy = XYPlane(Origin=volume.Centroid)
X = UnitX(Factor=1)

mesh_5 = Mesh(<mesh referenced from the Rhino model>)
volume_2 = Volume(Geometry=mesh_5)  # -> Volume, Centroid
name_2 = Panel("typeA")
xy_2 = XYPlane(Origin=volume_2.Centroid)
X_2 = UnitX(Factor=1)

concat = Concatenate(FragmentA=name_2, FragmentB="_geometry")
xdcon = ConstructXData(Label=concat, Data=mesh_2, ReferencePlane=xy_2, AssemblyObjectNameReference=name_2)

concat_2 = Concatenate(FragmentA=name, FragmentB="_geometry")
xdcon_2 = ConstructXData(Label=concat_2, Data=mesh_3, ReferencePlane=xy, AssemblyObjectNameReference=name)

# ---- group: circulation path
crv_6 = Curve([<curve referenced from the Rhino model> x11])

crv_7 = Curve([<curve referenced from the Rhino model> x11])

# ----
concat_3 = Concatenate(FragmentA=name, FragmentB="_data")
xdcon_3 = ConstructXData(Label=concat_3, Data=crv_7, ReferencePlane=xy, AssemblyObjectNameReference=name)

# ---- group: Create AssemblyObject
aocon = ConstructAssemblyObject(Name=name_2, CollisionMesh=mesh_5, ReferencePlane=xy_2, Direction=X_2, Weight="1.0", Handles=handles_2, ZLockAO=False)

aocon_2 = ConstructAssemblyObject(Name=name, CollisionMesh=mesh_4, ReferencePlane=xy, Direction=X, Weight="1.0", Handles=handles, ZLockAO=False)

# ---- group: XData - geometries
merge_5 = Merge(Data1=flatten(xdcon), Data2=flatten(xdcon_2))
data = Data(merge_5)

# ---- group: AssemblyObjects
# AO set: With more than one AssemblyObject, just build a list with the Merge component
merge_6 = Merge(Data1=flatten(aocon), Data2=flatten(aocon_2))
data_2 = Data(merge_6)

# ----
heuw = HeuristicsWriter(AssemblyObjectsSet=data_2, noSH=False, noSO=False, xHT=False)
cell_size = Slider(1.2, range=1..2)
number_slider = Slider(10, range=10..50)

# ---- group: base point
pt_6 = Point(Point(0, 20, 0))

# ----
heudex = HeuristicsDisplayEx(
    OriginPoint=pt_6,
    AssemblyObjectsSet=data_2,
    HeuristicsString=heuw,
    XSize=cell_size,
    YSize=cell_size,
    NRows=number_slider)  # -> AssemblyObjectPairs, CoherencePattern, HeuristicsStringTree, TextBasePoints, XData

# ---- group: Heuristics Display
heud = HeuristicDisplay(
    OriginPoint=pt_6,
    AssemblyObjectsSet=data_2,
    XData=data,
    HeuristicsString=heuw,
    XSize=cell_size,
    YSize=cell_size,
    NRows=number_slider,
    DisplayType="AO Types",
    ZLockFilter=False,
    OutputType="AO Types")

# ---- group: attractor point
# assign weights to heuristics
pt_7 = Point(Point(382.0823418, 168.60847, 0))

# ----
pt_8 = Point(flatten(heudex.TextBasePoints))
dist = Distance(PointA=pt_7, PointB=pt_8)
bnd = Bounds(Numbers=dist)
remap = RemapNumbers(Value=dist, Source=bnd, Target=Domain(0, 1))  # -> Mapped, Clipped
graph = GraphMapper(
    remap.Mapped,
    x0=0,
    x1=1,
    y0=0,
    y1=1,
    container_name="Bezier",
    cpx=[0, 0.387465328, 0.2114823908, 1],
    cpy=[1, 1, 0.07540494204, 0.06884586811])
# Weights can also be manually assigned or using any other association criteria.
# 
# This is just an example of an automated way of doing it.
multiplication = Multiplication(A=graph, B=Slider(100, range=0..100))

# ----
# Heuristics Weights must be integer numbers
int = Integer(multiplication)

wheu = WeighHeuristics(HeuristicsString=heuw, IntegerWeights=int)
Z = UnitZ(Factor=1)

# ---- group: environment control
environment = ValueList({"single mesh container": 0, "container + obstacles": 1, "obstacles only": 2}, selected="single mesh container")
resetex = Button()

# ----
# environment
# Containers can have any shape, but there can only be one during a simulation.
# 
# Obstacles can be as many as you want.
merge_7 = Merge(Data1=mbox, Data2=mbox_2)  # -> flatten(Result)
merge_8 = Merge(Data1=flip_4, Data2=mbox_4, Data3=mbox_5)  # -> flatten(Result)
merge_9 = Merge(Data1=flip_4, Data2=mbox_4, Data3=mbox_5)  # -> flatten(Result)
filter = StreamFilter(Gate=environment, Stream0=flip_3, Stream1=merge_8, Stream2=merge_7)

line = LineSDL(Start=pt_8, Direction=Z, Length=int)
weights = BarGraph(int, BarColor=RGB(255, 0, 90))

# ---- group: filter heuristics
heudex_2 = HeuristicsDisplayEx(OriginPoint=Point(0, 0, 0), AssemblyObjectsSet=data_2, HeuristicsString=wheu, XSize=1, YSize=1, NRows=10)  # -> AssemblyObjectPairs, CoherencePattern, HeuristicsStringTree, TextBasePoints, XData
cull = CullPattern(List=flatten(heudex_2.HeuristicsStringTree), CullPattern=flatten(heudex_2.CoherencePattern))

# ----
weighted_random_choice = Panel("7")
bnd_2 = Bounds(Numbers=line)
dedomain = DeconstructDomain(Domain=bnd_2)  # -> Start, End
reset = Button()
heuset = HeuristicsSettings(
    HeuristicsString=cull,
    CurrentHeuristics=0,
    HeuristicsMode=0,
    ReceiverSelectionMode=0,
    RuleSelectionMode=weighted_random_choice)
go = BooleanToggle(False)
step = Button()
max_objects = Panel("1000")
exoset = ExogeousSettings(
    EnvironmentMeshes=filter,
    EnvironmentMode=Slider(1, range=1..2),
    FieldScalarThreshold=0.5,
    Sandbox={Plane=PlaneXY(0, 0, 0), X=Domain(-1, 1), Y=Domain(0, 0), Z=Domain(0, 0)})
gradient = Gradient(
    LowerLimit=dedomain.Start,
    UpperLimit=dedomain.End,
    Parameter=line,
    stops=[0: RGB(21, 0, 33), 0.326: RGB(150, 66, 114), 0.664: RGB(224, 186, 187), 1: RGB(255, 255, 255)])
pt_9 = Point(Point(-129.8796384, 113.0177957, 0))
# 1 - simulate
xy_3 = XYPlane(Origin=pt_9)
previewlw = CustomPreviewLineweights(Geometry=line, Shader=gradient, Thickness=5, Absolute=False)

# ---- group: Assemblage Engine Xtended
aoengx = AssemblerEngineX(
    AssemblyObjectsSet=data_2,
    StartingPlane=xy_3,
    StartingObjectType=0,
    HeuristicsSettings=heuset,
    ExogenousSettings=exoset,
    Go=go,
    Step=step,
    NIterations=Slider(100, range=1..100),
    MaxNObjects=max_objects,
    ResetExogenous=resetex,
    Reset=reset,
    UseSupports=False,
    ZLockCheck=False)  # -> Assemblage, AssemblageCount

# ----
n_of_objects = Panel(aoengx.AssemblageCount)

# ---- group: auto-stop
larger = LargerThan(FirstNumber=aoengx.AssemblageCount, SecondNumber=max_objects)  # -> LargerThan, OrEqualTo
f_tas = ToggleAutostop(Toggle=go, Condition=larger.OrEqualTo)

# ---- group: weight distribution of applied rules
dam = DataDam(DataA=aoengx.Assemblage, BufferDelay=10000000, BufferMode=0)
aoadecon = DeconstructAssemblage(Assemblage=dam)  # -> AssemblageObjects, AssemblageRules, ReceiverObjectsIndexes, AvailableObjectIndexes, UnreachableObjectIndexes
split = TextSplit(Text=aoadecon.AssemblageRules, Separators="%")
item = ListItem(List=split, Index=0, Wrap=True)  # -> Item, flatten(Item1)
bar_graph = BarGraph(item.Item1, BarColor=RGB(255, 0, 90))

# ----
# 2 - analyze/post-process
aoadisp = DisplayAssemblage(Assemblage=aoengx.Assemblage, Bypass=False, OutputType="AO Types")  # -> ColoredCollisionMeshes, Edges, Colors

# ---- group: display "intermediate" geometries
aoadecon_2 = DeconstructAssemblage(Assemblage=aoengx.Assemblage)  # -> AssemblageObjects, AssemblageRules, ReceiverObjectsIndexes, AvailableObjectIndexes, UnreachableObjectIndexes
aoxd = AssociateXData(AssemblyObjects=aoadecon_2.AssemblageObjects, XData=data)
xddecon = DeconstructXData(XData=aoxd)  # -> Label, Data, ReferencePlane, AssemblyObjectNameReference
preview = CustomPreview(Geometry=xddecon.Data, Material=graft(aoadisp.Colors))

# ---- group: display components
mjoin = MeshJoin(Meshes=aoadisp.ColoredCollisionMeshes)
preview_2 = CustomPreview(Geometry=mjoin, Material=ColourSwatch(SwatchColor=RGB(255, 255, 255)))  # disabled

# ---- group: display components / display edges
previewlw_2 = CustomPreviewLineweights(Geometry=aoadisp.Edges, Shader=ColourSwatch(SwatchColor=RGB(0, 0, 0)), Thickness=Slider(1, range=1..3), Absolute=False)

# ----
panel = Panel(split)
concat_4 = Concatenate(FragmentA=name_2, FragmentB="_data")

xdcon_4 = ConstructXData(Label=concat_4, Data=crv_6, ReferencePlane=xy_2, AssemblyObjectNameReference=name_2)

# ---- group: XData - circulation path
# to pass Assembler data around, use the generic Data container
merge_10 = Merge(Data1=flatten(xdcon_4), Data2=flatten(xdcon_3))
data_3 = Data(merge_10)
