# Grasshopper definition 02-XX_Load AOs from ghData.gh (Grasshopper 1.0.7)
# Copyright: Co-de-iT
# plug-ins: Assembler

input = DataInput(
    Destination="C:\Users\aless\Documents\GitHub\a3_Co.De.S_2021-22\Assembler example files\02 - intermediate\AOs_2 objects setup.ghdata",
    RelativePath="C:\Users\aless\Documents\GitHub\a3_Co.De.S_2021-22\Assembler example files\02 - intermediate\AOs_2 objects setup.ghdata|AOs_2 objects setup.ghdata",
    UpdateDelay=50000)
heuw = HeuristicsWriter(AssemblyObjectsSet=input, noSH=False, noSO=False, xHT=False)
# Assembler
# 
# Framework for Iterative Assemblages workflow
# 
# code by Alessio Erioli
# 
# v 1.0
# © Co-de-iT 2021 / Creative Commons Attribution-Non Commercial-ShareAlike 4.0 International License
pt = Point(Point(0, 15, 0))
heud = HeuristicDisplay(
    OriginPoint=pt,
    AssemblyObjectsSet=input,
    HeuristicsString=heuw,
    XSize=1,
    YSize=1,
    NRows=10,
    DisplayType="AO Types",
    ZLockFilter=False)
