# Grasshopper definition 03-00_Fields - construct.gh (Grasshopper 1.0.7)
# Copyright: Co-de-iT
# plug-ins: Human, froGH, Assembler

xy = XYPlane(Origin="0,500,0")
Y = UnitY(Factor="500")
box = CenterBox(Base="0,0,0", X=Slider(94, range=1..200), Y=Slider(120, range=1..200), Z=Slider(85, range=1..200))
mesh = Mesh(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)
prot = RotatePlane(Plane=xy, Angle=Slider(1.2, range=0..3.142))
move = Move(Geometry=mesh, Motion=Y)  # -> Geometry, Transform
box_2 = CenterBox(Base=prot, X=Slider(94, range=1..200), Y=Slider(120, range=1..200), Z=Slider(85, range=1..200))
# Assembler
# 
# Framework for Iterative Assemblages workflow
# 
# code by Alessio Erioli
# 
# v 1.0
# © Co-de-iT 2021 / Creative Commons Attribution-Non Commercial-ShareAlike 4.0 International License
edges = BrepEdges(Brep=box)  # -> Naked, Interior, NonManifold
swatch = ColourSwatch(SwatchColor=RGB(0, 0, 0))
edges_2 = BrepEdges(Brep=box_2)  # -> Naked, Interior, NonManifold
f_mmeea = MeshesExtractEdgesWithToleranceAngle(Mesh=mesh, Angle="30")  # -> InternalEdges, NakedEdges
swatch_2 = ColourSwatch(SwatchColor=RGB(255, 255, 255))
f_mmeea_2 = MeshesExtractEdgesWithToleranceAngle(Mesh=move.Geometry, Angle="30")  # -> InternalEdges, NakedEdges
previewlw = CustomPreviewLineweights(Geometry=f_mmeea.InternalEdges, Shader=swatch, Thickness="3", Absolute=False)
previewlw_2 = CustomPreviewLineweights(Geometry=edges.Interior, Shader=swatch, Absolute=False)
list = ValueList({"Box": 0, "Mesh": 1}, selected="Box")
list_2 = ValueList({"Box": 0, "Mesh": 1}, selected="Box")
previewlw_3 = CustomPreviewLineweights(Geometry=f_mmeea_2.InternalEdges, Shader=swatch_2, Thickness="3", Absolute=False)
previewlw_4 = CustomPreviewLineweights(Geometry=edges_2.Interior, Shader=swatch_2, Absolute=False)
filter = StreamFilter(Gate=list, Stream0=box, Stream1=mesh)
filter_2 = StreamFilter(Gate=list_2, Stream0=box_2, Stream1=move.Geometry)
xy_2 = XYPlane(Origin=Point(0, 0, 0))
prot_2 = RotatePlane(Plane=xy_2, Angle=Slider(2.568, range=0..3.142))
afieldxyz = ConstructFieldXYZ(
    Geometry=filter_2,
    Plane=prot_2,
    NCellsX=Slider(10, range=10..30),
    NCellsY=Slider(13, range=10..30),
    NCellsZ=Slider(13, range=10..30))  # -> Field, FieldPoints
afieldn = ConstructFieldN(Geometry=filter, Plane=prot_2, NCells=Slider(15, range=10..30))  # -> Field, FieldPoints
panel = Panel(afieldn.Field)
panel_2 = Panel(afieldxyz.Field)
