# Grasshopper definition 03-01_Fields - populate.gh (Grasshopper 1.0.7)
# Copyright: Co-de-iT
# plug-ins: Human, Assembler, froGH

box = CenterBox(Base="0,0,0", X=Slider(94, range=1..200), Y=Slider(120, range=1..200), Z=Slider(85, range=1..200))

edges = BrepEdges(Brep=box)  # -> Naked, Interior, NonManifold
previewlw = CustomPreviewLineweights(Geometry=edges.Interior, Shader=ColourSwatch(SwatchColor=RGB(0, 0, 0)), Absolute=False)

# ----
# Assembler
# 
# Framework for Iterative Assemblages workflow
# 
# code by Alessio Erioli
# 
# v 1.0
# © Co-de-iT 2021 / Creative Commons Attribution-Non Commercial-ShareAlike 4.0 International License
list = ValueList({"space partition - coords": 0, "space partition - points": 1, "single point": 2, "multiple points": 3, "curve": 4, "multiple curves": 5, "surfaces/meshes": 6}, selected="space partition - coords")

# ---- group: empty field
afieldn = ConstructFieldN(Geometry=box, Plane=PlaneXY(0, 0, 0), NCells=Slider(15, range=10..30))  # -> Field, FieldPoints

# ----
panel = Panel(afieldn.Field)
gate = StreamGate(Stream=afieldn.FieldPoints, Gate=list)  # -> Target0, Target1, Target2, Target3, Target4, Target5, Target6
gate_2 = StreamGate(Stream=afieldn.Field, Gate=list)  # -> Target0, Target1, Target2, Target3, Target4, Target5, Target6

# ---- group: Empty Field
data = Data(gate_2.Target3)

# ---- group: Field Points
pt = Point(gate.Target3)

pt_2 = Point(gate.Target5)

# ---- group: Empty Field
data_2 = Data(gate_2.Target5)

data_3 = Data(gate_2.Target4)

# ---- group: Field Points
pt_3 = Point(gate.Target4)

# ---- group: multiple attractor points
pt_4 = Point(Point(-48.84849901, -75.02945501, -5.148424688))
pt_5 = Point(Point(-42.49842075, 73.73951069, -41.80343786))
pt_6 = Point(Point(68.60664749, -31.08153187, 43.23515265))
merge = Merge(Data1=pt_4, Data2=pt_6, Data3=pt_5)

# ---- group: Field Points
pt_7 = Point(gate.Target1)

# ---- group: Empty Field
data_4 = Data(gate_2.Target1)

# ---- group: polyline
crv = Curve(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)

# ---- group: smooth curve
crv_2 = Curve(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)

# ---- group: Empty Field
data_5 = Data(gate_2.Target0)

# ---- group: Field Points
pt_8 = Point(gate.Target0)

# ---- group: multiple curves
crv_3 = Curve([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])

# ---- group: multiple attractor points
pt_9 = Point(Point(-48.84849901, -75.02945501, -5.148424688))
pt_10 = Point(Point(-42.49842075, 73.73951069, -41.80343786))
pt_11 = Point(Point(68.60664749, -31.08153187, 43.23515265))
merge_2 = Merge(Data1=pt_9, Data2=pt_11, Data3=pt_10)

# ---- group: Empty Field
data_6 = Data(gate_2.Target2)

# ---- group: Field Points
pt_12 = Point(gate.Target2)

# ---- group: calculate vector
xprod = CrossProduct(VectorA=graft(pt), VectorB=merge, Unitize=True)  # -> Vector, Length
avr = Average(Input=xprod.Vector)  # -> flatten(ArithmeticMean)
unit = UnitVector(Vector=avr)

# ---- group: calculate scalar
dist = Distance(PointA=graft(pt), PointB=merge)
log = Logarithm(Value=dist)
avr_2 = Average(Input=log)  # -> flatten(ArithmeticMean)

# ---- group: Empty Field
data_7 = Data(gate_2.Target6)

# ---- group: Field Points
pt_13 = Point(gate.Target6)

# ---- group: attractor curve
crv_4 = Curve(crv_2)
previewlw_2 = CustomPreviewLineweights(Geometry=crv_4, Shader=ColourSwatch(SwatchColor=RGB(255, 0, 0)), Thickness="5", Absolute=False)

# ---- group: attractor curves
crv_5 = Curve(crv_3)
previewlw_3 = CustomPreviewLineweights(Geometry=crv_5, Shader=ColourSwatch(SwatchColor=RGB(32, 20, 140)), Thickness="5", Absolute=False)

# ---- group: single attractor point
pt_14 = Point(Point(-4.544887498, 33.05572667, -2.639582865))

# ---- group: 1 vector for each attractor point
X = UnitX(Factor=1)
Y = UnitY(Factor=1)
Z = UnitZ(Factor=1)
merge_3 = Merge(Data1=X, Data2=Y, Data3=Z)

# ---- group: geometry
geo = Geometry(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)
geo_2 = Geometry(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)
geo_3 = Geometry(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)

# ---- group: calculate scalar
crv_cp = CurveClosestPoint(Point=graft(pt_2), Curve=crv_5)  # -> Point, Parameter, Distance

# ---- group: modulate values
num = Number(avr_2)
bnd = Bounds(Numbers=num)
remap = RemapNumbers(Value=num, Source=bnd, Target=Domain(0, 1))  # -> Mapped, Clipped
graph = GraphMapper(
    remap.Mapped,
    x0=0,
    x1=1,
    y0=0,
    y1=1,
    container_name="Bezier",
    cpx=[0, 0.5385872126, 0.5452620983, 1],
    cpy=[0, 0.1508975029, 0.5873855352, 1])

# ----
# 3 - multiple points
panel_2 = Panel("3")
dots = DotDisplay(Point=merge, Colour=RGB(0, 0, 0), Size=panel_2)
afpop = PopulateField(Field=data, ScalarValues=graph, VectorValues=unit)

# ---- group: calculate scalar
crv_cp_2 = CurveClosestPoint(Point=pt_3, Curve=crv_4)  # -> Point, Parameter, Distance

# ---- group: calculate vector
eval = EvaluateCurve(Curve=crv_4, Parameter=crv_cp_2.Parameter)  # -> Point, Tangent, Angle

# ----
# 4 - curve
afpop_2 = PopulateField(Field=data_3, ScalarValues=crv_cp_2.Distance, VectorValues=eval.Tangent)

multiple_curves = ColourSwatch(SwatchColor=RGB(118, 106, 222))
surfaces_meshes = ColourSwatch(SwatchColor=RGB(22, 148, 186))

# ---- group: data color
partition = ColourSwatch(SwatchColor=RGB(255, 255, 255))
single_point = ColourSwatch(SwatchColor=RGB(170, 255, 0))
multiple_points = ColourSwatch(SwatchColor=RGB(255, 212, 0))
curve = ColourSwatch(SwatchColor=RGB(255, 0, 0))
filter = StreamFilter(
    Gate=list,
    Stream0=partition,
    Stream1=partition,
    Stream2=single_point,
    Stream3=multiple_points,
    Stream4=curve,
    Stream5=multiple_curves,
    Stream6=surfaces_meshes)

# ----
# 0 - space partition - by coordinate
z_threshold = Slider(-29.229, range=-1000..1000)
pdecon = Deconstruct(Point=pt_8)  # -> XComponent, YComponent, ZComponent

# ---- group: allocate vectors
larger = LargerThan(FirstNumber=pdecon.ZComponent, SecondNumber=z_threshold)  # -> LargerThan, OrEqualTo
X_2 = UnitX(Factor=1)
Z_2 = UnitZ(Factor=1)
merge_4 = Merge(Data1=X_2, Data2=Z_2)
item = ListItem(List=merge_4, Index=larger.LargerThan, Wrap=True)
unit_2 = UnitVector(Vector=item)

# ---- group: allocate scalars
scalar_values_to_allocate = Panel("""0
1""")
item_2 = ListItem(List=scalar_values_to_allocate, Index=larger.LargerThan, Wrap=True)

# ----
afpop_3 = PopulateField(Field=data_5, ScalarValues=item_2, VectorValues=unit_2)

# ----
# 1 - space partition - by points
# get the scalar and vector value corresponding to the closest attractor point
# scalar and vector values number must equal the number of points:
# 
# . 3 points> 3 scalars, 3 vectors
# . 4 points > 4 scalars, 4 vectors
# 
# etc.
panel_3 = Panel("3")
dots_2 = DotDisplay(Point=merge_2, Colour=RGB(0, 0, 0), Size=panel_3)
scalar_values_to_allocate_2 = Panel("""0
1
2""")
dist_2 = Distance(PointA=graft(pt_7), PointB=merge_2)

sort = SortList(Keys=dist_2, ValuesA=scalar_values_to_allocate_2, ValuesB=merge_3)  # -> Keys, ValuesA, ValuesB
item_3 = ListItem(List=sort.ValuesB, Index=0, Wrap=True)  # -> flatten(Item)

item_4 = ListItem(List=sort.ValuesA, Index=0, Wrap=True)  # -> flatten(Item)
afpop_4 = PopulateField(Field=data_4, ScalarValues=item_4, VectorValues=item_3)

# ----
# 2 - single point
swatch = ColourSwatch(SwatchColor=RGB(154, 232, 9))
dots_3 = DotDisplay(Point=pt_14, Colour=swatch, Size="3")
vec2pt = Vector2Pt(PointA=pt_12, PointB=pt_14, Unitize=False)  # -> Vector, Length

# ---- group: calculate vectors
Z_3 = UnitZ(Factor=1)
xprod_2 = CrossProduct(VectorA=vec2pt.Vector, VectorB=Z_3, Unitize=True)  # -> Vector, Length
unit_3 = UnitVector(Vector=xprod_2.Vector)

# ----
afpop_5 = PopulateField(Field=data_6, ScalarValues=vec2pt.Length, VectorValues=unit_3)

# ----
# 5 - multiple curves
f_ifroml = IndexesFromList(Data=crv_5)
sort_2 = SortList(Keys=crv_cp.Distance, ValuesA=f_ifroml, ValuesB=crv_cp.Parameter)  # -> Keys, ValuesA, ValuesB
item_5 = ListItem(List=sort_2.Keys, Index=0, Wrap=True)  # -> flatten(Item)
item_6 = ListItem(List=sort_2.ValuesB, Index=0, Wrap=True)
item_7 = ListItem(List=sort_2.ValuesA, Index=0, Wrap=True)
item_8 = ListItem(List=crv_5, Index=item_7, Wrap=True)

# ---- group: calculate vector
eval_2 = EvaluateCurve(Curve=item_8, Parameter=item_6)  # -> Point, flatten(Tangent), Angle

# ----
afpop_6 = PopulateField(Field=data_2, ScalarValues=item_5, VectorValues=eval_2.Tangent)

# ----
# 6 - surfaces, polysurfaces, meshes
swatch_2 = ColourSwatch(SwatchColor=RGBA(255, 255, 255, 75))
geo_4 = Geometry(geo)

preview = CustomPreview(Geometry=geo_4, Material=swatch_2)

# ---- group: signed/unsigned distance field
cluster = Cluster(field_points=pt_13, geometry=geo_4)  # -> unsigned_values, signed_values, tangent_vectors

# ----
afpop_7 = PopulateField(Field=data_7, ScalarValues=cluster.unsigned_values, VectorValues=cluster.tangent_vectors)

# ---- group: Field
filter_2 = StreamFilter(
    Gate=list,
    Stream0=afpop_3,
    Stream1=afpop_4,
    Stream2=afpop_5,
    Stream3=afpop,
    Stream4=afpop_2,
    Stream5=afpop_6,
    Stream6=afpop_7)

# ---- group: display Field
# Try the threshold slider and blend option (right click on component) with each scenario and see how they affect display
number_slider = Slider(0.25, range=0..1)
merge_5 = Merge(Data1=filter, Data2=ColourSwatch(SwatchColor=RGB(0, 0, 0)))
afcols = ColorFieldByScalar(Field=filter_2, Colors=merge_5, Index=0, Threshold=number_slider, FieldValueBlend=False)  # -> Field, Colors

# ---- group: Field for Assemblage
data_8 = Data(afcols.Field)

# ----
afdecon = DeconstructField(Field=data_8)  # -> Points, ScalarValues, Vectors, IWeights, Colors

# ---- group: display field vectors
vector_scale = Slider(5.568, range=1..10)
vec = Vector(flatten(afdecon.Vectors))
multiplication = Multiplication(A=vec, B=vector_scale)
unit_4 = UnitVector(Vector=multiplication)
vdisex = VectorDisplayEx(Point=afdecon.Points, Vector=multiplication, Colour=unit_4, Width=2)

# ----
vector_values = Panel(afdecon.Vectors)
iweight_values = Panel(afdecon.IWeights)
color_values = Panel(afdecon.Colors)
points = Panel(afdecon.Points)
scalar_values = Panel(afdecon.ScalarValues)

# ==== cluster Cluster
geometry = ClusterInput()  # Surfaces, polysurfaces or meshes
field_points = ClusterInput()
pull = PullPoint(Point=field_points, Geometry=geometry, ClosestOnly=True)  # -> ClosestPoint, Distance
mesh = Mesh(geometry)
meshcp = MeshClosestPoint(Point=pull.ClosestPoint, Mesh=mesh)  # -> Point, Index, Parameter
num = Number(pull.Distance)
meval = MeshEval(Mesh=mesh, Parameter=meshcp.Parameter)  # -> Point, Normal, Colour
bnd = Bounds(Numbers=num)
remap = RemapNumbers(Value=num, Source=bnd, Target=Domain(0, 1))  # -> Mapped, Clipped
vec2pt = Vector2Pt(PointA=field_points, PointB=meval.Point, Unitize=False)  # -> Vector, Length
xprod = CrossProduct(VectorA=vec2pt.Vector, VectorB=meval.Normal, Unitize=False)  # -> Vector, Length
angle = Angle(VectorA=vec2pt.Vector, VectorB=meval.Normal)  # -> Angle, Reflex
larger = LargerThan(FirstNumber=angle.Angle, SecondNumber="Pi*0.5")  # -> LargerThan, OrEqualTo
int = Integer(larger.LargerThan)
expression = Expression(y=remap.Mapped, x=int, Expression="y*2*(x-0.5)")
unit = UnitVector(Vector=xprod.Vector)
unsigned_values = ClusterOutput(remap.Mapped)
tangent_vectors = ClusterOutput(unit)
signed_values = ClusterOutput(expression)
