# Grasshopper definition 03-03_Fields - populate iWeights multiple zones.gh (Grasshopper 1.0.7)
# Copyright: Co-de-iT
# plug-ins: Assembler, Human, froGH

# ---- group: zone 1
pt = Point(Point(-93.58108481, 303.0405901, -15.28655841))
box = CenterBox(Base=pt, X=Slider(49.753, range=1..200), Y=Slider(59.725, range=1..200), Z=Slider(51.753, range=1..200))
mbox = MeshBox(Base=box, XCount="1", YCount="1", ZCount="1")

# ---- group: zone 2
pt_2 = Point(Point(-189.779253, 287.7363361, 32.6925056))
box_2 = CenterBox(Base=pt_2, X=Slider(32.838, range=1..200), Y=Slider(59.725, range=1..200), Z=Slider(34.838, range=1..200))
mbox_2 = MeshBox(Base=box_2, XCount="1", YCount="1", ZCount="1")

# ---- group: zone 0
pt_3 = Point(Point(-158.4726811, 157.9892994, 0))
box_3 = CenterBox(Base=pt_3, X=Slider(74.992, range=1..200), Y=Slider(47.473, range=1..200), Z=Slider(77.506, range=1..200))
mbox_3 = MeshBox(Base=box_3, XCount="1", YCount="1", ZCount="1")

# ---- group: container for Field
# Assembler
# 
# Framework for Iterative Assemblages workflow
# 
# code by Alessio Erioli
# 
# v 1.0
# © Co-de-iT 2021 / Creative Commons Attribution-Non Commercial-ShareAlike 4.0 International License
pt_4 = Point(Point(-140.2744565, 231.4122939, 0))
box_4 = CenterBox(Base=pt_4, X=Slider(100, range=1..200), Y=Slider(140, range=1..200), Z=Slider(85, range=1..200))

# ----
zone_0 = ColourSwatch(SwatchColor=RGB(0, 0, 0))
medges = MeshEdges(Mesh=box_4)  # -> NakedEdges, InteriorEdges, NonManifoldEdges
afieldn = ConstructFieldN(Geometry=box_4, Plane=PlaneXY(0, 0, 0), NCells="15")  # -> Field, FieldPoints
previewlw = CustomPreviewLineweights(Geometry=medges.InteriorEdges, Shader=zone_0, Thickness="3", Absolute=False)
merge = Merge(Data1=mbox_3, Data2=mbox, Data3=mbox_2)

# ---- group: zones colors
zone_1 = ColourSwatch(SwatchColor=RGB(255, 170, 0))
zone_2 = ColourSwatch(SwatchColor=RGB(32, 161, 66))
zone_3 = ColourSwatch(SwatchColor=RGB(0, 102, 255))
merge_2 = Merge(Data1=zone_1, Data2=zone_2, Data3=zone_3)

# ----
medges_2 = MeshEdges(Mesh=merge)  # -> NakedEdges, InteriorEdges, NonManifoldEdges

# ---- group: Mesh inclusion
minc = MeshInclusion(Mesh=merge, Point=graft(afieldn.FieldPoints), Strict=False)

# ----
previewlw_2 = CustomPreviewLineweights(Geometry=medges_2.InteriorEdges, Shader=graft(merge_2), Thickness="3", Absolute=False)

# ---- group: find mesh index and replace null/empty branches with -1
# Mesh inclusion will return True if the point is inside a Mesh, False otherwise.
# 
# Each point is compared with all sub-volume meshes, and the True/False pattern is used to filter the corresponding mesh index.
# 
# If a field point is not included in any of the sub-volume zones, its values will be all false and the resulting branch will be empty.
# 
# In this case, this part of the definition catches the empty branches and replaces them with a value of -1.
# 
# The final result is a list of indices, used to pick the appropriate value from the list of iWeights below.
f_ifroml = IndexesFromList(Data=minc)
cull = CullPattern(List=f_ifroml, CullPattern=minc)
null = NullItem(Item=cull)  # -> NullFlags, InvalidFlags, Description
weave = Weave(Pattern=null.NullFlags, Stream0=cull, Stream1="-1", NullGaps=False)  # -> flatten(Weave)

# ----
# iWeights: iWeights control the Heuristic Set used.
# 
# The last number in the list is the iWeight assigned to the points that do not belong to any of the sub-volumes (index -1).
# 
# Change the Heuristics set iWeights to fit your use case.
# 
# The color below is added to highlight the iWeight text in these "interzones".
iweights = Panel("""1
2
3
0""")

zone_0_2 = ColourSwatch(SwatchColor=RGB(0, 0, 0))
merge_3 = Merge(Data1=merge_2, Data2=zone_0_2)

# ----
# When Wrap is set to True, -1 corresponds to the last item in the list
panel = Panel("True")
item = ListItem(List=iweights, Index=weave, Wrap=panel)
item_2 = ListItem(List=merge_3, Index=weave, Wrap=True)

# ---- group: Populate Field (scalars, vectors)
afpop = PopulateField(Field=afieldn.Field, IWeightValues=item)

# ---- group: deconstruct field
afdecon = DeconstructField(Field=afpop)  # -> Points, ScalarValues, Vectors, flatten(IWeights), Colors

# ----
tag = TextTag3D(Location=afdecon.Points, Text=afdecon.IWeights, Size=Slider(3, range=1..3), Colour=item_2, Justification=7)
