# Grasshopper definition 04-01_base 2 Objects_Assemblage - E-F - save animation.gh (Grasshopper 1.0.7)
# Copyright: Co-de-iT
# plug-ins: Assembler, froGH, Human, EleFront

# ---- group: obstacle
pt = Point(Point(-122.3339923, 282.1586602, 0))
box = CenterBox(Base=pt, X=Slider(24, range=1..200), Y=Slider(9, range=1..200), Z=Slider(26, range=1..200))
mbox = MeshBox(Base=box, XCount="1", YCount="1", ZCount="1")

pt_2 = Point(Point(-158.4726811, 157.9892994, 0))
box_2 = CenterBox(Base=pt_2, X=Slider(11, range=1..200), Y=Slider(22.5, range=1..200), Z=Slider(26, range=1..200))
mbox_2 = MeshBox(Base=box_2, XCount="1", YCount="1", ZCount="1")

# ---- group: container
# environment
pt_3 = Point(Point(-140.2744565, 231.4122939, 0))
box_3 = CenterBox(Base=pt_3, X=Slider(100, range=1..200), Y=Slider(140, range=1..200), Z=Slider(85, range=1..200))
mbox_3 = MeshBox(Base=box_3, XCount="1", YCount="1", ZCount="1")

# ---- group: type 2
crv = Curve([<curve referenced from the Rhino model> x2])

# ---- group: type 1
# 0 - construct
crv_2 = Curve([<curve referenced from the Rhino model> x3])

# ---- group: container for Field
# field
number_slider = Slider(85, range=1..200)
pt_4 = Point(Point(-140.2744565, 231.4122939, 0))
box_4 = CenterBox(Base=pt_4, X=Slider(100, range=1..200), Y=Slider(140, range=1..200), Z=number_slider)

# ---- group: type 2
crv_3 = Curve([<curve referenced from the Rhino model> x2])

# ---- group: type 1
crv_4 = Curve([<curve referenced from the Rhino model> x4])

# ----
rotations = Panel("""0
180""")
lng = ListLength(List=crv)
lng_2 = ListLength(List=crv)
repeat = RepeatData(Data=graft(rotations), Length=lng_2)
repeat_2 = RepeatData(Data="2", Length=lng)
flip = FlipMatrix(Data=repeat)  # -> simplify(Data)

# ----
# Assembler
# 
# Framework for Iterative Assemblages workflow
# 
# code by Alessio Erioli
# 
# v 1.0
# © Co-de-iT 2021 / Creative Commons Attribution-Non Commercial-ShareAlike 4.0 International License
rotations_2 = Panel("""0
90
180""")
lng_3 = ListLength(List=crv_2)
lng_4 = ListLength(List=crv_2)
repeat_3 = RepeatData(Data=graft(rotations_2), Length=lng_3)
repeat_4 = RepeatData(Data="1", Length=lng_4)
flip_2 = FlipMatrix(Data=repeat_3)  # -> simplify(Data)

lng_5 = ListLength(List=crv_4)
rotations_3 = Panel("""0
90
180""")
lng_6 = ListLength(List=crv_4)
repeat_5 = RepeatData(Data="1", Length=lng_5)
repeat_6 = RepeatData(Data=graft(rotations_3), Length=lng_6)
flip_3 = FlipMatrix(Data=repeat_6)  # -> simplify(Data)

rotations_4 = Panel("""0
180""")
lng_7 = ListLength(List=crv_3)
lng_8 = ListLength(List=crv_3)
repeat_7 = RepeatData(Data=graft(rotations_4), Length=lng_7)
repeat_8 = RepeatData(Data="2", Length=lng_8)
flip_4 = FlipMatrix(Data=repeat_7)  # -> simplify(Data)

# ---- group: single container
mesh = Mesh(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)

# ---- group: container
# flip normals: A container must have normals pointing inward
flipm = FlipMesh(Mesh=mbox_3, VertexNormals=True, FaceNormals=True, FaceOrientation=True)

# ---- group: polyline
crv_5 = Curve(<curve referenced from the Rhino model>)

# ---- group: smooth curve
crv_6 = Curve(<curve referenced from the Rhino model>)

# ---- group: multiple lines
# field from multiple curves
# There are more ways to populate a field than just using a single curve: you can also use points, multiple curves, surfaces and Breps.
# 
# See example file:
# 
# 03-01_Fields - populate.gh
crv_7 = Curve([<curve referenced from the Rhino model> x3])

# ---- group: set box as environment container
smesh = SimpleMesh(Brep=box_4)
flipm_2 = FlipMesh(Mesh=smesh, VertexNormals=True, FaceNormals=True, FaceOrientation=True)

# ---- group: Create Handles
handles = ConstructHandles(Polyline=crv, RotationAngles=flip, Type=repeat_2)

# ---- group: single container
# flip normals: A container must have normals pointing inward
flipm_3 = FlipMesh(Mesh=mesh, VertexNormals=True, FaceNormals=True, FaceOrientation=True)

# ---- group: Create Handles
handles_2 = ConstructHandles(Polyline=crv_4, RotationAngles=flip_3, Type=repeat_5)

handles_3 = ConstructHandles(Polyline=crv_3, RotationAngles=flip_4, Type=repeat_8)

handles_4 = ConstructHandles(Polyline=crv_2, RotationAngles=flip_2, Type=repeat_4)

# ----
merge = Merge(Data1=flipm, Data2=mbox_2, Data3=mbox)  # -> flatten(Result)

merge_2 = Merge(Data1=handles_2, Data2=handles_3)
merge_3 = Merge(Data1=handles_4, Data2=handles)

mesh_2 = Mesh(<mesh referenced from the Rhino model>)

# ---- group: Display Handles
handdisp = DisplayHandle(Handles=merge_3, DisplaySize=Slider(0.1, range=0..0.5), absHTextSize=False)

handdisp_2 = DisplayHandle(Handles=merge_2, DisplaySize=Slider(0.1, range=0..0.5), absHTextSize=False)

# ---- group: v2 - vertical
# "Intermediate" geometry: Fast mesh representation of actual geometry - derived from the BRep. Check if Fast Mesh is good enough, otherwise:
# . either play with meshing parameters to get a good quality/speed compromise
# . model a mesh geometry in Rhino to use as representative
mesh_3 = Mesh(<mesh referenced from the Rhino model>)

# ---- group: v1 - horizontal
mesh_4 = Mesh(<mesh referenced from the Rhino model>)

# ----
mesh_5 = Mesh(<mesh referenced from the Rhino model>)
volume = Volume(Geometry=mesh_5)  # -> Volume, Centroid
name = Panel("typeB")
xy = XYPlane(Origin=volume.Centroid)
X = UnitX(Factor=1)

mesh_6 = Mesh(<mesh referenced from the Rhino model>)
volume_2 = Volume(Geometry=mesh_6)  # -> Volume, Centroid
name_2 = Panel("typeA")
xy_2 = XYPlane(Origin=volume_2.Centroid)
X_2 = UnitX(Factor=1)

# ----
# A scalar field generated using the distance from a geometry (ex. a curve - in white) will create a distribution that has isosurfaces that are like "onion skins" around that geometry.
# 
# A threshold between 0-1 identifies one of those "onion skins" (in green); Assembler will try to place objects as close as possible to that "onion skin" (red zones).
panel = Panel("_geometry")
concat = Concatenate(FragmentA=name, FragmentB=panel)
xdcon = ConstructXData(Label=concat, Data=mesh_2, ReferencePlane=xy, AssemblyObjectNameReference=name)

merge_4 = Merge(Data1=mesh_4, Data2=mesh_3)

concat_2 = Concatenate(FragmentA=name_2, FragmentB="_geometry")
xdcon_2 = ConstructXData(Label=concat_2, Data=merge_4, ReferencePlane=xy_2, AssemblyObjectNameReference=name_2)

# ---- group: circulation path
crv_8 = Curve([<curve referenced from the Rhino model> x11])

crv_9 = Curve([<curve referenced from the Rhino model> x11])

# ----
concat_3 = Concatenate(FragmentA=name, FragmentB="_data")
xdcon_3 = ConstructXData(Label=concat_3, Data=crv_9, ReferencePlane=xy, AssemblyObjectNameReference=name)

# ---- group: Create AssemblyObject
aocon = ConstructAssemblyObject(Name=name_2, CollisionMesh=mesh_6, ReferencePlane=xy_2, Direction=X_2, Weight="1.0", Handles=merge_3, ZLockAO=False)

aocon_2 = ConstructAssemblyObject(Name=name, CollisionMesh=mesh_5, ReferencePlane=xy, Direction=X, Weight="1.0", Handles=merge_2, ZLockAO=False)

# ---- group: XData - geometries
merge_5 = Merge(Data1=flatten(xdcon_2), Data2=flatten(xdcon))
data = Data(merge_5)

# ---- group: AssemblyObjects
# AO set: With more than one AssemblyObject, just build a list with the Merge component
merge_6 = Merge(Data1=flatten(aocon), Data2=flatten(aocon_2))
data_2 = Data(merge_6)

# ----
environment = ValueList({"single mesh container": 0, "container + obstacles": 1, "field container": 2, "field + obstacles": 3}, selected="container + obstacles")
resetex = Button()

# ----
# Containers can have any shape, but there can only be one during a simulation.
# 
# Obstacles can be as many as you want.
merge_7 = Merge(Data1=flipm_2, Data2=mbox_2, Data3=mbox)  # -> flatten(Result)
filter = StreamFilter(Gate=environment, Stream0=flipm_3, Stream1=merge, Stream2=flipm_2, Stream3=merge_7)

go = BooleanToggle(False)
step = Button()
max_objects = Panel("200")
reset = Button()

heuw = HeuristicsWriter(AssemblyObjectsSet=data_2, noSH=False, noSO=False, xHT=False)
cell_size = Slider(1.2, range=1..2)

panel_2 = Panel(heuw)
pt_5 = Point(Point(-140.8710125, 214.0670038, 0))
# 1 - simulate
xy_3 = XYPlane(Origin=pt_5)

# ---- group: filter heuristics
heudex = HeuristicsDisplayEx(OriginPoint=Point(0, 0, 0), AssemblyObjectsSet=data_2, HeuristicsString=heuw, XSize=1, YSize=1, NRows=10)  # -> AssemblyObjectPairs, CoherencePattern, HeuristicsStringTree, TextBasePoints, XData
cull = CullPattern(List=flatten(heudex.HeuristicsStringTree), CullPattern=flatten(heudex.CoherencePattern))

# ----
selrec = ValueList({"random": 0, "scalar field": 1, "scalar field acc": 2, "dense packing (SLOW)": 3}, selected="scalar field acc")
heuristics_mode = ValueList({"manual": 0, "field driven": 1}, selected="manual")
selrule = ValueList({"random": 0, "scalar field": 1, "scalar field acc": 2, "vector field": 3, "vector field acc": 4, "min locl bb vol": 5, "min loc bb diag": 6}, selected="vector field acc")
heuset = HeuristicsSettings(
    HeuristicsString=cull,
    CurrentHeuristics=Slider(0, range=0..3),
    HeuristicsMode=heuristics_mode,
    ReceiverSelectionMode=selrec,
    RuleSelectionMode=selrule)

# ---- group: base point
pt_6 = Point(Point(0, 20, 0))

# ---- group: capture animation
# The directory MUST already exist
directory_name = Panel("animation\")

# ----
# field from single curve
number_slider_2 = Slider(15, range=10..30)
crv_10 = Curve(crv_6)
list = ValueList({"by curve tangent": 0, "by threshold": 1}, selected="by threshold")

# ---- group: Construct Field
afieldn = ConstructFieldN(Geometry=box_4, Plane=PlaneXY(0, 0, 0), NCells=number_slider_2)  # -> Field, FieldPoints

# ---- group: calculate vector by coordinate threshold
pdecon = Deconstruct(Point=afieldn.FieldPoints)  # -> XComponent, YComponent, ZComponent
bnd = Bounds(Numbers=pdecon.YComponent)
remap = RemapNumbers(Value=Slider(0.457, range=0..1), Source=Domain(0, 1), Target=bnd)  # -> Mapped, Clipped
smaller = SmallerThan(FirstNumber=pdecon.YComponent, SecondNumber=remap.Mapped)  # -> SmallerThan, OrEqualTo
Y = UnitY(Factor=1)
Z = UnitZ(Factor=1)
weave = Weave(Pattern=graft(smaller.SmallerThan), Stream0=Y, Stream1=Z, NullGaps=False)  # -> flatten(Weave)

# ---- group: calculate scalar
crv_cp = CurveClosestPoint(Point=afieldn.FieldPoints, Curve=crv_10)  # -> Point, Parameter, Distance

# ---- group: calculate vector from curve tangent
eval = EvaluateCurve(Curve=crv_10, Parameter=crv_cp.Parameter)  # -> Point, Tangent, Angle

# ----
filter_2 = StreamFilter(Gate=list, Stream0=eval.Tangent, Stream1=weave)
afpop = PopulateField(Field=afieldn.Field, ScalarValues=crv_cp.Distance, VectorValues=filter_2)

# ----
# vectors in this case are calculated as closest curve tangent vectors
crv_11 = Curve(crv_7)
f_ifroml = IndexesFromList(Data=crv_11)

# ---- group: calculate scalar
crv_cp_2 = CurveClosestPoint(Point=graft(afieldn.FieldPoints), Curve=crv_11)  # -> Point, Parameter, Distance

# ----
concat_4 = Concatenate(FragmentA=name_2, FragmentB="_data")

xdcon_4 = ConstructXData(Label=concat_4, Data=crv_8, ReferencePlane=xy_2, AssemblyObjectNameReference=name_2)

# ---- group: XData
# to pass Assembler data around, use the generic Data container
merge_8 = Merge(Data1=flatten(xdcon_4), Data2=flatten(xdcon_3))
data_3 = Data(merge_8)

# ----
merge_9 = Merge(Data1=data_3, Data2=data)

# ---- group: Heuristics Display
heud = HeuristicDisplay(
    OriginPoint=pt_6,
    AssemblyObjectsSet=data_2,
    XData=merge_9,
    HeuristicsString=cull,
    XSize=cell_size,
    YSize=cell_size,
    NRows=Slider(16, range=10..50),
    DisplayType="AO Types",
    ZLockFilter=False)

# ----
sort = SortList(Keys=crv_cp_2.Distance, ValuesA=f_ifroml, ValuesB=crv_cp_2.Parameter)  # -> Keys, ValuesA, ValuesB
item = ListItem(List=sort.Keys, Index=0, Wrap=True)  # -> flatten(Item)
item_2 = ListItem(List=sort.ValuesB, Index=0, Wrap=True)
item_3 = ListItem(List=sort.ValuesA, Index=0, Wrap=True)
item_4 = ListItem(List=crv_11, Index=item_3, Wrap=True)

# ---- group: calculate vector
eval_2 = EvaluateCurve(Curve=item_4, Parameter=item_2)  # -> Point, flatten(Tangent), Angle

# ----
afpop_2 = PopulateField(Field=afieldn.Field, ScalarValues=item, VectorValues=eval_2.Tangent)

environment_mode = ValueList({"none": 0, "collision": 1, "inclusion": 2}, selected="inclusion")
field = ValueList({"single curve": 0, "multiple lines": 1}, selected="multiple lines")
number_slider_3 = Slider(0.13, range=0..1)

# ---- group: display geometry
filter_3 = StreamFilter(Gate=field, Stream0=crv_10, Stream1=crv_11)
previewlw = CustomPreviewLineweights(Geometry=filter_3, Shader=ColourSwatch(SwatchColor=RGB(255, 0, 161)), Thickness="5", Absolute=False)

# ---- group: display Field / Threshold from Exogenous Settings
num = Number(number_slider_3)

# ---- group: display Field
merge_10 = Merge(Data1=ColourSwatch(SwatchColor=RGB(255, 212, 0)), Data2=ColourSwatch(SwatchColor=RGB(130, 130, 130)))
# choose and display field
filter_4 = StreamFilter(Gate=field, Stream0=afpop, Stream1=afpop_2)
afcol = ColorField(Field=filter_4, Colors=merge_10, Index=0, Threshold=num, FieldValueBlend=False)  # -> Field, Colors
afdecon = DeconstructField(Field=afcol.Field)  # -> Points, ScalarValues, Vectors, IWeights, Colors

# ---- group: display Field / display Field vectors
multiplication = Multiplication(A=flatten(afdecon.Vectors), B=Slider(6.539, range=1..10))
unit = UnitVector(Vector=multiplication)
vdisex = VectorDisplayEx(Point=afieldn.FieldPoints, Vector=multiplication, Colour=unit, Width=2)

# ---- group: display Field / Field for Assemblage
data_4 = Data(afcol.Field)

# ----
exoset = ExogenousSettings(
    EnvironmentMeshes=filter,
    EnvironmentMode=environment_mode,
    Field=data_4,
    FieldScalarThreshold=number_slider_3,
    Sandbox={Plane=PlaneXY(0, 0, 0), X=Domain(-1, 1), Y=Domain(0, 0), Z=Domain(0, 0)})

# ---- group: Assemblage Engine Xtended
aoengx = AssemblerEngineX(
    AssemblyObjectsSet=data_2,
    StartingPlane=xy_3,
    StartingObjectType="1",
    HeuristicsSettings=heuset,
    ExogenousSettings=exoset,
    Go=go,
    Step=step,
    NIterations=Slider(20, range=10..100),
    MaxNObjects=max_objects,
    ResetExogenous=resetex,
    Reset=reset,
    UseSupports=False,
    ZLockCheck=False)  # -> Assemblage, AssemblageCount

# ----
n_of_objects = Panel(aoengx.AssemblageCount)

# ---- group: auto-stop
larger = LargerThan(FirstNumber=aoengx.AssemblageCount, SecondNumber=max_objects)  # -> LargerThan, OrEqualTo
f_tas = ToggleAutostop(Toggle=go, Condition=larger.OrEqualTo)

# ----
aoadecon = DeconstructAssemblage(Assemblage=aoengx.Assemblage)  # -> AssemblageObjects, AssemblageRules, ReceiverObjectsIndexes, AvailableObjectIndexes, UnreachableObjectIndexes
# 2 - analyze/post-process
aoadisp = DisplayAssemblage(Assemblage=aoengx.Assemblage, Bypass=False, OutputType="AO Types")  # -> ColoredCollisionMeshes, Edges, Colors

# ---- group: display components
mjoin = MeshJoin(Meshes=aoadisp.ColoredCollisionMeshes)
preview = CustomPreview(Geometry=mjoin, Material=ColourSwatch(SwatchColor=RGB(255, 255, 255)))  # disabled

# ---- group: display components / display edges
previewlw_2 = CustomPreviewLineweights(Geometry=aoadisp.Edges, Shader=ColourSwatch(SwatchColor=RGB(0, 0, 0)), Thickness=Slider(1, range=1..3), Absolute=False)

# ---- group: data dam
dam = DataDam(DataA=aoadecon.AssemblageObjects, BufferDelay=10000000, BufferMode=0)

# ---- group: Extract AO Type
aotype = ExtractType(AssemblyObject=dam)

# ---- group: type boolean pattern
# 1 - generate boolean pattern
# (mask)
aotype_2 = ExtractType(AssemblyObject=aoadecon.AssemblageObjects)
# boolean pattern (mask): generate a true/false pattern (or mask) to filter data belonging to a target type
target_type = Panel("0")
equals = Equality(FirstNumber=aotype_2, SecondNumber=target_type)  # -> graft(Equality), Inequality

# ---- group: objects statistics
aoset = ExtractAOSet(Assemblage=aoengx.Assemblage)
f_ifroml_2 = IndexesFromList(Data=aoset)
mindex = MemberIndex(Set=aotype_2, Member=f_ifroml_2)  # -> Index, Count
expression = Expression(x=f_ifroml_2, y=mindex.Count, Expression="Format(\"type {0}: {1}\", x, y)")
pt_7 = Point(Point(-218.075651, 73.00729024, 0))
join = TextJoin(Text=expression)
xy_4 = XYPlane(Origin=pt_7)
tag = TextTag3D(Location=xy_4, Text=join, Size="5", Colour=ColourSwatch(SwatchColor=RGB(0, 0, 0)), Justification=7)

# ----
# display intermediate geometries (filtering horizontal/vertical)
# 0 - associate XData
# merge branches: Merging branches rebuilds the data tree thanks to the individual branch indices
# process: Only the AssemblyObject of type 0 has different geometries for horizontal and vertical orientation, so the sequence of operations is:
# 
# . filter by type
# . only for type 0: separate horizontal and vertical, associate relative geometry
# . merge type 1 horizontal and vertical together
# . merge all types back together
# filter by type: filters with a boolean pattern. If type=0 data is passed to output A, else to output B
# filter horizontal/vertical: See explanation in the panel below.
# 
# We use those 0 and 1 as filtering indices in a List item, since we previously added the intermediate geometries in the XData in the corresponding order (0 horizontal, 1 vertical).
aoxd = AssociateXData(AssemblyObjects=aoadecon.AssemblageObjects, XData=data)
xddecon = DeconstructXData(XData=aoxd)  # -> Label, Data, ReferencePlane, AssemblyObjectNameReference

# ---- group: geometries
# 2 - filter by type
dispatch = Dispatch(List=xddecon.Data, DispatchPattern=equals.Equality)  # -> ListA, ListB

# ---- group: reference planes
dispatch_2 = Dispatch(List=xddecon.ReferencePlane, DispatchPattern=equals.Equality)  # -> ListA, ListB

# ----
# recognizing horizontal and vertical: The dot product of 2 unit vectors is equal to the cosine of the comprised angle.
# 
# Two perpendicular vectors (angle 90) have a dot product of 0, while two parallel vectors (angle 0 or 180) the dot product is 1 or -1 respectively. Using the absolute value function, the value becomes 1 regardless of the sign.
# 
# In this case we test the angle of each AssemblyObject's  reference plane X vector with the global Z vector. If they are parallel (absolute dot product = 1) then the object is oriented vertically, if they are perpendicular (absolute dot product = 0) the object is horizontal.
# associate blocks
# You can use the same boolean pattern filtering process used above, but in case you have multiple AssemblyObject types (>2) and need to assign different object types this is a more adaptable and modular construct (add outputs to the Sift/inputs to the Combine components accordingly)
# delays updated data transmission by a certain amount of time or only when clicked
# recombine types: In case of more than 2 types, add other channels to the input accordingly.
# sift by type: filters by a pattern of integers. In case of more than 2 types, add other channels to the output.
aoplane = ExtractReferencePlane(AssemblyObject=dam)
sift = SiftPattern(List=aoplane, SiftPattern=aotype)  # -> Output0, Output1
panel_3 = Panel("recombine horizontal/vertical")
bake = BooleanToggle(False)

# ---- group: separate horizontal/vertical
Z_2 = UnitZ(Factor=1)
deplane = DeconstructPlane(Plane=sift.Output0)  # -> Origin, XAxis, YAxis, ZAxis
dprod = DotProduct(VectorA=deplane.XAxis, VectorB=Z_2, Unitize=False)
abs = Absolute(Value=dprod)
int = Integer(abs)
dispatch_3 = Dispatch(List=sift.Output0, DispatchPattern=int)  # -> ListA, ListB

# ---- group: associate blocks / vertical elements
pln = Plane(dispatch_3.ListA)

# ---- group: associate blocks / horizontal elements
pln_2 = Plane(dispatch_3.ListB)

# ---- group: associate blocks
# objectA / type 0
# objectB / type 1
pln_3 = Plane(sift.Output1)
inblock = InsertBlock(BlockName="block_typeA_v1", SourcePlane=pln_2)
inblock_2 = InsertBlock(BlockName="block_typeA_v2", SourcePlane=pln)
inblock_3 = InsertBlock(BlockName="block_typeB", SourcePlane=pln_3)

# ----
weave_2 = Weave(Pattern=int, Stream0=inblock, Stream1=inblock_2, NullGaps=False)
combine = CombineData(Input0=weave_2, Input1=inblock_3)  # -> Result, Index
data_5 = Data(combine.Result)
bake_2 = BakeObjects(Geometry=data_5, Bake=bake)

# ---- group: filter horizontal/vertical
# 3 - filter horizontal and vertical
deplane_2 = DeconstructPlane(Plane=dispatch_2.ListA)  # -> Origin, XAxis, YAxis, ZAxis
Z_3 = UnitZ(Factor=1)
dprod_2 = DotProduct(VectorA=deplane_2.XAxis, VectorB=Z_3, Unitize=False)
abs_2 = Absolute(Value=dprod_2)

# ----
int_2 = Integer(abs_2)

# ---- group: filter horizontal/vertical (continued)
item_5 = ListItem(List=dispatch.ListA, Index=int_2, Wrap=True)

# ----
# 4 - merge types together
merge_11 = Merge(Data1=dispatch.ListB, Data2=item_5)  # -> flatten(Result)
preview_2 = CustomPreview(Geometry=merge_11, Material=aoadisp.Colors)

# ---- group: display edges
f_mmeea = MeshesExtractEdgesWithToleranceAngle(Mesh=merge_11, Angle=45)  # -> InternalEdges, NakedEdges
previewlw_3 = CustomPreviewLineweights(
    Geometry=f_mmeea.InternalEdges,
    Shader=ColourSwatch(SwatchColor=RGB(0, 0, 0)),
    Thickness=Slider(1, range=1..3),
    Absolute=False)

# ----
lng_9 = ListLength(List=flatten(merge_11))

# ---- group: capture animation
# capture animation frames: 1. set up your Assemblage system (max n. of objects, steps for each iteration)
# 
# 2. set up your directory, viewport and resolution
# 
# 3. activate the "capture" toggle
# 
# 4. use your "go" toggle to run the simulation
# 
# 5. once reached the max items, simulation and capture should autostop
# 
# 6. double click again on the "capture" toggle to save the final screenshot with all geometries
capture = BooleanToggle(False)
filename_with_extension = Panel("assemblage_anim.png")
f_ghfilepath = GHFilePathInfo()  # -> FileName, FilePath
resolution = Panel("1920x1080")
viewport_name = Panel("Perspective")
concat_5 = Concatenate(FragmentA=f_ghfilepath.FilePath, FragmentB=directory_name)
and = GateAnd(A=lng_9, B=capture)
f_tas_2 = ToggleAutostop(Toggle=capture, Condition=larger.OrEqualTo)
panel_4 = Panel(concat_5)
f_vc2f = ViewCaptureToFile(
    FilePath=concat_5,
    FileName=filename_with_extension,
    ImageSize=resolution,
    Scale=1,
    Grid=False,
    Axes=False,
    Widget=False,
    Capture=and)
