# Grasshopper definition 04-01_base 2 Objects_Assemblage - Environment-Field + save animation.gh (Grasshopper 1.0.7)
# Copyright: Co-de-iT
# plug-ins: Assembler, MeshEdit Components, froGH, Human

# ---- group: obstacle
pt = Point(Point(-122.3339923, 282.1586602, 0))
box = CenterBox(Base=pt, X=Slider(24, range=1..200), Y=Slider(9, range=1..200), Z=Slider(26, range=1..200))
mbox = MeshBox(Base=box, XCount="1", YCount="1", ZCount="1")

pt_2 = Point(Point(-158.4726811, 157.9892994, 0))
box_2 = CenterBox(Base=pt_2, X=Slider(11, range=1..200), Y=Slider(22.5, range=1..200), Z=Slider(26, range=1..200))
mbox_2 = MeshBox(Base=box_2, XCount="1", YCount="1", ZCount="1")

# ---- group: container
# environment
pt_3 = Point(Point(-140.2744565, 231.4122939, 0))
box_3 = CenterBox(Base=pt_3, X=Slider(100, range=1..200), Y=Slider(140, range=1..200), Z=Slider(85, range=1..200))
mbox_3 = MeshBox(Base=box_3, XCount="1", YCount="1", ZCount="1")

# ---- group: type 1
crv = Curve([<curve referenced from the Rhino model> x4])

# 0 - construct
crv_2 = Curve([<curve referenced from the Rhino model> x3])

# ---- group: type 2
crv_3 = Curve([<curve referenced from the Rhino model> x2])

crv_4 = Curve([<curve referenced from the Rhino model> x2])

# ---- group: container for Field
pt_4 = Point(Point(-140.2744565, 231.4122939, 0))
box_4 = CenterBox(Base=pt_4, X=Slider(100, range=1..200), Y=Slider(140, range=1..200), Z=Slider(85, range=1..200))

# ----
merge = Merge(Data1=crv_2, Data2=crv_3)
merge_2 = Merge(Data1=crv, Data2=crv_4)

lng = ListLength(List=crv)
lng_2 = ListLength(List=crv_4)
rotations = Panel("""0
180""")
lng_3 = ListLength(List=merge_2)
repeat = RepeatData(Data="1", Length=lng)
repeat_2 = RepeatData(Data="2", Length=lng_2)
repeat_3 = RepeatData(Data=graft(rotations), Length=lng_3)
merge_3 = Merge(Data1=repeat, Data2=repeat_2)
flip = FlipMatrix(Data=repeat_3)  # -> simplify(Data)

crv_5 = Curve(merge)

# ----
# Assembler
# 
# Framework for Iterative Assemblages workflow
# 
# code by Alessio Erioli
# 
# v 1.0
# © Co-de-iT 2021 / Creative Commons Attribution-Non Commercial-ShareAlike 4.0 International License
rotations_2 = Panel("""0
180""")
lng_4 = ListLength(List=crv_5)
lng_5 = ListLength(List=crv_2)
lng_6 = ListLength(List=crv_3)
# AssemblyObjects
repeat_4 = RepeatData(Data=graft(rotations_2), Length=lng_4)
repeat_5 = RepeatData(Data="1", Length=lng_5)
repeat_6 = RepeatData(Data="2", Length=lng_6)
flip_2 = FlipMatrix(Data=repeat_4)  # -> simplify(Data)
merge_4 = Merge(Data1=repeat_5, Data2=repeat_6)

# ---- group: single container
mesh = Mesh(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)

# ---- group: container
# flip normals: A container must have normals pointing inward
flip_3 = MeshFlip(Mesh=mbox_3)

# ---- group: polyline
crv_6 = Curve(<curve referenced from the Rhino model>)

# ---- group: smooth curve
crv_7 = Curve(<curve referenced from the Rhino model>)

# ---- group: multiple lines
# field from multiple curves
# There are more ways to populate a field than just using a single curve: you can also use points, multiple curves, surfaces and Breps.
# 
# See example file:
# 
# 03-01_Fields - populate.gh
crv_8 = Curve([<curve referenced from the Rhino model> x3])

# ---- group: single container
# flip normals: A container must have normals pointing inward
flip_4 = MeshFlip(Mesh=mesh)

# ---- group: Create Handles
handles = ConstructHandles(Polyline=merge_2, RotationAngles=flip, Type=merge_3)

handles_2 = ConstructHandles(Polyline=crv_5, RotationAngles=flip_2, Type=merge_4)

# ---- group: set box as environment container
# field
smesh = SimpleMesh(Brep=box_4)
flip_5 = MeshFlip(Mesh=smesh)

# ---- group: attractor curve
crv_9 = Curve(crv_7)
previewlw = CustomPreviewLineweights(Geometry=crv_9, Shader=ColourSwatch(SwatchColor=RGB(255, 0, 0)), Thickness="5", Absolute=False)

# ---- group: attractor curves
crv_10 = Curve(crv_8)
previewlw_2 = CustomPreviewLineweights(Geometry=crv_10, Shader=ColourSwatch(SwatchColor=RGB(255, 0, 161)), Thickness="5", Absolute=False)

# ----
merge_5 = Merge(Data1=flip_3, Data2=mbox_2, Data3=mbox)  # -> flatten(Result)

# ----
# "Intermediate" geometry: Fast mesh representation of actual geometry - derived from the BRep. Check if Fast Mesh is good enough, otherwise:
# . either play with meshing parameters to get a good quality/speed compromise
# . model a mesh geometry in Rhino to use as representative
mesh_2 = Mesh(<mesh referenced from the Rhino model>)

mesh_3 = Mesh(<mesh referenced from the Rhino model>)

# ---- group: Display Handles
handdisp = DisplayHandle(Handles=handles, DisplaySize=Slider(0.1, range=0..0.5), absHTextSize=False)

handdisp_2 = DisplayHandle(Handles=handles_2, DisplaySize=Slider(0.1, range=0..0.5), absHTextSize=False)

# ----
mesh_4 = Mesh(<mesh referenced from the Rhino model>)
volume = Volume(Geometry=mesh_4)  # -> Volume, Centroid
name = Panel("typeB")
xy = XYPlane(Origin=volume.Centroid)
X = UnitX(Factor=1)

mesh_5 = Mesh(<mesh referenced from the Rhino model>)
volume_2 = Volume(Geometry=mesh_5)  # -> Volume, Centroid
name_2 = Panel("typeA")
xy_2 = XYPlane(Origin=volume_2.Centroid)
X_2 = UnitX(Factor=1)

concat = Concatenate(FragmentA=name_2, FragmentB="_geometry")
xdcon = ConstructXData(Label=concat, Data=mesh_2, ReferencePlane=xy_2, AssemblyObjectNameReference=name_2)

concat_2 = Concatenate(FragmentA=name, FragmentB="_geometry")
xdcon_2 = ConstructXData(Label=concat_2, Data=mesh_3, ReferencePlane=xy, AssemblyObjectNameReference=name)

# ---- group: circulation path
crv_11 = Curve([<curve referenced from the Rhino model> x11])

crv_12 = Curve([<curve referenced from the Rhino model> x11])

# ----
concat_3 = Concatenate(FragmentA=name, FragmentB="_data")
xdcon_3 = ConstructXData(Label=concat_3, Data=crv_12, ReferencePlane=xy, AssemblyObjectNameReference=name)

# ---- group: Create AssemblyObject
aocon = ConstructAssemblyObject(Name=name_2, CollisionMesh=mesh_5, ReferencePlane=xy_2, Direction=X_2, Weight="1.0", Handles=handles_2, ZLockAO=False)

aocon_2 = ConstructAssemblyObject(Name=name, CollisionMesh=mesh_4, ReferencePlane=xy, Direction=X, Weight="1.0", Handles=handles, ZLockAO=False)

# ---- group: XData - geometries
merge_6 = Merge(Data1=flatten(xdcon), Data2=flatten(xdcon_2))
data = Data(merge_6)

# ---- group: AssemblyObjects
# AO set: With more than one AssemblyObject, just build a list with the Merge component
merge_7 = Merge(Data1=flatten(aocon), Data2=flatten(aocon_2))
data_2 = Data(merge_7)

# ----
environment = ValueList({"single mesh container": 0, "container + obstacles": 1, "field container": 2, "field + obstacles": 3}, selected="field + obstacles")
resetex = Button()

merge_8 = Merge(Data1=flip_5, Data2=mbox_2, Data3=mbox)  # -> flatten(Result)
filter = StreamFilter(Gate=environment, Stream0=flip_4, Stream1=merge_5, Stream2=flip_5, Stream3=merge_8)

field = ValueList({"single curve": 0, "multiple lines": 1}, selected="multiple lines")
heuw = HeuristicsWriter(AssemblyObjectsSet=data_2, noSH=False, noSO=False, xHT=False)
go = BooleanToggle(False)
step = Button()
max_objects = Panel("1000")
reset = Button()
cell_size = Slider(1.2, range=1..2)
show_edges = BooleanToggle(True)

# ---- group: base point
pt_5 = Point(Point(0, 20, 0))

# ----
jitter_rules = ValueList({"no": 0, "yes": 1}, selected="no")
pt_6 = Point(Point(-140.8710125, 214.0670038, 0))
jitter = Jitter(List=heuw, Jitter=Slider(1, range=0..1), Seed=Slider(0, range=0..100))  # -> Values, Indices
# 1 - simulate
xy_3 = XYPlane(Origin=pt_6)
filter_2 = StreamFilter(Gate=jitter_rules, Stream0=heuw, Stream1=jitter.Values)

# ---- group: filter heuristics
heudex = HeuristicsDisplayEx(OriginPoint=Point(0, 0, 0), AssemblyObjectsSet=data_2, HeuristicsString=filter_2, XSize=1, YSize=1, NRows=10)  # -> AssemblyObjectPairs, CoherencePattern, HeuristicsStringTree, TextBasePoints, XData
cull = CullPattern(List=flatten(heudex.HeuristicsStringTree), CullPattern=flatten(heudex.CoherencePattern))

# ----
selrule = ValueList({"random": 0, "scalar field": 1, "scalar field acc": 2, "vector field": 3, "vector field acc": 4, "min locl bb vol": 5, "min loc bb diag": 6, "weighted random choice": 7}, selected="vector field acc")
selrec = ValueList({"random": 0, "scalar field": 1, "scalar field acc": 2, "dense packing (SLOW)": 3}, selected="scalar field acc")
heuristics_mode = ValueList({"manual": 0, "field driven": 1}, selected="manual")
heuset = HeuristicsSettings(
    HeuristicsString=cull,
    CurrentHeuristics=Slider(0, range=0..3),
    HeuristicsMode=heuristics_mode,
    ReceiverSelectionMode=selrec,
    RuleSelectionMode=selrule)

or = GateOr(A=go, B=step)

# ---- group: capture animation
# The directory MUST already exist
directory_name = Panel("animation\")

# ----
# field from single curve
number_slider = Slider(15, range=10..30)
list = ValueList({"by curve tangent": 0, "by threshold": 1}, selected="by threshold")

# ---- group: Construct Field
afieldn = ConstructFieldN(Geometry=box_4, Plane=PlaneXY(0, 0, 0), NCells=number_slider)  # -> Field, FieldPoints

# ---- group: calculate vector by coordinate threshold
pdecon = Deconstruct(Point=afieldn.FieldPoints)  # -> XComponent, YComponent, ZComponent
bnd = Bounds(Numbers=pdecon.YComponent)
remap = RemapNumbers(Value=Slider(0.457, range=0..1), Source=Domain(0, 1), Target=bnd)  # -> Mapped, Clipped
smaller = SmallerThan(FirstNumber=pdecon.YComponent, SecondNumber=remap.Mapped)  # -> SmallerThan, OrEqualTo
Y = UnitY(Factor=1)
Z = UnitZ(Factor=1)
weave = Weave(Pattern=graft(smaller.SmallerThan), Stream0=Y, Stream1=Z, NullGaps=False)  # -> flatten(Weave)

# ---- group: calculate scalar
crv_cp = CurveClosestPoint(Point=afieldn.FieldPoints, Curve=crv_9)  # -> Point, Parameter, Distance

crv_cp_2 = CurveClosestPoint(Point=graft(afieldn.FieldPoints), Curve=crv_10)  # -> Point, Parameter, Distance

# ---- group: calculate vector from curve tangent
eval = EvaluateCurve(Curve=crv_9, Parameter=crv_cp.Parameter)  # -> Point, Tangent, Angle

# ----
filter_3 = StreamFilter(Gate=list, Stream0=eval.Tangent, Stream1=weave)
afpop = PopulateField(Field=afieldn.Field, ScalarValues=crv_cp.Distance, VectorValues=filter_3)

concat_4 = Concatenate(FragmentA=name_2, FragmentB="_data")

xdcon_4 = ConstructXData(Label=concat_4, Data=crv_11, ReferencePlane=xy_2, AssemblyObjectNameReference=name_2)

# ---- group: XData - circulation path
# to pass Assembler data around, use the generic Data container
merge_9 = Merge(Data1=flatten(xdcon_4), Data2=flatten(xdcon_3))
data_3 = Data(merge_9)

# ----
merge_10 = Merge(Data1=data_3, Data2=data)

# ---- group: Heuristics Display
heud = HeuristicDisplay(
    OriginPoint=pt_5,
    AssemblyObjectsSet=data_2,
    XData=merge_10,
    HeuristicsString=filter_2,
    XSize=cell_size,
    YSize=cell_size,
    NRows=Slider(10, range=10..50),
    DisplayType="AO Types",
    ZLockFilter=False)

# ----
# vectors in this case are calculated as closest curve tangent vectors
f_ifroml = IndexesFromList(Data=crv_10)
sort = SortList(Keys=crv_cp_2.Distance, ValuesA=f_ifroml, ValuesB=crv_cp_2.Parameter)  # -> Keys, ValuesA, ValuesB
item = ListItem(List=sort.Keys, Index=0, Wrap=True)  # -> flatten(Item)
item_2 = ListItem(List=sort.ValuesB, Index=0, Wrap=True)
item_3 = ListItem(List=sort.ValuesA, Index=0, Wrap=True)
item_4 = ListItem(List=crv_10, Index=item_3, Wrap=True)

# ---- group: calculate vector
eval_2 = EvaluateCurve(Curve=item_4, Parameter=item_2)  # -> Point, flatten(Tangent), Angle

# ----
afpop_2 = PopulateField(Field=afieldn.Field, ScalarValues=item, VectorValues=eval_2.Tangent)

environment_mode = ValueList({"none": 0, "collision": 1, "centroid": 2}, selected="collision")
number_slider_2 = Slider(0.1, range=0..1)

# ---- group: display Field / Threshold from Exogenous Settings
num = Number(number_slider_2)

# ---- group: display Field
merge_11 = Merge(Data1=ColourSwatch(SwatchColor=RGB(255, 212, 0)), Data2=ColourSwatch(SwatchColor=RGB(130, 130, 130)))
# choose and display field
filter_4 = StreamFilter(Gate=field, Stream0=afpop, Stream1=afpop_2)
afcol = ColorField(Field=filter_4, Colors=merge_11, Index=0, Threshold=num, FieldValueBlend=False)  # -> Field, Colors
afdecon = DeconstructField(Field=afcol.Field)  # -> Points, ScalarValues, Vectors, IWeights, Colors

# ---- group: display Field / display Field vectors
multiplication = Multiplication(A=flatten(afdecon.Vectors), B=Slider(6.539, range=1..10))
unit = UnitVector(Vector=multiplication)
vdisex = VectorDisplayEx(Point=afieldn.FieldPoints, Vector=multiplication, Colour=unit, Width=2)

# ---- group: display Field / Field for Assemblage
data_4 = Data(afcol.Field)

# ----
exoset = ExogeousSettings(
    EnvironmentMeshes=filter,
    EnvironmentMode=environment_mode,
    Field=data_4,
    FieldScalarThreshold=number_slider_2,
    Sandbox={Plane=PlaneXY(0, 0, 0), X=Domain(-1, 1), Y=Domain(0, 0), Z=Domain(0, 0)})

# ---- group: Assemblage Engine Xtended
aoengx = AssemblerEngineX(
    AssemblyObjectsSet=data_2,
    StartingPlane=xy_3,
    StartingObjectType="1",
    HeuristicsSettings=heuset,
    ExogenousSettings=exoset,
    Go=go,
    Step=step,
    NIterations=Slider(20, range=10..100),
    MaxNObjects=max_objects,
    ResetExogenous=resetex,
    Reset=reset,
    UseSupports=False,
    ZLockCheck=False)  # -> Assemblage, AssemblageCount

# ----
n_of_objects = Panel(aoengx.AssemblageCount)

# ---- group: auto-stop
larger = LargerThan(FirstNumber=aoengx.AssemblageCount, SecondNumber=max_objects)  # -> LargerThan, OrEqualTo
f_tas = ToggleAutostop(Toggle=go, Condition=larger.OrEqualTo)

# ----
aoadisp = DisplayAssemblage(Assemblage=aoengx.Assemblage, Bypass=or, OutputType="Objects", ValueTable_OutputType="Occupancy")  # -> ColoredCollisionMeshes, Edges, Colors
aoadecon = DeconstructAssemblage(Assemblage=aoengx.Assemblage)  # -> AssemblageObjects, AssemblageRules, ReceiverObjectsIndexes, AvailableObjectIndexes, UnreachableObjectIndexes

# ---- group: display components
# 2 - analyze/post-process
mjoin = MeshJoin(Meshes=aoadisp.ColoredCollisionMeshes)
preview = CustomPreview(Geometry=mjoin, Material=ColourSwatch(SwatchColor=RGB(255, 255, 255)))  # disabled

# ---- group: display components / display edges
previewlw_3 = CustomPreviewLineweights(Geometry=aoadisp.Edges, Shader=ColourSwatch(SwatchColor=RGB(0, 0, 0)), Thickness=Slider(1, range=1..3), Absolute=False)

# ---- group: associate XData
aoxd = AssociateXData(AssemblyObjects=aoadecon.AssemblageObjects, XData=data)
xddecon = DeconstructXData(XData=aoxd)  # -> Label, Data, ReferencePlane, AssemblyObjectNameReference

# ---- group: capture animation
# capture animation frames: 1. set up your Assemblage system (max n. of objects, steps for each iteration)
# 2. set up your directory, viewport and resolution
# 3. activate capture toggle
# 4. use your "go" toggle to run the simulation
# 5. once reached the max items, simulation and capture should autostop
filename_with_extension = Panel("assemblage_anim.png")
capture = BooleanToggle(False)
f_ghfilepath = GHFilePathInfo()  # -> FileName, FilePath
resolution = Panel("1920x1080")
viewport_name = Panel("Perspective")
concat_5 = Concatenate(FragmentA=f_ghfilepath.FilePath, FragmentB=directory_name)
and = GateAnd(A=aoengx.AssemblageCount, B=capture)
f_tas_2 = ToggleAutostop(Toggle=capture, Condition=larger.OrEqualTo)
panel = Panel(concat_5)
f_vc2f = ViewCaptureToFile(
    FilePath=concat_5,
    FileName=filename_with_extension,
    ImageSize=resolution,
    Scale=1,
    Grid=False,
    Axes=False,
    Widget=False,
    Capture=and)

# ---- group: Extract AO Type
aotype = ExtractType(AssemblyObject=aoadecon.AssemblageObjects)

# ---- group: geometries
sift = SiftPattern(List=xddecon.Data, SiftPattern=graft(aotype))  # -> Output0, Output1

# ---- group: reference planes
sift_2 = SiftPattern(List=xddecon.ReferencePlane, SiftPattern=graft(aotype))  # -> Output0, Output1

# ---- group: filter horizontal/vertical
Z_2 = UnitZ(Factor=1)
deplane = DeconstructPlane(Plane=sift_2.Output0)  # -> Origin, XAxis, YAxis, ZAxis
dprod = DotProduct(VectorA=deplane.XAxis, VectorB=Z_2, Unitize=False)
abs = Absolute(Value=dprod)
item_5 = ListItem(List=sift.Output0, Index=abs, Wrap=True)

# ----
clean = CleanTree(RemoveNulls=True, RemoveInvalid=True, RemoveEmpty=False, Tree=item_5)
clean_2 = CleanTree(RemoveNulls=True, RemoveInvalid=True, RemoveEmpty=False, Tree=sift.Output1)

# ----
# display intermediate geometries (filtering horizontal/vertical)
# merge branches: Merging branches rebuilds the data tree thanks to the individual branch indices
# sift by type: filters by a pattern of integers. In case of more than 2 types, add other channels to the output.
# remove nulls: Sift creates nulls in place of filtered data. Here, we remove them to get a cleaner data tree.
# filter horizontal/vertical: See explanation in the panel below.
# 
# We use those 0 and 1 as filtering indices in a List item, since we previously added the intermediate geometries in the XData in the corresponding order (0 horizontal, 1 vertical).
merge_12 = Merge(Data1=clean, Data2=clean_2)
preview_2 = CustomPreview(Geometry=flatten(merge_12), Material=aoadisp.Colors)
