# Grasshopper definition 04-02_base 2 objects_Assemblage - E-F - sel heuristics.gh (Grasshopper 1.0.7)
# Copyright: Co-de-iT
# plug-ins: Assembler, froGH, Human

# ---- group: obstacle
pt = Point(Point(-84.57490759, 229.9629792, 0))
box = CenterBox(Base=pt, X=Slider(24, range=1..200), Y=Slider(9, range=1..200), Z=Slider(26, range=1..200))
mbox = MeshBox(Base=box, XCount="1", YCount="1", ZCount="1")

pt_2 = Point(Point(-158.4726811, 157.9892994, 0))
box_2 = CenterBox(Base=pt_2, X=Slider(11, range=1..200), Y=Slider(22.5, range=1..200), Z=Slider(26, range=1..200))
mbox_2 = MeshBox(Base=box_2, XCount="1", YCount="1", ZCount="1")

# ---- group: type 1
crv = Curve([<curve referenced from the Rhino model> x4])

crv_2 = Curve([<curve referenced from the Rhino model> x3])

# ---- group: type 2
crv_3 = Curve([<curve referenced from the Rhino model> x2])

crv_4 = Curve([<curve referenced from the Rhino model> x2])

# ---- group: container
# environment
pt_3 = Point(Point(-140.2744565, 231.4122939, 0))
box_3 = CenterBox(Base=pt_3, X=Slider(100, range=1..200), Y=Slider(140, range=1..200), Z=Slider(85, range=1..200))
mbox_3 = MeshBox(Base=box_3, XCount="1", YCount="1", ZCount="1")

# ---- group: container for Field
pt_4 = Point(Point(-140.2744565, 231.4122939, 0))
box_4 = CenterBox(Base=pt_4, X=Slider(100, range=1..200), Y=Slider(140, range=1..200), Z=Slider(85, range=1..200))

# ----
merge = Merge(Data1=crv_2, Data2=crv_3)
merge_2 = Merge(Data1=crv, Data2=crv_4)

lng = ListLength(List=crv)
lng_2 = ListLength(List=crv_4)
rotations = Panel("""0
180""")
lng_3 = ListLength(List=merge_2)
repeat = RepeatData(Data="1", Length=lng)
repeat_2 = RepeatData(Data="2", Length=lng_2)
repeat_3 = RepeatData(Data=graft(rotations), Length=lng_3)
merge_3 = Merge(Data1=repeat, Data2=repeat_2)
flip = FlipMatrix(Data=repeat_3)  # -> simplify(Data)

crv_5 = Curve(merge)

# ----
# Assembler
# 
# Framework for Iterative Assemblages workflow
# 
# code by Alessio Erioli
# 
# v 1.0
# © Co-de-iT 2021 / Creative Commons Attribution-Non Commercial-ShareAlike 4.0 International License
# 0 - construct
rotations_2 = Panel("""0
180""")
lng_4 = ListLength(List=crv_5)
lng_5 = ListLength(List=crv_2)
lng_6 = ListLength(List=crv_3)
repeat_4 = RepeatData(Data=graft(rotations_2), Length=lng_4)
repeat_5 = RepeatData(Data="1", Length=lng_5)
repeat_6 = RepeatData(Data="2", Length=lng_6)
flip_2 = FlipMatrix(Data=repeat_4)  # -> simplify(Data)
merge_4 = Merge(Data1=repeat_5, Data2=repeat_6)

# ---- group: single container
mesh = Mesh(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)

# ---- group: container
# flip normals: A container must have normals pointing inward
flipm = FlipMesh(Mesh=mbox_3, VertexNormals=True, FaceNormals=True, FaceOrientation=True)

# ---- group: set box as environment container
smesh = SimpleMesh(Brep=box_4)
flipm_2 = FlipMesh(Mesh=smesh, VertexNormals=True, FaceNormals=True, FaceOrientation=True)

# ---- group: single container
# flip normals: A container must have normals pointing inward
flipm_3 = FlipMesh(Mesh=mesh, VertexNormals=True, FaceNormals=True, FaceOrientation=True)

# ---- group: Create Handles
handles = ConstructHandles(Polyline=merge_2, RotationAngles=flip, Type=merge_3)

handles_2 = ConstructHandles(Polyline=crv_5, RotationAngles=flip_2, Type=merge_4)

# ---- group: multiple attractor points
pt_5 = Point(Point(-106.1954929, 169.2417387, -5.148424688))
pt_6 = Point(Point(-199.2746517, 257.2703911, 43.23515265))
pt_7 = Point(Point(-139.562713, 346.229302, -41.80343786))
merge_5 = Merge(Data1=pt_5, Data2=pt_6, Data3=pt_7)

# ----
merge_6 = Merge(Data1=flipm, Data2=mbox_2, Data3=mbox)  # -> flatten(Result)

# ----
# "Intermediate" geometry: Fast mesh representation of actual geometry - derived from the BRep. Check if Fast Mesh is good enough, otherwise:
# . either play with meshing parameters to get a good quality/speed compromise
# . model a mesh geometry in Rhino to use as representative
mesh_2 = Mesh(<mesh referenced from the Rhino model>)

mesh_3 = Mesh(<mesh referenced from the Rhino model>)

# ---- group: Display Handles
handdisp = DisplayHandle(Handles=handles, DisplaySize=Slider(0.1, range=0..0.5), absHTextSize=False)

handdisp_2 = DisplayHandle(Handles=handles_2, DisplaySize=Slider(0.1, range=0..0.5), absHTextSize=False)

# ----
mesh_4 = Mesh(<mesh referenced from the Rhino model>)
volume = Volume(Geometry=mesh_4)  # -> Volume, Centroid
name = Panel("typeB")
xy = XYPlane(Origin=volume.Centroid)
X = UnitX(Factor=1)

mesh_5 = Mesh(<mesh referenced from the Rhino model>)
volume_2 = Volume(Geometry=mesh_5)  # -> Volume, Centroid
name_2 = Panel("typeA")
xy_2 = XYPlane(Origin=volume_2.Centroid)
X_2 = UnitX(Factor=1)

concat = Concatenate(FragmentA=name_2, FragmentB="_geometry")
xdcon = ConstructXData(Label=concat, Data=mesh_2, ReferencePlane=xy_2, AssemblyObjectNameReference=name_2)

concat_2 = Concatenate(FragmentA=name, FragmentB="_geometry")
xdcon_2 = ConstructXData(Label=concat_2, Data=mesh_3, ReferencePlane=xy, AssemblyObjectNameReference=name)

# ---- group: circulation path
crv_6 = Curve([<curve referenced from the Rhino model> x11])

crv_7 = Curve([<curve referenced from the Rhino model> x11])

# ----
concat_3 = Concatenate(FragmentA=name, FragmentB="_data")
xdcon_3 = ConstructXData(Label=concat_3, Data=crv_7, ReferencePlane=xy, AssemblyObjectNameReference=name)

# ---- group: Create AssemblyObject
aocon = ConstructAssemblyObject(Name=name_2, CollisionMesh=mesh_5, ReferencePlane=xy_2, Direction=X_2, Weight="1.0", Handles=handles_2, ZLockAO=False)

aocon_2 = ConstructAssemblyObject(Name=name, CollisionMesh=mesh_4, ReferencePlane=xy, Direction=X, Weight="1.0", Handles=handles, ZLockAO=False)

# ---- group: XData - geometries
merge_7 = Merge(Data1=flatten(xdcon), Data2=flatten(xdcon_2))
data = Data(merge_7)

# ---- group: AssemblyObjects
# AO set: With more than one AssemblyObject, just build a list with the Merge component
merge_8 = Merge(Data1=flatten(aocon), Data2=flatten(aocon_2))
data_2 = Data(merge_8)

# ----
heuw = HeuristicsWriter(AssemblyObjectsSet=data_2, noSH=False, noSO=False, xHT=False)

# ---- group: filter invalid heuristics
heudex = HeuristicsDisplayEx(OriginPoint=Point(0, 0, 0), AssemblyObjectsSet=data_2, HeuristicsString=heuw, XSize=1, YSize=1, NRows=10)  # -> AssemblyObjectPairs, CoherencePattern, HeuristicsStringTree, TextBasePoints, XData
cull = CullPattern(List=flatten(heudex.HeuristicsStringTree), CullPattern=flatten(heudex.CoherencePattern))

# ----
go = BooleanToggle(False)
step = Button()
max_objects = Panel("2000")
resetex = Button()
reset = Button()

# ---- group: create separate heuristics by object type
# sorting and filtering heuristics: This way of filtering heuristics rules is heavily dependent on AssemblyObject naming: typeA and typeB differ only by the last letter, so removing "type" leaves with the distinctive character only.
# 
# Clever naming can help you do more with your data.
# 
# If you are using a different naming system you should come up with your own filtering criteria.
panel = Panel("type|=%<")
panel_2 = Panel(cull)
split = TextSplit(Text=cull, Separators=panel)
panel_3 = Panel("""4
11""")
panel_4 = Panel(split)
item = ListItem(List=split, Index=panel_3, Wrap=True)
panel_5 = Panel(item)
join = TextJoin(Text=item)
panel_6 = Panel("""AA
BB
AB
BA""")
panel_7 = Panel(join)
mindex = MemberIndex(Set=flatten(join), Member=panel_6)  # -> Index, Count
item_2 = ListItem(List=cull, Index=mindex.Index, Wrap=True)

# ----
pt_8 = Point(Point(-128.0493523, 231.6872502, 0))
# 1 - simulate
xy_3 = XYPlane(Origin=pt_8)
heuristics_set = ValueList({"full": 0, "valid only": 1, "set 0": 2, "set 1": 3, "set 2": 4}, selected="valid only")
bang = ExplodeTree(Data=item_2)  # -> Branch0, Branch1, Branch2, Branch3
viewer = ParamViewer(item_2)
panel_8 = Panel(item_2)
merge_9 = Merge(Data1=bang.Branch2, Data2=bang.Branch3)  # -> flatten(Result)
cell_size = Slider(1.2, range=1..2)
filter = StreamFilter(Gate=heuristics_set, Stream0=heuw, Stream1=cull, Stream2=bang.Branch0, Stream3=bang.Branch1, Stream4=merge_9)

# ---- group: Build the final heuristics set
entwine = Entwine(Branch00=bang.Branch0, Branch01=bang.Branch1, Branch02=merge_9, FlattenInputs=True)

# ----
selrec = ValueList({"random": 0, "scalar field": 1, "scalar field acc": 2, "dense packing (SLOW)": 3}, selected="random")
heuristics_mode = ValueList({"manual": 0, "field driven": 1}, selected="field driven")
selrule = ValueList({"random": 0, "scalar field": 1, "scalar field acc": 2, "vector field": 3, "vector field acc": 4, "min locl bb vol": 5, "min loc bb diag": 6}, selected="random")
heuset = HeuristicsSettings(
    HeuristicsString=entwine,
    CurrentHeuristics=Slider(0, range=0..3),
    HeuristicsMode=heuristics_mode,
    ReceiverSelectionMode=selrec,
    RuleSelectionMode=selrule)

# ---- group: base point
pt_9 = Point(Point(0, 20, 0))

# ---- group: Heuristics Display
heud = HeuristicDisplay(
    OriginPoint=pt_9,
    AssemblyObjectsSet=data_2,
    XData=data,
    HeuristicsString=filter,
    XSize=cell_size,
    YSize=cell_size,
    NRows=Slider(10, range=10..50),
    DisplayType="AO Types",
    ZLockFilter=False,
    OutputType="AO Types",
    ShowEdges=True,
    Z_Lock=True)

# ----
iweights_one_for_each_attractor_point = Panel("""2
1
0""")
# field
afieldn = ConstructFieldN(Geometry=box_4, Plane=PlaneXY(0, 0, 0), NCells=Slider(15, range=10..30))  # -> Field, FieldPoints
cset = CreateSet(List=iweights_one_for_each_attractor_point)  # -> Set, Map
sort = SortList(Keys=cset.Set)  # -> Keys, ValuesA

# ---- group: calculate scalar values
dist = Distance(PointA=graft(afieldn.FieldPoints), PointB=merge_5)
log = Logarithm(Value=dist)
avr = Average(Input=log)  # -> flatten(ArithmeticMean)

# ---- group: calculate vector values
xprod = CrossProduct(VectorA=graft(afieldn.FieldPoints), VectorB=merge_5, Unitize=True)  # -> Vector, Length
avr_2 = Average(Input=xprod.Vector)  # -> flatten(ArithmeticMean)
unit = UnitVector(Vector=avr_2)

# ----
sort_2 = SortList(Keys=dist, ValuesA=iweights_one_for_each_attractor_point)  # -> Keys, ValuesA
item_3 = ListItem(List=sort_2.ValuesA, Index=0, Wrap=True)  # -> flatten(Item)
panel_9 = Panel(item_3)

# ---- group: Populate Field (scalars, vectors)
afpop = PopulateField(Field=afieldn.Field, ScalarValues=avr, VectorValues=unit, IWeightValues=item_3)

# ---- group: generate colors for iWeights
lng_7 = ListLength(List=sort.Keys)
wheel = ColourWheel(
    lng_7,
    ColourGrips_Style=20,
    ColourGrips_Grip=[3.85349811, 0.4167580559, 3.910274516, 2.863076965],
    ColourGrips_Lum=[0.1, 0.5180129257],
    ColourGrips_Range=[0.4110076533, 0.6092952285, 0.2617993878, 0.2617993878],
    ColourGrips_Sat=[0.5428562287, 1])

# ---- group: generate colors for iWeights / colour chart
legend = Legend(Colour=wheel, Tags=sort.Keys, LegendType=1)

# ---- group: deconstruct field
afdecon = DeconstructField(Field=afpop)  # -> Points, ScalarValues, Vectors, IWeights, Colors

# ---- group: Field for Assemblage
data_3 = Data(afpop)

# ----
item_4 = ListItem(List=wheel, Index=afdecon.IWeights, Wrap=True)
tag = TextTag3D(Location=graft(afdecon.Points), Text=afdecon.IWeights, Size="3", Colour=item_4, Justification=5)

# ----
# Containers can have any shape, but there can only be one during a simulation.
# 
# Obstacles can be as many as you want.
merge_10 = Merge(Data1=flipm_2, Data2=mbox_2, Data3=mbox)  # -> flatten(Result)

concat_4 = Concatenate(FragmentA=name_2, FragmentB="_data")

xdcon_4 = ConstructXData(Label=concat_4, Data=crv_6, ReferencePlane=xy_2, AssemblyObjectNameReference=name_2)

# ---- group: XData
# to pass Assembler data around, use the generic Data container
merge_11 = Merge(Data1=flatten(xdcon_4), Data2=flatten(xdcon_3))
data_4 = Data(merge_11)

# ----
environment = ValueList({"single mesh container": 0, "container + obstacles": 1, "field container": 2, "field + obstacles": 3}, selected="container + obstacles")
environment_mode = ValueList({"none": 0, "collision": 1, "inclusion": 2}, selected="collision")

filter_2 = StreamFilter(Gate=environment, Stream0=flipm_3, Stream1=merge_6, Stream2=flipm_2, Stream3=merge_10)

exoset = ExogenousSettings(
    EnvironmentMeshes=filter_2,
    EnvironmentMode=environment_mode,
    Field=data_3,
    FieldScalarThreshold=Slider(0.1, range=0..1),
    Sandbox={Plane=PlaneXY(0, 0, 0), X=Domain(-1, 1), Y=Domain(0, 0), Z=Domain(0, 0)})

# ---- group: Assemblage Engine Xtended
aoengx = AssemblerEngineX(
    AssemblyObjectsSet=data_2,
    StartingPlane=xy_3,
    StartingObjectType=0,
    HeuristicsSettings=heuset,
    ExogenousSettings=exoset,
    Go=go,
    Step=step,
    NIterations=Slider(100, range=10..100),
    MaxNObjects=max_objects,
    ResetExogenous=resetex,
    Reset=reset,
    UseSupports=False,
    ZLockCheck=False,
    Z_Lock=False)  # -> Assemblage, AssemblageCount

# ----
n_of_objects = Panel(aoengx.AssemblageCount)

# ---- group: auto-stop
larger = LargerThan(FirstNumber=aoengx.AssemblageCount, SecondNumber=max_objects)  # -> LargerThan, OrEqualTo
f_tas = ToggleAutostop(Toggle=go, Condition=larger.OrEqualTo)

# ----
aoadisp = DisplayAssemblage(Assemblage=aoengx.Assemblage, Bypass=False, OutputType="AO Types")  # -> ColoredCollisionMeshes, Edges, Colors

# ---- group: display "intermediate" geometries
aoadecon = DeconstructAssemblage(Assemblage=aoengx.Assemblage)  # -> AssemblageObjects, AssemblageRules, ReceiverObjectsIndexes, AvailableObjectIndexes, UnreachableObjectIndexes
aoxd = AssociateXData(AssemblyObjects=aoadecon.AssemblageObjects, XData=data)
xddecon = DeconstructXData(XData=aoxd)  # -> Label, Data, ReferencePlane, AssemblyObjectNameReference
preview = CustomPreview(Geometry=xddecon.Data, Material=graft(aoadisp.Colors))

# ---- group: objects statistics
aoadecon_2 = DeconstructAssemblage(Assemblage=aoengx.Assemblage)  # -> AssemblageObjects, AssemblageRules, ReceiverObjectsIndexes, AvailableObjectIndexes, UnreachableObjectIndexes
aoset = ExtractAOSet(Assemblage=aoengx.Assemblage)
aotype = ExtractType(AssemblyObject=aoadecon_2.AssemblageObjects)
f_ifroml = IndexesFromList(Data=aoset)
mindex_2 = MemberIndex(Set=aotype, Member=f_ifroml)  # -> Index, Count
expression = Expression(x=f_ifroml, y=mindex_2.Count, Expression="Format(\"type {0}: {1}\", x, y)")
pt_10 = Point(Point(-218.075651, 73.00729024, 0))
join_2 = TextJoin(Text=expression)
xy_4 = XYPlane(Origin=pt_10)
tag_2 = TextTag3D(Location=xy_4, Text=join_2, Size="5", Colour=ColourSwatch(SwatchColor=RGB(0, 0, 0)), Justification=7)

# ---- group: display components
# 2 - analyze/post-process
mjoin = MeshJoin(Meshes=aoadisp.ColoredCollisionMeshes)
preview_2 = CustomPreview(Geometry=mjoin, Material=ColourSwatch(SwatchColor=RGB(255, 255, 255)))  # disabled

# ---- group: display components / display edges
previewlw = CustomPreviewLineweights(Geometry=aoadisp.Edges, Shader=ColourSwatch(SwatchColor=RGB(0, 0, 0)), Thickness=Slider(1, range=1..3), Absolute=False)
