# Grasshopper definition AH_distance.gh (Grasshopper 1.0.7)
# Copyright: Co-de-iT
# plug-ins: Assembler, froGH, Human, LunchBoxML

# ---- group: create 3D cubic voxel space
# distance
size = Slider(10, range=10..100)
number_slider = Slider(15, range=5..20)
# <title>
# 
# <description>
# 
# code by Alessio Erioli
# 
# v 0.1
# AH - Analysis Helpers
box = CenterBox(Base=PlaneXY(0, 0, 0), X=size, Y=size, Z=size)
# © a3 2021 / Creative Commons Attribution-Non Commercial-ShareAlike 4.0 International License
afieldn = ConstructFieldN(Geometry=box, Plane=PlaneXY(0, 0, 0), NCells=number_slider)  # -> Field, FieldPoints

# ----
# attractor geometry
pt = Point(Point(0.6409550447, 3.241415123, 4.222701212))
pt_2 = Point(Point(4.80854245, -4.709093151, -4.958460515))
pt_3 = Point(Point(-7.646546477, -5.426958086, 0))

# ---- group: remove some voxels (to make it more interesting)
lng = ListLength(List=afieldn.FieldPoints)
multiplication = Multiplication(A=lng, B=Slider(0.4, range=0..1))
total_points = Panel(lng)
int = Integer(multiplication)
removed = Panel(int)

# ----
# placeholder spatial distribution
# This is just for test, use your AssemblyObjects reference planes instead.
division = Division(A=size, B=number_slider)
reduce = RandomReduce(List=afieldn.FieldPoints, Reduction=int, Seed=1)

merge = Merge(Data1=pt, Data2=pt_2, Data3=pt_3)
pt_4 = Point(merge)
# compute feature (distance)
pt_5 = Point(graft(reduce))

# ---- group: create a 2D cell for display
f_sdom = SymmetricDomain(DomainSemiextension=division)
rectangle = Rectangle(Plane=PlaneXY(0, 0, 0), XSize=f_sdom, YSize=f_sdom, Radius=0)  # -> Rectangle, Length
mplane = MeshPlane(Boundary=rectangle.Rectangle, WidthCount="1", HeightCount="1")  # -> Mesh, Area

# ---- group: create a cell voxel for later display
box_2 = CenterBox(Base=PlaneXY(0, 0, 0), X=division, Y=division, Z=division)
mbox = MeshBox(Base=box_2, XCount=10, YCount=10, ZCount=10)

# ---- group: simple K-means clusters
pdecon = Deconstruct(Point=pt_5)  # -> XComponent, YComponent, ZComponent
merge_2 = Merge(Data1=pdecon.XComponent, Data2=pdecon.YComponent, Data3=pdecon.ZComponent)
k_means = KMeansClustering(TrainingInputs=merge_2, OfClusters=Slider(20, range=2..20), RandomSeed=5)  # -> Result, Likelihood, Centroids
bnd = Bounds(Numbers=k_means.Result)
dedomain = DeconstructDomain(Domain=bnd)  # -> Start, End
gradient = Gradient(
    LowerLimit=dedomain.Start,
    UpperLimit=dedomain.End,
    Parameter=k_means.Result,
    stops=[0: RGB(243, 57, 0), 0.1: RGB(236, 27, 60), 0.2: RGB(210, 0, 118), 0.3: RGB(103, 0, 120), 0.4: RGB(39, 72, 161), 0.5: RGB(1, 192, 229), 0.6: RGB(18, 178, 90), 0.7: RGB(79, 186, 8), 0.8: RGB(220, 237, 32), 0.9: RGB(247, 159, 20)])
move = Move(Geometry=mbox, Motion=pt_5)  # -> flatten(Geometry), Transform
preview = CustomPreview(Geometry=move.Geometry, Material=gradient)  # disabled

# ---- group: simple K-means clusters / clusters Centroids
item = ListItem(List=k_means.Centroids, Index=0, Wrap=True)  # -> Item, Item1, Item2
pt_6 = ConstructPoint(XCoordinate=item.Item, YCoordinate=item.Item1, ZCoordinate=item.Item2)  # -> flatten(Point)

# ---- group: Chebyshev distance
# https://en.wikipedia.org/wiki/Chebyshev_distance
expression = Expression(P=pt_5, A=pt_4, Expression="Max(Max(abs(A.X-P.X),abs(A.Y-P.Y)),abs(A.Z-P.Z))")

# ---- group: Manhattan Distance (dx+dy+dz)
# https://en.wikipedia.org/wiki/Taxicab_geometry
expression_2 = Expression(P=pt_5, A=pt_4, Expression="abs(A.X-P.X)+abs(A.Y-P.Y)+abs(A.Z-P.Z)")

# ---- group: Euclidean distance
dist = Distance(PointA=pt_5, PointB=pt_4)

# ---- group: create a grid for layers display
number_slider_2 = Slider(10, range=1..10)
number_slider_3 = Slider(2, range=1..10)

# ----
lng_2 = ListLength(List=pt_4)
value_list = ValueList({"K-Means": 0, "Gaussian Mixtures": 1}, selected="Gaussian Mixtures")
value_list_2 = ValueList({"distance": 0, "clustering": 1}, selected="distance")

# ---- group: cluster by Z height
# finds unique values of Z (with approximation) to group objects by common values
multiplier = Slider(10, range=10..1000)
pdecon_2 = Deconstruct(Point=pt_5)  # -> XComponent, YComponent, flatten(ZComponent)
multiplication_2 = Multiplication(A=pdecon_2.ZComponent, B=multiplier)
int_2 = Integer(multiplication_2)
cset = CreateSet(List=int_2)  # -> Set, Map
mindex = MemberIndex(Set=int_2, Member=cset.Set)  # -> Index, Count

# ---- group: create a grid for layers display
num = Number(cset.Set)
num_2 = Number(size)
lng_3 = ListLength(List=num)
multiplication_3 = Multiplication(A=num_2, B="2.5")
pt_7 = Point(Point(0, 20.4135468, 0))
recgrid = Rectangular(Plane=pt_7, SizeX=multiplication_3, SizeY=multiplication_3, ExtentX=number_slider_2, ExtentY=number_slider_3)  # -> Cells, flatten(Points)
subset = SubList(List=flatten(recgrid.Cells), Domain=lng_3, Wrap=True)  # -> List, Index
pcen = PolygonCenter(Polyline=subset.List)  # -> graft(CenterV), CenterE, CenterA

# ----
# Different definitions of distance:
# 
# https://machinelearningmastery.com/distance-measures-for-machine-learning/
# 
# https://twitter.com/alanzucconi/status/1372869237455384580?lang=en
order = Slider(1, range=1..5)
distance_type = ValueList({"Euclidean": 0, "Manhattan": 1, "Minkowski": 2, "Chebyshev": 3}, selected="Minkowski")

# ---- group: Minkowski distance
# https://en.wikipedia.org/wiki/Minkowski_distance
expression_3 = Expression(P=pt_5, A=pt_4, n=order, Expression="pow(pow(abs(A.X-P.X), n)+pow(abs(A.Y-P.Y), n)+ pow(abs(A.Z-P.Z),n), 1/n)")

# ----
filter = StreamFilter(Gate=distance_type, Stream0=dist, Stream1=expression_2, Stream2=expression_3, Stream3=expression)

sort = SortList(Keys=filter)  # -> Keys, ValuesA

# ---- group: normalize data
num_3 = Number(sort.Keys)
bnd_2 = Bounds(Numbers=flatten(num_3))
remap = RemapNumbers(Value=num_3, Source=bnd_2, Target=Domain(0, 1))  # -> Mapped, Clipped

# ----
item_2 = ListItem(List=sort.Keys, Index=0, Wrap=True)
num_4 = Number(flatten(item_2))
bar_graph = BarGraph(num_4, BarColor=RGB(255, 0, 90))
bnd_3 = Bounds(Numbers=num_4)

# ---- group: Clustering
# K-Means or Gaussian Mixtures?
# 
# There's not a clear winner:
# 
# https://towardsdatascience.com/gaussian-mixture-models-vs-k-means-which-one-to-choose-62f2736025f0
gaussianmix = GaussianMixture(TrainingInputs=remap.Mapped, Components=lng_2, RandomSeed=5)  # -> Result, Likelihood, Probability
k_means_2 = KMeansClustering(TrainingInputs=remap.Mapped, OfClusters=lng_2, RandomSeed=5)  # -> Result, Likelihood, Centroids

# ----
remap_2 = RemapNumbers(Value=num_4, Source=bnd_3, Target=Domain(0, 1))  # -> Mapped, Clipped
bar_graph_2 = BarGraph(remap_2.Mapped, BarColor=RGB(255, 0, 90))
filter_2 = StreamFilter(Gate=value_list, Stream0=k_means_2.Result, Stream1=gaussianmix.Result)
panel = Panel(gaussianmix.Probability)
bnd_4 = Bounds(Numbers=filter_2)
dedomain_2 = DeconstructDomain(Domain=bnd_4)  # -> Start, End
gradient_2 = Gradient(
    LowerLimit=0,
    UpperLimit=1,
    Parameter=remap_2.Mapped,
    stops=[0: RGB(21, 0, 33), 0.326: RGB(150, 66, 114), 0.664: RGB(224, 186, 187), 1: RGB(255, 255, 255)])
gradient_3 = Gradient(
    LowerLimit=dedomain_2.Start,
    UpperLimit=dedomain_2.End,
    Parameter=filter_2,
    stops=[0: RGB(243, 57, 0), 0.1: RGB(236, 27, 60), 0.2: RGB(210, 0, 118), 0.3: RGB(103, 0, 120), 0.4: RGB(39, 72, 161), 0.5: RGB(1, 192, 229), 0.6: RGB(18, 178, 90), 0.7: RGB(79, 186, 8), 0.8: RGB(220, 237, 32), 0.9: RGB(247, 159, 20)])
filter_3 = StreamFilter(Gate=value_list_2, Stream0=gradient_2, Stream1=gradient_3)
col = Colour(filter_3)

# ----
# display 3D voxels
move_2 = Move(Geometry=mplane.Mesh, Motion=reduce)  # -> Geometry, Transform
f_mmeea = MeshesExtractEdgesWithToleranceAngle(Mesh=move_2.Geometry, Angle=45)  # -> InternalEdges, NakedEdges
previewlw = CustomPreviewLineweights(Geometry=f_mmeea.InternalEdges, Shader=ColourSwatch(SwatchColor=RGB(0, 0, 0)), Absolute=False)

# ----
# placeholder display
col_2 = Colour(col)
int_3 = Integer(mindex.Index)
col_3 = Colour(col)

preview_2 = CustomPreview(Geometry=move_2.Geometry, Material=col_2)

# ---- group: sort points
item_3 = ListItem(List=reduce, Index=int_3, Wrap=True)

# ---- group: sort colours
item_4 = ListItem(List=col_3, Index=int_3, Wrap=True)

# ----
avr = Average(Input=item_3)
orient = Orient(Geometry=item_3, Source=avr, Target=pcen.CenterV)  # -> Geometry, Transform
move_3 = Move(Geometry=mplane.Mesh, Motion=orient.Geometry)  # -> Geometry, Transform
preview_3 = CustomPreview(Geometry=move_3.Geometry, Material=item_4)
