# Grasshopper definition PP extract horizontal faces.gh (Grasshopper 1.0.7)
# Copyright: Co-de-iT
# plug-ins: froGH, Human

# ---- group: small assemblage (171 meshes)
# reference the meshes in the assemblage (or the part you want to analyze) here
mesh = Mesh([<mesh referenced from the Rhino model> x176])

# ---- group: intermediate assemblage (509 meshes)
mesh_2 = Mesh([<mesh referenced from the Rhino model> x592])

# ---- group: entire assemblage (2001 meshes)
mesh_3 = Mesh([<mesh referenced from the Rhino model> x2001])

# ----
# Assembler
# 
# Framework for Iterative Assemblages workflow
# 
# code by Alessio Erioli
# 
# v 1.0
# © Co-de-iT 2021 / Creative Commons Attribution-Non Commercial-ShareAlike 4.0 International License
mjoin = MeshJoin(Meshes=mesh)

facen = FaceNormals(Mesh=mjoin)  # -> Centers, Normals
# find faces with normals pointing in the direction of the global Z
# (with a tolerance)
Z = UnitZ(Factor=1)
angle = Angle(VectorA=facen.Normals, VectorB=Z)  # -> Angle, Reflex
similar = Similarity(FirstNumber=angle.Angle, SecondNumber="0", Threshold=0.1)  # -> Similarity, AbsoluteDifference

# ---- group: display face normals
vdisex = VectorDisplayEx(Point=facen.Centers, Vector=facen.Normals, Colour=facen.Normals, Width=2)

# ----
panel = Panel(angle.Angle)

# ----
# remove all other faces
not = GateNot(A=similar.Similarity)
cullf = CullFaces(Mesh=mjoin, Pattern=not)

# ----
# intercept distance should be larger than the slab thickness, ideally equal to the space height necessary for a person to walk through
mesh_4 = Mesh(cullf)
offset_distance = Panel("0.01")
facen_2 = FaceNormals(Mesh=mesh_4)  # -> Centers, Normals
# exclude faces with obstacles above
Z_2 = UnitZ(Factor=offset_distance)
intercept_distance = Panel("2")
move = Move(Geometry=facen_2.Centers, Motion=Z_2)  # -> Geometry, Transform
line = LineSDL(Start=move.Geometry, Direction=facen_2.Normals, Length=intercept_distance)
mcx = MeshCurve(Mesh=mesh_4, Curve=line)  # -> Points, flatten(Faces)
lng = ListLength(List=mcx.Points)
equals = Equality(FirstNumber=lng, SecondNumber="0")  # -> flatten(Equality), flatten(Inequality)
cullf_2 = CullFaces(Mesh=mesh_4, Pattern=equals.Inequality)

# ----
# weld them and disjoint separate chunks
# this component is the bottleneck
alignvert = AlignVertices(Mesh=cullf_2, Tolerance=0.01)  # -> Result, Count

weld = WeldMesh(Mesh=alignvert.Result, Angle=3.141592654)
disjoint = DisjointMesh(Mesh=weld)

panel_2 = Panel("fix normals")
unim = UnifyMesh(Mesh=disjoint)  # -> Result, Count

area_threshold = Slider(10, range=0..50)
area = Area(Geometry=unim.Result)  # -> Area, Centroid
# filter zones below a certain area threshold (cull small pieces)
larger = LargerThan(FirstNumber=area.Area, SecondNumber=area_threshold)  # -> LargerThan, OrEqualTo
cull = CullPattern(List=area.Centroid, CullPattern=larger.LargerThan)
cull_2 = CullPattern(List=area.Area, CullPattern=larger.LargerThan)
cull_3 = CullPattern(List=unim.Result, CullPattern=larger.LargerThan)

# ---- group: area data range
bar_graph = BarGraph(area.Area, BarColor=RGB(255, 0, 90))

# ---- group: move to origin (for display)
move_along_x = Slider(-32.3, range=-100..0)
bbox = BoundingBox(Content=cull_3, Plane=PlaneXY(0, 0, 0), UnionBox=True)  # -> Box, Box_2
box = EvaluateBox(Box=bbox.Box, UParameter="1", VParameter="0", WParameter="0")  # -> Plane, Point, Include
X = UnitX(Factor=move_along_x)
rev = Reverse(Vector=box.Point)
addition = Addition(A=rev, B=X)
move_2 = Move(Geometry=cull_3, Motion=addition)  # -> Geometry, Transform

# ---- group: color by area
bnd = Bounds(Numbers=cull_2)
dedomain = DeconstructDomain(Domain=bnd)  # -> Start, End
panel_3 = Panel(bnd)
gradient = Gradient(
    LowerLimit=dedomain.Start,
    UpperLimit=dedomain.End,
    Parameter=cull_2,
    stops=[0: RGB(0, 128, 0), 0.5: RGB(255, 255, 0), 1: RGB(255, 0, 0)])

# ---- group: display naked edges
f_mmeea = MeshesExtractEdgesWithToleranceAngle(Mesh=move_2.Geometry, Angle=45)  # -> InternalEdges, NakedEdges
previewlw = CustomPreviewLineweights(Geometry=f_mmeea.NakedEdges, Shader=ColourSwatch(SwatchColor=RGB(0, 0, 0)), Thickness="3", Absolute=False)

# ---- group: find largest span
bbox_2 = BoundingBox(Content=cull_3, Plane=PlaneXY(0, 0, 0), UnionBox=False)  # -> Box, Box_2
boxprop = BoxProperties(Box=bbox_2.Box)  # -> Center, Diagonal, Area, Volume, Degeneracy
devec = DeconstructVector(Vector=boxprop.Diagonal)  # -> XComponent, YComponent, ZComponent
sort = SortList(Keys=devec.YComponent)  # -> reverse(Keys), ValuesA
sort_2 = SortList(Keys=devec.XComponent)  # -> reverse(Keys), ValuesA
item = ListItem(List=sort.Keys, Index=0, Wrap=True)
item_2 = ListItem(List=sort_2.Keys, Index=0, Wrap=True)
vec = VectorXYZ(XComponent=item_2, YComponent=item, ZComponent=0)  # -> Vector, Length

# ----
preview = CustomPreview(Geometry=move_2.Geometry, Material=gradient)

sort_3 = SortList(Keys=cull_2, ValuesA=cull_3, ValuesB=cull, ValuesC=gradient)  # -> Keys, ValuesA, ValuesB, ValuesC
n_of_rows = Slider(38, range=2..50)
lng_2 = ListLength(List=sort_3.ValuesB)
integer_division = IntegerDivision(A=lng_2, B=n_of_rows)  # -> expr("x+1", Result)
multiplication = Multiplication(A=vec.Vector, B=Slider(1.1, range=1..2))
devec_2 = DeconstructVector(Vector=multiplication)  # -> XComponent, YComponent, ZComponent
# sort individual meshes by area on a table
recgrid = Rectangular(Plane=PlaneXY(0, 0, 0), SizeX=devec_2.XComponent, SizeY=devec_2.YComponent, ExtentX=integer_division, ExtentY=n_of_rows)  # -> flatten(Cells), Points
subtraction = Subtraction(A=lng_2, B="1")
subset = SubList(List=recgrid.Cells, Domain=subtraction, Wrap=True)  # -> List, Index
pcen = PolygonCenter(Polyline=subset.List)  # -> CenterV, CenterE, CenterA
orient = Orient(Geometry=sort_3.ValuesA, Source=sort_3.ValuesB, Target=pcen.CenterV)  # -> Geometry, Transform
preview_2 = CustomPreview(Geometry=orient.Geometry, Material=sort_3.ValuesC)  # disabled

# ---- group: move for display / move to origin
vec_2 = Vector(addition)

# ----
list = ValueList({"Z height": 0, "area": 1}, selected="Z height")

# ---- group: display naked edges
f_mmeea_2 = MeshesExtractEdgesWithToleranceAngle(Mesh=orient.Geometry, Angle=45)  # -> InternalEdges, NakedEdges
previewlw_2 = CustomPreviewLineweights(Geometry=f_mmeea_2.NakedEdges, Shader=ColourSwatch(SwatchColor=RGB(0, 0, 0)), Thickness="3", Absolute=False)  # disabled

# ----
pdecon = Deconstruct(Point=cull)  # -> XComponent, YComponent, ZComponent
grouping_distance_m = Slider(1, range=0.1..10)

# ---- group: "normalize" heights (start from 0)
bnd_2 = Bounds(Numbers=pdecon.ZComponent)
dedomain_2 = DeconstructDomain(Domain=bnd_2)  # -> Start, End
subtraction_2 = Subtraction(A=pdecon.ZComponent, B=dedomain_2.Start)

# ----
division = Division(A=subtraction_2, B=grouping_distance_m)

round = Round(Number=division)  # -> Nearest, Floor, Ceiling
# group meshes by floor height (approximated to the grouping distance)
cset = CreateSet(List=round.Nearest)  # -> Set, Map
f_ifroml = IndexesFromList(Data=cset.Set)
mindex = MemberIndex(Set=cset.Map, Member=f_ifroml)  # -> Index, Count
item_3 = ListItem(List=cull_3, Index=mindex.Index, Wrap=True)
mjoin_2 = MeshJoin(Meshes=item_3)  # -> flatten(Mesh)

area_2 = Area(Geometry=mjoin_2)  # -> Area, Centroid
pdecon_2 = Deconstruct(Point=area_2.Centroid)  # -> XComponent, YComponent, ZComponent

# ---- group: move for display
bbox_3 = BoundingBox(Content=mjoin_2, Plane=PlaneXY(0, 0, 0), UnionBox=True)  # -> Box, Box_2
boxprop_2 = BoxProperties(Box=bbox_3.Box)  # -> Center, Diagonal, Area, Volume, Degeneracy
pdecon_3 = Deconstruct(Point=boxprop_2.Diagonal)  # -> XComponent, YComponent, ZComponent
multiplication_2 = Multiplication(A=pdecon_3.YComponent, B=Slider(1.1, range=1..2))
Y = UnitY(Factor=multiplication_2)
addition_2 = Addition(A=Y, B=vec_2)
move_3 = Move(Geometry=mjoin_2, Motion=addition_2)  # -> Geometry, Transform

# ---- group: color by area
bnd_3 = Bounds(Numbers=area_2.Area)
dedomain_3 = DeconstructDomain(Domain=bnd_3)  # -> Start, End
panel_4 = Panel(bnd_3)
gradient_2 = Gradient(
    LowerLimit=dedomain_3.Start,
    UpperLimit=dedomain_3.End,
    Parameter=area_2.Area,
    stops=[0: RGB(0, 128, 0), 0.5: RGB(255, 255, 0), 1: RGB(255, 0, 0)])

# ---- group: color group by z height
bnd_4 = Bounds(Numbers=pdecon_2.ZComponent)
dedomain_4 = DeconstructDomain(Domain=bnd_4)  # -> Start, End
panel_5 = Panel(bnd_4)
gradient_3 = Gradient(
    LowerLimit=dedomain_4.Start,
    UpperLimit=dedomain_4.End,
    Parameter=pdecon_2.ZComponent,
    stops=[0: RGB(21, 0, 33), 0.326: RGB(150, 66, 114), 0.664: RGB(224, 186, 187), 1: RGB(255, 255, 255)])

# ---- group: display naked edges
f_mmeea_3 = MeshesExtractEdgesWithToleranceAngle(Mesh=move_3.Geometry, Angle=45)  # -> InternalEdges, NakedEdges
previewlw_3 = CustomPreviewLineweights(Geometry=f_mmeea_3.NakedEdges, Shader=ColourSwatch(SwatchColor=RGB(0, 0, 0)), Thickness="3", Absolute=False)

# ----
preview_3 = CustomPreview(Geometry=move_3.Geometry, Material=gradient_3)

# ---- group: find largest span
bbox_4 = BoundingBox(Content=mjoin_2, Plane=PlaneXY(0, 0, 0), UnionBox=False)  # -> Box, Box_2
boxprop_3 = BoxProperties(Box=bbox_4.Box)  # -> Center, Diagonal, Area, Volume, Degeneracy
devec_3 = DeconstructVector(Vector=boxprop_3.Diagonal)  # -> XComponent, YComponent, ZComponent
sort_4 = SortList(Keys=devec_3.YComponent)  # -> reverse(Keys), ValuesA
sort_5 = SortList(Keys=devec_3.XComponent)  # -> reverse(Keys), ValuesA
item_4 = ListItem(List=sort_4.Keys, Index=0, Wrap=True)
item_5 = ListItem(List=sort_5.Keys, Index=0, Wrap=True)
vec_3 = VectorXYZ(XComponent=item_5, YComponent=item_4, ZComponent=0)  # -> Vector, Length

# ----
filter = StreamFilter(Gate=list, Stream0=gradient_3, Stream1=gradient_2)
filter_2 = StreamFilter(Gate=list, Stream0=pdecon_2.ZComponent, Stream1=area_2.Area)

sort_6 = SortList(
    Keys=filter_2,
    ValuesA=mjoin_2,
    ValuesB=area_2.Centroid,
    ValuesC=filter,
    ValuesD=area_2.Area,
    ValuesE=pdecon_2.ZComponent)  # -> Keys, ValuesA, ValuesB, ValuesC, ValuesD, ValuesE
n_of_rows_2 = Slider(5, range=2..50)
lng_3 = ListLength(List=sort_6.ValuesB)
scale = Slider(1.1, range=1..2)
integer_division_2 = IntegerDivision(A=lng_3, B=n_of_rows_2)  # -> expr("x+1", Result)
multiplication_3 = Multiplication(A=vec_3.Vector, B=scale)
devec_4 = DeconstructVector(Vector=multiplication_3)  # -> XComponent, YComponent, ZComponent
# sort floor meshes by level on a table
recgrid_2 = Rectangular(
    Plane=PlaneXY(0, 0, 0),
    SizeX=devec_4.XComponent,
    SizeY=devec_4.YComponent,
    ExtentX=integer_division_2,
    ExtentY=n_of_rows_2)  # -> flatten(Cells), Points
subtraction_3 = Subtraction(A=lng_3, B="1")
subset_2 = SubList(List=recgrid_2.Cells, Domain=subtraction_3, Wrap=True)  # -> List, Index
pcen_2 = PolygonCenter(Polyline=subset_2.List)  # -> CenterV, CenterE, CenterA
orient_2 = Orient(Geometry=sort_6.ValuesA, Source=sort_6.ValuesB, Target=pcen_2.CenterV)  # -> Geometry, Transform
preview_4 = CustomPreview(Geometry=orient_2.Geometry, Material=sort_6.ValuesC)

# ---- group: table captions
expression = Expression(x=sort_6.ValuesD, Expression="round(x,2)")
expression_2 = Expression(x=sort_6.ValuesE, Expression="round(x,2)")
expression_3 = Expression(x=expression_2, y=expression, Expression="Format(\"Level {0} m, area: {1} mq\", x, y)")
multiplication_4 = Multiplication(A=multiplication_3, B="{-0.5,-0.5,0}")
addition_3 = Addition(A=pcen_2.CenterV, B=multiplication_4)
tag = TextTag3D(
    Location=addition_3,
    Text=expression_3,
    Size=Slider(2.3, range=1..10),
    Colour=ColourSwatch(SwatchColor=RGB(0, 0, 0)),
    Justification=7)

# ---- group: display naked edges
f_mmeea_4 = MeshesExtractEdgesWithToleranceAngle(Mesh=orient_2.Geometry, Angle=45)  # -> InternalEdges, NakedEdges
previewlw_4 = CustomPreviewLineweights(Geometry=f_mmeea_4.NakedEdges, Shader=ColourSwatch(SwatchColor=RGB(0, 0, 0)), Thickness="3", Absolute=False)
