# Grasshopper definition circulation - shortest path & frequency.gh (Grasshopper 1.0.7)
# Copyright: Co-de-iT
# plug-ins: Shortest Walk in Gh, Human, Assembler, froGH

assemblage = Relay()
xdata_circulation_path = Relay()
# Data Dam: Click on the play symbol (when present) to manually update the data
dam = DataDam(DataA=assemblage, BufferDelay=10000000, BufferMode=0)
# Assembler
# 
# Framework for Iterative Assemblages workflow
# 
# code by Alessio Erioli
# 
# v 1.0
# © Co-de-iT 2021 / Creative Commons Attribution-Non Commercial-ShareAlike 4.0 International License
# shortest walk - AssemblyObjects connections
aoadecon = DeconstructAssemblage(Assemblage=dam)  # -> AssemblageObjects, AssemblageRules, ReceiverObjectsIndexes, AvailableObjectIndexes, UnreachableObjectIndexes

# ---- group: Assemblage Topology
# Assemblage Topology: hO - Handle Occupancy
# 
# 0 - available
# 1 - connected
# -1 - occluded
# 
# nO - neighbour AssemblyObject index (-1 if Handle is available)
# 
# nH - neighbour Handle index (-1 if Handle is available or occluded)
aotopo = ExtractTopology(Assemblage=dam)  # -> HandleOccupancy, NeighbourObjectIndex, NeighbourHandleIndex

# ---- group: AO Reference Planes
# AO connectivity network: Creates the connectivity network between AssemblyObjects by connecting centres of reference planes with connected handles.
# 
# This network does not necessarily coincide with the spatial connectivity network, just tells how the Assembly Objects are connected to each other.
aoplane = ExtractReferencePlane(AssemblyObject=aoadecon.AssemblageObjects)  # -> graft(ReferencePlane)

# ---- group: AO Handles Sender Planes
aosp = ExtractSenderHandlesPlanes(AssemblyObject=aoadecon.AssemblageObjects)

# ---- group: select free Handles
equals = Equality(FirstNumber=aotopo.HandleOccupancy, SecondNumber="0")  # -> Equality, Inequality
cull = CullPattern(List=aosp, CullPattern=equals.Equality)  # -> flatten(List)

# ----
# AO circulation path: Associates the designed circulation path to its AssemblyObject
aoxd = AssociateXData(AssemblyObjects=aoadecon.AssemblageObjects, XData=xdata_circulation_path)
xddecon = DeconstructXData(XData=aoxd)  # -> Label, Data, ReferencePlane, AssemblyObjectNameReference

# ---- group: select vertical handles only
Z = UnitZ(Factor=1)
deplane = DeconstructPlane(Plane=cull)  # -> Origin, XAxis, YAxis, ZAxis
dprod = DotProduct(VectorA=deplane.ZAxis, VectorB=Z, Unitize=False)
abs = Absolute(Value=dprod)
int = Integer("0")
int_2 = Integer(abs)
equals_2 = Equality(FirstNumber=int_2, SecondNumber=int)  # -> Equality, Inequality
cull_2 = CullPattern(List=cull, CullPattern=equals_2.Equality)

# ---- group: filter connected handles
equals_3 = Equality(FirstNumber=aotopo.HandleOccupancy, SecondNumber="1")  # -> Equality, Inequality
cull_3 = CullPattern(List=aosp, CullPattern=equals_3.Equality)

# ---- group: exclude occluded
equals_4 = Equality(FirstNumber=aotopo.HandleOccupancy, SecondNumber="-1")  # -> Equality, Inequality
cull_4 = CullPattern(List=aosp, CullPattern=equals_4.Inequality)

# ----
list = ValueList({"AO connectivity": 0, "Circulation path": 1}, selected="AO connectivity")

ln = Line(StartPoint=aoplane, EndPoint=cull_4)

filter = StreamFilter(Gate=list, Stream0=ln, Stream1=xddecon.Data)

# ---- group: display line network
previewlw = CustomPreviewLineweights(Geometry=filter, Shader=ColourSwatch(SwatchColor=RGB(255, 0, 0)), Absolute=False)  # disabled

# ----
line = Line(simplify(filter))

# ---- group: generate all possible connections
crossref = CrossReference(ListA=cull_2, ListB=cull_2, CrossMode=5)  # -> ListA, ListB
ln_2 = Line(StartPoint=crossref.ListA, EndPoint=crossref.ListB)

# ----
# note on shortest path: Whle connectivity network will always show a path (all objects are connected at least to another object, so a path between any two points always exists), circulation path might fail to find a path if the 2 points are on isolated clusters.
line_2 = Line(flatten(line))
explode = Explode(Curve=line_2, Recursive=True)  # -> Segments, flatten(Vertices)
pt = Point(Point(-177.684312, 75.04751204, 0))
pt_2 = Point(Point(-100.4864648, 130.5510248, -25.53229878))
cp = ClosestPoint(Point=pt, Cloud=explode.Vertices)  # -> ClosestPoint, CPIndex, Distance
cp_2 = ClosestPoint(Point=pt_2, Cloud=explode.Vertices)  # -> ClosestPoint, CPIndex, Distance
ln_3 = Line(StartPoint=pt_2, EndPoint=cp_2.ClosestPoint)
ln_4 = Line(StartPoint=pt, EndPoint=cp.ClosestPoint)
ln_5 = Line(StartPoint=cp.ClosestPoint, EndPoint=cp_2.ClosestPoint)
start = ColourSwatch(SwatchColor=RGB(255, 0, 0))
end = ColourSwatch(SwatchColor=RGB(0, 153, 255))
shortwalk = ShortestWalk(Curves=line_2, WantedPath=ln_5)  # -> ShortestWalk, Succession, Direction, Length
dots = DotDisplay(Point=[cp.ClosestPoint, cp_2.ClosestPoint], Colour=[start, end], Size="1")
previewlw_2 = CustomPreviewLineweights(Geometry=shortwalk.ShortestWalk, Shader=ColourSwatch(SwatchColor=RGB(255, 212, 0)), Thickness="5", Absolute=False)  # disabled

# ---- group: sub-selection (for testing)
subset = SubList(List=ln_2, Domain="10000", Wrap=True)  # -> List, Index

# ----
line_3 = Line(flatten(filter))

# ---- group: extract indexes of involved objects
f_ifroml = IndexesFromList(Data=line_2)
unflatten = UnflattenTree(Tree=f_ifroml, Guide=line)
mindex = MemberIndex(Set=unflatten, Member=shortwalk.Succession)  # -> Index, Count
f_massbool = MassBoolean(Values=mindex.Count, BooleanOperator="OR", Boolean_Operator="OR")

# ----
data = Data(graft(aoadecon.AssemblageObjects))
# finding objects involved in the shortest walk: the steps are:
# 
# . generate an index for each of the lines in the network
# 
# . rebuild the original tree structure for the indexes (this puts the index of each line in a branch which index corresponds to the Object the line belongs to)
# 
# . check in which branches are the indexes involved in the shortest walk (see how Member Index works below)
dispatch = Dispatch(List=data, DispatchPattern=f_massbool)  # -> ListA, ListB
preview = CustomPreview(
    Geometry=dispatch.ListA,
    Material={diffuse=RGB(221, 160, 221), emission=RGB(66, 48, 66), shine=0.5, specular=RGB(255, 255, 255), transparency=0})  # disabled

# ----
# circulation frequency
shortwalk_2 = ShortestWalk(Curves=line_3, WantedPath=subset.List)  # -> ShortestWalk, Succession, Direction, Length
f_ifroml_2 = IndexesFromList(Data=line_3)
dom = ConstructDomain(DomainStart="1", DomainEnd=Slider(15, range=5..15))

# ---- group: counts occurrences in a list
c_script = CSharpScript(L=flatten(shortwalk_2.Succession), M=f_ifroml_2)  # -> out, N; inputs L: list of Int32, M: list of Int32
# ---------- c_script: C# usings ----------
using System.Threading.Tasks;
# ---------- c_script: C# ----------
    int[] occurrences = new int[M.Count];

    Parallel.For(0, M.Count, i =>
      {
      int count = 0;
      for (int j = 0; j < L.Count; j++)
      {
        if(L[j] == M[i]) count++;
      }
      occurrences[i] = count;
      });

   N = occurrences;
# ---------- end c_script ----------

# ----
log = Logarithm(Value=c_script.N)
sqrt = SquareRoot(Value=c_script.N)
num = Number(sqrt)
bnd = Bounds(Numbers=num)
remap = RemapNumbers(Value=num, Source=bnd, Target=Domain(0, 1))  # -> Mapped, Clipped
gradient = Gradient(LowerLimit=0, UpperLimit=1, Parameter=remap.Mapped, stops=[0: RGB(0, 128, 0), 0.5: RGB(255, 255, 0), 1: RGB(255, 0, 0)])
remap_2 = RemapNumbers(Value=remap.Mapped, Source=Domain(0, 1), Target=dom)  # -> Mapped, Clipped
previewlw_3 = CustomPreviewLineweights(Geometry=line_3, Shader=gradient, Thickness=remap_2.Mapped, Absolute=False)

# ---- group: original distribution
bar_graph = BarGraph(c_script.N, BarColor=RGB(255, 0, 90))

# ---- group: logarithmic distrbution
bar_graph_2 = BarGraph(log, BarColor=RGB(255, 0, 90))

# ---- group: inverse square distribution
bar_graph_3 = BarGraph(sqrt, BarColor=RGB(255, 0, 90))
