# Grasshopper definition cluster by distance.gh (Grasshopper 1.0.7)
# Copyright: Co-de-iT
# plug-ins: Assembler

assemblyobject_geometries = Relay()
assemblyobjects = Relay()
# Assembler
# 
# Framework for Iterative Assemblages workflow
# 
# code by Alessio Erioli
# 
# v 1.0
# © Co-de-iT 2021 / Creative Commons Attribution-Non Commercial-ShareAlike 4.0 International License
aoplane = ExtractReferencePlane(AssemblyObject=assemblyobjects)

# ---- group: index of starting point
number_slider = Slider(66, range=0..200)

# ---- group: clustering distance
number_slider_2 = Slider(30, range=0..30)

# ---- group: cluster by distance
c_script = CSharpScript(P=aoplane, i=number_slider, d=number_slider_2)  # -> out, C, iC; inputs P: list of Point3d, i: Int32, d: Double
# ---------- c_script: C# usings ----------
using Rhino.Collections;
using System.Linq;
# ---------- c_script: C# ----------
    if(P == null || P.Count == 0) return;
                                                                            /*
  . pseudo-algorithm:
  . clusters are classes with a point list and a centroid
  . start with a single-point cluster from a selectable point (by index)
  . seek closest point from current cluster centroid
  . point within distance? Add and recompute centroid : start a new cluster

  */
    List<Point3d> points = P.Select(p => new Point3d(p)).ToList();
    List<int> pInd = new List<int>();
    for(int j = 0; j < P.Count; j++) pInd.Add(j);

    double distsq = (d * d);

    // initialize clusters
    List<Cluster> clusters = new List<Cluster>();
    // make sure index does not overshoot number of points
    i %= P.Count;

    Cluster currentCluster = new Cluster(points[i], i);
    points.RemoveAt(i);
    pInd.RemoveAt(i);

    for(int j = 1; j < P.Count; j++)
    {
      int index = Point3dList.ClosestIndexInList(points, currentCluster.centroid);
      
      if(!currentCluster.TryAddPoint(points[index], pInd[index], distsq))
      {
        clusters.Add(currentCluster);
        currentCluster = new Cluster(points[index], pInd[index]);
      }
      points.RemoveAt(index);
      pInd.RemoveAt(index);
    }

    clusters.Add(currentCluster);

    C = ConvertToTree(clusters);
    iC = ConvertIndToTree(clusters);
# ---------- c_script: C# additional code ----------
  public class Cluster
  {
    public List<Point3d> points;
    public List<int> indexes;
    public Point3d centroid;

    public Cluster()
    {
      points = new List<Point3d>();
      indexes = new List<int>();
      centroid = Point3d.Unset;
    }

    public Cluster(Point3d point, int ind)
    {
      points = new List<Point3d>();
      indexes = new List<int>();
      points.Add(point);
      indexes.Add(ind);
      centroid = point;
    }

    public void AddPoint(Point3d p, int ind)
    {
      points.Add(p);
      indexes.Add(ind);
      ComputeCentroid();
    }

    public bool TryAddPoint(Point3d p, int ind, double distsq)
    {

      double dist = centroid.DistanceToSquared(p);
      if (dist < distsq)
      {
        AddPoint(p, ind);
      } else return false;

      if(!CheckRange(distsq))
      {
        points.RemoveAt(points.Count - 1);
        indexes.RemoveAt(indexes.Count - 1);
        ComputeCentroid();
        return false;
      }
      return true;
    }

    public bool CheckRange(double distsq)
    {

      for(int i = 0; i < points.Count; i++)
      {
        if(centroid.DistanceToSquared(points[i]) > distsq)
          return false;
      }
      return true;
    }

    public void ComputeCentroid()
    {
      centroid = new Point3d();
      for(int i = 0; i < points.Count; i++)
        centroid += points[i];
      centroid /= points.Count;
    }

  }


  DataTree<Point3d> ConvertToTree(List<Cluster> clusters)
  {
    DataTree<Point3d> clustersTree = new DataTree<Point3d>();

    for(int i = 0; i < clusters.Count; i++)
      clustersTree.AddRange(clusters[i].points, new GH_Path(i));

    return clustersTree;
  }

  DataTree<int> ConvertIndToTree (List<Cluster> clusters)
  {
    DataTree<int> clustersTree = new DataTree<int>();

    for(int i = 0; i < clusters.Count; i++)
      clustersTree.AddRange(clusters[i].indexes, new GH_Path(i));

    return clustersTree;
  }
# ---------- end c_script ----------

# ---- group: generate random clusters colors for better display
tstat = TreeStatistics(Tree=c_script.C)  # -> Paths, Length, Count
range = Range(Domain=Domain(0, 1), Steps=tstat.Count)
jitter = Jitter(List=range, Jitter=1, Seed=2)  # -> Values, Indices
gradient = Gradient(
    LowerLimit=0,
    UpperLimit=1,
    Parameter=jitter.Values,
    stops=[0: RGB(243, 57, 0), 0.1: RGB(236, 27, 60), 0.2: RGB(210, 0, 118), 0.3: RGB(103, 0, 120), 0.4: RGB(39, 72, 161), 0.5: RGB(1, 192, 229), 0.6: RGB(18, 178, 90), 0.7: RGB(79, 186, 8), 0.8: RGB(220, 237, 32), 0.9: RGB(247, 159, 20), 1: RGB(243, 57, 0)])

# ---- group: display clusters and connections
# activate these for debugging purposes
avr = Average(Input=c_script.C)  # disabled
ln = Line(StartPoint=c_script.C, EndPoint=avr)  # disabled
preview = CustomPreview(Geometry=c_script.C, Material=graft(gradient))  # disabled
preview_2 = CustomPreview(Geometry=ln, Material=graft(gradient))  # disabled

# ----
item = ListItem(List=assemblyobject_geometries, Index=c_script.iC, Wrap=True)
preview_3 = CustomPreview(Geometry=item, Material=graft(gradient))
