# Grasshopper definition display Handles occupancy.gh (Grasshopper 1.0.7)
# Copyright: Co-de-iT
# plug-ins: Assembler, Human

assemblage = Relay()

# ---- group: Show Handles Occupancy status
aotopo = ExtractTopology(Assemblage=assemblage)  # -> HandleOccupancy, NeighbourObjectIndex, NeighbourHandleIndex
# Assembler
# 
# Framework for Iterative Assemblages workflow
# 
# code by Alessio Erioli
# 
# v 1.0
# © Co-de-iT 2021 / Creative Commons Attribution-Non Commercial-ShareAlike 4.0 International License
aoadecon = DeconstructAssemblage(Assemblage=assemblage)  # -> AssemblageObjects, AssemblageRules, ReceiverObjectsIndexes, AvailableObjectIndexes, UnreachableObjectIndexes
aosp = ExtractSenderHandlesPlanes(AssemblyObject=aoadecon.AssemblageObjects)
occluded = ColourSwatch(SwatchColor=RGB(255, 0, 0))
available = ColourSwatch(SwatchColor=RGB(255, 255, 255))
connected = ColourSwatch(SwatchColor=RGB(58, 222, 47))
deplane = DeconstructPlane(Plane=aosp)  # -> Origin, XAxis, YAxis, ZAxis
merge = Merge(Data1=available, Data2=connected, Data3=occluded)
line = LineSDL(Start=aosp, Direction=deplane.ZAxis, Length=Slider(0.8, range=0..1))
item = ListItem(List=merge, Index=aotopo.HandleOccupancy, Wrap=True)
previewlw = CustomPreviewLineweights(Geometry=line, Shader=item, Absolute=False)
