# Grasshopper definition filter blocks H-V.gh (Grasshopper 1.0.7)
# Copyright: Co-de-iT
# plug-ins: Assembler, EleFront

assemblage = Relay()
# Assembler
# 
# Framework for Iterative Assemblages workflow
# 
# code by Alessio Erioli
# 
# v 1.0
# © Co-de-iT 2021 / Creative Commons Attribution-Non Commercial-ShareAlike 4.0 International License
aoadecon = DeconstructAssemblage(Assemblage=assemblage)  # -> AssemblageObjects, AssemblageRules, ReceiverObjectsIndexes, AvailableObjectIndexes, UnreachableObjectIndexes

# ---- group: data dam
dam = DataDam(DataA=aoadecon.AssemblageObjects, BufferDelay=10000000, BufferMode=0)

# ---- group: Extract AO Type
aotype = ExtractType(AssemblyObject=dam)

# ----
# recognizing horizontal and vertical: The dot product of 2 unit vectors is equal to the cosine of the comprised angle.
# 
# Two perpendicular vectors (angle 90) have a dot product of 0, while two parallel vectors (angle 0 or 180) the dot product is 1 or -1 respectively. Using the absolute value function, the value becomes 1 regardless of the sign.
# 
# In this case we test the angle of each AssemblyObject's  reference plane X vector with the global Z vector. If they are parallel (absolute dot product = 1) then the object is oriented vertically, if they are perpendicular (absolute dot product = 0) the object is horizontal.
# associate blocks
# You can use the same boolean pattern filtering process used above, but in case you have multiple AssemblyObject types (>2) and need to assign different object types this is a more adaptable and modular construct (add outputs to the Sift/inputs to the Combine components accordingly)
# delays updated data transmission by a certain amount of time or only when clicked
# recombine types: In case of more than 2 types, add other channels to the input accordingly.
# sift by type: filters by a pattern of integers. In case of more than 2 types, add other channels to the output.
aoplane = ExtractReferencePlane(AssemblyObject=dam)
sift = SiftPattern(List=aoplane, SiftPattern=aotype)  # -> Output0, Output1
panel = Panel("recombine horizontal/vertical")
bake = BooleanToggle(False)

# ---- group: separate horizontal/vertical
Z = UnitZ(Factor=1)
deplane = DeconstructPlane(Plane=sift.Output0)  # -> Origin, XAxis, YAxis, ZAxis
dprod = DotProduct(VectorA=deplane.XAxis, VectorB=Z, Unitize=False)
abs = Absolute(Value=dprod)
int = Integer(abs)
dispatch = Dispatch(List=sift.Output0, DispatchPattern=int)  # -> ListA, ListB

# ---- group: associate blocks / vertical elements
pln = Plane(dispatch.ListA)

# ---- group: associate blocks / horizontal elements
pln_2 = Plane(dispatch.ListB)

# ---- group: associate blocks
# block names must match the names of Rhino blocks that you can see in the BlockManager
# objectA / type 0
# objectB / type 1
pln_3 = Plane(sift.Output1)
inblock = InsertBlock(BlockName="block_typeA_v1", SourcePlane=pln_2)
inblock_2 = InsertBlock(BlockName="block_typeA_v2", SourcePlane=pln)
inblock_3 = InsertBlock(BlockName="block_typeB", SourcePlane=pln_3)

# ----
weave = Weave(Pattern=int, Stream0=inblock, Stream1=inblock_2, NullGaps=False)
combine = CombineData(Input0=weave, Input1=inblock_3)  # -> Result, Index
data = Data(combine.Result)
bake_2 = BakeObjects(Geometry=data, Bake=bake)
