# Grasshopper definition filter handles - composite criteria.gh (Grasshopper 1.0.7)
# Copyright: Co-de-iT
# plug-ins: Assembler

assemblyobjects = Relay()
# Assembler
# 
# Framework for Iterative Assemblages workflow
# 
# code by Alessio Erioli
# 
# v 1.0
# © Co-de-iT 2021 / Creative Commons Attribution-Non Commercial-ShareAlike 4.0 International License
aodecon = DeconstructAssemblyObject(AssemblyObject=assemblyobjects)  # -> Name, CollisionMesh, ReferencePlane, Direction, Weight, OccludedNeighbours, Handles, Children, ZLock
occupancy = ValueList({"free": 0, "connected": 1, "occluded": -1}, selected="free")
handecon = DeconstructHandle(Handle=aodecon.Handles)  # -> SenderPlane, ReceiverPlanes, ReceiverPlanesRotations, HandleType, HandleWeight, HandleOccupancy, NeighbourObject, NeighbourHandle
# replace with your target type
target_type = Panel("2")
equals = Equality(FirstNumber=handecon.HandleOccupancy, SecondNumber=occupancy)  # -> Equality, Inequality
equals_2 = Equality(FirstNumber=handecon.HandleType, SecondNumber=target_type)  # -> Equality, Inequality
or = GateOr()
# you can compose criteria with AND or OR components for complex selection filters
# 
# Zoom in to add inputs
and = GateAnd(A=equals_2.Equality, B=equals.Equality)
dispatch = Dispatch(List=aodecon.Handles, DispatchPattern=and)  # -> ListA, ListB
# Filtered handles for selected type
handecon_2 = DeconstructHandle(Handle=dispatch.ListA)  # -> SenderPlane, ReceiverPlanes, ReceiverPlanesRotations, HandleType, HandleWeight, HandleOccupancy, NeighbourObject, NeighbourHandle
pln = Plane(handecon_2.SenderPlane)
