# Grasshopper definition filter handles - topology.gh (Grasshopper 1.0.7)
# Copyright: Co-de-iT
# plug-ins: Assembler, froGH

assemblage = Relay()
aoadecon = DeconstructAssemblage(Assemblage=assemblage)  # -> AssemblageObjects, AssemblageRules, ReceiverObjectsIndexes, AvailableObjectIndexes, UnreachableObjectIndexes

# ---- group: Assemblage topology
# hO - handle occupancy (0 = free,  = connected, -1 = occluded)
# 
# nC - neighbour Object index
# 
# nH - neighbour component handle index
aotopo = ExtractTopology(Assemblage=assemblage)  # -> HandleOccupancy, NeighbourObjectIndex, NeighbourHandleIndex

# ----
occupancy = ValueList({"free": 0, "connected": 1, "occluded": -1}, selected="free")
# Assembler
# 
# Framework for Iterative Assemblages workflow
# 
# code by Alessio Erioli
# 
# v 1.0
# © Co-de-iT 2021 / Creative Commons Attribution-Non Commercial-ShareAlike 4.0 International License
panel = Panel(aotopo.HandleOccupancy)

# ---- group: extract sender handle plane
aosp = ExtractSenderHandlesPlanes(AssemblyObject=aoadecon.AssemblageObjects)

# ----
equals = Equality(FirstNumber=aotopo.HandleOccupancy, SecondNumber=occupancy)  # -> Equality, Inequality

# ---- group: filter handles sender planes
cull = CullPattern(List=aosp, CullPattern=equals.Equality)  # -> simplify(List)

# ----
pln = Plane(cull)

# ---- group: planes at non-connected handles
# operation on filtered handles
number_slider = Slider(250, range=0..300)
f_cdom = CenteredDomain(DomainLength=number_slider)
planesrf = PlaneSurface(Plane=pln, XSize=f_cdom, YSize=Slider(280, range=10..500))
# An example of post-assemblage operation:
# 
# . locate all non-connected handles
# . draw a panel in their location
mplane = MeshPlane(Boundary=planesrf, WidthCount="1", HeightCount="1")  # -> Mesh, Area
