# Grasshopper definition find sender-receiver indices at iteration.gh (Grasshopper 1.0.7)
# Copyright: Co-de-iT
# plug-ins: Assembler

assemblage = Relay()
aopa = Relay()
# Assembler
# 
# Framework for Iterative Assemblages workflow
# 
# code by Alessio Erioli
# 
# v 1.0
# © Co-de-iT 2021 / Creative Commons Attribution-Non Commercial-ShareAlike 4.0 International License
aoadecon = DeconstructAssemblage(Assemblage=assemblage)  # -> AssemblageObjects, AssemblageRules, ReceiverObjectsIndexes, AvailableObjectIndexes, UnreachableObjectIndexes
iteration_to_sample = Panel("0")
# Length of previous AssemblyObjects list.
# 
# If starting from scratch, use 1 instead
lng = ListLength(List=aopa)
addition = Addition(A=iteration_to_sample, B=lng)
item = ListItem(List=aoadecon.ReceiverObjectsIndexes, Index=iteration_to_sample, Wrap=True)

# ---- group: receiver
item_2 = ListItem(List=aoadecon.AssemblageObjects, Index=item, Wrap=True)

# ---- group: sender
item_3 = ListItem(List=aoadecon.AssemblageObjects, Index=addition, Wrap=True)
