# Grasshopper definition c02_20211006_in class.gh (Grasshopper 1.0.7)
# Copyright: Co-de-iT

mesh = Mesh(<mesh referenced from the Rhino model>)
brep = Brep(<brep referenced from the Rhino model>)
pt = Point(Point(0.2507413789, 6.810276458, 3.71236785))
pt_2 = Point(<point referenced from the Rhino model>)
panel = Panel(brep)
panel_2 = Panel(mesh)
move = Move(Geometry=pt, Motion=Vector(0, 0, 10))  # -> Geometry, Transform
ln = Line(StartPoint=pt, EndPoint=pt_2)
panel_3 = Panel(move.Geometry)
panel_4 = Panel(pt_2)
# <title>
# 
# <description>
# 
# code by Alessio Erioli
# 
# v 0.1
# © a3 2021 / Creative Commons Attribution-Non Commercial-ShareAlike 4.0 International License
panel_5 = Panel(pt)
data = Data([mesh, brep, move.Geometry])
panel_6 = Panel(data)
