# Grasshopper definition Assembler basic test + show geometry.gh (Grasshopper 1.0.7)
# Copyright: Co-de-iT
# plug-ins: Assembler, MeshEdit Components

panel = Panel("""0
90
180""")
crv = Curve(<curve referenced from the Rhino model>)
handles = ConstructHandles(Polyline=crv, RotationAngles=panel, Type="1")

panel_2 = Panel("""0
90""")
crv_2 = Curve(<curve referenced from the Rhino model>)
handles_2 = ConstructHandles(Polyline=crv_2, RotationAngles=panel_2, Type="1")

panel_3 = Panel("""0
90""")
# 0 - Costruzione del sistema
# Handle
crv_3 = Curve(<curve referenced from the Rhino model>)
handles_3 = ConstructHandles(Polyline=crv_3, RotationAngles=panel_3, Type="1")

crv_4 = Curve(<curve referenced from the Rhino model>)
# Il Nome dell'AssemblyObject serve ad associare gli XData al relativo tipo di oggetto. Ogni tipo di oggetto può avere più XData da associare, distinguibili tra loro dalla Label
handles_4 = ConstructHandles(Polyline=crv_4, RotationAngles="0", Type="1")

panel_4 = Panel("""0
90""")
crv_5 = Curve(<curve referenced from the Rhino model>)
handles_5 = ConstructHandles(Polyline=crv_5, RotationAngles=panel_4, Type="1")

merge = Merge(Data1=handles_3, Data2=handles, Data3=handles_2, Data4=handles_5, Data5=handles_4)

# ---- group: collision mesh
# AssemblyObject
mesh = Mesh(<mesh referenced from the Rhino model>)

# ----
volume = MeshVolume(Mesh=mesh)  # -> Volume, Centroid
X = UnitX(Factor=1)
# <title>
# 
# <description>
# 
# code by Alessio Erioli
# 
# v 0.1
# © a3 2021 / Creative Commons Attribution-Non Commercial-ShareAlike 4.0 International License
# il nome di un AssemblyObject deve essere unico e non ripetuto tra gli AssemblyObject dello stesso set
nome = Panel("L-block")
aocon = ConstructAssemblyObject(Name=nome, CollisionMesh=mesh, ReferencePlane=volume.Centroid, Direction=X, Weight=1, Handles=merge, ZLockAO=False)

# ---- group: geometry
# XData (eXtanded Data): con Construct XData è possibile inserire dati da associare ad un tipo di AssemblyObject. I dati possono poi essere associati a tutte le istanze dello stesso tipo dopo il processo di assemblaggio.
# 
# L - label (etichetta)
# D - i dati veri e propri: è possibile inserire qualunque tipo di dato, ordinato secondo una lista
# P - piano di riferimento - salvo casi particolari utilizzare lo stesso piano dell'AssemblyObject associato
# N - nome dell'AssemblyObject a cui i dati vengono associati
mesh_2 = Mesh(<mesh referenced from the Rhino model>)

# ----
# referenziare la geometria effettiva qui dentro
panel_5 = Panel("L-block-geomLO")
xdcon = ConstructXData(Label=panel_5, Data=mesh_2, ReferencePlane=volume.Centroid, AssemblyObjectNameReference=nome)

merge_2 = Merge(Data1=xdcon)
merge_3 = Merge(Data1=aocon)

# ---- group: XData
# 2 - Simulazione
data = Data(merge_2)

# ---- group: AO set
# 1 - Scrittura delle euristiche e preview
data_2 = Data(merge_3)

# ----
go = BooleanToggle(False)
step = Button()
reset = Button()
pt = Point(Point(0, -54.35363653, 0))
heuw = HeuristicsWriter(AssemblyObjectsSet=data_2, noSH=False, noSO=False, xHT=False)
aoeng = AssemblerEngineSimple(
    AssemblyObjectsSet=data_2,
    StartingPlane=pt,
    StartingObjectType=0,
    HeuristicsString=heuw,
    Go=go,
    Step=step,
    NIterations=Slider(100, range=1..100),
    MaxNObjects=1000,
    Reset=reset)  # -> Assemblage, AssemblageCount
counter = Panel(aoeng.AssemblageCount)
pt_2 = Point(Point(0, 16.14738045, 0))
# Display Assemblage: Permette di visualizzare colorimetricamente diverse informazioni relative all'assemblaggio.
# 
# Cliccare l'icona con il tasto dx del mouse per vedere le opzioni
aoadisp = DisplayAssemblage(Assemblage=aoeng.Assemblage, Bypass=False, OutputType="Objects")  # -> ColoredCollisionMeshes, Edges, Colors
heud = HeuristicDisplay(
    OriginPoint=pt_2,
    AssemblyObjectsSet=data_2,
    XData=data,
    HeuristicsString=heuw,
    XSize=1,
    YSize=1,
    NRows=10,
    DisplayType="S-R",
    ZLockFilter=False,
    OutputType="S-R")
# 3 - Assegnazione geometrie da XData
line = Line(aoadisp.Edges)

# ----
# Deconstruct Assemblage: Permette di accedere agli oggetti che compongono l'assemblaggio e altre informazioni utili
aoadecon = DeconstructAssemblage(Assemblage=aoeng.Assemblage)  # -> AssemblageObjects, AssemblageRules, ReceiverObjectsIndexes, AvailableObjectIndexes, UnreachableObjectIndexes
# Associate XData: Associa gli XData ai relativi AssemblyObjects
aoxd = AssociateXData(AssemblyObjects=aoadecon.AssemblageObjects, XData=data)
# Deconstruct XData: Spacchetta gli XData, permettendo di accedere agli elementi costituenti
xddecon = DeconstructXData(XData=aoxd)  # -> Label, Data, ReferencePlane, AssemblyObjectNameReference
# Custom preview: Migliora la preview degli oggetti di Grasshopper, permettendo di visualizzarli con colori personalizzati (provare una vista renderizzata)
preview = CustomPreview(Geometry=xddecon.Data, Material=graft(aoadisp.Colors))
