# Grasshopper definition Assembler basic test.gh (Grasshopper 1.0.7)
# Copyright: Co-de-iT
# plug-ins: Assembler, MeshEdit Components

# ----
# panel: Quando Multiline Data è inattivo
# il panel funziona
# come un blocco appunti.
# Il testo viene visto come
# una stringa unica.
# panel multilinea: Attivando
# Multiline Data
# ogni riga
# diventa
# un elemento
# di una
# lista
senza_multiline_data = Panel("""0
1
2
3
4""")
con_multiline_data = Panel("""0
1
2
3
4""")
int = Integer(con_multiline_data)
int_2 = Integer(senza_multiline_data)
# H
# AOs
# HeS
# AOa
panel = Panel(int_2)
panel_2 = Panel(int)

# ----
# volendo assegnare più rotazioni ad una stessa handle, posso usare un panel con Multiline Data attivo
panel_3 = Panel("""0
90
180""")
crv = Curve(<curve referenced from the Rhino model>)
handles = ConstructHandles(Polyline=crv, RotationAngles=panel_3, Type="1")

panel_4 = Panel("""0
90""")
crv_2 = Curve(<curve referenced from the Rhino model>)
handles_2 = ConstructHandles(Polyline=crv_2, RotationAngles=panel_4, Type="1")

# ----
# Handle
panel_5 = Panel("""0
90""")
# In Assembler, inputs e outputs con la stessa denominazione indicano lo stesso tipo di oggetto (H - Handle, AO - AssemblyObject, HeS - Heuristic Set, AOs - AssemblyObject set, Aoa - Assemblage)
# 0 - Costruzione del sistema
crv_3 = Curve(<curve referenced from the Rhino model>)
# Handle: LP - L-polyline
# R - rotazioni (in gradi 0-360)
# T - tipo (numero intero)
# W - weight (opzionale)
handles_3 = ConstructHandles(Polyline=crv_3, RotationAngles=panel_5, Type="1")

crv_4 = Curve(<curve referenced from the Rhino model>)
handles_4 = ConstructHandles(Polyline=crv_4, RotationAngles="0", Type="1")

crv_5 = Curve(<curve referenced from the Rhino model>)
handles_5 = ConstructHandles(Polyline=crv_5, RotationAngles="0", Type="1")

# ----
# Si possono aggiungere più Handles.
# Zoomate su questo componente (Merge), fino a quando compaiono dei simboli + e - accanto ai vari input D1, D1, etc.
# Cliccando su + si possono aggiungere  ulteriori input (e con - eliminarli)
merge = Merge(Data1=handles_3, Data2=handles, Data3=handles_2, Data4=handles_4, Data5=handles_5)

# ---- group: collision mesh
# <title>
# 
# <description>
# 
# code by Alessio Erioli
# 
# v 0.1
# © a3 2021 / Creative Commons Attribution-Non Commercial-ShareAlike 4.0 International License
mesh = Mesh(<mesh referenced from the Rhino model>)

# ----
# AssemblyObject
# AssemblyObject: N - nome (deve essere unico)
# M - Collision Mesh
# P - piano di riferimento
# D - direzione
# W - weight (opzionale)
# H - Handles
volume = MeshVolume(Mesh=mesh)  # -> Volume, Centroid
X = UnitX(Factor=1)
nome = Panel("L-block")
aocon = ConstructAssemblyObject(Name=nome, CollisionMesh=mesh, ReferencePlane=volume.Centroid, Direction=X, Weight=1, Handles=merge, ZLockAO=False)

# ----
# Le Handles vengono passate all'AssemblyObject come semplice lista
panel_6 = Panel(merge)
# 1 - Scrittura delle euristiche e preview
# È possibile avere anche più di un AssemblyObject (che può essere aggiunto in questo Merge), purché ognuno abbia un nome unico. il nome di un AssemblyObject deve essere unico e non ripetuto tra gli AssemblyObject dello stesso set
# 2 - Simulazione
merge_2 = Merge(Data1=aocon)
go = BooleanToggle(False)
step = Button()
reset = Button()
pt = Point(Point(0, -54.35363653, 0))

# ---- group: AO set
data = Data(merge_2)

# ----
heuw = HeuristicsWriter(AssemblyObjectsSet=data, noSH=False, noSO=False, xHT=False)
aoeng = AssemblerEngineSimple(
    AssemblyObjectsSet=data,
    StartingPlane=pt,
    StartingObjectType=0,
    HeuristicsString=heuw,
    Go=go,
    Step=step,
    NIterations=Slider(100, range=1..100),
    MaxNObjects=1000,
    Reset=reset)  # -> Assemblage, AssemblageCount
counter = Panel(aoeng.AssemblageCount)
# Display Assemblage: Permette di visualizzare colorimetricamente diverse informazioni relative all'assemblaggio.
# 
# Cliccare l'icona con il tasto dx del mouse per vedere le opzioni
aoadisp = DisplayAssemblage(Assemblage=aoeng.Assemblage, Bypass=False, OutputType="Objects")  # -> ColoredCollisionMeshes, Edges, Colors
pt_2 = Point(Point(0, 16.14738045, 0))
heud = HeuristicDisplay(
    OriginPoint=pt_2,
    AssemblyObjectsSet=data,
    HeuristicsString=heuw,
    XSize=1,
    YSize=1,
    NRows=10,
    DisplayType="S-R",
    ZLockFilter=False,
    OutputType="S-R")
line = Line(aoadisp.Edges)
