# Grasshopper definition Assembler basic test_in class.gh (Grasshopper 1.0.7)
# Copyright: Co-de-iT
# plug-ins: Assembler, MeshEdit Components

crv = Curve(<curve referenced from the Rhino model>)
handles = ConstructHandles(Polyline=crv, RotationAngles=["0", "90"], Type="1")

crv_2 = Curve(<curve referenced from the Rhino model>)
handles_2 = ConstructHandles(Polyline=crv_2, RotationAngles=["0", "90"], Type="1")

crv_3 = Curve(<curve referenced from the Rhino model>)
handles_3 = ConstructHandles(Polyline=crv_3, RotationAngles="0", Type="1")

mesh = Mesh(<mesh referenced from the Rhino model>)
volume = MeshVolume(Mesh=mesh)  # -> Volume, Centroid
# <title>
# 
# <description>
# 
# code by Alessio Erioli
# 
# v 0.1
# © a3 2021 / Creative Commons Attribution-Non Commercial-ShareAlike 4.0 International License
panel = Panel("L block")
X = UnitX(Factor=1)
merge = Merge(Data1=handles, Data2=handles_2, Data3=handles_3)
aocon = ConstructAssemblyObject(Name=panel, CollisionMesh=mesh, ReferencePlane=volume.Centroid, Direction=X, Weight=1, Handles=merge, ZLockAO=False)
heuw = HeuristicsWriter(AssemblyObjectsSet=aocon, noSH=False, noSO=False, xHT=False)
aoeng = AssemblerEngineSimple(
    AssemblyObjectsSet=aocon,
    StartingPlane=PlaneXY(0, 0, 0),
    StartingObjectType=0,
    HeuristicsString=heuw,
    Go=Toggle(False),
    Step=Button(),
    NIterations=10,
    MaxNObjects=1000,
    Reset=Button())  # -> Assemblage, AssemblageCount
panel_2 = Panel(heuw)
panel_3 = Panel(aoeng.AssemblageCount)
heud = HeuristicDisplay(
    OriginPoint=Point(0, 0, 0),
    AssemblyObjectsSet=aocon,
    HeuristicsString=heuw,
    XSize=1,
    YSize=1,
    NRows=10,
    DisplayType="S-R",
    ZLockFilter=False,
    OutputType="S-R")
aoadisp = DisplayAssemblage(Assemblage=aoeng.Assemblage, Bypass=False, OutputType="Objects")  # -> ColoredCollisionMeshes, Edges, Colors
