# Grasshopper definition mesh in class.gh (Grasshopper 1.0.7)
# Copyright: Co-de-iT

# Questo è uno scribble
# fai doppio click per editare
panel = Panel("panel")
panel_2 = Panel("unwelded mesh")
panel_3 = Panel("Welded mesh")

# ---- group: Unwelded
# CTRL+Q preview
mesh = Mesh(<mesh referenced from the Rhino model>)

# ---- group: Welded
# Questo panel appartiene ad un gruppo
# Seleziona uno o più componenti e crea un gruppo con CTRL+G
# 
# Cliccando col tasto destro sull'area colorata è possibile cambiare il colore e/o renderlo default
mesh_2 = Mesh(<mesh referenced from the Rhino model>)

# ----
series = Series(Start=0, Step=1, Count=10)
demesh = DeconstructMesh(Mesh=mesh)  # -> Vertices, Faces, Colours, Normals
# trascinando dall'area colorata è possibile riposizionare tutti i componenti che appartengono allo stesso gruppo.
# Si possono aggiungere o rimuovere componenti ad un gruppo: selezionare i componenti da aggiungere (o togliere) e poi cliccare col tasto destro nell'area colorata del gruppo: appariranno le opzioni Add to Group e Remove From Group
demesh_2 = DeconstructMesh(Mesh=mesh_2)  # -> Vertices, Faces, Colours, Normals
# dato singolo
number_slider = Slider(5, range=0..15)
number_slider_2 = Slider(8, range=0..15)
# lista
panel_4 = Panel(series)
# <title>
# 
# <description>
# 
# code by Alessio Erioli
# 
# v 0.1
# © a3 2021 / Creative Commons Attribution-Non Commercial-ShareAlike 4.0 International License
# branch indices
panel_5 = Panel(demesh.Faces)
series_2 = Series(Start=series, Step=1, Count=10)
# Merge permette di unire insieme più flussi di dati
merge = Merge(Data1=number_slider, Data2=number_slider_2)
# data tree
panel_6 = Panel(series_2)
panel_7 = Panel(demesh_2.Faces)
panel_8 = Panel(demesh_2.Vertices)
pt = ConstructPoint(XCoordinate=0, YCoordinate=series_2, ZCoordinate=series)
item = ListItem(List=demesh_2.Vertices, Index=[number_slider, number_slider_2], Wrap=True)
item_2 = ListItem(List=series, Index=merge, Wrap=True)
panel_9 = Panel(item_2)
panel_10 = Panel(pt)
sph = Sphere(Base=item, Radius=1)
pline = PolyLine(Vertices=pt, Closed=False)
panel_11 = Panel(demesh.Vertices)
panel_12 = Panel(item)
# data trees tutorial
# Questo tutorial di Andrew Heumann è molto importante per comprendere il modello mentale delle strutture dati di Grasshopper
# 
# https://youtu.be/ob3ER12ut3Y
panel_13 = Panel(pline)
