# Grasshopper definition Data Tree Basics.gh (Grasshopper 1.0.7)
# Copyright: Co-de-iT

int = Integer([0, 1, 2])
# Entwine
panel = Panel("""A
B
C
D
E""")
panel_2 = Panel("""0
1
2""")
# Merge
panel_3 = Panel("""A
B
C
D
E""")
panel_4 = Panel("""0
1
2""")
# list <> singe item
panel_5 = Panel("""A
B
C""")
panel_6 = Panel(int)
# list <> list (equal length)
panel_7 = Panel("""A
B
C""")
panel_8 = Panel("""0
1
2""")
panel_9 = Panel("""A
B
C
D
E""")
# list <> list (different length)
panel_10 = Panel("""A
B
C
D
E""")
panel_11 = Panel("""0
1
2""")
merge = Merge(Data1=panel_3, Data2=panel_4)
merge_2 = Merge(Data1=panel_9, Data2=panel_6)
entwine = Entwine(Branch00=panel, Branch01=panel_2, FlattenInputs=True)
concat = Concatenate(FragmentA=panel_5, FragmentB="0")
concat_2 = Concatenate(FragmentA=panel_7, FragmentB=panel_8)
concat_3 = Concatenate(FragmentA=panel_10, FragmentB=panel_11)
panel_12 = Panel(entwine)
panel_13 = Panel(merge)
panel_14 = Panel(merge_2)
# Data Tree basics
# 
# Logiche di base e operazioni con il Data Tree
# 
# code by Alessio Erioli
# 
# v 0.1
# © a3 2021 / Creative Commons Attribution-Non Commercial-ShareAlike 4.0 International License
panel_15 = Panel(concat)
panel_16 = Panel(concat_2)
panel_17 = Panel(concat_3)
int_2 = Integer(Tree({3}: [3, 4], {4}: [5, 6, 7, 8]))
txt = Text(Tree({0;0}: ["A", "B", "C"], {0;1}: ["D", "E", "F"], {0;2}: ["G", "H", "I"]))
int_3 = Integer(Tree({0;0}: [0, 1, 2], {0;1}: [3, 4], {0;2}: [5, 6, 7, 8]))
txt_2 = Text(Tree({0;0}: ["A", "B", "C"], {0;1}: ["D", "E", "F"], {0;2}: ["G", "H", "I"]))
int_4 = Integer(Tree({0;0}: [0, 1, 2], {0;1}: [3, 4]))
txt_3 = Text(Tree({0;0}: ["A", "B", "C"], {0;1}: ["D", "E", "F"], {0;2}: ["G", "H", "I"]))
txt_4 = Text(Tree({0;0}: ["A", "B", "C"], {0;1}: ["D", "E", "F"]))
txt_5 = Text(Tree({0;0}: ["A", "B", "C"], {0;1}: ["D", "E", "F"]))
txt_6 = Text(Tree({0;0}: ["A", "B", "C"], {0;1}: ["D", "E", "F"]))
int_5 = Integer(Tree({0;0}: [0, 1, 2], {0;1}: [3, 4, 5]))
# tree <> tree (different M, different Ns, different branch indices)
panel_18 = Panel(txt)
panel_19 = Panel(int_2)
panel_20 = Panel(int_4)
# tree <> singe item
panel_21 = Panel(txt_4)
# tree <> tree (different M, different Ns)
panel_22 = Panel(txt_2)
panel_23 = Panel(int_3)
# tree <> tree (same M, different Ns)
panel_24 = Panel(txt_3)
# tree <> list
# M=2
# N=3
# N=3
panel_25 = Panel(txt_5)
# tree <> tree (same structure)
# M=2
# N=3
panel_26 = Panel(txt_6)
panel_27 = Panel(int_5)
# M=1
# N=3
panel_28 = Panel("""0
1
2""")
concat_4 = Concatenate(FragmentA=txt, FragmentB=int_2)
concat_5 = Concatenate(FragmentA=txt_2, FragmentB=int_4)
concat_6 = Concatenate(FragmentA=txt_3, FragmentB=int_3)
concat_7 = Concatenate(FragmentA=txt_5, FragmentB=panel_28)
concat_8 = Concatenate(FragmentA=txt_6, FragmentB=int_5)
concat_9 = Concatenate(FragmentA=panel_21, FragmentB="0")
# In casi come questi (estremi, non dovrebbero nemmeno mai presentarsi se si lavora bene), i rami vengono confrontati per il loro ordine sequenziale (il primo ramo del Data Tree A con il primo del Data Tree B etc.), sempre con la regola di confrontare i rami in eccesso del Data Tree che ne ha di più con l'ultimo del Data Tree che ne ha di meno.
# Gli indici vengono ereditati dal DataTree con più rami.
panel_29 = Panel(concat_4)
panel_30 = Panel(concat_5)
panel_31 = Panel(concat_6)
panel_32 = Panel(concat_7)
# Per convenienza indicheremo con M il numero dei rami (branches) e N il numero di elementi (items) contenuti nella lista.
# 
# In questo caso ogni Data Tree ha M = 2 rami e N = 3 elementi per ciascuna lista
panel_33 = Panel(concat_8)
panel_34 = Panel(concat_9)
# Flatten
txt_7 = Text(Tree({0;0;0}: ["A"], {0;0;1}: ["B"], {0;0;2}: ["C"], {0;1;0}: ["D"], {0;1;1}: ["E"], {0;1;2}: ["F"]))
# Shift Paths/Trim Tree
txt_8 = Text(Tree({0;0;0}: ["A"], {0;0;1}: ["B"], {0;0;2}: ["C"], {0;1;0}: ["D"], {0;1;1}: ["E"], {0;1;2}: ["F"]))
# Graft
txt_9 = Text(Tree({0;0}: ["A", "B", "C"], {0;1}: ["D", "E", "F"]))
viewer = ParamViewer(txt_7)
viewer_2 = ParamViewer(txt_7)
panel_35 = Panel(txt_7)
viewer_3 = ParamViewer(txt_8)
viewer_4 = ParamViewer(txt_8)
panel_36 = Panel(txt_8)
viewer_5 = ParamViewer(txt_9)
viewer_6 = ParamViewer(txt_9)
panel_37 = Panel(txt_9)
txt_10 = Text(graft(txt_9))
txt_11 = Text(flatten(txt_7))
graft = GraftTree(Tree=txt_9, IncludeEmptyLists=True, IncludeNullItems=True)
flatten = FlattenTree(Tree=txt_7, Path="{0}")
pshift = ShiftPaths(Data=txt_8, Offset=-1)
trim = TrimTree(Tree=txt_8, Depth=1)
viewer_7 = ParamViewer(txt_10)
viewer_8 = ParamViewer(txt_10)
panel_38 = Panel(txt_10)
viewer_9 = ParamViewer(trim)
viewer_10 = ParamViewer(pshift)
viewer_11 = ParamViewer(trim)
viewer_12 = ParamViewer(pshift)
panel_39 = Panel(trim)
panel_40 = Panel(flatten)
viewer_13 = ParamViewer(txt_11)
panel_41 = Panel(pshift)
viewer_14 = ParamViewer(txt_11)
panel_42 = Panel(txt_11)
panel_43 = Panel(graft)
