# Grasshopper definition in class.gh (Grasshopper 1.0.7)
# Copyright: Co-de-iT
# plug-ins: Bifocals

panel = Panel("""0
10
52.6
John
Mary
Jack
Augusto""")
panel_2 = Panel("""20
3
84.3
Anne
Christian
Louis
Filippo""")
entwine = Entwine(Branch00=panel, Branch01=panel_2, FlattenInputs=True)
panel_3 = Panel(entwine)
number_slider = Slider(3, range=0..6)
# <title>
# 
# <description>
# 
# code by Alessio Erioli
# 
# v 0.1
# © a3 2021 / Creative Commons Attribution-Non Commercial-ShareAlike 4.0 International License
panel_4 = Panel("""1943
23683
4234
10""")
panel_5 = Panel("""Edificio 1
Edificio 2
Edificio 3
Edificio 4""")
entwine_2 = Entwine(Branch00=number_slider, Branch01=Slider(2, range=0..6), FlattenInputs=True)
num = Number(panel_4)
split = SplitList(List=entwine, Index=number_slider)  # -> ListA, ListB
sort = SortList(Keys=num, ValuesA=panel_5)  # -> Keys, ValuesA
panel_6 = Panel(split.ListB)
panel_7 = Panel(split.ListA)
rev = ReverseList(List=sort.Keys)
rev_2 = ReverseList(List=sort.ValuesA)
panel_8 = Panel(rev)
panel_9 = Panel(sort.Keys)
panel_10 = Panel(rev_2)
panel_11 = Panel(sort.ValuesA)
random = Random(Range="0 To 100", Number="10000", Seed=2, Integers=True)
mod = Modulus(A=random, B="2")
panel_12 = Panel(random)
panel_13 = Panel(mod)
pt = ConstructPoint(XCoordinate=0, YCoordinate=0, ZCoordinate=random)
equals = Equality(FirstNumber=mod, SecondNumber="0")  # -> Equality, Inequality
bool = Boolean(equals.Equality)
panel_14 = Panel(bool)
cull = CullPattern(List=random, CullPattern=bool)
dispatch = Dispatch(List=random, DispatchPattern=bool)  # -> ListA, ListB
sift = SiftPattern(List=random, SiftPattern=bool)  # -> Output0, Output1
cull_2 = CullPattern(List=pt, CullPattern=bool)
panel_15 = Panel(sift.Output1)
panel_16 = Panel(sift.Output0)

# ---- group: False
panel_17 = Panel(dispatch.ListB)
multiplication = Multiplication(A=dispatch.ListB, B="2")
panel_18 = Panel(multiplication)

# ----
int = Integer(bool)

# ---- group: True
panel_19 = Panel(dispatch.ListA)
addition = Addition(A=dispatch.ListA, B="1")
panel_20 = Panel(addition)

# ----
panel_21 = Panel(cull_2)
panel_22 = Panel(int)
combine = CombineData(Input0=sift.Output0, Input1=sift.Output1)  # -> Result, Index
bool_2 = Boolean(int)
panel_23 = Panel(bool_2)
panel_24 = Panel(combine.Result)
weave = Weave(Pattern=bool, Stream0=multiplication, Stream1=addition, NullGaps=False)

bool_3 = Boolean()
dispatch_2 = Dispatch(DispatchPattern=bool_3)  # -> ListA, ListB
weave_2 = Weave(Pattern=bool_3, Stream0=dispatch_2.ListB, Stream1=dispatch_2.ListA, NullGaps=False)

charseq = CharSequence(Count=10, CharPool="ABCDEFGHIJKLMNOPQRSTUVWXYZ", Format="{0}")
series = Series(Start=0, Step=1, Count=10)
panel_25 = Panel(weave)
panel_26 = Panel(series)
panel_27 = Panel(charseq)
panel_28 = Panel("""1
0
1""")
weave_3 = Weave(Pattern=panel_28, Stream0=charseq, Stream1=series, NullGaps=False)
panel_29 = Panel(weave_3)
