# Grasshopper definition base 1 object_alt_setup.gh (Grasshopper 1.0.7)
# Copyright: Co-de-iT
# plug-ins: Assembler, Bifocals, MeshEdit Components

panel = Panel("""0
90
180""")
crv = Curve(<curve referenced from the Rhino model>)
handles = ConstructHandles(Polyline=crv, RotationAngles=panel, Type="2")

panel_2 = Panel("""0
180""")
crv_2 = Curve(<curve referenced from the Rhino model>)
handles_2 = ConstructHandles(Polyline=crv_2, RotationAngles=panel_2, Type="1")

mesh = Mesh(<mesh referenced from the Rhino model>)
volume = MeshVolume(Mesh=mesh)  # -> Volume, Centroid
# <title>
# 
# <description>
# 
# code by Alessio Erioli
# 
# v 0.1
# © a3 2021 / Creative Commons Attribution-Non Commercial-ShareAlike 4.0 International License
panel_3 = Panel("type A")
xy = XYPlane(Origin=volume.Centroid)
X = UnitX(Factor=1)
merge = Merge(Data1=handles_2, Data2=handles)
handdisp = DisplayHandle(Handles=merge, absHTextSize=False)
aocon = ConstructAssemblyObject(Name=panel_3, CollisionMesh=mesh, ReferencePlane=xy, Direction=X, Weight=1, Handles=merge, ZLockAO=False)
heuw = HeuristicsWriter(AssemblyObjectsSet=aocon, noSH=False, noSO=False, xHT=False)
number_slider = Slider(2.205, range=1..3)
pt = Point(Point(1.325211902, 15.64305411, 0))
panel_4 = Panel(heuw)

mesh_2 = Mesh(<mesh referenced from the Rhino model>)

merge_2 = Merge(Data1=mesh_2, Data2="hello world", Data3="3")

xdcon = ConstructXData(Label="A geometry", Data=merge_2, ReferencePlane=xy, AssemblyObjectNameReference=panel_3)

heudex = HeuristicsDisplayEx(
    OriginPoint=pt,
    AssemblyObjectsSet=aocon,
    XData=xdcon,
    HeuristicsString=heuw,
    XSize=number_slider,
    YSize=number_slider,
    NRows=10)  # -> AssemblyObjectPairs, CoherencePattern, HeuristicsStringTree, TextBasePoints, XData
panel_5 = Panel(heudex.XData)
heud = HeuristicDisplay(
    OriginPoint=pt,
    AssemblyObjectsSet=aocon,
    XData=xdcon,
    HeuristicsString=heuw,
    XSize=number_slider,
    YSize=number_slider,
    NRows=10,
    DisplayType="S-R",
    ZLockFilter=False,
    OutputType="S-R")
pshift = ShiftPaths(Data=heudex.XData, Offset=-1)
panel_6 = Panel(pshift)
xddecon = DeconstructXData(XData=pshift)  # -> Label, Data, ReferencePlane, AssemblyObjectNameReference
item = ListItem(List=xddecon.Data, Index=0, Wrap=True)
panel_7 = Panel(xddecon.Data)
viewer = ParamViewer(xddecon.Data)
