# Grasshopper definition member index.gh (Grasshopper 1.0.7)
# Copyright: Co-de-iT

charseq = CharSequence(Count=10, CharPool="ABCDEFGHIJKLMNOPQRSTUVWXYZ", Format="{0}")
# <title>
# 
# <description>
# 
# code by Alessio Erioli
# 
# v 0.1
# © a3 2021 / Creative Commons Attribution-Non Commercial-ShareAlike 4.0 International License
panel = Panel(charseq)
merge = Merge(Data1=Slider(0, range=0..20), Data2=Slider(6, range=0..20), Data3=Slider(15, range=0..20))
random = Random(Range="0 to 20", Number="500", Seed=2, Integers=True)
panel_2 = Panel("""F
H
B""")
int = Integer(merge)
mindex = MemberIndex(Set=panel, Member=panel_2)  # -> Index, Count
mindex_2 = MemberIndex(Set=random, Member=int)  # -> Index, Count
panel_3 = Panel(mindex.Index)
panel_4 = Panel(mindex.Count)
panel_5 = Panel(mindex_2.Index)
panel_6 = Panel(mindex_2.Count)
