# Grasshopper definition stream filter-gate.gh (Grasshopper 1.0.7)
# Copyright: Co-de-iT

pt = Point(Point(28.69817432, 0, 0))
# filters and gates
# double-click this
list = ValueList({"One": 1, "Two": 2, "Three": 2² - 1, "Four": Sqrt(16)}, selected="One")
msphere = MeshSphere(Base=PlaneXY(0, 0, 0), Radius=10, UCount=10, VCount=20)
mbox = MeshBox(
    Base={Plane=PlaneXY(0, 0, 0), X=Domain(-10, 10), Y=Domain(-10, 10), Z=Domain(-10, 10)},
    XCount="1",
    YCount="1",
    ZCount="1")
msphere_2 = MeshSphere(Base=pt, Radius=10, UCount=10, VCount=20)
number_slider = Slider(0, range=0..1)
list_2 = ValueList({"sphere": 0, "box": 1}, selected="sphere")
toggle = BooleanToggle(False)
list_3 = ValueList({"purple": 0, "green": 1}, selected="purple")
filter = StreamFilter(Gate=list_2, Stream0=msphere, Stream1=mbox)
gate = StreamGate(Stream=msphere_2, Gate=list_3)  # -> Target0, Target1
preview = CustomPreview(Geometry=filter, Material=ColourSwatch(SwatchColor=RGB(0, 208, 255)))

# ----
# toggles and buttons
button = Button()
# <title>
# 
# <description>
# 
# code by Alessio Erioli
# 
# v 0.1
# © a3 2021 / Creative Commons Attribution-Non Commercial-ShareAlike 4.0 International License
toggle_2 = BooleanToggle(False)
panel = Panel(button)
panel_2 = Panel(toggle_2)

preview_2 = CustomPreview(Geometry=gate.Target1, Material=ColourSwatch(SwatchColor=RGB(132, 255, 0)))
preview_3 = CustomPreview(Geometry=gate.Target0, Material=ColourSwatch(SwatchColor=RGB(204, 0, 255)))
filter_2 = StreamFilter(Gate=0)
gate_2 = StreamGate(Gate=0)  # -> Target0, Target1, Target2, Target3

# ----
# ghost wires
# right click on an input  parameter, under Wire Display, choose Faint or Hidden.
# 
# Default is the usual wire display.
# 
# Wires become visible when you select the component.
pt_2 = Point()
pt_3 = Point()
data = Data()
data_2 = Data()
data_3 = Data()
ln = Line(StartPoint=pt_3, EndPoint=pt_2)
data_4 = Data(data_3)
data_5 = Data(data)
data_6 = Data(data_2)
