# Grasshopper definition Make2D.gh (Grasshopper 1.0.7)
# Copyright: Co-de-iT
# plug-ins: Human

panel = Panel("Perspective")
crv = Curve(<curve referenced from the Rhino model>)
m2d_parallel = Make2DParallelView(Projection=crv)
m2d_rhino = Make2DRhinoView(Name="Top", Clip=Toggle(True))
# © a3 2021 / Creative Commons Attribution-Non Commercial-ShareAlike 4.0 International License
mesh = Mesh([<mesh referenced from the Rhino model> x2001])
panel_2 = Panel(m2d_parallel)
pt = Point(Point(55.83068234, 111.5334433, -39.48875941))
xy = XYPlane(Origin=pt)
make2d = Make2D(Geometry=mesh, ClippingPlanes=xy, View=m2d_rhino, TangentEdges=False, TangentSeams=False, AutoComputeMake2D=False)  # -> VisibleCurves, VisibleIndex, VisibleType, HiddenCurves, HiddenIndex, HiddenType
dam = DataDam(DataA=make2d.HiddenType, BufferDelay=10000000, BufferMode=0)
cset = CreateSet(List=make2d.VisibleType)  # -> Set, Map
cset_2 = CreateSet(List=dam)  # -> Set, Map
line_types = Panel(cset_2.Set)
# <title>
# 
# <description>
# 
# code by Alessio Erioli
# 
# v 0.1
line_types_2 = Panel(cset.Set)
mindex = MemberIndex(Set=dam, Member=cset_2.Set)  # -> Index, Count
line_types_3 = Panel(cset.Set)
mindex_2 = MemberIndex(Set=make2d.VisibleType, Member=cset.Set)  # -> Index, Count
item = ListItem(List=make2d.HiddenCurves, Index=mindex.Index, Wrap=True)
item_2 = ListItem(List=make2d.VisibleCurves, Index=mindex_2.Index, Wrap=True)
bang = ExplodeTree(Data=item)  # -> Branch0, Branch1
bang_2 = ExplodeTree(Data=item_2)  # -> Branch0, Branch1, Branch2, Branch3, Branch4

panel_3 = Panel("""0.1
0.2""")
dash = DashPattern(Curve=bang.Branch0, Pattern=panel_3)  # -> Dashes, Gaps
# Crease
previewlw = CustomPreviewLineweights(Geometry=dash.Dashes, Shader=ColourSwatch(SwatchColor=RGB(138, 138, 138)), Absolute=False)

panel_4 = Panel("""0.1
0.2""")
dash_2 = DashPattern(Curve=bang.Branch1, Pattern=panel_4)  # -> Dashes, Gaps
# Tangent
previewlw_2 = CustomPreviewLineweights(Geometry=dash_2.Dashes, Shader=ColourSwatch(SwatchColor=RGB(138, 138, 138)), Absolute=False)

# ----
# Crease
previewlw_3 = CustomPreviewLineweights(Geometry=bang_2.Branch0, Shader=ColourSwatch(SwatchColor=RGB(0, 0, 0)), Thickness="2", Absolute=False)

# ----
# Silhouette, Tangent
previewlw_4 = CustomPreviewLineweights(Geometry=bang_2.Branch2, Shader=ColourSwatch(SwatchColor=RGB(0, 0, 0)), Thickness="1", Absolute=False)

# ----
# Section
previewlw_5 = CustomPreviewLineweights(Geometry=bang_2.Branch4, Shader=ColourSwatch(SwatchColor=RGB(0, 0, 0)), Thickness="4", Absolute=False)

# ----
# Tangent
previewlw_6 = CustomPreviewLineweights(Geometry=bang_2.Branch1, Shader=ColourSwatch(SwatchColor=RGB(89, 89, 89)), Thickness="1", Absolute=False)

# ----
# Silhouette, Crease
previewlw_7 = CustomPreviewLineweights(Geometry=bang_2.Branch3, Shader=ColourSwatch(SwatchColor=RGB(0, 0, 0)), Thickness="1", Absolute=False)

join = JoinCurves(Curves=bang_2.Branch4, Preserve=False)
phatch = PatternHatch(Boundaries=join, Pattern=0, Scale=1, Angle=0)
