# Grasshopper definition domains and remap.gh (Grasshopper 1.0.7)
# Copyright: Co-de-iT

series = Series(Start=0, Step=1, Count=10)
# domains
number_slider = Slider(0.25, range=0..10)
# remap
series_2 = Series(Start=0, Step=1, Count=10)
dom = ConstructDomain(DomainStart=0, DomainEnd=1)
panel = Panel(series)
panel_2 = Panel(series_2)
random = Random(Range="0 to 1", Number="2000", Seed=2)
bnd = Bounds(Numbers=series)
bnd_2 = Bounds(Numbers=series_2)
domain = Panel(dom)
dom_2 = ConstructDomain(DomainStart=number_slider, DomainEnd=Slider(6.268, range=0..10))
range = Range(Domain=dom, Steps=Slider(4, range=1..20))
domain_from_numbers = Panel(bnd)
domain_from_numbers_2 = Panel(bnd_2)
# <title>
# 
# <description>
# 
# code by Alessio Erioli
# 
# v 0.1
# © a3 2021 / Creative Commons Attribution-Non Commercial-ShareAlike 4.0 International License
domain_2 = Panel(dom_2)
numbers_from_domain_division = Panel(range)

# ---- group: remap
num = Number(random)
dom_3 = ConstructDomain(DomainStart=Slider(0.25, range=0..10), DomainEnd=Slider(6.268, range=0..10))
bnd_3 = Bounds(Numbers=num)
target_domain = Panel(dom_3)
remap = RemapNumbers(Value=num, Source=bnd_3, Target=dom_3)  # -> Mapped, Clipped
source_domain = Panel(bnd_3)

# ---- group: bar graph shows the distribution of values
bar_graph = BarGraph(random, BarColor=RGB(255, 0, 90))

# ---- group: remapping values preserves their distribution
bar_graph_2 = BarGraph(remap.Mapped, BarColor=RGB(255, 0, 90))

# ----
pt = Point(Point(9.308288156, 11.40450968, 0))
sqgrid = Square(Plane=PlaneXY(0, 0, 0), Size=1, ExtentX="20", ExtentY="20")  # -> Cells, flatten(Points)
dist = Distance(PointA=sqgrid.Points, PointB=pt)
one_over_x = OneOverX(Value=dist)
pow = Power(A=one_over_x, B=Slider(0.118, range=0.001..0.5))
sqrt = SquareRoot(Value=one_over_x)
cbrt = CubeRoot(Value=one_over_x)
log = Logarithm(Value=one_over_x)
filter = StreamFilter(Gate=Slider(5, range=0..5), Stream0=dist, Stream1=one_over_x, Stream2=sqrt, Stream3=cbrt, Stream4=pow, Stream5=log)
num_2 = Number(filter)
bar_graph_3 = BarGraph(num_2, BarColor=RGB(255, 0, 90))
dom_4 = ConstructDomain(DomainStart=Slider(0.225, range=0..10), DomainEnd=Slider(6.784, range=0..10))
bnd_4 = Bounds(Numbers=num_2)
remap_2 = RemapNumbers(Value=num_2, Source=bnd_4, Target=dom_4)  # -> Mapped, Clipped
bar_graph_4 = BarGraph(remap_2.Mapped, BarColor=RGB(255, 0, 90))
Z = UnitZ(Factor=remap_2.Mapped)
move = Move(Geometry=sqgrid.Points, Motion=Z)  # -> Geometry, Transform
addition = Addition(A="20", B="1")
srfgrid = SurfaceFromPoints(Points=move.Geometry, UCount=addition, Interpolate=True)
pt_2 = Point(Point(0, 30, 0))
pt_3 = Point(Point(9.308288156, 40.91940536, 0))
sqgrid_2 = Square(Plane=pt_2, Size=1, ExtentX="20", ExtentY="20")  # -> Cells, flatten(Points)
dist_2 = Distance(PointA=sqgrid_2.Points, PointB=pt_3)
one_over_x_2 = OneOverX(Value=dist_2)
pow_2 = Power(A=one_over_x_2, B=Slider(0.118, range=0.001..0.5))
sqrt_2 = SquareRoot(Value=one_over_x_2)
cbrt_2 = CubeRoot(Value=one_over_x_2)
log_2 = Logarithm(Value=one_over_x_2)
filter_2 = StreamFilter(
    Gate=Slider(5, range=0..5),
    Stream0=dist_2,
    Stream1=one_over_x_2,
    Stream2=sqrt_2,
    Stream3=cbrt_2,
    Stream4=pow_2,
    Stream5=log_2)
num_3 = Number(filter_2)
bar_graph_5 = BarGraph(num_3, BarColor=RGB(255, 0, 90))
bnd_5 = Bounds(Numbers=num_3)
remap_3 = RemapNumbers(Value=num_3, Source=bnd_5, Target=Domain(0, 1))  # -> Mapped, Clipped
bar_graph_6 = BarGraph(remap_3.Mapped, BarColor=RGB(255, 0, 90))
graph = GraphMapper(
    remap_3.Mapped,
    x0=0,
    x1=1,
    y0=0,
    y1=1,
    container_name="Bezier",
    cpx=[0, 0.3346371949, 0.2071550936, 1],
    cpy=[0, 0.1394202113, 1, 1])
bar_graph_7 = BarGraph(graph, BarColor=RGB(255, 0, 90))
dom_5 = ConstructDomain(DomainStart=Slider(0.225, range=0..10), DomainEnd=Slider(5.9, range=0..10))
remap_4 = RemapNumbers(Value=graph, Source=Domain(0, 1), Target=dom_5)  # -> Mapped, Clipped
bar_graph_8 = BarGraph(remap_4.Mapped, BarColor=RGB(255, 0, 90))
Z_2 = UnitZ(Factor=remap_4.Mapped)
move_2 = Move(Geometry=sqgrid_2.Points, Motion=Z_2)  # -> Geometry, Transform
addition_2 = Addition(A="20", B="1")
srfgrid_2 = SurfaceFromPoints(Points=move_2.Geometry, UCount=addition_2, Interpolate=True)
