# Grasshopper definition import AOs.gh (Grasshopper 1.0.7)
# Copyright: Co-de-iT
# plug-ins: Assembler, froGH

f_ghfilepath = GHFilePathInfo()  # -> FileName, FilePath
concat = Concatenate(FragmentA=f_ghfilepath.FilePath, FragmentB="Assemblage example_000_d.JSON")
# <title>
# 
# <description>
# 
# code by Alessio Erioli
# 
# v 0.1
# © a3 2021 / Creative Commons Attribution-Non Commercial-ShareAlike 4.0 International License
json2ao = AssemblyObjectsFromJSON(FilePath=concat, Load=Toggle(False))
aodecon = DeconstructAssemblyObject(AssemblyObject=json2ao)  # -> Name, CollisionMesh, ReferencePlane, Direction, Weight, OccludedNeighbours, Handles, Children, ZLock
handecon = DeconstructHandle(Handle=aodecon.Handles)  # -> SenderPlane, ReceiverPlanes, ReceiverPlanesRotations, HandleType, HandleWeight, HandleOccupancy, NeighbourObject, NeighbourHandle
