# Grasshopper definition import blocks.gh (Grasshopper 1.0.7)
# Copyright: Co-de-iT
# plug-ins: EleFront

listblockd = ListBlockDocument()
# <title>
# 
# <description>
# 
# code by Alessio Erioli
# 
# v 0.1
panel = Panel(listblockd)
item = ListItem(List=listblockd, Index=0, Wrap=True)  # -> Item, Item1, Item2
# © a3 2021 / Creative Commons Attribution-Non Commercial-ShareAlike 4.0 International License
panel_2 = Panel(item.Item)
panel_3 = Panel(item.Item1)
panel_4 = Panel(item.Item2)
refblock = ReferenceBlockByName(BlockName=panel_2)  # disabled
refblock_2 = ReferenceBlockByName(BlockName=panel_3)  # disabled
refblock_3 = ReferenceBlockByName(BlockName=panel_4)  # disabled
deblock = DeconstructBlock(Block=refblock_2)  # -> Name, Plane, Geometry; disabled
crv = Curve(deblock.Geometry)
panel_5 = Panel(crv)
