# Grasshopper definition cross reference & member index.gh (Grasshopper 1.0.7)
# Copyright: Co-de-iT

# ---- group: how Cross Reference works
# consider the connections among all points (A to B) avoiding duplicates (B to A) and points connecting to themselves (A to A or B to B)
number_slider = Slider(6, range=3..6)
series = Series(Start=0, Step=1, Count=number_slider)
crossref = CrossReference(ListA=series, ListB=series, CrossMode=1)  # -> ListA, ListB
concat = Concatenate(FragmentA=crossref.ListA, FragmentB=crossref.ListB)
# <title>
# 
# <description>
# 
# code by Alessio Erioli
# 
# v 0.1
# © a3 2021 / Creative Commons Attribution-Non Commercial-ShareAlike 4.0 International License
panel = Panel(series)
crossref_2 = CrossReference(ListA=series, ListB=series, CrossMode=5)  # -> ListA, ListB
matrix = ConstructMatrix(Rows=number_slider, Columns=number_slider, Values=concat)
concat_2 = Concatenate(FragmentA=crossref_2.ListA, FragmentB=crossref_2.ListB)
matrix_2 = DisplayMatrix(matrix)
panel_2 = Panel(concat_2)

# ---- group: how Member Index works / set to search from
int = Integer(Tree({0;0;0}: [2, 1, 5, 8, 7], {0;0;1}: [7, 8, 8, 6, 2], {0;0;2}: [7, 8, 8, 6, 2], {0;0;3}: [2, 1, 5, 8, 7], {0;0;4}: [7, 8, 8, 6, 2]))

# ---- group: how Member Index works
# This tells us if any number occurs in any of the provided sets (each branch is considered one separate set).
# 
# The first branch tells us that in the first set 5 and 1 occur one time each, while the other numbers occur 0 times.
members = Panel("""5
9
1
3""")
panel_3 = Panel(int)

# ---- group: how Member Index works / members to search for
int_2 = Integer(members)

# ---- group: how Member Index works (continued)
mindex = MemberIndex(Set=int, Member=int_2)  # -> Index, Count
numbers_of_occurrences = Panel(mindex.Count)
