# Grasshopper definition operate on blocks.gh (Grasshopper 1.0.7)
# Copyright: Co-de-iT
# plug-ins: Human, EleFront

listblockd = ListBlockDocument()
panel = Panel(listblockd)
panel_2 = Panel("""0
1
2""")
item = ListItem(List=listblockd, Index=panel_2, Wrap=True)
# <title>
# 
# <description>
# 
# code by Alessio Erioli
# 
# v 0.1
# © a3 2021 / Creative Commons Attribution-Non Commercial-ShareAlike 4.0 International License
panel_3 = Panel(item)
refblock = ReferenceBlockByName(BlockName=item)
deblock = DeconstructBlock(Block=refblock)  # -> Name, Plane, Geometry

# ----
# place lights on predefined points
pt = Point(flatten(deblock.Geometry))
clean = CleanTree(RemoveNulls=True, RemoveInvalid=True, RemoveEmpty=False, Tree=pt)
intensity_range = Panel("0.1 to 0.5")
lng = ListLength(List=clean)
random = Random(Range=intensity_range, Number=lng, Seed=2)
dedomain = DeconstructDomain(Domain=intensity_range)  # -> Start, End
gradient = Gradient(
    LowerLimit=dedomain.Start,
    UpperLimit=dedomain.End,
    Parameter=random,
    stops=[0: RGB(252, 246, 220), 1: RGB(196, 163, 96)])
bake_lights = BooleanToggle(False)
createlight = CreateLight(Bake=bake_lights, Location=clean, Direction=Vector(0, 0, 1), LightStyle="WorldPoint", Intensity=random, Color=gradient)
