# Grasshopper definition terrain workflow.gh (Grasshopper 1.0.7)
# Copyright: Co-de-iT
# plug-ins: froGH

panel = Panel("2 - polilinea di fondo")
# 1 - bordo di taglio della Mesh
crv = Curve(<curve referenced from the Rhino model>)
crv_2 = Curve(<curve referenced from the Rhino model>)
merge = Merge(Data1=crv, Data2=crv_2)
f_fmesh = FastMeshFromPolyline(Polylines=crv_2)
# <title>
# 
# <description>
# 
# code by Alessio Erioli
# 
# v 0.1
# © a3 2021 / Creative Commons Attribution-Non Commercial-ShareAlike 4.0 International License
f_pmloft = PolylinesMeshLoft(Polylines=merge, Closed=False)
mjoin = MeshJoin(Meshes=[f_pmloft, f_fmesh])
unim = UnifyMesh(Mesh=mjoin)  # -> Result, Count

# ---- group: bake
mesh = Mesh(unim.Result)
